# Grasshopper definition circles_outer surfs.gh (Grasshopper 0.9.76)
# Copyright: Co-de-iT
# plug-ins: Sandbox Topology, Human, Kangaroo Components, Weaverbird, MeshDual

srf = Surface(reparameterize(<surface referenced from the Rhino model>))
mesh = Mesh(<mesh referenced from the Rhino model>)
mesh_2 = Mesh(<mesh referenced from the Rhino model>)

nv = NakedVertices(Mesh=mesh_2)  # -> ClothedIndex, NakedIndex, ClothedPts, NakedPts
mesh_topo_vertex = MeshTopologyVertex(Mesh=mesh_2)  # -> ListOfMeshVertices, VertexVertexStructure, VertexFaceStructure
bpath = BranchPath(T=mesh_topo_vertex.VertexVertexStructure, i=nv.ClothedIndex)  # -> P, B; inputs T: tree, i: Int32
# ---------- bpath: C# ----------
    String eol = Environment.NewLine;
    Component.Name = "Branch Path";
    Component.NickName = "BPath";
    Component.Description = "Retrieves the data tree path and data for a specific branch index" + eol + "P path index | B branch elements";
    int ind = i % T.BranchCount;
    P = T.Path(ind);
    B = T.Branches[ind];
# ---------- end bpath ----------
panel = Panel(bpath.B)
item = ListItem(List=mesh_topo_vertex.ListOfMeshVertices, Index=bpath.B, Wrap=True)
# neighbors of clothed points
bpath_2 = BranchPath(T=item, i=Slider(20, range=0..20))  # -> P, B; inputs T: tree, i: Int32; same code as bpath
msphere = MeshSphere(Base=bpath_2.B, Radius=Slider(0.765, range=0..1), UCount="10", VCount="10")
previewmat = CustomPreviewMaterials(Geometry=msphere, DiffuseColor=RGB(255, 255, 255))

mesh_topo_edge = MeshTopologyEdge(Mesh=mesh_2)  # -> ListOfEdges, FaceFaceStructure, EdgeFaceStructure
tangentcircles = TangentCircles(mesh=mesh_2)  # -> C, flatten(P)
medges = MeshEdges(Mesh=mesh_2)  # -> NakedEdges, InteriorEdges, NonManifoldEdges
Y = UnitY(Factor="100")
nv_2 = NakedVertices(Mesh=mesh_2)  # -> ClothedIndex, NakedIndex, ClothedPts, NakedPts
meshdual = MeshDual(Mesh=mesh_2, Center=0)
crv = Curve([medges.NakedEdges, medges.InteriorEdges])
wbdual = WeaverbirdsDualGraph(MeshCurves=mesh_2, DualMode=Slider(0, range=0..1))
demesh = DeconstructMesh(Mesh=mesh_2)  # -> Vertices, Faces, Colours, Normals
deplane = DeconstructPlane(Plane=tangentcircles.P)  # -> Origin, XAxis, YAxis, ZAxis
deface = DeconstructFace(Face=demesh.Faces)  # -> graft(CornerA), graft(CornerB), graft(CornerC), graft(CornerD)
move = Move(Geometry=srf, Motion=Y)  # -> Geometry, Transform
faceb = FaceBoundaries(Mesh=mesh_2)
merge = Merge(Data1=deface.CornerA, Data2=deface.CornerB, Data3=deface.CornerC, Data4=deface.CornerD)
srf_cp = SurfaceClosestPoint(Point=demesh.Vertices, Surface=move.Geometry)  # -> Point, UVPoint, Distance

# ---- group: normals
item_2 = ListItem(List=demesh.Normals, Index=merge, Wrap=True)
cull_i = CullIndex(List=item_2, Indices=-1, Wrap=True)

# ---- group: points
item_3 = ListItem(List=demesh.Vertices, Index=merge, Wrap=True)
cull_i_2 = CullIndex(List=item_3, Indices=-1, Wrap=True)

# ----
number_slider = Slider(2.25, range=0..10)
curvature = SurfaceCurvature(Surface=move.Geometry, Point=srf_cp.UVPoint)  # -> Frame, Gaussian, Mean
panel_2 = Panel(cull_i)
bnd = Bounds(Numbers=curvature.Gaussian)
remap = RemapNumbers(Value=curvature.Gaussian, Source=bnd, Target=Domain(0, 1))  # -> Mapped, Clipped
neg = Negative(Value=number_slider)
amp = Amplitude(Vector=cull_i, Amplitude=number_slider)
amp_2 = Amplitude(Vector=cull_i, Amplitude=neg)
graph = GraphMapper(remap.Mapped, x0=0, x1=1, y0=0, y1=1, container_name="Bezier", cpx=[0, 0.4052186012, 0.5675367117, 1], cpy=[0, 0, 1, 1])

# ----
# thickness regulation
number_slider_2 = Slider(1.619, range=0..5)
dom = ConstructDomain(DomainStart=number_slider_2, DomainEnd=Slider(0.6, range=0..5))
remap_2 = RemapNumbers(Value=graph, Source=Domain(0, 1), Target=dom)  # -> Mapped, Clipped

move_2 = Move(Geometry=cull_i_2, Motion=amp)  # -> Geometry, Transform
move_3 = Move(Geometry=cull_i_2, Motion=amp_2)  # -> Geometry, Transform
gradient = Gradient(LowerLimit=0, UpperLimit=1, Parameter=remap.Mapped, stops=[0: RGB(255, 255, 255), 1: RGB(0, 0, 0)])
item_4 = ListItem(List=graph, Index=nv_2.ClothedIndex, Wrap=True)
dom_2 = ConstructDomain(DomainStart=Slider(0.322, range=0.001..1), DomainEnd=Slider(0.466, range=0.001..1))
ln = Line(StartPoint=move_2.Geometry, EndPoint=move_3.Geometry)  # -> simplify(Line)
remap_3 = RemapNumbers(Value=item_4, Source=Domain(0, 1), Target=dom_2)  # -> Mapped, Clipped
shift = ShiftList(List=ln, Shift=1, Wrap=True)  # -> simplify(List)
merge_2 = Merge(Data1=graft(ln), Data2=graft(shift))
loft = Loft(Curves=merge_2, Options={Adjust=False, Closed=False, LoftEnds=0, LoftSimp=0, LoftType=0, Rebuild=10, Refit=0.01})
conmesh = ConstructMesh(Vertices=demesh.Vertices, Faces=demesh.Faces, Colours=gradient)
scale = Scale(Geometry=tangentcircles.C, Center=tangentcircles.P, Factor=remap_3.Mapped)  # -> Geometry, Transform
scale_2 = Scale(Geometry=tangentcircles.C, Center=tangentcircles.P, Factor=Slider(0.9, range=0.001..1))  # -> Geometry, Transform
rev = Reverse(Vector=deplane.ZAxis)
bcx = BrepCurve(Brep=loft, Curve=scale_2.Geometry)  # -> Curves, Points
item_5 = ListItem(List=remap_2.Mapped, Index=nv_2.ClothedIndex, Wrap=True)
pshift = ShiftPaths(Data=bcx.Points, Offset=-2)
rev_2 = Reverse(Vector=demesh.Normals)
multiplication = Multiplication(A=remap_2.Mapped, B=2)
amp_3 = Amplitude(Vector=rev, Amplitude=item_5)
lng = ListLength(List=pshift)
amp_4 = Amplitude(Vector=rev_2, Amplitude=multiplication)
sunion = SetUnion(SetA=flatten(lng), SetB=flatten(lng))
move_4 = Move(Geometry=demesh.Vertices, Motion=amp_4)  # -> Geometry, Transform

# ---- group: lower mesh
conmesh_2 = ConstructMesh(Vertices=move_4.Geometry, Faces=demesh.Faces)

# ----
medges_2 = MeshEdges(Mesh=mesh_2)  # -> NakedEdges, InteriorEdges, NonManifoldEdges
medges_3 = MeshEdges(Mesh=conmesh_2)  # -> NakedEdges, InteriorEdges, NonManifoldEdges
curvepoint = PointOnCurve(medges_3.InteriorEdges, parameter=0.5)
curvepoint_2 = PointOnCurve(medges_2.InteriorEdges, parameter=0.5)
cp = ClosestPoint(Point=curvepoint_2, Cloud=curvepoint)  # -> ClosestPoint, CPIndex, Distance
item_6 = ListItem(List=medges_3.InteriorEdges, Index=cp.CPIndex, Wrap=True)
merge_3 = Merge(Data1=simplify(graft(medges_2.InteriorEdges)), Data2=simplify(graft(item_6)))
loft_2 = Loft(Curves=merge_3, Options={Adjust=False, Closed=False, LoftEnds=0, LoftSimp=0, LoftType=0, Rebuild=10, Refit=0.01})
previewmat_2 = CustomPreviewMaterials(Geometry=loft_2, DiffuseColor=RGB(255, 255, 255))

tangentcircles_2 = TangentCircles(mesh=conmesh_2)  # -> C, flatten(P)
scale_3 = Scale(Geometry=tangentcircles_2.C, Center=tangentcircles_2.P, Factor=Slider(0.9, range=0.001..1))  # -> Geometry, Transform
move_5 = Move(Geometry=scale.Geometry, Motion=amp_3)  # -> Geometry, Transform
bar_graph = BarGraph(lng, BarColor=RGB(255, 0, 90))
merge_4 = Merge(Data1=simplify(graft(scale_2.Geometry)), Data2=simplify(graft(move_5.Geometry)))
merge_5 = Merge(Data1=simplify(graft(scale_3.Geometry)), Data2=simplify(graft(move_5.Geometry)))
loft_3 = Loft(Curves=merge_4, Options={Adjust=False, Closed=False, LoftEnds=0, LoftSimp=0, LoftType=0, Rebuild=10, Refit=0.01})
loft_4 = Loft(Curves=merge_5, Options={Adjust=False, Closed=False, LoftEnds=0, LoftSimp=0, LoftType=0, Rebuild=10, Refit=0.01})

# ==== cluster TangentCircles: A compact circle packing from a flat mesh
mesh = ClusterInput()
mesh_2 = Mesh(mesh)
nv = NakedVertices(Mesh=mesh_2)  # -> ClothedIndex, NakedIndex, ClothedPts, NakedPts
vn = VertexNeighbours(Mesh=mesh_2, VertexNumber=nv.ClothedIndex)  # -> graft(Vertex), Neighbours, Normal
item = ListItem(List=vn.Neighbours, Index=0, Wrap=True)  # -> Item, Item1
dist = Distance(PointA=item.Item, PointB=item.Item1)
dist_2 = Distance(PointA=vn.Vertex, PointB=[item.Item, item.Item1])
ma = MassAddition(Input=[dist_2, dist])  # -> Result, PartialResults
multiplication = Multiplication(A=ma.Result, B=0.5)
pl = PlaneNormal(Origin=vn.Vertex, ZAxis=graft(vn.Normal))
subtraction = Subtraction(A=multiplication, B=dist)
cir = Circle(Plane=pl, Radius=subtraction)  # -> flatten(Circle)
C = ClusterOutput(cir)
P = ClusterOutput(pl)
