# Grasshopper definition mesh network from curves.gh (Grasshopper 0.9.76)
# plug-ins: Kangaroo Components, Weaverbird, Kangaroo2 Components

number_slider = Slider(4, range=2..10)
list = ValueList({"Simple Curves": 0, "Complex Curves": 1}, selected="Simple Curves")
crv = Curve(<curve referenced from the Rhino model>)
crv_2 = Curve(<curve referenced from the Rhino model>)
range = Range(Domain=Domain(0, 1), Steps=number_slider)
multiplication = Multiplication(A=reverse(range), B=Slider(45.305, range=0..100))
divide = DivideCurve(Curve=crv, Count=number_slider, Kinks=False)  # -> Points, Tangents, Parameters
crv_3 = Curve([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])
crv_4 = Curve([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])
divide_2 = DivideCurve(Curve=crv_2, Count=Slider(4, range=2..10), Kinks=False)  # -> Points, Tangents, Parameters
multiplication_2 = Multiplication(A=range, B=Slider(19.361, range=0..100))
amp = Amplitude(Vector=divide_2.Tangents, Amplitude=multiplication)
filter = StreamFilter(Gate=list, Stream0=crv_3, Stream1=crv_4)
amp_2 = Amplitude(Vector=divide.Tangents, Amplitude=multiplication_2)
rev = Reverse(Vector=amp)
dupln = RemoveDuplicateLines(Lines=filter, Tolerance=0.01)
bzspan = BezierSpan(StartPoint=divide.Points, StartTangent=amp_2, EndPoint=divide_2.Points, EndTangent=rev)  # -> Curve, Length, Domain
groups = Panel("""Sofia
Katerina
Thanae

Elena
Thanos
Kristina A

Maria
Efi

Kristina B
Livia

Fotini
Hary""")
divide_3 = DivideCurve(Curve=bzspan.Curve, Count=Slider(5, range=2..10), Kinks=False)  # -> Points, Tangents, Parameters
explode = Explode(Curve=dupln, Recursive=True)  # -> Segments, Vertices
number_slider_2 = Slider(1, range=1..100)
pline = PolyLine(Vertices=divide.Points, Closed=False)
pline_2 = PolyLine(Vertices=divide_2.Points, Closed=False)
pline_3 = PolyLine(Vertices=divide_3.Points, Closed=False)

# ---- group: curves to lines
dom = ConstructDomain(DomainStart=0, DomainEnd=1)
range_2 = Range(Domain=dom, Steps=number_slider_2)
series = Series(Start=0, Step=1, Count=number_slider_2)
eval = EvaluateLength(Curve=simplify(graft(explode.Segments)), Length=range_2, Normalized=True)  # -> Point, Tangent, Parameter
item = ListItem(List=eval.Point, Index=series, Wrap=True)  # -> simplify(Item), simplify(Item1)
ln = Line(StartPoint=item.Item, EndPoint=item.Item1)  # -> flatten(Line)

# ----
feet_roundness = Slider(96, range=-170..180)
dent = Panel("0")

# ---- group: Attractor point
pt = Point(Point(-29, -31, 0))

# ----
crv_5 = Curve(flatten([pline, pline_2, pline_3]))
explode_2 = Explode(Curve=crv_5, Recursive=True)  # -> flatten(Segments), Vertices
dom_2 = ConstructDomain(DomainStart=Slider(4.38, range=0..5), DomainEnd=Slider(3.19, range=0..5))
dupln_2 = RemoveDuplicateLines(Lines=explode_2.Segments, Tolerance=0.01)
end = EndPoints(Curve=dupln_2)  # -> Start, End
dist = Distance(PointA=end.End, PointB=pt)  # -> flatten(Distance)
dist_2 = Distance(PointA=end.Start, PointB=pt)  # -> flatten(Distance)
bnd = Bounds(Numbers=flatten([dist, dist_2]))
tolerance_for_stitching_lines = Panel("0.001")
remap = RemapNumbers(Value=dist_2, Source=bnd, Target=dom_2)  # -> Mapped, Clipped
remap_2 = RemapNumbers(Value=dist, Source=bnd, Target=dom_2)  # -> Mapped, Clipped
line = Line(dupln_2)
rad = Radians(Degrees=feet_roundness)

# ---- group: Component by Laurent Delrieu
c_script = CSharpScript(
    lines_in=line,
    tolerance=tolerance_for_stitching_lines,
    width_b=remap.Mapped,
    width_e=remap_2.Mapped,
    deviation=dent,
    angle=rad,
    n_u=Slider(1, range=1..10),
    n_v=Slider(2, range=1..10),
    zbool=Toggle(True))  # -> out, P, LP, PP, PL, lines, ends, connect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; inputs lines_in: list of Line, tolerance: Double, width_b: list of Double, width_e: list of Double, deviation: Double, angle: Double, n_u: Int32, n_v: Int32, zbool: Boolean
# ---------- c_script: C# ----------
    //v02
    //Add variable width per lines
    //V03
    //Suppression of limitation in number of run of the while
    //Test of n_u and n_v in order to be no less than 2
    //

    //OUT data
    List<Point3d> points = new List<Point3d>();
    DataTree<int> lineVertex = new DataTree<int>();
    DataTree<int> vertexVertexes = new DataTree<int>();
    DataTree<int> vertexLine = new DataTree<int>();

    List<Line> linesOut = new List<Line>();
    DataTree<Line> linesBranch = new DataTree<Line>();
    bool isEnd;
    List<Line> linesEnd = new List<Line>();

    List<LDPanel> panels = new List<LDPanel>();
    double width_calc = 0.0;

    ///BEGIN TEST INPUTS
    if (lines_in == null) return;

    if (lines_in.Count < 1)
    {
      this.Component.AddRuntimeMessage(GH_RuntimeMessageLevel.Error, "There must be more than 1 line");
      return;
    }
    LineTopology(lines_in, tolerance, ref points, ref  lineVertex, ref vertexVertexes, ref vertexLine);

    //v0.2
    if (width_b.Count < lines_in.Count)
    {
      int size_width = width_b.Count;

      for (int i = size_width; i <= lines_in.Count; i++)
      {
        width_b.Add(width_b[size_width - 1]);
      }
    }

    if (width_e.Count < lines_in.Count)
    {
      int size_width = width_e.Count;

      for (int i = size_width; i <= lines_in.Count; i++)
      {
        width_e.Add(width_e[size_width - 1]);
      }
    }
    //v0.2
    if (n_u < 2) n_u = 2;
    if (n_v < 2) n_v = 2;

    //For all lines
    for (int i = 0; i < lineVertex.BranchCount; i++)
    {
      Line lineOut = new Line();
      LDSide side1 = new LDSide();
      LDSide side2 = new LDSide();

      //One side of the line
      lineOut = LinePerp(points, lineVertex, vertexVertexes, true, true, i, width_b, width_e, out isEnd, out width_calc);
      if (isEnd) linesEnd.Add(lineOut);
      linesBranch.Add(lineOut, new GH_Path(i * 2));
      side1 = new LDSide(lineVertex.Branch(i)[1], points[lineVertex.Branch(i)[1]], lineOut.Direction, isEnd, width_calc);

      lineOut = LinePerp(points, lineVertex, vertexVertexes, false, false, i, width_b, width_e, out isEnd, out width_calc);
      if (isEnd) linesEnd.Add(lineOut);
      linesBranch.Add(lineOut, new GH_Path(i * 2));
      side2 = new LDSide(lineVertex.Branch(i)[0], points[lineVertex.Branch(i)[0]], lineOut.Direction, isEnd, width_calc);
      panels.Add(new LDPanel(side1, side2, i));

      //Other side of the line
      lineOut = LinePerp(points, lineVertex, vertexVertexes, false, true, i, width_b, width_e, out isEnd, out width_calc);
      if (isEnd) linesEnd.Add(lineOut);
      linesBranch.Add(lineOut, new GH_Path(i * 2 + 1));
      side1 = new LDSide(lineVertex.Branch(i)[0], points[lineVertex.Branch(i)[0]], lineOut.Direction, isEnd, width_calc);

      lineOut = LinePerp(points, lineVertex, vertexVertexes, true, false, i, width_b, width_e, out isEnd, out width_calc);
      if (isEnd) linesEnd.Add(lineOut);
      linesBranch.Add(lineOut, new GH_Path(i * 2 + 1));
      side2 = new LDSide(lineVertex.Branch(i)[1], points[lineVertex.Branch(i)[1]], lineOut.Direction, isEnd, width_calc);
      panels.Add(new LDPanel(side1, side2, i));
    }

    DataTree<LDPanel> treePanels = new DataTree<LDPanel>();
    DataTree<int> treeInt = new DataTree<int>();

    int test = 0;
    int branch = 0;
    while (panels.Count > 0)
    {
      treePanels.Add(panels[0], new GH_Path(branch));
      treeInt.Add(panels[0].lineNumber, new GH_Path(branch));
      panels.RemoveAt(0);

      int intersections = 0;
      do
      {
        List<LDPanel> intPanels = GetIntersections(treePanels.Branch(branch), panels);
        intersections = intPanels.Count;
        for (int i = (intPanels.Count - 1); i >= 0; i--)
        {
          treePanels.Add(intPanels[i], new GH_Path(branch));
          treeInt.Add(intPanels[i].lineNumber, new GH_Path(branch));
          panels.Remove(intPanels[i]);
        }
      } while (intersections > 0);
      test += 1;
      branch += 1;
    }
    DataTree<Brep> brepTree = new DataTree<Brep>();

    for (int i = 0; i < treePanels.BranchCount; i++)
    {
      for (int j = 0; j < treePanels.Branch(i).Count; j++)
      {
        brepTree.Add(treePanels.Branch(i)[j].ToBrep(), new GH_Path(i));
      }
    }
    DataTree<Mesh> meshTree = new DataTree<Mesh>();
    List<Point3d> fixedPoints = new List<Point3d>();
    DataTree<LineCurve> listUCurves = new DataTree<LineCurve> ();
    DataTree<LineCurve> listVCurves = new DataTree<LineCurve> ();

    for (int i = 0; i < treePanels.BranchCount; i++)
    {
      for (int j = 0; j < treePanels.Branch(i).Count; j++)
      {
        //meshTree.Add(treePanels.Branch(i)[j].ToMesh(n_u, n_v, angle, width_b[0], ref fixedPoints, ref listUCurves, ref  listVCurves, deviation, zbool), new GH_Path(i));
        meshTree.Add(treePanels.Branch(i)[j].ToMesh(n_u, n_v, angle, ref fixedPoints, ref listUCurves, ref  listVCurves, deviation, zbool), new GH_Path(i));
      }
    }
    P = points;
    LP = lineVertex;
    PP = vertexVertexes;
    PL = vertexLine;
    lines = linesBranch;
    ends = linesEnd;
    connect = treeInt;
    brep = brepTree;
    M = meshTree;
    F = fixedPoints;
    U = listUCurves;
    V = listVCurves;
# ---------- c_script: C# additional code ----------
  //For points begin and end, representing a line, search the width
  public double getWidthAtBeginning(int begin, int end, DataTree<int> lineVertex, List<double> w_b, List<double> w_e)
  {
    double output = w_b[0];

    for (int i = 0; i < lineVertex.BranchCount; i++)
    {
      if ((lineVertex.Branches[i][0] == begin) && (lineVertex.Branches[i][1] == end))
      {
        output = w_b[i];
        break;
      }
      if ((lineVertex.Branches[i][0] == end) && (lineVertex.Branches[i][1] == begin))
      {
        output = w_e[i];
        break;
      }
    }
    return output;
  }

  //Calculate on the line i, some curve perpandicular if it is an end or mediane if connection with othe lines
  // bool one is used to know if we begin from the firs point (beginning) of line or second (end)
  public Line LinePerp(List<Point3d> points, DataTree<int> lineVertex, DataTree<int> vertexVertexes, bool one, bool two, int i, List<double> width_b, List<double> width_e, out bool isEnd, out double width_calc)
  {
    int i0, i1;
    double signe = 1.0;
    double width;
    if (one)
    {
      i0 = 0;
      i1 = 1;
      width = width_e[i];
    }
    else
    {
      i0 = 1;
      i1 = 0;
      width = width_b[i];
    }

    if (two)
    {
      signe = 1.0;
    }
    else
    {
      signe = -1.0;
    }

    Vector3d dirPerp2 = new Vector3d();
    //Direction of the line
    Vector3d dir = (Vector3d) (points[lineVertex.Branch(i)[i1]] - points[lineVertex.Branch(i)[i0]]);
    //One direction perpendicular of the line, depending on signe sign
    Vector3d dirPerp = Vector3d.CrossProduct(dir, signe * Vector3d.ZAxis);
    dirPerp.Unitize();

    double angleTampon;
    double angle = 10.0;
    double width_buffer = width;
    angle = angle * signe;
    //More than one branch
    if (vertexVertexes.Branch(lineVertex.Branch(i)[i1]).Count > 1)
    {
      isEnd = false;
      //For all points connected to the points at the end of the line (end could be a beginning !)
      for (int j = 0; j < vertexVertexes.Branch(lineVertex.Branch(i)[i1]).Count; j++)
      {
        //If it is not the same line
        if (vertexVertexes.Branch(lineVertex.Branch(i)[i1])[j] != lineVertex.Branch(i)[i0])
        {
          Vector3d dir2 = (Vector3d) (points[vertexVertexes.Branch(lineVertex.Branch(i)[i1])[j]] - points[lineVertex.Branch(i)[i1]]);
          Vector3d dirPerp2Tampon = Vector3d.CrossProduct(dir2, signe * Vector3d.ZAxis);
          dirPerp2Tampon.Unitize();

          //Line connected as 2 points :
          // vertexVertexes.Branch(lineVertex.Branch(i)[i1])[j]
          // lineVertex.Branch(i)[i1]
          angleTampon = Angle(dirPerp2Tampon, dirPerp);
          if (signe > 0)
          {
            if (angleTampon < angle)
            {
              angle = angleTampon;
              dirPerp2 = dirPerp2Tampon;
              width_buffer = getWidthAtBeginning(lineVertex.Branch(i)[i1], vertexVertexes.Branch(lineVertex.Branch(i)[i1])[j], lineVertex, width_b, width_e);
            }
          }
          else
          {
            if ( angleTampon > angle)
            {
              angle = angleTampon;
              dirPerp2 = dirPerp2Tampon;
              width_buffer = getWidthAtBeginning(lineVertex.Branch(i)[i1], vertexVertexes.Branch(lineVertex.Branch(i)[i1])[j], lineVertex, width_b, width_e);
            }
          }
        }
      }
    }
      //Line as an End
    else
    {
      isEnd = true;
      angle = 0.0;
      dirPerp2 = dirPerp;
    }
    width = width + width_buffer;
    width = width / 2;
    width_calc = width;
    if (width / (2.0 * Math.Cos(angle / 2) * Math.Cos(angle / 2)) > 100)
    {
      return new Line(points[lineVertex.Branch(i)[i1]], points[lineVertex.Branch(i)[i1]] - width * (dirPerp + dirPerp2));
    }
    else
      return new Line(points[lineVertex.Branch(i)[i1]], points[lineVertex.Branch(i)[i1]] - width * (dirPerp + dirPerp2) / (2.0 * Math.Cos(angle / 2) * Math.Cos(angle / 2)));
  }


  //This function replicate SandBox lines topology
  //As inputs there are lines
  //Tolerance is used to glued points thar are close to each others
  //Outputs are
  //points list of Point3d
  //linePoint dataTree containing the points index number for end and beginning of the line
  //pointPoint dataTree containing the points index number for each other point connected to this point
  public static void LineTopology(List < Line > lines, double tolerance, ref List<Point3d> points, ref DataTree<int> linePoint, ref DataTree<int> pointPoint, ref  DataTree<int> pointLine)
  {
    for (int n_line = 0; n_line < lines.Count; n_line++)
    {
      bool addPoint = true;
      int nPoint = 0;
      for (int i = 0; i < points.Count; i++)
      {
        if (points[i].DistanceTo(lines[n_line].From) < tolerance)
        {
          addPoint = false;
          nPoint = i;
        }
      }
      if (addPoint)
      {
        points.Add(lines[n_line].From);
        linePoint.Add(points.Count - 1, new GH_Path(n_line));
      }
      else
      {
        linePoint.Add(nPoint, new GH_Path(n_line));
      }

      addPoint = true;
      for (int i = 0; i < points.Count; i++)
      {
        if (points[i].DistanceTo(lines[n_line].To) < tolerance)
        {
          addPoint = false;
          nPoint = i;
        }
      }
      if (addPoint)
      {
        points.Add(lines[n_line].To);
        linePoint.Add(points.Count - 1, new GH_Path(n_line));
      }
      else
      {
        linePoint.Add(nPoint, new GH_Path(n_line));
      }
    }
    for (int n_line = 0; n_line < linePoint.BranchCount; n_line++)
    {
      pointPoint.Add(linePoint.Branches[n_line][0], new GH_Path(linePoint.Branches[n_line][1]));
      pointPoint.Add(linePoint.Branches[n_line][1], new GH_Path(linePoint.Branches[n_line][0]));
    }

    for (int j = 0; j < linePoint.BranchCount; j++)
    {
      pointLine.Add(j, new GH_Path(linePoint.Branch(j)[0]));
      pointLine.Add(j, new GH_Path(linePoint.Branch(j)[1]));
    }

  }
  ///End lineTopology

  public static double Angle(Vector3d v1, Vector3d v2)
  {
    double output = -10;
    v1.Unitize();
    v2.Unitize();
    double g1 = Math.Acos(Math.Max(Math.Min(v1 * v2, 1.0), -1.0));
    Vector3d cross = Vector3d.CrossProduct(v1, v2);
    double g2 = Math.Asin(Math.Max(Math.Min(cross.Z, 1.0), -1.0));

    if (g2 >= 0)
    {
      output = g1;
    }

    else
    {
      if (g1 >= 0)
      {
        output = 2 * Math.PI - g1;
      }
      else
      {
        output = g2 + Math.PI;
      }
    }
    if (output > Math.PI) output = output - 2 * Math.PI;
    return (output % Math.PI);
  }
  ///////////////////////////
  public class LDPanel
  {
    public LDSide side1;
    public LDSide side2;
    public int lineNumber;

    public List<int> ToList()
    {
      List<int> output = new List<int>();
      output.Add(side1.nodeNumber);
      output.Add(side2.nodeNumber);
      output.Add(lineNumber);
      return output;
    }
    public Brep ToBrep()
    {
      List<Curve> curves = new List<Curve>();
      curves.Add(side1.ToCurve());
      curves.Add(side2.ToCurve());
      // Brep[] output = Brep.CreateFromLoft(curves, side1.point, side2.point, LoftType.Normal, false);
      Brep[] output = Brep.CreateFromLoft(curves, Point3d.Unset, Point3d.Unset, LoftType.Normal, false);

      if (output.Length > 0) return output[0];
      else return null;
    }

    //With LIST
    //public Mesh ToMesh(int nu, int nv, double angle, double radius, ref List<Point3d> fixedPoints, ref List<LineCurve> listUCurves, ref List<LineCurve> listVCurves, double deviation, bool zbool)
    public Mesh ToMesh(int nu, int nv, double angle, ref List<Point3d> fixedPoints, ref List<LineCurve> listUCurves, ref List<LineCurve> listVCurves, double deviation, bool zbool)
    {
      List < Point3d > pts1 = new  List < Point3d >();
      List < Point3d > pts2 = new  List < Point3d >();

      if (side1.isEnd)
      {
        pts1 = ToArcDeviation(side1.point, new Vector3d(side2.point - side1.point), side1.direction, angle, nv, deviation, zbool);
        fixedPoints.AddRange(pts1);
      }
      else
      {
        //pts1 = ToLine(side1.point, side1.direction, nv, angle, radius, zbool);
        pts1 = ToLine(side1.point, side1.direction, nv, angle, side1.width, zbool);
      }


      if (side2.isEnd)
      {
        pts2 = ToArcDeviation(side2.point, new Vector3d(side1.point - side2.point), side2.direction, angle, nv, deviation, zbool);
        fixedPoints.AddRange(pts2);
      }
      else
      {
        //pts2 = ToLine(side2.point, side2.direction, nv, angle, radius, zbool);
        pts2 = ToLine(side2.point, side2.direction, nv, angle, side2.width, zbool);
      }

      return PointsToMesh(pts1, pts2, nu, ref listUCurves, ref  listVCurves);
    }

    //With DATATREE
    // public Mesh ToMesh(int nu, int nv, double angle, double radius, ref List<Point3d> fixedPoints, ref DataTree<LineCurve> listUCurves, ref DataTree<LineCurve> listVCurves, double deviation, bool zbool)
    public Mesh ToMesh(int nu, int nv, double angle, ref List<Point3d> fixedPoints, ref DataTree<LineCurve> listUCurves, ref DataTree<LineCurve> listVCurves, double deviation, bool zbool)
    {
      List < Point3d > pts1 = new  List < Point3d >();
      List < Point3d > pts2 = new  List < Point3d >();

      if (side1.isEnd)
      {
        pts1 = ToArcDeviation(side1.point, new Vector3d(side2.point - side1.point), side1.direction, angle, nv, deviation, zbool);
        fixedPoints.AddRange(pts1);
      }
      else
      {
        //pts1 = ToLine(side1.point, side1.direction, nv, angle, radius, zbool);
        pts1 = ToLine(side1.point, side1.direction, nv, angle, side1.width, zbool);
      }

      if (side2.isEnd)
      {
        pts2 = ToArcDeviation(side2.point, new Vector3d(side1.point - side2.point), side2.direction, angle, nv, deviation, zbool);
        fixedPoints.AddRange(pts2);
      }
      else
      {
        //pts2 = ToLine(side2.point, side2.direction, nv, angle, radius, zbool);
        pts2 = ToLine(side2.point, side2.direction, nv, angle, side2.width, zbool);
      }

      return PointsToMesh(pts1, pts2, nu, ref listUCurves, ref  listVCurves);
    }


    public LDPanel(LDSide s1, LDSide s2, int line)
    {
      side1 = s1;
      side2 = s2;
      lineNumber = line;
    }
    public bool Touch(LDPanel other)
    {
      bool output = false;
      Vector3d vect = new Vector3d();
      if (other.side1.nodeNumber == side1.nodeNumber)
      {
        vect = other.side1.direction - side1.direction;
        if (vect.Length < 0.001) output = true;
      }

      if (other.side2.nodeNumber == side1.nodeNumber)
      {
        vect = other.side2.direction - side1.direction;
        if (vect.Length < 0.001) output = true;
      }

      if (other.side1.nodeNumber == side2.nodeNumber)
      {
        vect = other.side1.direction - side2.direction;
        if (vect.Length < 0.001) output = true;
      }

      if (other.side2.nodeNumber == side2.nodeNumber)
      {
        vect = other.side2.direction - side2.direction;
        if (vect.Length < 0.001) output = true;
      }

      return output;
    }



  }
  public static  List<LDPanel> GetIntersections(List < LDPanel > lines, List<LDPanel> source)
  {
    List<LDPanel> output = new List<LDPanel>();

    for (int i = 0; i < lines.Count; i++)
    {
      for (int j = 0; j < source.Count; j++)
      {
        if (lines[i].Touch(source[j]))
        {
          bool test = true;
          for (int k = 0; k < output.Count; k++)
          {
            if (source[j].lineNumber == output[k].lineNumber) test = false;
          }
          if (test) output.Add(source[j]);
        }
      }
    }
    return output;
  }
  public class LDSide
  {
    public int nodeNumber;
    public Point3d point;
    public Vector3d direction;
    public bool isEnd;
    public double width;

    public LDSide()
    {
      nodeNumber = -1;
      point = new Point3d(Point3d.Unset);
      direction = new Vector3d(Vector3d.Unset);
      isEnd = true;
    }

    public LDSide(LDSide side)
    {
      LDSideSet(side.nodeNumber, side.point, side.direction, side.isEnd, side.width);
    }
    public LDSide(int n, Point3d pt, Vector3d dir, bool end, double width_calc)
    {
      nodeNumber = n;
      point = new Point3d(pt);
      direction = new Vector3d(dir);
      isEnd = end;
      width = width_calc;
    }
    public void LDSideSet(int n, Point3d pt, Vector3d dir, bool end, double width_calc)
    {
      nodeNumber = n;
      point = new Point3d(pt);
      direction = new Vector3d(dir);
      isEnd = end;
      width = width_calc;
    }
    public Curve ToCurve()
    {
      return new LineCurve(point, (Point3d) (point + direction));
    }
  }
  /////////////////////////////////////////////////////
  public static List<Point3d> ToArc(Point3d zero, Vector3d x, Vector3d y, double angle, int n, bool zbool)
  {
    List<Point3d> output = new List<Point3d>();

    Vector3d x_unit = new Vector3d(x);
    x_unit.Unitize();
    if (zbool) x_unit = Vector3d.ZAxis;

    Vector3d y_unit = new Vector3d(y);
    y_unit.Unitize();

    double width = y.Length;
    double angle0 = 0.0;

    if (Math.Abs(angle) < 0.01)
    {
      for (int i = 0; i < n; i++)
      {
        angle0 = angle * (double) i / (double) (n - 1);
        Vector3d x1 = x_unit * ( width * angle0);
        Vector3d y1 = y_unit * width * (double) i / (double) (n - 1);
        output.Add(new Point3d(zero + x1 + y1));
      }
    }
    else
    {
      for (int i = 0; i < n; i++)
      {
        angle0 = angle * (double) i / (double) (n - 1);
        Vector3d x1 = x_unit * ( width / Math.Sin(angle) * (1.0 - Math.Cos(angle0)));
        Vector3d y1 = y_unit * ( width * Math.Sin(angle0) / Math.Sin(angle));
        output.Add(new Point3d(zero + x1 + y1));
      }
    }
    return output;
  }
  /////////////////////////////////////////////////////
  public static List<Point3d> ToArcDeviation(Point3d zero, Vector3d x, Vector3d y, double angle, int n, double maxDeviation, bool zbool)
  {
    List<Point3d> output = new List<Point3d>();
    Vector3d x_unit = new Vector3d(x);
    x_unit.Unitize();
    if (zbool) x_unit = Vector3d.ZAxis;

    Vector3d y_unit = new Vector3d(y);
    y_unit.Unitize();

    double width = y.Length;
    double angle0 = 0.0;
    double deviation = 1.2;
    if (Math.Abs(angle) < 0.01)
    {
      for (int i = 0; i < n; i++)
      {
        deviation = ((double) i % 2.0) * maxDeviation;
        angle0 = angle * (double) i / (double) (n - 1);
        Vector3d x1 = x_unit * (deviation * width * angle0);
        Vector3d y1 = y_unit * width * (double) i / (double) (n - 1);
        output.Add(new Point3d(zero + x1 + y1));
      }
    }
    else
    {
      double angle_max;
      if (angle > Math.PI / 2)
      {
        angle_max = Math.PI / 2;
      }
      else
      {
        if (angle < -Math.PI / 2) angle_max = -Math.PI / 2;
        else angle_max = angle;
      }

      for (int i = 0; i < n; i++)
      {
        deviation = ((double) i % 2.0) * maxDeviation;
        angle0 = angle * (double) i / (double) (n - 1);
        Vector3d x1 = x_unit * (width / Math.Sin(angle_max) * (1.0 - Math.Cos(angle0)) - deviation * Math.Cos(angle0));
        Vector3d y1 = y_unit * ( width / Math.Sin(angle_max) + deviation) * Math.Sin(angle0);
        output.Add(new Point3d(zero + x1 + y1));
      }
    }
    return output;
  }
  /////////////////////////////////////////////////////
  public static List<Point3d> ToLine(Point3d zero, Vector3d y, int n, double angle0, double radius, bool zbool)
  {
    List<Point3d> output = new List<Point3d>();
    if (zbool)
    {
      double angle;
      //y.Unitize();
      Vector3d z = Vector3d.ZAxis;

      for (int i = 0; i < n; i++)
      {
        angle = Math.Abs(angle0) * (double) i / (double) (n - 1);
        output.Add(new Point3d(zero + y * Math.Sin(angle) + z * Math.Sign(angle0) * radius * (1 - Math.Cos(angle))));
      }

    }
    else
    {
      for (int i = 0; i < n; i++)
      {
        output.Add(new Point3d(zero + y * (double) i / (double) (n - 1)));
      }
    }
    return output;

    //return ToArc(zero, new Vector3d(0.0, 0.0, 0.0), y, angle, n, zbool);
  }
  /////////////////////////////////////////////////////
  public static Mesh PointsToMesh(List < Point3d > pts1, List<Point3d> pts2, int nx, ref List<LineCurve> listUCurves, ref List<LineCurve> listVCurves)
  {
    int ny = pts1.Count;

    Rhino.Geometry.Mesh mesh = new Rhino.Geometry.Mesh();

    for (int iy = 0; iy < ny; iy++)
    {
      for (int ix = 0; ix < nx; ix++)
      {

        mesh.Vertices.Add(new Point3d(pts1[iy] + (pts2[iy] - pts1[iy]) * (double) ix / (double) (nx - 1)));
      }
    }
    int i0, i1, i2, i3;
    for (int ix = 0; ix < (nx - 1); ix++)
    {
      for (int iy = 0; iy < (ny - 1); iy++)
      {
        i0 = ix + iy * nx;
        i1 = (ix + 1) + iy * nx;
        i2 = (ix + 1) + (iy + 1) * nx;
        i3 = ix + (iy + 1) * nx;
        mesh.Faces.AddFace(i0, i1, i2, i3);
        listUCurves.Add(new LineCurve(mesh.Vertices[i0], mesh.Vertices[i1]));
        listVCurves.Add(new LineCurve(mesh.Vertices[i1], mesh.Vertices[i2]));
        listUCurves.Add(new LineCurve(mesh.Vertices[i2], mesh.Vertices[i3]));
        listVCurves.Add(new LineCurve(mesh.Vertices[i3], mesh.Vertices[i0]));
      }
    }
    mesh.Normals.ComputeNormals();
    mesh.Compact();
    return mesh;
  }
  /////////////////////////////////////////////////////
  public static Mesh PointsToMesh(List < Point3d > pts1, List<Point3d> pts2, int nx, ref DataTree<LineCurve> listUCurves, ref DataTree<LineCurve> listVCurves)
  {
    int ny = pts1.Count;

    Rhino.Geometry.Mesh mesh = new Rhino.Geometry.Mesh();

    for (int iy = 0; iy < ny; iy++)
    {
      for (int ix = 0; ix < nx; ix++)
      {

        mesh.Vertices.Add(new Point3d(pts1[iy] + (pts2[iy] - pts1[iy]) * (double) ix / (double) (nx - 1)));
      }
    }
    int i0, i1, i2, i3;
    for (int ix = 0; ix < (nx - 1); ix++)
    {
      for (int iy = 0; iy < (ny - 1); iy++)
      {
        i0 = ix + iy * nx;
        i1 = (ix + 1) + iy * nx;
        i2 = (ix + 1) + (iy + 1) * nx;
        i3 = ix + (iy + 1) * nx;
        mesh.Faces.AddFace(i0, i1, i2, i3);
        listUCurves.Add(new LineCurve(mesh.Vertices[i0], mesh.Vertices[i1]), new GH_Path(iy));
        listVCurves.Add(new LineCurve(mesh.Vertices[i1], mesh.Vertices[i2]), new GH_Path(iy));
        listUCurves.Add(new LineCurve(mesh.Vertices[i2], mesh.Vertices[i3]), new GH_Path(iy + 1));
        listVCurves.Add(new LineCurve(mesh.Vertices[i3], mesh.Vertices[i0]), new GH_Path(iy));
      }
    }
    mesh.Normals.ComputeNormals();
    mesh.Compact();
    return mesh;
  }
# ---------- end c_script ----------

# ----
panel = Panel(c_script.P)
crv_6 = Curve(c_script.V)
mesh = Mesh(flatten(c_script.M))
mjoin = MeshJoin(Meshes=mesh)
brep = Brep(c_script.brep)
pt_2 = Point(c_script.P)
wbcatmullclark = WeaverbirdsCatmullClarkSubdivision(MeshCurves=mjoin, Level=3, SmoothNakedEdges=1)
wbjoin = WeaverbirdsJoinMeshesAndWeld(Mesh=mjoin, Weld=True)
demesh = DeconstructMesh(Mesh=wbjoin)  # -> Vertices, Faces, Colours, Normals
cp = ClosestPoint(Point=pt_2, Cloud=demesh.Vertices)  # -> ClosestPoint, CPIndex, Distance
panel_2 = Panel(mjoin)
item_2 = ListItem(List=demesh.Normals, Index=cp.CPIndex, Wrap=True)
item_3 = ListItem(List=demesh.Vertices, Index=cp.CPIndex, Wrap=True)
amp_3 = Amplitude(Vector=item_2, Amplitude=Slider(3.438, range=0..5))
move = Move(Geometry=item_3, Motion=amp_3)  # -> Geometry, Transform
replace = ReplaceItems(List=demesh.Vertices, Item=move.Geometry, Indices=cp.CPIndex, Wrap=False)
conmesh = ConstructMesh(Vertices=replace, Faces=demesh.Faces)
number_slider_3 = Slider(-100, range=-100..0)  # disabled
number_slider_4 = Slider(39, range=2..50)  # disabled
number_slider_5 = Slider(20, range=0..20)  # disabled
nv = NakedVertices(Mesh=conmesh)  # -> ClothedIndex, NakedIndex, ClothedPts, NakedPts; disabled
srf = Surface(<surface referenced from the Rhino model>)  # disabled
number_slider_6 = Slider(36.64, range=1..100)  # disabled
medges = MeshEdges(Mesh=conmesh)  # -> NakedEdges, InteriorEdges, NonManifoldEdges; disabled
mesh_uv = MeshSurface(Surface=srf, UCount=number_slider_4, VCount=number_slider_4, Overhang=True, Equalize=False)  # disabled
Z = UnitZ(Factor=number_slider_3)  # disabled
pt_3 = Point([nv.ClothedPts, nv.NakedPts])  # disabled
length_line = LengthLine(Line=[medges.InteriorEdges, medges.NakedEdges], Strength=10)  # disabled
load = Load(Point=nv.ClothedPts, ForceVector=Z)  # disabled
number_slider_7 = Slider(12.88, range=1..100)  # disabled
sc = SphereCollide(Points=pt_3, Radius=number_slider_5, Strength=1)  # disabled
onmesh = OnMesh(Points=nv.NakedPts, Mesh=mesh_uv, Strength=number_slider_6)  # disabled
toggle = BooleanToggle(True)  # disabled
msphere = MeshSphere(Base=pt_3, Radius=number_slider_5, UCount=10, VCount=20)  # disabled
show = Show(G=conmesh)  # disabled
toggle_2 = BooleanToggle(True)  # disabled
button = Button()  # disabled
plasticanchor = PlasticAnchor(Point=nv.NakedPts, Limit=1, Strength=number_slider_7)  # disabled
solver = Solver(
    GoalObjects=[show, sc, onmesh, length_line, load, plasticanchor],
    Reset=button,
    Threshold=1e-15,
    Tolerance=0.01,
    On=toggle_2)  # -> I, V, O; disabled
