# Grasshopper definition remesh plankton circles.gh (Grasshopper 0.9.76)
# plug-ins: Human, Kangaroo Components, PlanktonGh, Weaverbird

# ----
# leave untouched!
# Inverse distance weighted interpolation(Shepard's method). Lets you set different target edge length values in different regions.
pt = Point([Point(-16, 4, 0), Point(17, 21, 0), Point(10, -11, 0)])
panel = Panel("""0.4
1
3""")

# ----
# A low number here results in a smoother blend, while a high number gives more sharply distinguished regions
panel_2 = Panel("4")

number_slider = Slider(12, range=2..20)

# ---- group: initial surface
srf = Surface(reparameterize(<surface referenced from the Rhino model>))

# ----
# A tolerance for the edge collapse/split thresholds
# strengths for the smoothing and circlepacking forces
# How strongly to pull vertices onto the target mesh
pull = Slider(0.8, range=0..1)
smooth = Slider(0.14, range=0..1)
circlify = Slider(0.14, range=0..1)
allow = Slider(0.832, range=0.5..1)

mesh_uv = MeshSurface(Surface=srf, UCount=number_slider, VCount=number_slider, Overhang=True, Equalize=False)

# ---- group: initial/target mesh
# The mesh to pull to. You can also change or replace this while the remeshing is running.
mesh = Mesh(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)

# ----
merge = Merge(Data1=Slider(8, range=2..15), Data2=Slider(8, range=2..15), Data3=Slider(5, range=2..15))
pt_2 = Point([<point referenced from the Rhino model> x3])
wbnaked = WeaverbirdsNakedBoundary(MeshClosedPolylines=mesh_uv)
tag = TextTag3D(Location=pt_2, Text=merge, Size=Slider(3.63, range=0..5), Justification=7)
panel_3 = Panel("""allow : 
smooth : 
circlify : 
pull : 
point radius : """)

number_slider_2 = Slider(100, range=1..100)  # disabled
# please do not use
edges = BrepEdges(Brep=srf)  # -> Naked, Interior, NonManifold; disabled
crv = Curve(<curve referenced from the Rhino model>)  # disabled
cir = Circle(Plane=PlaneXY(0, 0, 0), Radius=12)  # disabled
join = JoinCurves(Curves=edges.Naked, Preserve=False)  # disabled
number_slider_3 = Slider(1, range=0..1)  # disabled
end = EndPoints(Curve=cir)  # -> Start, End; disabled
number_slider_4 = Slider(0.624, range=0..1)  # disabled
panel_4 = Panel("false")  # disabled
number_slider_5 = Slider(8, range=3..10)  # disabled
mesh_2 = Mesh(srf)  # disabled
number_slider_6 = Slider(0, range=0..1)  # disabled
mesh_3 = Mesh(crv)  # disabled
disc = Discontinuity(Curve=join, Level=1)  # -> Points, Parameters; disabled
not = GateNot(A=panel_4)  # disabled
sequence = Sequence(Frames=number_slider_2)  # disabled
toggle = BooleanToggle(False)  # disabled
repeat = RepeatData(Data=panel_4)  # disabled
merge_2 = Merge(Data1=not, Data2=repeat)  # disabled
meshmachine = MeshMachine(
    Geometry=mesh_2,
    Length=number_slider_5,
    FixCurves=join,
    Flip=number_slider_6,
    PullStrength=number_slider_4,
    CurvatureAdaptivity=0,
    BoundaryScale=number_slider_3,
    BoundaryDistance=6,
    Exponent=2,
    Background=0.5,
    Iterations=1,
    Reset=sequence)  # disabled
item = ListItem(List=meshmachine, Index=0, Wrap=True)  # disabled
swatch = ColourSwatch(SwatchColor=RGBA(255, 255, 255, 0))  # disabled
pmesh = PlanktonMesh(item)  # disabled
mesh_4 = Mesh(pmesh)  # disabled
clean = CombineClean(Meshes=mesh_4)  # disabled
tangentcircles = TangentCircles_2(mesh=clean)  # disabled
previewlw = CustomPreviewLineweights(Geometry=clean, Shader=swatch, Absolute=False)  # disabled

entwine = Entwine(Branch00=allow, Branch01=smooth, Branch02=circlify, Branch03=pull, Branch04=merge, FlattenInputs=True)
concat = Concatenate(FragmentA=graft(panel_3), FragmentB=entwine)

timer = Timer(TimerInterval=5, Target=c_script)  # disabled

join_2 = TextJoin(Text=flatten(concat))
# You may need to change the reference paths (Right click and 'Manage Assemblies')
# 
# You need references to:
# 
# Kangaroo0096.gha
# KangarooLib0096.dll
# Plankton.dll
# PlanktonGH.dll
c_script = CSharpScript(
    M1=mesh_uv,
    boundary=wbnaked,
    t=allow,
    smooth=smooth,
    circlepack=circlify,
    pull=pull,
    SizePoints=pt_2,
    Sizes=merge,
    Falloff="4",
    reset=Toggle(False),
    Reference=["C:\Users\Alessio\AppData\Roaming\Grasshopper\Libraries\KangarooLib0099.dll", "C:\Users\Alessio\AppData\Roaming\Grasshopper\Libraries\Kangaroo0099.gha", "C:\Users\Alessio\AppData\Roaming\Grasshopper\Libraries\PlanktonGh.dll", "C:\Users\Alessio\AppData\Roaming\Grasshopper\Libraries\Plankton.dll"])  # -> out, A; inputs M1: Mesh, boundary: Curve, t: Double, smooth: Double, circlepack: Double, pull: Double, SizePoints: list of Point3d, Sizes: list of Double, Falloff: Int32, reset: Boolean
# ---------- c_script: C# ----------
    //Remeshing/Circle packing script
    //Daniel Piker, 08/01/2014
    
    if(reset)
    {
      M1.Faces.ConvertQuadsToTriangles();
      P = M1.ToPlanktonMesh();
    }

    else
    {
      int EdgeCount = P.Halfedges.Count / 2;
      double[] EdgeLength = P.Halfedges.GetLengths();
      bool[] Visited = new bool[P.Vertices.Count];

      //Split the edges that are too long

      for(int i = 0;i < EdgeCount;i++)
      {
        double L = WeightedCombo(MidPt(P, i), SizePoints, Sizes, Falloff);
        if((Visited[P.Halfedges[2 * i].StartVertex] == false)
          && (Visited[P.Halfedges[2 * i + 1].StartVertex] == false)
          && (EdgeLength[2 * i] > (2 - t) * (4f / 3f) * L))
        {
          int SplitCenter = P.Halfedges[P.Halfedges.TriangleSplitEdge(2 * i)].StartVertex;
          if (SplitCenter != -1)
          {
            int[] Neighbours = P.Vertices.GetVertexNeighbours(SplitCenter);
            foreach (int n in Neighbours)
            {Visited[n] = true;}
          }
        }
      }

      //Collapse the edges that are too short

      for(int i = 0;i < EdgeCount;i++)
      {
        if(P.Halfedges[2 * i].IsUnused == false)
        {
          double L = WeightedCombo(MidPt(P, i), SizePoints, Sizes, Falloff);

          if((Visited[P.Halfedges[2 * i].StartVertex] == false)
            && (Visited[P.Halfedges[2 * i + 1].StartVertex] == false)
            && (EdgeLength[2 * i] < t * 4f / 5f * L))
          {
            int Collapsed = -1;
            Collapsed = P.Halfedges[2 * i].StartVertex;
            P.Vertices.SetVertex(Collapsed, MidPt(P, i));
            int CollapseRtn = P.Halfedges.CollapseEdge(2 * i);
            if(CollapseRtn != -1)
            {
              int[] Neighbours = P.Vertices.GetVertexNeighbours(Collapsed);
              foreach (int n in Neighbours)
              {Visited[n] = true;}
            }
          }
        }
      }

      EdgeCount = P.Halfedges.Count / 2;

      //Flip edges to reduce valence error
      for(int i = 0;i < EdgeCount;i++)
      {
        if(!P.Halfedges[2 * i].IsUnused && (P.Halfedges[2 * i].AdjacentFace != -1) && (P.Halfedges[2 * i + 1].AdjacentFace != -1))
        {
          int Valence1 = P.Vertices.GetValence(P.Halfedges[2 * i].StartVertex);
          int Valence2 = P.Vertices.GetValence(P.Halfedges[2 * i + 1].StartVertex);
          int Valence3 = P.Vertices.GetValence(P.Halfedges[P.Halfedges[P.Halfedges[2 * i].NextHalfedge].NextHalfedge].StartVertex);
          int Valence4 = P.Vertices.GetValence(P.Halfedges[P.Halfedges[P.Halfedges[2 * i + 1].NextHalfedge].NextHalfedge].StartVertex);

          int CurrentError =
            Math.Abs(Valence1 - 6) +
            Math.Abs(Valence2 - 6) +
            Math.Abs(Valence3 - 6) +
            Math.Abs(Valence4 - 6);
          int FlippedError =
            Math.Abs(Valence1 - 7) +
            Math.Abs(Valence2 - 7) +
            Math.Abs(Valence3 - 5) +
            Math.Abs(Valence4 - 5);
          if(CurrentError > FlippedError)
          {
            P.Halfedges.FlipEdge(2 * i);
          }
        }
      }

      P.Compact();

      Vector3d[] Smooth = GhKangaroo.MeshPhysics.LaplacianSmooth(P, 0, smooth);
      Vector3d[] Circlify = GhKangaroo.MeshPhysics.TangentIncircles(P, circlepack);

      for(int i = 0;i < P.Vertices.Count;i++)
      {
        if(!P.Vertices[i].IsUnused)
        {
          P.Vertices.MoveVertex(i, Smooth[i] + Circlify[i]);
          Point3d Point = P.Vertices[i].ToPoint3d();
          P.Vertices.SetVertex(i, Point * (1 - pull) + pull * M1.ClosestPoint(Point));

          if(P.Vertices.NakedEdgeCount(i) > 0)
          {
            double boundaryT = 0;
            boundary.ClosestPoint(Point, out boundaryT);
            Point3d boundarypt = boundary.PointAt(boundaryT);
            P.Vertices.SetVertex(i, boundarypt);
          }
        }
      }
    }
    A = P.ToRhinoMesh();
# ---------- c_script: C# additional code ----------
  PlanktonMesh P = new PlanktonMesh();

  public double WeightedCombo(Point3d Pos, List<Point3d> SizePoints, List<double> Sizes, int Falloff)
  {
    double WeightedSize = 0, WeightSum = 0;
    double[] Weighting = new double[SizePoints.Count];

    for(int j = 0;j < SizePoints.Count;j++)
    {
      Weighting[j] = Math.Pow(Pos.DistanceTo(SizePoints[j]), -1.0 * Falloff);
      WeightSum += Weighting[j];
    }

    for(int j = 0;j < SizePoints.Count;j++)
    {
      WeightedSize += Weighting[j] * (1.0 / WeightSum) * Sizes[j];
    }
    return WeightedSize;
  }

  public Point3d MidPt (PlanktonMesh P, int E)
  {
    Point3d Pos1 = P.Vertices[P.Halfedges[2 * E].StartVertex].ToPoint3d();
    Point3d Pos2 = P.Vertices[P.Halfedges[2 * E + 1].StartVertex].ToPoint3d();
    return (Pos1 + Pos2) * 0.5;
  }
# ---------- end c_script ----------
panel_5 = Panel(join_2)
pt_3 = Point(<point referenced from the Rhino model>)
clean_2 = CombineClean(Meshes=c_script.A)
panel_6 = Panel(c_script.out)
tag_2 = TextTag3D(Location=pt_3, Text=join_2, Size=Slider(2, range=1..5), Justification=7)
tangentcircles_2 = TangentCircles(mesh=clean_2)  # -> C, P
mesh_5 = Mesh(<mesh referenced from the Rhino model>)
mesh_6 = Mesh(<mesh referenced from the Rhino model>)
tangentcircles_3 = TangentCircles(mesh=mesh_5)  # -> C, flatten(P)
demesh = DeconstructMesh(Mesh=mesh_5)  # -> Vertices, Faces, Colours, Normals
Y = UnitY(Factor="100")
nv = NakedVertices(Mesh=mesh_5)  # -> ClothedIndex, NakedIndex, ClothedPts, NakedPts
deplane = DeconstructPlane(Plane=tangentcircles_3.P)  # -> Origin, XAxis, YAxis, ZAxis
move = Move(Geometry=srf, Motion=Y)  # -> Geometry, Transform
srf_cp = SurfaceClosestPoint(Point=demesh.Vertices, Surface=move.Geometry)  # -> Point, UVPoint, Distance
curvature = SurfaceCurvature(Surface=move.Geometry, Point=srf_cp.UVPoint)  # -> Frame, Gaussian, Mean
bnd = Bounds(Numbers=curvature.Gaussian)
remap = RemapNumbers(Value=curvature.Gaussian, Source=bnd, Target=Domain(0, 1))  # -> Mapped, Clipped
graph = GraphMapper(remap.Mapped, x0=0, x1=1, y0=0, y1=1, container_name="Bezier", cpx=[0, 0.4052186012, 0.5675367117, 1], cpy=[0, 0, 1, 1])

# ----
# thickness regulation
number_slider_7 = Slider(1.619, range=0..5)
dom = ConstructDomain(DomainStart=number_slider_7, DomainEnd=Slider(0.6, range=0..5))
remap_2 = RemapNumbers(Value=graph, Source=Domain(0, 1), Target=dom)  # -> Mapped, Clipped

gradient = Gradient(LowerLimit=0, UpperLimit=1, Parameter=remap.Mapped, stops=[0: RGB(255, 255, 255), 1: RGB(0, 0, 0)])
item_2 = ListItem(List=graph, Index=nv.ClothedIndex, Wrap=True)
dom_2 = ConstructDomain(DomainStart=Slider(0.322, range=0.001..1), DomainEnd=Slider(0.466, range=0.001..1))
remap_3 = RemapNumbers(Value=item_2, Source=Domain(0, 1), Target=dom_2)  # -> Mapped, Clipped
conmesh = ConstructMesh(Vertices=demesh.Vertices, Faces=demesh.Faces, Colours=gradient)
scale = Scale(Geometry=tangentcircles_3.C, Center=tangentcircles_3.P, Factor=remap_3.Mapped)  # -> Geometry, Transform
scale_2 = Scale(Geometry=tangentcircles_3.C, Center=tangentcircles_3.P, Factor=Slider(0.9, range=0.001..1))  # -> Geometry, Transform
rev = Reverse(Vector=deplane.ZAxis)
item_3 = ListItem(List=remap_2.Mapped, Index=nv.ClothedIndex, Wrap=True)
rev_2 = Reverse(Vector=demesh.Normals)
multiplication = Multiplication(A=remap_2.Mapped, B=2)
amp = Amplitude(Vector=rev, Amplitude=item_3)
amp_2 = Amplitude(Vector=rev_2, Amplitude=multiplication)
move_2 = Move(Geometry=demesh.Vertices, Motion=amp_2)  # -> Geometry, Transform

# ---- group: lower mesh
conmesh_2 = ConstructMesh(Vertices=move_2.Geometry, Faces=demesh.Faces)

# ----
tangentcircles_4 = TangentCircles(mesh=conmesh_2)  # -> C, flatten(P)
scale_3 = Scale(Geometry=tangentcircles_4.C, Center=tangentcircles_4.P, Factor=Slider(0.9, range=0.001..1))  # -> Geometry, Transform
move_3 = Move(Geometry=scale.Geometry, Motion=amp)  # -> Geometry, Transform
merge_3 = Merge(Data1=simplify(graft(scale_2.Geometry)), Data2=simplify(graft(move_3.Geometry)))
merge_4 = Merge(Data1=simplify(graft(scale_3.Geometry)), Data2=simplify(graft(move_3.Geometry)))
loft = Loft(Curves=merge_3, Options={Adjust=False, Closed=False, LoftEnds=0, LoftSimp=0, LoftType=0, Rebuild=10, Refit=0.01})
loft_2 = Loft(Curves=merge_4, Options={Adjust=False, Closed=False, LoftEnds=0, LoftSimp=0, LoftType=0, Rebuild=10, Refit=0.01})
edges_2 = BrepEdges(Brep=loft)  # -> Naked, Interior, NonManifold
crv_2 = Curve(edges_2.Naked)
len = Length(Curve=edges_2.Naked)
sort = SortList(Keys=len, ValuesA=edges_2.Naked)  # -> Keys, reverse(ValuesA)
item_4 = ListItem(List=sort.ValuesA, Index=0, Wrap=True)

# ==== cluster TangentCircles: A compact circle packing from a flat mesh
mesh = ClusterInput()
mesh_2 = Mesh(mesh)
nv = NakedVertices(Mesh=mesh_2)  # -> ClothedIndex, NakedIndex, ClothedPts, NakedPts
vn = VertexNeighbours(Mesh=mesh_2, VertexNumber=nv.ClothedIndex)  # -> graft(Vertex), Neighbours, Normal
item = ListItem(List=vn.Neighbours, Index=0, Wrap=True)  # -> Item, Item1
dist = Distance(PointA=item.Item, PointB=item.Item1)
dist_2 = Distance(PointA=vn.Vertex, PointB=[item.Item, item.Item1])
ma = MassAddition(Input=[dist_2, dist])  # -> Result, PartialResults
multiplication = Multiplication(A=ma.Result, B=0.5)
pl = PlaneNormal(Origin=vn.Vertex, ZAxis=graft(vn.Normal))
subtraction = Subtraction(A=multiplication, B=dist)
cir = Circle(Plane=pl, Radius=subtraction)  # -> flatten(Circle)
C = ClusterOutput(cir)
P = ClusterOutput(pl)

# ==== cluster TangentCircles_2: A compact circle packing from a flat mesh
mesh = ClusterInput()
mesh_2 = Mesh(mesh)
nv = NakedVertices(Mesh=mesh_2)  # -> ClothedIndex, NakedIndex, ClothedPts, NakedPts
vn = VertexNeighbours(Mesh=mesh_2, VertexNumber=nv.ClothedIndex)  # -> graft(Vertex), Neighbours, Normal
item = ListItem(List=vn.Neighbours, Index=0, Wrap=True)  # -> Item, Item1
dist = Distance(PointA=item.Item, PointB=item.Item1)
dist_2 = Distance(PointA=vn.Vertex, PointB=[item.Item, item.Item1])
ma = MassAddition(Input=[dist_2, dist])  # -> Result, PartialResults
multiplication = Multiplication(A=ma.Result, B=0.5)
pl = PlaneNormal(Origin=vn.Vertex, ZAxis=graft(vn.Normal))
subtraction = Subtraction(A=multiplication, B=dist)
cir = Circle(Plane=pl, Radius=subtraction)  # -> flatten(Circle)
C = ClusterOutput(cir)
