# Grasshopper definition Relief_post-WS_20160518.gh (Grasshopper 0.9.76)
# Copyright: Co-de-iT
# plug-ins: treesloth01, Unroller, Human, horsterCameraControl

# gen curves_right
# gen curves_left
# surface for lower Z regulation
shorten = Slider(0, range=0..0.4)
# students
# 
# SOFIA PLATI
# KATERINA ALTINI
# LYDIA KONTOZOGLOU
# ATHANASIOS RODIFTSIS
# CHARALAMBOS DOULKAS
# FOTEINI SALVERIDOU
# EFFIE DOUROUDI
# MARIA LANTAVOU
# CHRISTINA LOUKA
# DANAI TOURSOGLOU
# ELENA VAFEIDOU
# CHRISTINA CHARALAMPIDOU KOURFALI
# 
# 
# assitant tutor: KATERINA SAPRAPTZIAN
# ceiling definition
# 
# final definition for ceiling generation. Thin corrugated cardboard, laser cut fabrication
# 
# code by Alessio Erioli and the workshop students
# 
# v  1.0
# 
# © Co-de-iT 2016 _ Creative Commons Attribution-NonCommercial-ShareAlike 4.0 International License
# COLOR LEGEND
# from file
# cluster
# bake
# geometry milestone
# NOTE
# 
# the definition contains two workflows:
# 
# . the first (and active) is a revised workflow
# that uses data symmetry to operate on the
# entire structure
# 
# . the second one (inactive, in the black box)
# is the one developed during the workshop,
# with split data flows for left and right parts
# of the installation
# display
# warning
# input geometry
configuration = ValueList({"configurator": 0, "final": 1}, selected="final")

# ----
# animation control
number_slider = Slider(1, range=0..1)
crv = Curve(reparameterize(<curve referenced from the Rhino model>))
crv_2 = Curve(reparameterize(<curve referenced from the Rhino model>))
bbox = BoundingBox(Content=crv, Plane=PlaneXY(0, 0, 0))  # -> Box, Box_2
box = EvaluateBox(Box=bbox.Box, UParameter=0.5, VParameter=0.5, WParameter=0.5)  # -> Plane, Point, Include
cir = Circle(Plane=box.Point, Radius=Slider(2, range=0..50))
area = Area(Geometry=crv_2)  # -> Area, Centroid
flip = FlipCurve(Curve=cir)  # -> Curve, Flag
eval = EvaluateCurve(Curve=reparameterize(flip.Curve), Parameter=number_slider)  # -> Point, Tangent, Angle
eval_2 = EvaluateCurve(Curve=crv_2, Parameter=number_slider)  # -> Point, Tangent, Angle
setcam = SetCamera(
    CameraLocation=eval_2.Point,
    TargetLocation=area.Centroid,
    LensLength=Slider(27, range=0..100),
    UpDirection=eval_2.Tangent,
    Activate=Toggle(False))

crv_3 = Curve(reparameterize([<curve referenced from the Rhino model> x2]))
crv_4 = Curve(reparameterize([<curve referenced from the Rhino model> x2]))
srf = Surface(<surface referenced from the Rhino model>)
# medial axis
crv_5 = Curve(<curve referenced from the Rhino model>)
subtraction = Subtraction(A=1, B=shorten)
dom = ConstructDomain(DomainStart=shorten, DomainEnd=subtraction)
fill_curves = Slider(4, range=2..50)
sampling = Slider(20, range=2..200)

# ---- group: right
# tattoo
crv_6 = Curve(Tree({0;0}: [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], {0;1}: [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], {0;2}: [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], {0;3}: [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], {0;4}: [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], {0;5}: [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]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))

# ---- group: left
crv_7 = Curve(Tree({0;0}: [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], {0;1}: [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], {0;2}: [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], {0;3}: [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], {0;4}: [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], {0;5}: [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]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))

# ----
connectors_half_length = Panel("5")

# ---- group: medial axis
crv_8 = Curve(reparameterize(<curve referenced from the Rhino model>))

# ----
holes_distance_from_edge = Panel("2")
Z = UnitZ(Factor=1)
panel = Panel("""c.r
c.m
c.f""")
Y = UnitY(Factor="100")

# ---- group: all others
brep = Brep([<brep referenced from the Rhino model> x54])

# ---- group: medial axis
brep_2 = Brep([<brep referenced from the Rhino model> x3])

# ----
debrep = DeconstructBrep(Brep=brep)  # -> Faces, Edges, Vertices
item = ListItem(List=debrep.Faces, Index=0, Wrap=True)  # -> flatten(Item)
pt = Point(Point(0.5, 0.5, 0))

# ----
# unrolled connector tag - centre
join = BrepJoin(Breps=brep_2)  # -> Breps, Closed
area_2 = Area(Geometry=join.Breps)  # -> Area, flatten(Centroid)
tag = TextTag3D(Location=area_2.Centroid, Text=panel, Size=Slider(2, range=0..100), Justification=5)

evalsrf = EvaluateSurface(Surface=reparameterize(item), Point=pt)  # -> Point, Normal, Frame
pdecon = Deconstruct(Point=evalsrf.Point)  # -> XComponent, YComponent, ZComponent
sort = SortList(Keys=pdecon.XComponent, ValuesA=brep)  # -> Keys, ValuesA

# ---- group: mid axis
crv_9 = Curve(reparameterize(<curve referenced from the Rhino model>))  # disabled

# ----
edges = BrepEdges(Brep=brep_2)  # -> Naked, Interior, NonManifold
join_2 = JoinCurves(Curves=edges.Naked, Preserve=False)
holes_radius = Panel(".5")
explode = Explode(Curve=join_2, Recursive=True)  # -> Segments, Vertices
item_2 = ListItem(List=explode.Vertices, Index=0, Wrap=True)  # -> Item, Item1
item_3 = ListItem(List=explode.Vertices, Index="4", Wrap=True)  # -> Item, Item1
ln = Line(StartPoint=item_2.Item, EndPoint=item_3.Item1)
ln_2 = Line(StartPoint=item_2.Item1, EndPoint=item_3.Item)
panel_2 = Panel("""2
6""")
panel_3 = Panel("""2
6""")
item_4 = ListItem(List=explode.Segments, Index=panel_2, Wrap=True)
merge = Merge(Data1=ln, Data2=ln_2, Data3=item_4)  # -> simplify(Result)
panel_4 = Panel("""0
1
2
3""")
dup = DuplicateData(Data=graft(panel_4), Number="3", Order=True)  # -> simplify(graft(Data))

# ---- group: from file
brep_3 = Brep([<brep referenced from the Rhino model> x3])  # disabled
brep_4 = Brep([<brep referenced from the Rhino model> x54])  # disabled

# ----
cull_i = CullIndex(List=explode.Segments, Indices=panel_2, Wrap=True)
join_3 = JoinCurves(Curves=cull_i, Preserve=False)
end = EndPoints(Curve=join_3)  # -> Start, End
Z_2 = UnitZ(Factor=1)
rev = Reverse(Vector=Z_2)
Y_2 = UnitY(Factor=Slider(-200, range=-300..0))

# ---- group: previous unroll from file
crv_10 = Curve([<curve referenced from the Rhino model> x1908])  # disabled

# ----
panel_5 = Panel("1500")  # disabled
X = UnitX(Factor=panel_5)  # disabled
move = Move(Geometry=crv_10, Motion=X)  # -> Geometry, Transform; disabled
previewlw = CustomPreviewLineweights(
    Geometry=move.Geometry,
    Shader={ambient=RGB(0, 0, 0), diffuse=RGB(255, 105, 180), emission=RGB(76, 32, 54), shine=0.5, specular=RGB(255, 255, 255), transparency=0},
    Absolute=False)  # disabled

bake = Button()

# ---- group: previous unroll from file
crv_11 = Curve([<curve referenced from the Rhino model> x1908])

# ----
X_2 = UnitX(Factor="1500")
move_2 = Move(Geometry=crv_11, Motion=X_2)  # -> Geometry, Transform
previewlw_2 = CustomPreviewLineweights(
    Geometry=move_2.Geometry,
    Shader={ambient=RGB(0, 0, 0), diffuse=RGB(255, 105, 180), emission=RGB(76, 32, 54), shine=0.5, specular=RGB(255, 255, 255), transparency=0},
    Absolute=False)

srf_2 = Surface(<surface referenced from the Rhino model>)
srfpt = SurfacePoints(Surface=srf_2)  # -> Points, Weights, Greville, UCount, VCount
area_3 = Area(Geometry=srf_2)  # -> Area, Centroid
dist = Distance(PointA=srfpt.Points, PointB=area_3.Centroid)
cp = ControlPoints(Curve=crv_4)  # -> Points, Weights, Knots
# configurator
cp_2 = ControlPoints(Curve=crv_3)  # -> Points, Weights, Knots
one_over_x = OneOverX(Value=dist)
vec2pt = Vector2Pt(PointA=cp_2.Points, PointB=area_3.Centroid, Unitize=False)  # -> Vector, Length
vec2pt_2 = Vector2Pt(PointA=cp.Points, PointB=area_3.Centroid, Unitize=False)  # -> Vector, Length
pow = Power(A=one_over_x, B=Slider(5, range=1..5))
bnd = Bounds(Numbers=pow)
one_over_x_2 = OneOverX(Value=vec2pt_2.Length)
one_over_x_3 = OneOverX(Value=vec2pt.Length)
pow_2 = Power(A=vec2pt.Length, B=Slider(1, range=1..5))
remap = RemapNumbers(Value=pow, Source=bnd, Target=Domain(0, 1))  # -> Mapped, Clipped
pow_3 = Power(A=vec2pt_2.Length, B=Slider(1, range=1..5))
bnd_2 = Bounds(Numbers=flatten(pow_3))
bnd_3 = Bounds(Numbers=flatten(pow_2))
graph = GraphMapper(remap.Mapped, x0=0, x1=1, y0=0, y1=1, container_name="Sine", Equation_px=[0, 0.498550415], Equation_py=[0, 0.9828977585])
remap_2 = RemapNumbers(Value=pow_3, Source=bnd_2, Target=Domain(0, 1))  # -> Mapped, Clipped
remap_3 = RemapNumbers(Value=pow_2, Source=bnd_3, Target=Domain(0, 1))  # -> Mapped, Clipped
graph_2 = GraphMapper(remap_2.Mapped, x0=0, x1=1, y0=0, y1=1, container_name="Sine", Equation_px=[0, 0.2862318754], Equation_py=[0, 1])
rev_2 = Reverse(Vector=vec2pt_2.Vector)
multiplication = Multiplication(A=remap.Mapped, B=Slider(90.781, range=-100..1000))
Z_3 = UnitZ(Factor=multiplication)
rev_3 = Reverse(Vector=vec2pt.Vector)
multiplication_2 = Multiplication(A=graph_2, B=Slider(61.627, range=-10..100))
rev_4 = Reverse(Vector=Z_3)
amp = Amplitude(Vector=rev_2, Amplitude=multiplication_2)
move_3 = Move(Geometry=srfpt.Points, Motion=rev_4)  # -> Geometry, Transform
move_4 = Move(Geometry=cp.Points, Motion=amp)  # -> Geometry, Transform
srfgrid = SurfaceFromPoints(Points=move_3.Geometry, UCount=srfpt.UCount, Interpolate=False)
nurbs = NurbsCurve(Vertices=move_4.Geometry, Degree=3, Periodic=False)  # -> flatten(Curve), Length, Domain
crv_12 = Curve(reparameterize(nurbs.Curve))

graph_3 = GraphMapper(remap_3.Mapped, x0=0, x1=1, y0=0, y1=1, container_name="Sine", Equation_px=[0, 0.2862318754], Equation_py=[0, 1])

multiplication_3 = Multiplication(A=graph_3, B=Slider(34.688, range=-10..100))
amp_2 = Amplitude(Vector=rev_3, Amplitude=multiplication_3)
# RELIEF
# shape as structural device
# tutor: Alessio Erioli
# Thessaloniki . 10-16.05.2016
# required plugins:
# 
# . FabTools
# . Unroller (MilkBox)
# . Tree Sloth
# 
# . Horster (for animation)
move_5 = Move(Geometry=cp_2.Points, Motion=amp_2)  # -> Geometry, Transform
nurbs_2 = NurbsCurve(Vertices=move_5.Geometry, Degree=3, Periodic=False)  # -> flatten(Curve), Length, Domain
crv_13 = Curve(reparameterize(nurbs_2.Curve))

filter = StreamFilter(Gate=configuration, Stream0=crv_13, Stream1=crv_3)
filter_2 = StreamFilter(Gate=configuration, Stream0=crv_12, Stream1=crv_4)
filter_3 = StreamFilter(Gate=configuration, Stream0=srfgrid, Stream1=srf)
subcrv = SubCurve(BaseCurve=filter, Domain=dom)
subcrv_2 = SubCurve(BaseCurve=filter_2, Domain=dom)

# ----
# ye olde split method
# inter-beam connections
# create jigsaw contours
# tagging
# right
# top surf
# left surf
# right
# right surf
# tag curve side
# points for connectors holes
# right
# surfs
# points
# substitution pattern
# left
# left
# automated layer separation and grouping for automated nesting
# left
# sub-components
# top surf
# left surf
# jigsaws
# right surf
# tag beams
# on model
# unrolled
# division curves (on model)
# component index on model
# beam2beam connectors
# unrolled connector tag
# center line
# right
# top surf
# left surf
# right surf
# left
# top surf
# all others
# left surf
# right surf
# unrolled connector tag
# depth control
# reorganize paths
# frames
# connector tag & callout
# parameter t
# connector tag & callout
# hanging lines
divide = DivideCurve(Curve=subcrv, Count=sampling, Kinks=False)  # -> Points, Tangents, Parameters; disabled
divide_2 = DivideCurve(Curve=subcrv_2, Count=sampling, Kinks=False)  # -> Points, Tangents, Parameters; disabled
flip_2 = FlipMatrix(Data=divide.Points)  # disabled
flip_3 = FlipMatrix(Data=divide_2.Points)  # disabled
pline = PolyLine(Vertices=flip_3, Closed=False)  # disabled
pline_2 = PolyLine(Vertices=flip_2, Closed=False)  # disabled
explode_2 = Explode(Curve=pline, Recursive=True)  # -> Segments, Vertices; disabled
explode_3 = Explode(Curve=pline_2, Recursive=True)  # -> Segments, Vertices; disabled
divide_3 = DivideCurve(Curve=explode_2.Segments, Count=fill_curves, Kinks=False)  # -> Points, Tangents, Parameters; disabled
divide_4 = DivideCurve(Curve=explode_3.Segments, Count=fill_curves, Kinks=False)  # -> Points, Tangents, Parameters; disabled
pshift = ShiftPaths(Data=divide_3.Points, Offset=-1)  # disabled
pshift_2 = ShiftPaths(Data=divide_4.Points, Offset=-1)  # disabled
flip_4 = FlipMatrix(Data=pshift)  # disabled
flip_5 = FlipMatrix(Data=pshift_2)  # disabled
intcrv = Interpolate(Vertices=flip_5, Degree=3, Periodic=False, KnotStyle=1)  # -> flatten(Curve), Length, Domain; disabled
intcrv_2 = Interpolate(Vertices=flip_4, Degree=3, Periodic=False, KnotStyle=1)  # -> flatten(Curve), Length, Domain; disabled
divide_5 = DivideCurve(Curve=intcrv.Curve, Count=10, Kinks=False)  # -> Points, Tangents, Parameters; disabled
divide_6 = DivideCurve(Curve=intcrv_2.Curve, Count=10, Kinks=False)  # -> Points, Tangents, Parameters; disabled
Z_4 = UnitZ(Factor=-1)  # disabled
panel_6 = Panel("100")  # disabled
Z_5 = UnitZ(Factor=-1)  # disabled
line = LineSDL(Start=divide_5.Points, Direction=Z_5, Length=panel_6)  # disabled
line_2 = LineSDL(Start=divide_6.Points, Direction=Z_4, Length=panel_6)  # disabled
scx = SurfaceCurve(Surface=filter_3, Curve=line)  # -> Curves, Points, UVPoints, Normals, Parameters, Tangents; disabled
scx_2 = SurfaceCurve(Surface=filter_3, Curve=line_2)  # -> Curves, Points, UVPoints, Normals, Parameters, Tangents; disabled
pshift_3 = ShiftPaths(Data=scx.Points, Offset=-1)  # disabled
pshift_4 = ShiftPaths(Data=scx_2.Points, Offset=-1)  # disabled
nurbs_3 = NurbsCurve(Vertices=pshift_3, Degree=3, Periodic=False)  # -> Curve, Length, Domain; disabled
nurbs_4 = NurbsCurve(Vertices=pshift_4, Degree=3, Periodic=False)  # -> Curve, Length, Domain; disabled
divide_7 = DivideCurve(Curve=nurbs_4.Curve, Count=10, Kinks=False)  # -> Points, Tangents, Parameters; disabled
divide_8 = DivideCurve(Curve=nurbs_3.Curve, Count=10, Kinks=False)  # -> Points, Tangents, Parameters; disabled
flip_6 = FlipMatrix(Data=divide_8.Points)  # disabled
flip_7 = FlipMatrix(Data=divide_7.Points)  # disabled
toggle = BooleanToggle(False)  # disabled
toggle_2 = BooleanToggle(False)  # disabled
panel_7 = Panel("1")  # disabled
panel_8 = Panel("-1")  # disabled
panel_9 = Panel("1")  # disabled
panel_10 = Panel("-1")  # disabled
shift = ShiftList(List=flip_6, Shift=panel_7, Wrap=toggle)  # -> graft(List); disabled
shift_2 = ShiftList(List=flip_6, Shift=panel_8, Wrap=toggle)  # -> graft(List); disabled
shift_3 = ShiftList(List=flip_7, Shift=panel_9, Wrap=toggle_2)  # -> graft(List); disabled
shift_4 = ShiftList(List=flip_7, Shift=panel_10, Wrap=toggle_2)  # -> graft(List); disabled
avr = Average(Input=[shift, shift_2])  # disabled
vec2pt_3 = Vector2Pt(PointA=shift_2, PointB=shift, Unitize=False)  # -> Vector, Length; disabled
avr_2 = Average(Input=[shift_3, shift_4])  # disabled
vec2pt_4 = Vector2Pt(PointA=shift_4, PointB=shift_3, Unitize=False)  # -> Vector, Length; disabled
attractor_threshold = Slider(69, range=0..100)  # disabled
crv_cp = CurveClosestPoint(Point=avr, Curve=crv_5)  # -> Point, Parameter, Distance; disabled
crv_cp_2 = CurveClosestPoint(Point=avr_2, Curve=crv_5)  # -> Point, Parameter, Distance; disabled
number_slider_2 = Slider(0.6, range=0..1)  # disabled
min = Minimum(A=crv_cp.Distance, B=attractor_threshold)  # disabled
min_2 = Minimum(A=crv_cp_2.Distance, B=attractor_threshold)  # disabled
bnd_4 = Bounds(Numbers=flatten(min))  # disabled
bnd_5 = Bounds(Numbers=flatten(min_2))  # disabled
dom_2 = ConstructDomain(DomainStart=0, DomainEnd=number_slider_2)  # disabled
dom_3 = ConstructDomain(DomainStart=0, DomainEnd=number_slider_2)  # disabled
toggle_3 = BooleanToggle(False)  # disabled
toggle_4 = BooleanToggle(False)  # disabled
remap_4 = RemapNumbers(Value=min_2, Source=bnd_5, Target=dom_3)  # -> Mapped, Clipped; disabled
multiplication_4 = Multiplication(A=vec2pt_4.Vector, B=remap_4.Clipped)  # disabled
remap_5 = RemapNumbers(Value=min, Source=bnd_4, Target=dom_2)  # -> Mapped, Clipped; disabled
multiplication_5 = Multiplication(A=vec2pt_3.Vector, B=remap_5.Clipped)  # disabled
panel_11 = Panel("1")  # disabled
panel_12 = Panel("1")  # disabled
panel_13 = Panel("-1")  # disabled
panel_14 = Panel("-1")  # disabled
multiplication_6 = Multiplication(A=multiplication_4, B=-1)  # disabled
move_6 = Move(Geometry=avr, Motion=multiplication_5)  # -> Geometry, Transform; disabled
vdisex = VectorDisplayEx(Point=avr, Vector=multiplication_5, Colour=RGB(0, 0, 0), Width=2)  # disabled
move_7 = Move(Geometry=avr_2, Motion=multiplication_6)  # -> Geometry, Transform; disabled
vdisex_2 = VectorDisplayEx(Point=avr_2, Vector=multiplication_6, Colour=RGB(0, 0, 0), Width=2)  # disabled
pshift_5 = ShiftPaths(Data=move_6.Geometry, Offset=-1)  # -> simplify(Data); disabled
pshift_6 = ShiftPaths(Data=move_7.Geometry, Offset=-1)  # -> simplify(Data); disabled
flip_8 = FlipMatrix(Data=pshift_5)  # disabled
flip_9 = FlipMatrix(Data=pshift_6)  # disabled
panel_15 = Panel("{0;*}")  # disabled
number_slider_3 = Slider(5, range=0..10)  # disabled
panel_16 = Panel("""0
-1""")  # disabled
panel_17 = Panel("-1")  # disabled
panel_18 = Panel("1")  # disabled
panel_19 = Panel("-1")  # disabled
panel_20 = Panel("1")  # disabled
parts_to_invert_all_staples = Panel("""{0;3;0;0}
{1;0;0;0}
{1;0;0;1}
{1;1;0;0}
{1;2;1;0}
{1;2;1;1}
{1;3;1;0}
{1;3;1;1}
{1;3;2;1}""")  # disabled
number_slider_4 = Slider(2, range=0..10)  # disabled
Z_6 = UnitZ(Factor=1)  # disabled
number_slider_5 = Slider(54.505, range=0..100)  # disabled
number_slider_6 = Slider(15.662, range=0..100)  # disabled
panel_21 = Panel("""c.r
c.m
c.f""")  # disabled
panel_22 = Panel("100")  # disabled
Y_3 = UnitY(Factor=panel_22)  # disabled
debrep_2 = DeconstructBrep(Brep=brep_4)  # -> Faces, Edges, Vertices; disabled
item_5 = ListItem(List=debrep_2.Faces, Index=0, Wrap=True)  # -> flatten(Item); disabled
pt_2 = Point(Point(0.5, 0.5, 0))  # disabled
evalsrf_2 = EvaluateSurface(Surface=reparameterize(item_5), Point=pt_2)  # -> Point, Normal, Frame; disabled
pdecon_2 = Deconstruct(Point=evalsrf_2.Point)  # -> XComponent, YComponent, ZComponent; disabled
sort_2 = SortList(Keys=pdecon_2.XComponent, ValuesA=brep_4)  # -> Keys, ValuesA; disabled
edges_2 = BrepEdges(Brep=brep_3)  # -> Naked, Interior, NonManifold; disabled
join_4 = JoinCurves(Curves=edges_2.Naked, Preserve=False)  # disabled
disc = Discontinuity(Curve=edges_2.Naked, Level=1)  # -> Points, Parameters; disabled
number_slider_7 = Slider(6.639, range=0..10)  # disabled
explode_4 = Explode(Curve=join_4, Recursive=True)  # -> Segments, Vertices; disabled
crv_14 = Curve(edges_2.Interior)  # disabled
panel_23 = Panel("""2
6""")  # disabled
panel_24 = Panel("""2
6""")  # disabled
panel_25 = Panel("4")  # disabled
panel_26 = Panel("4")  # disabled
item_6 = ListItem(List=explode_4.Vertices, Index=0, Wrap=True)  # -> Item, Item1; disabled
item_7 = ListItem(List=explode_4.Vertices, Index=panel_25, Wrap=True)  # -> Item, Item1; disabled
item_8 = ListItem(List=crv_14, Index=0, Wrap=True)  # disabled
ln_3 = Line(StartPoint=item_6.Item, EndPoint=item_7.Item1)  # disabled
ln_4 = Line(StartPoint=item_6.Item1, EndPoint=item_7.Item)  # disabled
panel_27 = Panel("0.9")  # disabled
item_9 = ListItem(List=explode_4.Segments, Index=panel_23, Wrap=True)  # disabled
panel_28 = Panel("0.9")  # disabled
panel_29 = Panel("-1")  # disabled
merge_2 = Merge(Data1=ln_3, Data2=ln_4, Data3=item_9)  # -> simplify(Result); disabled
panel_30 = Panel("-1")  # disabled
panel_31 = Panel("0.3")  # disabled
cull_i_2 = CullIndex(List=explode_4.Segments, Indices=panel_23, Wrap=True)  # disabled
join_5 = JoinCurves(Curves=cull_i_2, Preserve=False)  # disabled
end_2 = EndPoints(Curve=join_5)  # -> Start, End; disabled
Z_7 = UnitZ(Factor=1)  # disabled
rev_5 = Reverse(Vector=Z_7)  # disabled
panel_32 = Panel("2")  # disabled
panel_33 = Panel(".5")  # disabled
swatch = ColourSwatch(SwatchColor=RGB(0, 0, 0))  # disabled

# ---- group: top curves - right
crv_15 = Curve(reparameterize(intcrv.Curve))  # disabled

# ---- group: top curves - left
crv_16 = Curve(reparameterize(intcrv_2.Curve))  # disabled

# ---- group: bottom curves
intcrv_3 = Interpolate(Vertices=flip_8, Degree=3, Periodic=False, KnotStyle=1)  # -> simplify(graft(Curve)), Length, Domain; disabled

intcrv_4 = Interpolate(Vertices=flip_9, Degree=3, Periodic=False, KnotStyle=1)  # -> simplify(graft(Curve)), Length, Domain; disabled

# ----
join_6 = BrepJoin(Breps=brep_3)  # -> Breps, Closed; disabled
area_4 = Area(Geometry=join_6.Breps)  # -> Area, flatten(Centroid); disabled
number_slider_8 = Slider(2, range=0..100)  # disabled
tag_2 = TextTag3D(Location=area_4.Centroid, Text=panel_21, Size=number_slider_8, Justification=5)  # disabled

# ----
# beam generation
# top surf
# left surf
# right surf
entwine = Entwine(Branch00=subcrv, Branch01=subcrv_2, FlattenInputs=True)
divide_9 = DivideCurve(Curve=entwine, Count=sampling, Kinks=False)  # -> Points, Tangents, Parameters
flip_last = FlipLast(Data=divide_9.Points)
pline_3 = PolyLine(Vertices=flip_last, Closed=False)
explode_5 = Explode(Curve=pline_3, Recursive=True)  # -> Segments, Vertices
divide_10 = DivideCurve(Curve=explode_5.Segments, Count=fill_curves, Kinks=False)  # -> Points, Tangents, Parameters
pshift_7 = ShiftPaths(Data=divide_10.Points, Offset=-1)
flip_last_2 = FlipLast(Data=pshift_7)
Z_8 = UnitZ(Factor=-1)
toggle_5 = BooleanToggle(False)
attractor_threshold_2 = Slider(69, range=0..100)
dom_4 = ConstructDomain(DomainStart=0, DomainEnd=Slider(0.6, range=0..1))
entwine_2 = Entwine(Branch00="1", Branch01="-1", FlattenInputs=True)
toggle_6 = BooleanToggle(False)

# ---- group: top curves
intcrv_5 = Interpolate(Vertices=flip_last_2, Degree=3, Periodic=False, KnotStyle=1)  # -> reparameterize(Curve), Length, Domain

# ----
pshift_8 = ShiftPaths(Data=intcrv_5.Curve, Offset=-1)
divide_11 = DivideCurve(Curve=pshift_8, Count=10, Kinks=False)  # -> Points, Tangents, Parameters
line_3 = LineSDL(Start=divide_11.Points, Direction=Z_8, Length="100")
scx_3 = SurfaceCurve(Surface=filter_3, Curve=line_3)  # -> Curves, Points, UVPoints, Normals, Parameters, Tangents
pshift_9 = ShiftPaths(Data=scx_3.Points, Offset=-1)
nurbs_5 = NurbsCurve(Vertices=pshift_9, Degree=3, Periodic=False)  # -> Curve, Length, Domain
divide_12 = DivideCurve(Curve=nurbs_5.Curve, Count=10, Kinks=False)  # -> Points, Tangents, Parameters
flip_last_3 = FlipLast(Data=divide_12.Points)
shift_5 = ShiftList(List=flip_last_3, Shift="1", Wrap=toggle_5)  # -> graft(List)
shift_6 = ShiftList(List=flip_last_3, Shift="-1", Wrap=toggle_5)  # -> graft(List)
avr_3 = Average(Input=[shift_5, shift_6])
vec2pt_5 = Vector2Pt(PointA=shift_6, PointB=shift_5, Unitize=False)  # -> Vector, Length
crv_cp_3 = CurveClosestPoint(Point=avr_3, Curve=crv_5)  # -> Point, Parameter, Distance
min_3 = Minimum(A=crv_cp_3.Distance, B=attractor_threshold_2)
bnd_6 = Bounds(Numbers=flatten(min_3))
remap_6 = RemapNumbers(Value=min_3, Source=bnd_6, Target=dom_4)  # -> Mapped, Clipped
multiplication_7 = Multiplication(A=vec2pt_5.Vector, B=remap_6.Clipped)
lng = ListLength(List=flatten(multiplication_7))
multiplication_8 = Multiplication(A=lng, B="0.5")
dup_2 = DuplicateData(Data=entwine_2, Number=multiplication_8, Order=True)  # -> graft(Data)
multiplication_9 = Multiplication(A=multiplication_7, B=dup_2)
move_8 = Move(Geometry=avr_3, Motion=multiplication_9)  # -> Geometry, Transform
vdisex_3 = VectorDisplayEx(Point=avr_3, Vector=multiplication_9, Colour=ColourSwatch(SwatchColor=RGB(255, 0, 0)), Width=2)
pshift_10 = ShiftPaths(Data=move_8.Geometry, Offset=-1)  # -> simplify(Data)
flip_last_4 = FlipLast(Data=pshift_10)
shift_7 = ShiftList(List=pshift_8, Shift="1", Wrap=toggle_6)  # -> graft(List)
shift_8 = ShiftList(List=pshift_8, Shift="-1", Wrap=toggle_6)  # -> graft(List)
merge_3 = Merge(Data1=shift_8, Data2=shift_7)
loft = Loft(Curves=merge_3, Options={Adjust=False, Closed=False, LoftEnds=0, LoftSimp=0, LoftType=0, Rebuild=10, Refit=0.01})
pshift_11 = ShiftPaths(Data=loft, Offset=-1)  # -> simplify(Data)

number_slider_9 = Slider(0.475, range=0..1)
# beam2beam connectors
panel_34 = Panel("""0
-1""")
cull_i_3 = CullIndex(List=pshift_8, Indices=panel_34, Wrap=True)
shatter = Shatter(Curve=cull_i_3, Parameters=number_slider_9)
dispatch = Dispatch(List=shatter, DispatchPattern=[True, False])  # -> ListA, ListB
flip_10 = FlipCurve(Curve=dispatch.ListA)  # -> Curve, Flag
weave = Weave(Pattern=[0, 1], Stream0=dispatch.ListB, Stream1=flip_10.Curve, NullGaps=False)
range = Range(Domain=Domain(0, 1), Steps=Slider(5, range=2..8))
cull_i_4 = CullIndex(List=range, Indices=-1, Wrap=True)
number_slider_10 = Slider(0.03, range=0..1)
graph_4 = GraphMapper(
    cull_i_4,
    x0=0,
    x1=1,
    y0=0,
    y1=1,
    container_name="Bezier",
    cpx=[0, 0.2869572341, 0.6637688279, 1],
    cpy=[0, 0.4768119454, 0.9695655704, 1])
subtraction_2 = Subtraction(A="1", B=number_slider_10)
pframe = PerpFrame(Curve=reparameterize(graft(weave)), Parameter=graph_4)
Z_9 = UnitZ(Factor=1)
merge_4 = Merge(Data1=number_slider_10, Data2=subtraction_2)
item_10 = TreeItem(Tree=pshift_8, Path="{0;0}", Index="-1", Wrap=True)
item_11 = TreeItem(Tree=pshift_8, Path="{0;1}", Index="0", Wrap=True)
align = AlignPlane(Plane=pframe, Direction=Z_9)  # -> Plane, Angle
pframe_2 = PerpFrame(Curve=reparameterize(graft(item_11)), Parameter=merge_4)
pframe_3 = PerpFrame(Curve=item_10, Parameter=number_slider_9)
pshift_12 = ShiftPaths(Data=align.Plane, Offset=-1)
cull_i_5 = CullIndex(List=pshift_12, Indices=0, Wrap=True)
align_2 = AlignPlane(Plane=pframe_3, Direction=Z_9)  # -> Plane, Angle
align_3 = AlignPlane(Plane=pframe_2, Direction=Z_9)  # -> Plane, Angle

# ---- group: bottom curves
intcrv_6 = Interpolate(Vertices=flip_last_4, Degree=3, Periodic=False, KnotStyle=1)  # -> simplify(graft(Curve)), Length, Domain

# ----
merge_5 = Merge(Data1=intcrv_6.Curve, Data2=simplify(shift_8))
merge_6 = Merge(Data1=simplify(shift_7), Data2=intcrv_6.Curve)
loft_2 = Loft(Curves=merge_6, Options={Adjust=False, Closed=False, LoftEnds=0, LoftSimp=0, LoftType=0, Rebuild=10, Refit=0.01})
loft_3 = Loft(Curves=merge_5, Options={Adjust=False, Closed=False, LoftEnds=0, LoftSimp=0, LoftType=0, Rebuild=10, Refit=0.01})
pshift_13 = ShiftPaths(Data=loft_3, Offset=-1)  # -> simplify(Data)
pshift_14 = ShiftPaths(Data=loft_2, Offset=-1)
merge_7 = Merge(Data1=graft(pshift_11), Data2=graft(pshift_14), Data3=graft(pshift_13))

pt_3 = Point(Point(0.5, 0.5, 0))
evalsrf_3 = EvaluateSurface(Surface=reparameterize(graft(pshift_11)), Point=pt_3)  # -> Point, Normal, Frame
cir_2 = Circle(Plane=evalsrf_3.Point, Radius="0.1")
group = Group(Objects=cir_2)  # -> simplify(Group)

srf_3 = Surface(merge_7)

# ----
# dummy circle to equalize curves tree
# imported curves
pshift_15 = ShiftPaths(Data=crv_7, Offset=-1)
pshift_16 = ShiftPaths(Data=crv_6, Offset=-1)
viewer = ParamViewer(pshift_16)
dispatch_2 = Dispatch(List=viewer, DispatchPattern=[True, False])  # -> ListA, ListB
weave_2 = Weave(Pattern=[0, 1], Stream0=dispatch_2.ListB, Stream1=dispatch_2.ListA, NullGaps=False)
branch = TreeBranch(Tree=pshift_15, Path=weave_2, MaintainPaths=False)
branch_2 = TreeBranch(Tree=pshift_16, Path=weave_2, MaintainPaths=False)
group_2 = Group(Objects=pshift_15)  # -> flatten(Group)
group_3 = Group(Objects=branch_2)  # -> flatten(Group)
partition = PartitionList(List=group_2, Size="2")
partition_2 = PartitionList(List=group_3, Size="2")
entwine_3 = Entwine(Branch0X=partition_2, Branch1X=partition, FlattenInputs=False)  # -> simplify(Result)
merge_8 = Merge(Data1=group, Data2=entwine_3)
ungroup = Ungroup(Group=graft(merge_8))
pull = PullCurve(Curve=simplify(ungroup), Surface=graft(srf_3))

viewer_2 = ParamViewer(srf_3)

# ----
# tattoo
# unrolled tattoo
swatch_2 = ColourSwatch(SwatchColor=RGB(88, 109, 112))
# points for connectors holes
previewlw_3 = CustomPreviewLineweights(Geometry=pull, Shader=swatch_2, Absolute=False)

edges_3 = BrepEdges(Brep=srf_3)  # -> Naked, Interior, NonManifold
previewmat = CustomPreviewMaterials(Geometry=srf_3, DiffuseColor=RGB(255, 255, 255))
previewlw_4 = CustomPreviewLineweights(Geometry=edges_3.Naked, Shader=ColourSwatch(SwatchColor=RGB(0, 0, 0)), Absolute=False)

pln = Plane([cull_i_5, align_2.Plane, align_3.Plane])
crv_17 = Curve(simplify(graft(cull_i_3)))

# ----
# surfaces
panel_35 = Panel("0")
cull_i_6 = CullIndex(List=srf_3, Indices=panel_35, Wrap=True)  # -> reverse(simplify(List))
pshift_17 = ShiftPaths(Data=cull_i_6, Offset=-1)
panel_36 = Panel("""0
-1""")
cull_i_7 = CullIndex(List=pshift_17, Indices=panel_36, Wrap=True)
item_12 = ListItem(List=pshift_17, Index=panel_36, Wrap=True)
partition_3 = PartitionList(List=cull_i_7, Size="2")  # -> simplify(Chunks)

# ----
# tag beams - single channel
# on model
srf_4 = Surface(srf_3)
lng_2 = ListLength(List=srf_4)
viewer_3 = ParamViewer(srf_4)
series = Series(Start=0, Step=1, Count=lng_2)
pt_4 = Point(Point(0.5, 0.5, 0))
int = Integer(series)
evalsrf_4 = EvaluateSurface(Surface=reparameterize(srf_4), Point=pt_4)  # -> Point, Normal, Frame
concat = Concatenate(FragmentA=graft(viewer_3), FragmentB=int)
tag_3 = TextTag3D(
    Location=evalsrf_4.Point,
    Text=concat,
    Size=Slider(5.435, range=0..100),
    Colour=ColourSwatch(SwatchColor=RGB(46, 41, 166)),
    Justification=4)

shift_9 = ShiftList(List=crv_16, Shift=panel_12, Wrap=toggle_4)  # -> simplify(graft(List)); disabled
shift_10 = ShiftList(List=crv_15, Shift=panel_11, Wrap=toggle_3)  # -> simplify(graft(List)); disabled
shift_11 = ShiftList(List=crv_15, Shift=panel_13, Wrap=toggle_3)  # -> simplify(graft(List)); disabled
shift_12 = ShiftList(List=crv_16, Shift=panel_14, Wrap=toggle_4)  # -> simplify(graft(List)); disabled
merge_9 = Merge(Data1=shift_12, Data2=shift_9)  # disabled
merge_10 = Merge(Data1=shift_11, Data2=shift_10)  # disabled
merge_11 = Merge(Data1=intcrv_4.Curve, Data2=shift_12)  # disabled
merge_12 = Merge(Data1=intcrv_3.Curve, Data2=shift_11)  # disabled
loft_4 = Loft(Curves=merge_9, Options={Adjust=False, Closed=False, LoftEnds=0, LoftSimp=0, LoftType=0, Rebuild=10, Refit=0.01})  # disabled
loft_5 = Loft(Curves=merge_11, Options={Adjust=False, Closed=False, LoftEnds=0, LoftSimp=0, LoftType=0, Rebuild=10, Refit=0.01})  # disabled
loft_6 = Loft(
    Curves=[shift_9, intcrv_4.Curve],
    Options={Adjust=False, Closed=False, LoftEnds=0, LoftSimp=0, LoftType=0, Rebuild=10, Refit=0.01})  # disabled
loft_7 = Loft(
    Curves=[shift_10, intcrv_3.Curve],
    Options={Adjust=False, Closed=False, LoftEnds=0, LoftSimp=0, LoftType=0, Rebuild=10, Refit=0.01})  # disabled
loft_8 = Loft(Curves=merge_12, Options={Adjust=False, Closed=False, LoftEnds=0, LoftSimp=0, LoftType=0, Rebuild=10, Refit=0.01})  # disabled
loft_9 = Loft(Curves=merge_10, Options={Adjust=False, Closed=False, LoftEnds=0, LoftSimp=0, LoftType=0, Rebuild=10, Refit=0.01})  # disabled
merge_13 = Merge(Data1=loft_4, Data2=loft_6, Data3=loft_5)  # disabled
crv_18 = Curve(crv_16)  # disabled
crv_19 = Curve(crv_15)  # disabled
cull_i_8 = CullIndex(List=crv_19, Indices=panel_16, Wrap=True)  # disabled
cull_i_9 = CullIndex(List=crv_18, Indices=panel_16, Wrap=True)  # disabled
merge_14 = Merge(Data1=cull_i_8, Data2=cull_i_9)  # -> graft(Result); disabled
srf_5 = Surface(loft_9)  # disabled
srf_6 = Surface(loft_7)  # disabled
srf_7 = Surface(loft_4)  # disabled
srf_8 = Surface(loft_5)  # disabled
srf_9 = Surface(loft_8)  # disabled
srf_10 = Surface(loft_6)  # disabled
shift_13 = ShiftList(List=flatten(srf_10), Shift=panel_17, Wrap=False)  # disabled
shift_14 = ShiftList(List=flatten(srf_8), Shift=panel_18, Wrap=False)  # disabled
shift_15 = ShiftList(List=flatten(srf_6), Shift=panel_19, Wrap=False)  # disabled
shift_16 = ShiftList(List=flatten(srf_9), Shift=panel_20, Wrap=False)  # disabled
merge_15 = Merge(Data1=graft(shift_13), Data2=graft(shift_14))  # disabled
merge_16 = Merge(Data1=graft(shift_15), Data2=graft(shift_16))  # disabled
entwine_4 = Entwine(Branch0X=simplify(merge_16), Branch1X=simplify(merge_15), FlattenInputs=False)  # disabled
item_13 = ListItem(List=entwine_4, Index=0, Wrap=True)  # -> Item, Item1; disabled

merge_17 = Merge(Data1=loft_9, Data2=loft_7, Data3=loft_8)  # disabled
entwine_5 = Entwine(Branch0X=merge_17, Branch1X=merge_13, FlattenInputs=False)  # disabled
srf_11 = Surface(entwine_5)  # disabled

srf_12 = Surface(entwine_5)  # disabled
lng_3 = ListLength(List=srf_12)  # disabled
viewer_4 = ParamViewer(srf_12)  # disabled
series_2 = Series(Start=0, Step=1, Count=lng_3)  # disabled
pt_5 = Point(Point(0.5, 0.5, 0))  # disabled
number_slider_11 = Slider(5.435, range=0..100)  # disabled
int_2 = Integer(series_2)  # disabled
evalsrf_5 = EvaluateSurface(Surface=reparameterize(srf_12), Point=pt_5)  # -> Point, Normal, Frame; disabled
swatch_3 = ColourSwatch(SwatchColor=RGB(255, 82, 82))  # disabled
concat_2 = Concatenate(FragmentA=graft(viewer_4), FragmentB=int_2)  # disabled
tag_4 = TextTag3D(Location=evalsrf_5.Point, Text=concat_2, Size=number_slider_11, Colour=swatch_3, Justification=6)  # disabled

panel_37 = Panel("{0;0;<3}")  # disabled
split = SplitTree(Data=merge_14, Masks=flatten(panel_37))  # -> Positive, Negative; disabled
viewer_5 = ParamViewer(split.Negative)  # disabled
branch_3 = TreeBranch(Tree=split.Negative, Path=viewer_5, MaintainPaths=False)  # disabled
entwine_6 = Entwine(Branch0X=simplify(split.Positive), Branch1X=simplify(branch_3), FlattenInputs=False)  # disabled

# ---- group: just the bottom surfaces
panel_38 = Panel("0")  # disabled
srf_13 = Surface(srf_11)  # disabled
cull_i_10 = CullIndex(List=srf_13, Indices=panel_38, Wrap=True)  # -> flatten(List); disabled

# ----
edges_4 = BrepEdges(Brep=[merge_17, merge_13])  # -> Naked, Interior, NonManifold; disabled
viewer_6 = ParamViewer(srf_11)  # disabled
crv_20 = Curve(entwine_6)  # disabled

swatch_4 = ColourSwatch(SwatchColor=RGB(0, 0, 0))  # disabled
previewmat_2 = CustomPreviewMaterials(Geometry=merge_17, DiffuseColor=RGB(255, 255, 255))  # disabled
previewmat_3 = CustomPreviewMaterials(Geometry=merge_13, DiffuseColor=RGB(255, 255, 255))  # disabled
previewlw_5 = CustomPreviewLineweights(Geometry=edges_4.Naked, Shader=swatch_4, Absolute=False)  # disabled

# ----
# connection frames
number_slider_12 = Slider(0.475, range=0..1)  # disabled
panel_39 = Panel("""0
-1""")  # disabled
panel_40 = Panel("""0
-1""")  # disabled
item_14 = ListItem(List=crv_15, Index=-1, Wrap=True)  # disabled
cull_i_11 = CullIndex(List=crv_16, Indices=panel_39, Wrap=True)  # disabled
cull_i_12 = CullIndex(List=crv_15, Indices=panel_40, Wrap=True)  # disabled
eval_3 = EvaluateCurve(Curve=crv_15, Parameter=number_slider_12)  # -> Point, Tangent, Angle; disabled
item_15 = ListItem(List=crv_16, Index=0, Wrap=True)  # disabled
item_16 = ListItem(List=eval_3.Point, Index=-1, Wrap=True)  # disabled
crv_cp_4 = CurveClosestPoint(Point=item_16, Curve=item_15)  # -> Point, Parameter, Distance; disabled
shatter_2 = Shatter(Curve=cull_i_12, Parameters=number_slider_12)  # disabled
shatter_3 = Shatter(Curve=cull_i_11, Parameters=crv_cp_4.Parameter)  # disabled
dispatch_3 = Dispatch(List=shatter_2, DispatchPattern=[True, False])  # -> ListA, ListB; disabled
flip_11 = FlipCurve(Curve=dispatch_3.ListA)  # -> Curve, Flag; disabled
dispatch_4 = Dispatch(List=shatter_3, DispatchPattern=[True, False])  # -> ListA, ListB; disabled
number_slider_13 = Slider(0.5, range=0..1)  # disabled
number_slider_14 = Slider(5, range=2..8)  # disabled
flip_12 = FlipCurve(Curve=dispatch_4.ListA)  # -> Curve, Flag; disabled
weave_3 = Weave(Pattern=[0, 1], Stream0=dispatch_3.ListB, Stream1=flip_11.Curve, NullGaps=False)  # disabled
len = Length(Curve=weave_3)  # disabled
weave_4 = Weave(Pattern=[0, 1], Stream0=dispatch_4.ListB, Stream1=flip_12.Curve, NullGaps=False)  # disabled
division = Division(A=len, B=number_slider_13)  # disabled
range_2 = Range(Domain=Domain(0, 1), Steps=number_slider_14)  # disabled
int_3 = Integer(division)  # disabled
cull_i_13 = CullIndex(List=range_2, Indices=-1, Wrap=True)  # disabled
divlength = DivideLength(Curve=weave_4, Length=number_slider_13)  # -> Points, Tangents, Parameters; disabled
divlength_2 = DivideLength(Curve=weave_3, Length=number_slider_13)  # -> Points, Tangents, Parameters; disabled
graph_5 = GraphMapper(
    cull_i_13,
    x0=0,
    x1=1,
    y0=0,
    y1=1,
    container_name="Bezier",
    cpx=[0, 0.2869572341, 0.6637688279, 1],
    cpy=[0, 0.4768119454, 0.9695655704, 1])  # disabled
number_slider_15 = Slider(0.03, range=0..1)  # disabled
eval_4 = EvaluateCurve(Curve=reparameterize(graft(weave_3)), Parameter=graph_5)  # -> Point, Tangent, Angle; disabled
pframe_4 = PerpFrame(Curve=reparameterize(graft(weave_3)), Parameter=graph_5)  # disabled
panel_41 = Panel("1")  # disabled
pframe_5 = PerpFrame(Curve=reparameterize(graft(weave_4)), Parameter=graph_5)  # disabled
eval_5 = EvaluateCurve(Curve=reparameterize(graft(weave_4)), Parameter=graph_5)  # -> Point, Tangent, Angle; disabled
Z_10 = UnitZ(Factor=1)  # disabled
subtraction_3 = Subtraction(A=panel_41, B=number_slider_15)  # disabled
item_17 = ListItem(List=crv_16, Index=0, Wrap=True)  # disabled
align_4 = AlignPlane(Plane=pframe_4, Direction=Z_10)  # -> Plane, Angle; disabled
align_5 = AlignPlane(Plane=pframe_5, Direction=Z_10)  # -> Plane, Angle; disabled
merge_18 = Merge(Data1=number_slider_15, Data2=subtraction_3)  # disabled
pframe_6 = PerpFrame(Curve=reparameterize(graft(item_17)), Parameter=merge_18)  # disabled
pframe_7 = PerpFrame(Curve=item_14, Parameter=number_slider_12)  # disabled
pshift_18 = ShiftPaths(Data=align_5.Plane, Offset=-1)  # disabled
pshift_19 = ShiftPaths(Data=align_4.Plane, Offset=-1)  # disabled
align_6 = AlignPlane(Plane=pframe_7, Direction=Z_10)  # -> Plane, Angle; disabled
align_7 = AlignPlane(Plane=pframe_6, Direction=Z_10)  # -> Plane, Angle; disabled

cull_i_14 = CullIndex(List=pshift_18, Indices=0, Wrap=True)  # disabled
cull_i_15 = CullIndex(List=pshift_19, Indices=0, Wrap=True)  # disabled

lng_4 = ListLength(List=flatten([cull_i_15, cull_i_14, align_6.Plane, align_7.Plane]))  # disabled
sec = BrepPlane(Brep=graft(merge_17), Plane=flatten(cull_i_15))  # -> Curves, Points; disabled
pln_2 = Plane([cull_i_15, cull_i_14, align_6.Plane, align_7.Plane])  # disabled

number_slider_16 = Slider(1139.98, range=0..1500)  # disabled
number_slider_17 = Slider(579.459, range=0..1500)  # disabled
Y_4 = UnitY(Factor=number_slider_17)  # disabled

number_slider_18 = Slider(1139.98, range=0..1500)  # disabled

area_5 = Area(Geometry=flatten(merge_13))  # -> Area, Centroid; disabled
area_6 = Area(Geometry=flatten(merge_17))  # -> Area, Centroid; disabled
lng_5 = ListLength(List=area_5.Centroid)  # disabled
lng_6 = ListLength(List=area_6.Centroid)  # disabled
series_3 = Series(Start=0, Step=1, Count=lng_5)  # disabled
series_4 = Series(Start=0, Step=1, Count=lng_6)  # disabled
number_slider_19 = Slider(2.399, range=0..100)  # disabled
number_slider_20 = Slider(2.399, range=0..100)  # disabled
tag_5 = TextTag3D(Location=area_5.Centroid, Text=series_3, Size=number_slider_19, Justification=7)  # disabled
tag_6 = TextTag3D(Location=area_6.Centroid, Text=series_4, Size=number_slider_20, Justification=7)  # disabled

pt_6 = Point(Point(0.5, 0.5, 0))  # disabled
number_slider_21 = Slider(20, range=0..100)  # disabled
panel_42 = Panel("-1500")  # disabled
swatch_5 = ColourSwatch(SwatchColor=RGB(255, 0, 0))  # disabled
X_3 = UnitX(Factor=panel_42)  # disabled

# ----
# center line
# double frames
merge_19 = Merge(Data1=align_2.Plane, Data2=align_3.Plane)
sph = Sphere(Base=merge_19, Radius=connectors_half_length)  # -> flatten(Sphere)
bcx = BrepCurve(Brep=sph, Curve=crv_8)  # -> Curves, Points
crv_cp_5 = CurveClosestPoint(Point=flatten(bcx.Points), Curve=crv_8)  # -> Point, Parameter, Distance
sort_3 = SortList(Keys=crv_cp_5.Parameter)  # -> Keys, ValuesA
dispatch_5 = Dispatch(List=sort_3.Keys, DispatchPattern=[True, False])  # -> ListA, ListB
merge_20 = Merge(Data1=graft(dispatch_5.ListA), Data2=graft(dispatch_5.ListB))
pframe_8 = PerpFrame(Curve=crv_8, Parameter=merge_20)
avr_4 = Average(Input=merge_20)  # -> flatten(ArithmeticMean)
item_18 = ListItem(List=item_12, Index=reverse(graft(panel_36)), Wrap=True)  # -> flatten(Item)
pt_7 = Point(graft(pframe_8))
pframe_9 = PerpFrame(Curve=crv_8, Parameter=avr_4)

# ---- group: center circles
cir_3 = Circle(Plane=pframe_9, Radius=holes_distance_from_edge)

# ----
x_span = Slider(1139.98, range=0..1500)
y_offset = Slider(579.459, range=0..1500)
entwine_7 = Entwine(Branch00="0", Branch01=y_offset, FlattenInputs=True)

# ----
# all others
# double frames
# parameter t
sph_2 = Sphere(Base=pln, Radius=connectors_half_length)  # -> flatten(Sphere)
bcx_2 = BrepCurve(Brep=sph_2, Curve=crv_17)  # -> Curves, Points
pshift_20 = ShiftPaths(Data=bcx_2.Points, Offset=-1)
crv_cp_6 = CurveClosestPoint(Point=pshift_20, Curve=crv_17)  # -> Point, Parameter, Distance
sort_4 = SortList(Keys=crv_cp_6.Parameter)  # -> Keys, ValuesA
pframe_10 = PerpFrame(Curve=crv_17, Parameter=sort_4.Keys)
item_19 = ListItem(List=partition_3, Index=0, Wrap=True)  # -> Item, Item1
pt_8 = Point(graft(pframe_10))
crv_21 = Curve(crv_17)
dispatch_6 = Dispatch(List=sort_4.Keys, DispatchPattern=[True, False])  # -> ListA, ListB
merge_21 = Merge(Data1=graft(dispatch_6.ListA), Data2=graft(dispatch_6.ListB))
avr_5 = Average(Input=merge_21)
pshift_21 = ShiftPaths(Data=avr_5, Offset=-1)
pframe_11 = PerpFrame(Curve=crv_21, Parameter=pshift_21)

depth_variation = Slider(4, range=0..10)
min_depth = Slider(8, range=0..10)
# depth control
pi = Pi(Factor=1)
multiplication_10 = Multiplication(A=sort_4.Keys, B=pi)
sin = Sine(Value=multiplication_10)
multiplication_11 = Multiplication(A=sin, B=depth_variation)
addition = Addition(A=min_depth, B=multiplication_11)

cir_4 = Circle(Plane=pframe_10, Radius=addition)
bcx_3 = BrepCurve(Brep=item_19.Item, Curve=cir_4)  # -> Curves, Points
bcx_4 = BrepCurve(Brep=item_19.Item1, Curve=cir_4)  # -> Curves, Points
merge_22 = Merge(Data1=bcx_3.Points, Data2=bcx_4.Points)
merge_23 = Merge(Data1=pt_8, Data2=merge_22)
pline_4 = PolyLine(Vertices=merge_23, Closed=True)
pshift_22 = ShiftPaths(Data=pline_4, Offset=-1)
dispatch_7 = Dispatch(List=pshift_22, DispatchPattern=[True, False])  # -> ListA, ListB
merge_24 = Merge(Data1=graft(dispatch_7.ListA), Data2=graft(dispatch_7.ListB))

cir_5 = Circle(Plane=pframe_8, Radius=min_depth)
bcx_5 = BrepCurve(Brep=item_18, Curve=graft(cir_5))  # -> Curves, Points
pshift_23 = ShiftPaths(Data=bcx_5.Points, Offset=-1)
merge_25 = Merge(Data1=pt_7, Data2=pshift_23)
pline_5 = PolyLine(Vertices=merge_25, Closed=True)
pshift_24 = ShiftPaths(Data=pline_5, Offset=-1)

# ---- group: surfaces on model
loft_10 = Loft(Curves=pshift_24, Options={Adjust=False, Closed=False, LoftEnds=0, LoftSimp=0, LoftType=0, Rebuild=10, Refit=0.01})

loft_11 = Loft(Curves=merge_24, Options={Adjust=False, Closed=False, LoftEnds=0, LoftSimp=0, LoftType=0, Rebuild=10, Refit=0.01})

# ---- group: all other circles
cir_6 = Circle(Plane=pframe_11, Radius=holes_distance_from_edge)

# ----
# hanging lines
number_slider_22 = Slider(410, range=0..500)
Z_11 = UnitZ(Factor=number_slider_22)
xy = XYPlane(Origin=Z_11)
project = Project(Geometry=pframe_11, Plane=xy)  # -> Geometry, Transform
xy_2 = XYPlane(Origin=project.Geometry)
prot = RotatePlane(Plane=xy_2, Angle="Pi*.5")
ln_5 = Line(StartPoint=pframe_11, EndPoint=project.Geometry)
len_2 = Length(Curve=ln_5)
expression = Expression(x=len_2, Expression="round(x,1)")
tag_7 = TextTag3D(Location=prot, Text=expression, Size=Slider(3, range=0..10), Justification=7)

brep_5 = Brep([loft_10, loft_11])

# ----
# connector geometry
swatch_6 = ColourSwatch(SwatchColor=RGB(0, 0, 0))
previewmat_4 = CustomPreviewMaterials(Geometry=brep_5, DiffuseColor=swatch_6)

# ---- group: points for unroll on connectors
bcx_6 = BrepCurve(Brep=flatten(loft_10), Curve=graft(cir_3))  # -> Curves, Points
pshift_25 = ShiftPaths(Data=bcx_6.Points, Offset=-1)

bcx_7 = BrepCurve(Brep=flatten(loft_11), Curve=graft(cir_6))  # -> Curves, Points
pshift_26 = ShiftPaths(Data=bcx_7.Points, Offset=-1)

# ----
# connector tag & callout - all others
callout_extent = Slider(10, range=0..100)
vec2pt_6 = Vector2Pt(PointA=graft(pframe_11), PointB=pshift_26, Unitize=False)  # -> Vector, Length
avr_6 = Average(Input=vec2pt_6.Vector)
rev_6 = Reverse(Vector=avr_6)
amp_3 = Amplitude(Vector=rev_6, Amplitude=callout_extent)
move_9 = Move(Geometry=graft(pframe_11), Motion=amp_3)  # -> Geometry, Transform
viewer_7 = ParamViewer(move_9.Geometry)
xy_3 = XYPlane(Origin=move_9.Geometry)
txt = Text(graft(viewer_7))
swatch_7 = ColourSwatch(SwatchColor=RGB(0, 0, 0))
multiplication_12 = Multiplication(A=callout_extent, B="0.9")
match = MatchTree(Tree=txt, Guide=move_9.Geometry)
line_4 = LineSDL(Start=graft(pframe_11), Direction=rev_6, Length=multiplication_12)
tag_8 = TextTag3D(Location=xy_3, Text=match, Size=Slider(2, range=0..50), Colour=swatch_7, Justification=7)
previewlw_6 = CustomPreviewLineweights(Geometry=line_4, Shader=swatch_7, Absolute=False)

# ----
# connector tag & callout - centre
callout_extent_2 = Slider(20, range=0..100)
amp_4 = Amplitude(Vector=Z, Amplitude=callout_extent_2)
move_10 = Move(Geometry=graft(pframe_9), Motion=amp_4)  # -> Geometry, Transform
xy_4 = XYPlane(Origin=move_10.Geometry)  # -> flatten(Plane)
swatch_8 = ColourSwatch(SwatchColor=RGB(255, 0, 234))
multiplication_13 = Multiplication(A=callout_extent_2, B="0.9")
line_5 = LineSDL(Start=pframe_9, Direction=Z, Length=multiplication_13)
tag_9 = TextTag3D(Location=xy_4, Text=panel, Size=Slider(2, range=0..50), Colour=swatch_7, Justification=7)
previewlw_7 = CustomPreviewLineweights(Geometry=line_5, Shader=swatch_7, Absolute=False)

lng_7 = ListLength(List=flatten(loft_10))
lng_8 = ListLength(List=flatten(loft_11))
series_5 = Series(Start=0, Step=Slider(54.505, range=0..100), Count=lng_7)

# ---- group: all circles
merge_26 = Merge(Data1=cir_3, Data2=cir_6)  # -> flatten(Result)

# ----
srf_14 = Surface(graft(srf_3))
bcx_8 = BrepCurve(Brep=srf_14, Curve=merge_26)  # -> Curves, Points

unroller = Unroller(Brep=loft_10, Points=pshift_25)  # -> Brep, Curves, Points
unroller_2 = Unroller(Brep=loft_11, Points=pshift_26)  # -> Brep, Curves, Points
series_6 = Series(Start=0, Step=Slider(15.662, range=0..100), Count=lng_8)
X_4 = UnitX(Factor=graft(series_5))
X_5 = UnitX(Factor=graft(series_6))
addition_2 = Addition(A=X_4, B=Y)

# ---- group: points fo unroll on surfaces
pshift_27 = ShiftPaths(Data=bcx_8.Points, Offset=-1)

# ----
pt_9 = Point(pshift_27)

move_11 = Move(Geometry=unroller_2.Brep, Motion=X_5)  # -> Geometry, Transform
move_12 = Move(Geometry=unroller.Brep, Motion=addition_2)  # -> Geometry, Transform

resolution = Slider(190, range=2..200)
pshift_28 = ShiftPaths(Data=intcrv_6.Curve, Offset=-1)
bbox_2 = BoundingBox(Content=flatten(srf_3), Plane=PlaneXY(0, 0, 0), UnionBox=True)  # -> Box, Box_2
srf_15 = Surface(srf_3)
Z_12 = UnitZ(Factor=1)
divide_13 = DivideCurve(Curve=pshift_28, Count=resolution, Kinks=False)  # -> Points, Tangents, Parameters
line_6 = LineSDL(Start=divide_13.Points, Direction=Z_12, Length=1)
area_7 = Area(Geometry=flatten(srf_15))  # -> Area, Centroid
join_7 = BrepJoin(Breps=pshift_11)  # -> Breps, Closed
pshift_29 = ShiftPaths(Data=line_6, Offset=-1)
sheet_area_mq = Panel("0.7")
ma = MassAddition(Input=area_7.Area)  # -> Result, PartialResults
blx = BrepLine(Brep=join_7.Breps, Line=pshift_29, LimitToFirst=False)  # -> Curves, Points
multiplication_14 = Multiplication(A=ma.Result, B=0.0001)
dist_2 = Distance(PointA=graft(divide_13.Points), PointB=blx.Points)  # -> flatten(Distance)
ln_6 = Line(StartPoint=graft(divide_13.Points), EndPoint=blx.Points)  # disabled
area_8 = Area(Geometry=[move_12.Geometry, move_11.Geometry])  # -> Area, Centroid
multiplication_15 = Multiplication(A=multiplication_14, B=Slider(1.5, range=1..2))
boxprop = BoxProperties(Box=bbox_2.Box)  # -> Center, Diagonal, Area, Volume, Degeneracy
bnd_7 = Bounds(Numbers=dist_2)
ma_2 = MassAddition(Input=flatten(area_8.Area))  # -> Result, PartialResults
division_2 = Division(A=multiplication_15, B=sheet_area_mq)
# dimensions
devec = DeconstructVector(Vector=boxprop.Diagonal)  # -> XComponent, YComponent, ZComponent
dedomain = DeconstructDomain(Domain=bnd_7)  # -> Start, End
int_4 = Integer(division_2)
connectors_unrolled_area_cm2 = Panel(ma_2.Result)
size_lxdxh_cm = Panel([devec.XComponent, devec.YComponent, devec.ZComponent])
min_max_depth_cm = Panel([dedomain.Start, dedomain.End])
total_area_sqm = Panel(multiplication_14)
n_of_sheets_est = Panel(int_4)

# ---- group: points
move_13 = Move(Geometry=unroller_2.Points, Motion=X_5)  # -> Geometry, Transform

move_14 = Move(Geometry=unroller.Points, Motion=addition_2)  # -> Geometry, Transform

# ----
# unrolled connector tag - all others
dpath = DeconstructPath(Branch=viewer_7)
item_20 = ListItem(List=dpath, Index=0, Wrap=True)  # -> Item, Item1, Item2
expression_2 = Expression(x=item_20.Item, y=item_20.Item1, z=item_20.Item2, Expression="Format(\"{0}.{1}_{2}\", x, y,z)")  # -> flatten(R)
area_9 = Area(Geometry=sort.ValuesA)  # -> Area, flatten(Centroid)
tag_10 = TextTag3D(Location=area_9.Centroid, Text=expression_2, Size=Slider(2, range=0..100), Justification=5)

adjust_orient_roty = AdjustOrientRotY(brep=graft(sort.ValuesA), pt=move_13.Geometry)  # -> S, pt_4
edges_5 = BrepEdges(Brep=adjust_orient_roty.S)  # -> Naked, Interior, NonManifold
pt_10 = Point(move_14.Geometry)
pt_11 = Point(adjust_orient_roty.pt_4)
join_8 = JoinCurves(Curves=edges_5.Naked, Preserve=False)
explode_6 = Explode(Curve=join_8, Recursive=True)  # -> Segments, Vertices
item_21 = ListItem(List=explode_6.Vertices, Index=0, Wrap=True)  # -> Item, Item1
item_22 = ListItem(List=explode_6.Vertices, Index="4", Wrap=True)  # -> Item, Item1
merge_27 = Merge(Data1=panel, Data2=expression_2)
merge_28 = Merge(Data1=area_2.Centroid, Data2=area_9.Centroid)
cir_7 = Circle(Plane=pt_10, Radius=holes_radius)
cir_8 = Circle(Plane=pt_11, Radius=holes_radius)
ln_7 = Line(StartPoint=item_21.Item, EndPoint=item_22.Item1)
ln_8 = Line(StartPoint=item_21.Item1, EndPoint=item_22.Item)
item_23 = ListItem(List=explode_6.Segments, Index=panel_3, Wrap=True)
merge_29 = Merge(Data1=ln_7, Data2=ln_8, Data3=item_23)  # -> simplify(Result)

# ---- group: mirror circles
item_24 = ListItem(List=explode.Vertices, Index="6", Wrap=True)  # -> Item, Item1
item_25 = ListItem(List=explode.Vertices, Index="2", Wrap=True)  # -> Item, Item1
avr_7 = Average(Input=[item_24.Item, item_24.Item1])
vec2pt_7 = Vector2Pt(PointA=item_24.Item, PointB=item_24.Item1, Unitize=False)  # -> Vector, Length
avr_8 = Average(Input=[item_25.Item, item_25.Item1])
vec2pt_8 = Vector2Pt(PointA=item_25.Item, PointB=item_25.Item1, Unitize=False)  # -> Vector, Length
item_26 = ListItem(List=edges.Interior, Index="1", Wrap=True)
item_27 = ListItem(List=cir_7, Index="1", Wrap=True)
item_28 = ListItem(List=cir_7, Index=0, Wrap=True)
rot3d = Rotate3D(Geometry=item_26, Angle="Pi", Center=avr_7, Axis=vec2pt_7.Vector)  # -> Geometry, Transform
rot3d_2 = Rotate3D(Geometry=item_27, Angle="Pi", Center=avr_7, Axis=vec2pt_7.Vector)  # -> Geometry, Transform
rot3d_3 = Rotate3D(Geometry=ln, Angle="Pi", Center=avr_8, Axis=vec2pt_8.Vector)  # -> Geometry, Transform
rot3d_4 = Rotate3D(Geometry=item_28, Angle="Pi", Center=avr_8, Axis=vec2pt_8.Vector)  # -> Geometry, Transform

item_29 = ListItem(List=explode_6.Vertices, Index="6", Wrap=True)  # -> Item, Item1
item_30 = ListItem(List=explode_6.Vertices, Index="2", Wrap=True)  # -> Item, Item1
avr_9 = Average(Input=[item_29.Item, item_29.Item1])
vec2pt_9 = Vector2Pt(PointA=item_29.Item, PointB=item_29.Item1, Unitize=False)  # -> Vector, Length
avr_10 = Average(Input=[item_30.Item, item_30.Item1])
vec2pt_10 = Vector2Pt(PointA=item_30.Item, PointB=item_30.Item1, Unitize=False)  # -> Vector, Length
item_31 = ListItem(List=cir_8, Index=0, Wrap=True)
item_32 = ListItem(List=cir_8, Index="1", Wrap=True)
rot3d_5 = Rotate3D(Geometry=ln_7, Angle="Pi", Center=avr_9, Axis=vec2pt_9.Vector)  # -> Geometry, Transform
rot3d_6 = Rotate3D(Geometry=item_31, Angle="Pi", Center=avr_9, Axis=vec2pt_9.Vector)  # -> Geometry, Transform
rot3d_7 = Rotate3D(Geometry=ln_8, Angle="Pi", Center=avr_10, Axis=vec2pt_10.Vector)  # -> Geometry, Transform
rot3d_8 = Rotate3D(Geometry=item_32, Angle="Pi", Center=avr_10, Axis=vec2pt_10.Vector)  # -> Geometry, Transform

# ----
curvepoint = PointOnCurve(rot3d.Geometry, parameter=0.5)
curvepoint_2 = PointOnCurve(rot3d_3.Geometry, parameter=0.5)
curvepoint_3 = PointOnCurve(rot3d_5.Geometry, parameter=0.5)
curvepoint_4 = PointOnCurve(rot3d_7.Geometry, parameter=0.5)
vec2pt_11 = Vector2Pt(PointA=curvepoint, PointB=avr_7, Unitize=False)  # -> Vector, Length
scale = Scale(Geometry=rot3d_3.Geometry, Center=curvepoint_2, Factor="0.9")  # -> Geometry, Transform
vec2pt_12 = Vector2Pt(PointA=curvepoint_2, PointB=avr_8, Unitize=False)  # -> Vector, Length
vec2pt_13 = Vector2Pt(PointA=curvepoint_3, PointB=avr_9, Unitize=False)  # -> Vector, Length
scale_2 = Scale(Geometry=rot3d_7.Geometry, Center=curvepoint_4, Factor="0.9")  # -> Geometry, Transform
vec2pt_14 = Vector2Pt(PointA=curvepoint_4, PointB=avr_10, Unitize=False)  # -> Vector, Length
scale_3 = Scale(Geometry=rot3d.Geometry, Center=curvepoint, Factor="0.9")  # -> Geometry, Transform
scale_4 = Scale(Geometry=rot3d_5.Geometry, Center=curvepoint_3, Factor="0.9")  # -> Geometry, Transform
amp_5 = Amplitude(Vector=vec2pt_11.Vector, Amplitude="-1")
amp_6 = Amplitude(Vector=vec2pt_12.Vector, Amplitude="-1")
amp_7 = Amplitude(Vector=vec2pt_13.Vector, Amplitude="-1")
amp_8 = Amplitude(Vector=vec2pt_14.Vector, Amplitude="-1")
move_15 = Move(Geometry=scale_3.Geometry, Motion=amp_5)  # -> Geometry, Transform
move_16 = Move(Geometry=scale.Geometry, Motion=amp_6)  # -> Geometry, Transform
move_17 = Move(Geometry=scale_4.Geometry, Motion=amp_7)  # -> Geometry, Transform
move_18 = Move(Geometry=scale_2.Geometry, Motion=amp_8)  # -> Geometry, Transform
cull_i_16 = CullIndex(List=explode_6.Segments, Indices=panel_3, Wrap=True)
merge_30 = Merge(Data1=move_15.Geometry, Data2=move_16.Geometry)
merge_31 = Merge(Data1=move_17.Geometry, Data2=move_18.Geometry)
join_9 = JoinCurves(Curves=cull_i_16, Preserve=False)
end_3 = EndPoints(Curve=merge_30)  # -> Start, End
end_4 = EndPoints(Curve=merge_31)  # -> Start, End
end_5 = EndPoints(Curve=join_9)  # -> Start, End
merge_32 = Merge(Data1=end_3.Start, Data2=end_3.End)
merge_33 = Merge(Data1=end_4.Start, Data2=end_4.End)
cp_3 = ClosestPoint(Point=merge_32, Cloud=[end.Start, end.End])  # -> ClosestPoint, CPIndex, Distance
cp_4 = ClosestPoint(Point=merge_33, Cloud=[end_5.Start, end_5.End])  # -> ClosestPoint, CPIndex, Distance
ln_9 = Line(StartPoint=merge_32, EndPoint=cp_3.ClosestPoint)
ln_10 = Line(StartPoint=merge_33, EndPoint=cp_4.ClosestPoint)
merge_34 = Merge(Data1=simplify(merge_30), Data2=simplify(join_3), Data3=simplify(ln_9))
merge_35 = Merge(Data1=simplify(merge_31), Data2=simplify(join_9), Data3=simplify(ln_10))
join_10 = JoinCurves(Curves=merge_34, Preserve=False)
join_11 = JoinCurves(Curves=merge_35, Preserve=False)
viewer_8 = ParamViewer(join_10)
lng_9 = ListLength(List=viewer_8)
match_2 = MatchTree(Tree=cir_8, Guide=simplify(rot3d_6.Geometry))
merge_36 = Merge(Data1=simplify(rot3d_6.Geometry), Data2=simplify(rot3d_8.Geometry), Data3=simplify(match_2))
merge_37 = Merge(Data1=simplify(rot3d_2.Geometry), Data2=simplify(rot3d_4.Geometry), Data3=simplify(cir_7))
viewer_9 = ParamViewer(merge_36)
viewer_10 = ParamViewer(merge_29)
lng_10 = ListLength(List=viewer_10)
lng_11 = ListLength(List=viewer_9)
series_7 = Series(Start=lng_9, Step=1, Count=lng_10)
series_8 = Series(Start=lng_9, Step=1, Count=lng_11)
int_5 = Integer(series_7)
int_6 = Integer(series_8)
replace = ReplacePaths(Data=merge_36, Search=viewer_9, Replace=int_6)
replace_2 = ReplacePaths(Data=merge_29, Search=viewer_10, Replace=int_5)
merge_38 = Merge(Data1=flatten(join_10), Data2=flatten(join_11))  # -> graft(Result)
merge_39 = Merge(Data1=merge_37, Data2=replace)
move_19 = Move(Geometry=merge_38, Motion=Y_2)  # -> Geometry, Transform
move_20 = Move(Geometry=merge_39, Motion=Y_2)  # -> Geometry, Transform

# ----
# unroll beam surfaces
unroller_3 = Unroller(Brep=graft(srf_3), Curves=pull, Points=pt_9)  # -> simplify(Brep), simplify(Curves), simplify(Points)
lng_12 = ListLength(List=flatten(unroller_3.Brep))
multiplication_16 = Multiplication(A=lng_12, B="0.5")
range_3 = Range(Domain=x_span, Steps=expr("x-1", multiplication_16))  # -> graft(Range)

entwine_8 = Entwine(Branch0X=range_3, Branch1X=range_3, FlattenInputs=False)
repeat = RepeatData(Data=entwine_7, Length=multiplication_16)  # -> graft(Data)
match_3 = MatchTree(Tree=repeat, Guide=unroller_3.Brep)
match_4 = MatchTree(Tree=entwine_8, Guide=unroller_3.Brep)
Y_5 = UnitY(Factor=match_3)

X_6 = UnitX(Factor=match_4)

addition_3 = Addition(A=X_6, B=Y_5)

move_21 = Move(Geometry=unroller_3.Brep, Motion=addition_3)  # -> Geometry, Transform
move_22 = Move(Geometry=unroller_3.Curves, Motion=addition_3)  # -> Geometry, Transform
move_23 = Move(Geometry=unroller_3.Points, Motion=addition_3)  # -> Geometry, Transform
srf_16 = Surface(reparameterize(move_21.Geometry))
adjunor = AdjustUnrollOrient(brep=srf_16, curves=move_22.Geometry, pt=move_23.Geometry)  # -> S, curves_2, pt_4

# ----
# curves
pshift_30 = ShiftPaths(Data=adjunor.curves_2, Offset=-1)
# points
pshift_31 = ShiftPaths(Data=adjunor.pt_4, Offset=-1)
# unrolled
# surfaces
srf_17 = Surface(adjunor.S)

previewlw_8 = CustomPreviewLineweights(Geometry=pshift_30, Shader=swatch_2, Absolute=False)

# ----
# unrolled
pshift_32 = ShiftPaths(Data=srf_17, Offset=-1)
lng_13 = ListLength(List=pshift_32)
viewer_11 = ParamViewer(pshift_32)
series_9 = Series(Start=0, Step=1, Count=lng_13)
pt_12 = Point(Point(0.5, 0.5, 0))
int_7 = Integer(series_9)
evalsrf_6 = EvaluateSurface(Surface=reparameterize(pshift_32), Point=pt_12)  # -> Point, Normal, Frame
concat_3 = Concatenate(FragmentA=graft(viewer_11), FragmentB=int_7)
X_7 = UnitX(Factor="-1500")
move_24 = Move(Geometry=evalsrf_6.Point, Motion=X_7)  # -> Geometry, Transform
tag_11 = TextTag3D(
    Location=evalsrf_6.Point,
    Text=concat_3,
    Size=Slider(20, range=0..100),
    Colour=ColourSwatch(SwatchColor=RGB(0, 31, 143)),
    Justification=9)

area_10 = Area(Geometry=flatten(srf_3))  # -> Area, Centroid
area_11 = Area(Geometry=flatten(srf_17))  # -> Area, Centroid
subtraction_4 = Subtraction(A=area_10.Area, B=area_11.Area)
abs = Absolute(Value=subtraction_4)
bnd_8 = Bounds(Numbers=subtraction_4)
division_3 = Division(A=abs, B=area_10.Area)
remap_7 = RemapNumbers(Value=subtraction_4, Source=bnd_8, Target=Domain(0, 1))  # -> Mapped, Clipped
lng_14 = ListLength(List=area_10.Centroid)
multiplication_17 = Multiplication(A=division_3, B=100)
gradient = Gradient(LowerLimit=0, UpperLimit=1, Parameter=remap_7.Mapped, stops=[0: RGB(255, 0, 0), 1: RGB(255, 255, 255)])
series_10 = Series(Start=0, Step=1, Count=lng_14)
panel_43 = Panel(multiplication_17)
# deviation
number_slider_23 = Slider(2.399, range=0..100)
bar_graph = BarGraph(multiplication_17, BarColor=RGB(255, 0, 90))
previewmat_5 = CustomPreviewMaterials(Geometry=flatten(srf_3), DiffuseColor=gradient)
tag_12 = TextTag3D(Location=area_10.Centroid, Text=series_10, Size=number_slider_23, Justification=7)

crv_22 = Curve(reparameterize(flatten(pshift_30)))
srf_18 = Surface(reparameterize(srf_17))
pt_13 = Point(pshift_31)
move_25 = Move(Geometry=pt_13, Motion=Z_2)  # -> Geometry, Transform
line_7 = LineSDL(Start=move_25.Geometry, Direction=rev, Length="2")

# ----
# reparametrize + graft
# sub-list takes only the elements
# up to index 1
# another way of reversing lists
# or we can use a split list
# since we'll need also the
# other curves
edges_6 = BrepEdges(Brep=srf_17)  # -> Naked, Interior, NonManifold
# create jigsaw contours
len_3 = Length(Curve=edges_6.Naked)
sort_5 = SortList(Keys=len_3, ValuesA=edges_6.Naked)  # -> Keys, reverse(ValuesA)
split_2 = SplitList(List=sort_5.ValuesA, Index="2")  # -> ListA, ListB
subset = SubList(List=sort_5.ValuesA, Domain="1", Wrap=True)  # -> List, Index
jig_length = Slider(4, range=0..10)
crv_23 = Curve(reparameterize(graft(split_2.ListA)))
len_4 = Length(Curve=crv_23)
division_4 = Division(A=len_4, B=jig_length)
int_8 = Integer(division_4)
pattern = ValueList({"jigsaw (all even)": 0, "overlap (all odd)": 1, "installation (bypass)": 2}, selected="overlap (all odd)")
Z_13 = UnitZ(Factor=1)
crv_24 = Curve(simplify(split_2.ListB))

# ----
# tag curve side
crv_25 = Curve(split_2.ListA)
curvepoint_5 = PointOnCurve(crv_25, parameter=0.5)
panel_44 = Panel("""0
1""")
tag_13 = TextTag3D(
    Location=curvepoint_5,
    Text=panel_44,
    Size=Slider(13.732, range=0..20),
    Colour=ColourSwatch(SwatchColor=RGB(0, 0, 0)),
    Justification=5)

# ----
# NOTE on divisions: in order for the jigsaw technique to work, the number of divisions should be ALWAYS EVEN
# 
# if a correspondance between "flaps" is desired (i.e. stapling) then the number of divisions should be ALWAYS ODD
mod = Modulus(A=int_8, B=2)
dispatch_8 = Dispatch(List=int_8, DispatchPattern=mod)  # -> ListA, ListB
addition_4 = Addition(A=dispatch_8.ListB, B=1)
subtraction_5 = Subtraction(A=dispatch_8.ListA, B=1)
weave_5 = Weave(Pattern=mod, Stream0=dispatch_8.ListB, Stream1=subtraction_5, NullGaps=False)
weave_6 = Weave(Pattern=mod, Stream0=addition_4, Stream1=dispatch_8.ListA, NullGaps=False)
all_odd_divisions = Panel(weave_6)
all_even_divisions = Panel(weave_5)

sph_3 = Sphere(Base=pln_2, Radius=number_slider_3)  # -> flatten(Sphere); disabled
bcx_9 = BrepCurve(Brep=sph_3, Curve=entwine_6)  # -> Curves, Points; disabled
pshift_33 = ShiftPaths(Data=bcx_9.Points, Offset=-1)  # disabled
crv_cp_7 = CurveClosestPoint(Point=pshift_33, Curve=entwine_6)  # -> Point, Parameter, Distance; disabled
sort_6 = SortList(Keys=crv_cp_7.Parameter)  # -> Keys, ValuesA; disabled
pframe_12 = PerpFrame(Curve=entwine_6, Parameter=sort_6.Keys)  # disabled
merge_40 = Merge(Data1=align_6.Plane, Data2=align_7.Plane)  # disabled
sph_4 = Sphere(Base=merge_40, Radius=number_slider_3)  # -> flatten(Sphere); disabled
bcx_10 = BrepCurve(Brep=sph_4, Curve=crv_9)  # -> Curves, Points; disabled
pt_14 = Point(graft(pframe_12))  # disabled
dispatch_9 = Dispatch(List=sort_6.Keys, DispatchPattern=[True, False])  # -> ListA, ListB; disabled
merge_41 = Merge(Data1=graft(dispatch_9.ListA), Data2=graft(dispatch_9.ListB))  # disabled
avr_11 = Average(Input=merge_41)  # disabled
pshift_34 = ShiftPaths(Data=avr_11, Offset=-1)  # disabled
pframe_13 = PerpFrame(Curve=crv_20, Parameter=pshift_34)  # disabled

pi_2 = Pi(Factor=1)  # disabled
multiplication_18 = Multiplication(A=sort_6.Keys, B=pi_2)  # disabled
number_slider_24 = Slider(4, range=0..10)  # disabled
number_slider_25 = Slider(8, range=0..10)  # disabled
sin_2 = Sine(Value=multiplication_18)  # disabled
multiplication_19 = Multiplication(A=sin_2, B=number_slider_24)  # disabled
addition_5 = Addition(A=number_slider_25, B=multiplication_19)  # disabled

crv_cp_8 = CurveClosestPoint(Point=flatten(bcx_10.Points), Curve=crv_9)  # -> Point, Parameter, Distance; disabled
sort_7 = SortList(Keys=crv_cp_8.Parameter)  # -> Keys, ValuesA; disabled
dispatch_10 = Dispatch(List=sort_7.Keys, DispatchPattern=[True, False])  # -> ListA, ListB; disabled
merge_42 = Merge(Data1=graft(dispatch_10.ListA), Data2=graft(dispatch_10.ListB))  # disabled
avr_12 = Average(Input=merge_42)  # -> flatten(ArithmeticMean); disabled
pframe_14 = PerpFrame(Curve=crv_9, Parameter=avr_12)  # disabled

panel_45 = Panel("-1")  # disabled
item_33 = ListItem(List=flatten(srf_6), Index=panel_45, Wrap=True)  # disabled
item_34 = ListItem(List=flatten(srf_8), Index=0, Wrap=True)  # disabled
pframe_15 = PerpFrame(Curve=crv_9, Parameter=merge_42)  # disabled
merge_43 = Merge(Data1=item_33, Data2=item_34)  # disabled
cir_9 = Circle(Plane=pframe_15, Radius=number_slider_25)  # disabled
bcx_11 = BrepCurve(Brep=merge_43, Curve=graft(cir_9))  # -> Curves, Points; disabled
pt_15 = Point(graft(pframe_15))  # disabled
pshift_35 = ShiftPaths(Data=bcx_11.Points, Offset=-1)  # disabled
merge_44 = Merge(Data1=pt_15, Data2=pshift_35)  # disabled
pline_6 = PolyLine(Vertices=merge_44, Closed=True)  # disabled
pshift_36 = ShiftPaths(Data=pline_6, Offset=-1)  # disabled

# ---- group: all other circles
cir_10 = Circle(Plane=pframe_13, Radius=number_slider_4)  # disabled

# ---- group: surfaces on model
loft_12 = Loft(Curves=pshift_36, Options={Adjust=False, Closed=False, LoftEnds=0, LoftSimp=0, LoftType=0, Rebuild=10, Refit=0.01})  # disabled

# ---- group: center circles
cir_11 = Circle(Plane=pframe_14, Radius=number_slider_4)  # disabled

# ----
number_slider_26 = Slider(410, range=0..500)  # disabled
Z_14 = UnitZ(Factor=number_slider_26)  # disabled
panel_46 = Panel("Pi*.5")  # disabled
xy_5 = XYPlane(Origin=Z_14)  # disabled
project_2 = Project(Geometry=pframe_13, Plane=xy_5)  # -> Geometry, Transform; disabled
xy_6 = XYPlane(Origin=project_2.Geometry)  # disabled
prot_2 = RotatePlane(Plane=xy_6, Angle=panel_46)  # disabled
ln_11 = Line(StartPoint=pframe_13, EndPoint=project_2.Geometry)  # disabled
number_slider_27 = Slider(3, range=0..10)  # disabled
len_5 = Length(Curve=ln_11)  # disabled
expression_3 = Expression(x=len_5, Expression="round(x,1)")  # disabled
tag_14 = TextTag3D(Location=prot_2, Text=expression_3, Size=number_slider_27, Justification=7)  # disabled

# ---- group: points for unroll on connectors
bcx_12 = BrepCurve(Brep=flatten(loft_12), Curve=graft(cir_11))  # -> Curves, Points; disabled
pshift_37 = ShiftPaths(Data=bcx_12.Points, Offset=-1)  # disabled

# ---- group: all circles
merge_45 = Merge(Data1=cir_11, Data2=cir_10)  # -> flatten(Result); disabled

# ----
srf_19 = Surface(graft(srf_11))  # disabled
bcx_13 = BrepCurve(Brep=srf_19, Curve=merge_45)  # -> Curves, Points; disabled

# ---- group: points fo unroll on surfaces
pshift_38 = ShiftPaths(Data=bcx_13.Points, Offset=-1)  # disabled

# ----
pt_16 = Point(pshift_38)  # disabled
split_3 = SplitTree(Data=pt_16, Masks=flatten(panel_15))  # -> Positive, Negative; disabled
path_mapper = PathMapper(split_3.Negative, source="{A;B;C}", target="{0;B;C}")  # disabled
cir_12 = Circle(Plane=pframe_12, Radius=addition_5)  # disabled
bcx_14 = BrepCurve(Brep=item_13.Item, Curve=cir_12)  # -> Curves, Points; disabled
bcx_15 = BrepCurve(Brep=item_13.Item1, Curve=cir_12)  # -> Curves, Points; disabled
merge_46 = Merge(Data1=bcx_14.Points, Data2=bcx_15.Points)  # disabled
merge_47 = Merge(Data1=pt_14, Data2=merge_46)  # disabled
pline_7 = PolyLine(Vertices=merge_47, Closed=True)  # disabled
pshift_39 = ShiftPaths(Data=pline_7, Offset=-1)  # disabled
dispatch_11 = Dispatch(List=pshift_39, DispatchPattern=[True, False])  # -> ListA, ListB; disabled
merge_48 = Merge(Data1=graft(dispatch_11.ListA), Data2=graft(dispatch_11.ListB))  # disabled
lng_15 = ListLength(List=flatten(loft_12))  # disabled
series_11 = Series(Start=0, Step=number_slider_5, Count=lng_15)  # disabled
unroller_4 = Unroller(Brep=loft_12, Points=pshift_37)  # -> Brep, Curves, Points; disabled
X_8 = UnitX(Factor=graft(series_11))  # disabled
addition_6 = Addition(A=X_8, B=Y_3)  # disabled

unroller_5 = Unroller(Brep=graft(merge_17), Points=split_3.Positive)  # -> simplify(Brep), Curves, simplify(Points); disabled
lng_16 = ListLength(List=flatten(unroller_5.Brep))  # -> expr("x-1", Length); disabled
range_4 = Range(Domain=number_slider_18, Steps=lng_16)  # -> graft(Range); disabled
X_9 = UnitX(Factor=range_4)  # disabled
move_26 = Move(Geometry=unroller_5.Points, Motion=X_9)  # -> Geometry, Transform; disabled
move_27 = Move(Geometry=unroller_5.Brep, Motion=X_9)  # -> Geometry, Transform; disabled
srf_20 = Surface(reparameterize(move_27.Geometry))  # disabled
adjust_orient = AdjustOrient(srf=srf_20, pt=move_26.Geometry)  # -> S, pt_4; disabled
pshift_40 = ShiftPaths(Data=adjust_orient.S, Offset=-1)  # disabled
pt_17 = Point(adjust_orient.pt_4)  # disabled

# ---- group: surfaces on model
loft_13 = Loft(Curves=merge_48, Options={Adjust=False, Closed=False, LoftEnds=0, LoftSimp=0, LoftType=0, Rebuild=10, Refit=0.01})  # disabled

# ---- group: points for unroll on connectors
bcx_16 = BrepCurve(Brep=flatten(loft_13), Curve=graft(cir_10))  # -> Curves, Points; disabled
pshift_41 = ShiftPaths(Data=bcx_16.Points, Offset=-1)  # disabled

# ----
callout_extent_3 = Slider(10, range=0..100)  # disabled
vec2pt_15 = Vector2Pt(PointA=graft(pframe_13), PointB=pshift_41, Unitize=False)  # -> Vector, Length; disabled
avr_13 = Average(Input=vec2pt_15.Vector)  # disabled
rev_7 = Reverse(Vector=avr_13)  # disabled
amp_9 = Amplitude(Vector=rev_7, Amplitude=callout_extent_3)  # disabled
move_28 = Move(Geometry=graft(pframe_13), Motion=amp_9)  # -> Geometry, Transform; disabled
viewer_12 = ParamViewer(move_28.Geometry)  # disabled
number_slider_28 = Slider(2, range=0..50)  # disabled
panel_47 = Panel("0.9")  # disabled
xy_7 = XYPlane(Origin=move_28.Geometry)  # disabled
txt_2 = Text(graft(viewer_12))  # disabled
swatch_9 = ColourSwatch(SwatchColor=RGB(0, 0, 0))  # disabled
multiplication_20 = Multiplication(A=callout_extent_3, B=panel_47)  # disabled
match_5 = MatchTree(Tree=txt_2, Guide=move_28.Geometry)  # disabled
line_8 = LineSDL(Start=graft(pframe_13), Direction=rev_7, Length=multiplication_20)  # disabled
tag_15 = TextTag3D(Location=xy_7, Text=match_5, Size=number_slider_28, Colour=swatch_9, Justification=7)  # disabled
previewlw_9 = CustomPreviewLineweights(Geometry=line_8, Shader=swatch_9, Absolute=False)  # disabled

callout_extent_4 = Slider(20, range=0..100)  # disabled
amp_10 = Amplitude(Vector=Z_6, Amplitude=callout_extent_4)  # disabled
move_29 = Move(Geometry=graft(pframe_14), Motion=amp_10)  # -> Geometry, Transform; disabled
number_slider_29 = Slider(2, range=0..50)  # disabled
panel_48 = Panel("0.9")  # disabled
xy_8 = XYPlane(Origin=move_29.Geometry)  # -> flatten(Plane); disabled
swatch_10 = ColourSwatch(SwatchColor=RGB(255, 0, 234))  # disabled
multiplication_21 = Multiplication(A=callout_extent_4, B=panel_48)  # disabled
line_9 = LineSDL(Start=pframe_14, Direction=Z_6, Length=multiplication_21)  # disabled
tag_16 = TextTag3D(Location=xy_8, Text=panel_21, Size=number_slider_29, Colour=swatch_9, Justification=7)  # disabled
previewlw_10 = CustomPreviewLineweights(Geometry=line_9, Shader=swatch_9, Absolute=False)  # disabled

# ---- group: points
move_30 = Move(Geometry=unroller_4.Points, Motion=addition_6)  # -> Geometry, Transform; disabled

# ----
dpath_2 = DeconstructPath(Branch=viewer_12)  # disabled
item_35 = ListItem(List=dpath_2, Index=0, Wrap=True)  # -> Item, Item1, Item2; disabled
expression_4 = Expression(x=item_35.Item, y=item_35.Item1, z=item_35.Item2, Expression="Format(\"{0}.{1}_{2}\", x, y,z)")  # -> flatten(R); disabled
number_slider_30 = Slider(2, range=0..100)  # disabled
area_12 = Area(Geometry=sort_2.ValuesA)  # -> Area, flatten(Centroid); disabled
tag_17 = TextTag3D(Location=area_12.Centroid, Text=expression_4, Size=number_slider_30, Justification=5)  # disabled

unroller_6 = Unroller(Brep=graft(merge_13), Points=path_mapper)  # -> simplify(Brep), Curves, simplify(Points); disabled
lng_17 = ListLength(List=flatten(unroller_6.Brep))  # -> expr("x-1", Length); disabled
range_5 = Range(Domain=number_slider_16, Steps=lng_17)  # -> graft(Range); disabled
X_10 = UnitX(Factor=range_5)  # disabled

area_13 = Area(Geometry=flatten(unroller_6.Brep))  # -> Area, Centroid; disabled
area_14 = Area(Geometry=flatten(unroller_5.Brep))  # -> Area, Centroid; disabled
subtraction_6 = Subtraction(A=area_5.Area, B=area_13.Area)  # disabled
subtraction_7 = Subtraction(A=area_6.Area, B=area_14.Area)  # disabled
abs_2 = Absolute(Value=subtraction_6)  # disabled
abs_3 = Absolute(Value=subtraction_7)  # disabled
division_5 = Division(A=abs_2, B=area_5.Area)  # disabled
division_6 = Division(A=abs_3, B=area_6.Area)  # disabled
bnd_9 = Bounds(Numbers=[subtraction_6, subtraction_7])  # disabled
remap_8 = RemapNumbers(Value=subtraction_6, Source=bnd_9, Target=Domain(0, 1))  # -> Mapped, Clipped; disabled
multiplication_22 = Multiplication(A=division_5, B=100)  # disabled
multiplication_23 = Multiplication(A=division_6, B=100)  # disabled
remap_9 = RemapNumbers(Value=subtraction_7, Source=bnd_9, Target=Domain(0, 1))  # -> Mapped, Clipped; disabled
panel_49 = Panel(multiplication_23)  # disabled
gradient_2 = Gradient(LowerLimit=0, UpperLimit=1, Parameter=remap_8.Mapped, stops=[0: RGB(255, 0, 0), 1: RGB(255, 255, 255)])  # disabled
panel_50 = Panel(multiplication_22)  # disabled
gradient_3 = Gradient(LowerLimit=0, UpperLimit=1, Parameter=remap_9.Mapped, stops=[0: RGB(255, 0, 0), 1: RGB(255, 255, 255)])  # disabled
bar_graph_2 = BarGraph(multiplication_23, BarColor=RGB(255, 0, 90))  # disabled
bar_graph_3 = BarGraph(multiplication_22, BarColor=RGB(255, 0, 90))  # disabled
previewmat_6 = CustomPreviewMaterials(Geometry=flatten(merge_17), DiffuseColor=gradient_3)  # disabled
previewmat_7 = CustomPreviewMaterials(Geometry=flatten(merge_13), DiffuseColor=gradient_2)  # disabled

addition_7 = Addition(A=X_10, B=Y_4)  # disabled
brep_6 = Brep([loft_12, loft_13])  # disabled
lng_18 = ListLength(List=flatten(loft_13))  # disabled
series_12 = Series(Start=0, Step=number_slider_6, Count=lng_18)  # disabled
unroller_7 = Unroller(Brep=loft_13, Points=pshift_41)  # -> Brep, Curves, Points; disabled
X_11 = UnitX(Factor=graft(series_12))  # disabled
pt_18 = Point(move_30.Geometry)  # disabled
merge_49 = Merge(Data1=panel_21, Data2=expression_4)  # disabled
merge_50 = Merge(Data1=area_4.Centroid, Data2=area_12.Centroid)  # disabled

move_31 = Move(Geometry=unroller_6.Points, Motion=addition_7)  # -> Geometry, Transform; disabled
move_32 = Move(Geometry=unroller_6.Brep, Motion=addition_7)  # -> Geometry, Transform; disabled
srf_21 = Surface(reparameterize(move_32.Geometry))  # disabled
adjust_orient_2 = AdjustOrient(srf=srf_21, pt=move_31.Geometry)  # -> S, pt_4; disabled
pshift_42 = ShiftPaths(Data=adjust_orient_2.S, Offset=-1)  # disabled
pt_19 = Point(adjust_orient_2.pt_4)  # disabled

move_33 = Move(Geometry=unroller_4.Brep, Motion=addition_6)  # -> Geometry, Transform; disabled
move_34 = Move(Geometry=unroller_7.Brep, Motion=X_11)  # -> Geometry, Transform; disabled

# ---- group: points
move_35 = Move(Geometry=unroller_7.Points, Motion=X_11)  # -> Geometry, Transform; disabled

# ----
area_15 = Area(Geometry=[move_33.Geometry, move_34.Geometry])  # -> Area, Centroid; disabled
panel_51 = Panel("100")  # disabled
panel_52 = Panel("70")  # disabled
ma_3 = MassAddition(Input=flatten(area_15.Area))  # -> Result, PartialResults; disabled
multiplication_24 = Multiplication(A=panel_52, B=panel_51)  # disabled
subtraction_8 = Subtraction(A=multiplication_24, B=ma_3.Result)  # disabled
panel_53 = Panel(subtraction_8)  # disabled

panel_54 = Panel(".5")  # disabled
cir_13 = Circle(Plane=pt_18, Radius=panel_54)  # disabled

# ---- group: mirror circles
panel_55 = Panel("6")  # disabled
panel_56 = Panel("2")  # disabled
item_36 = ListItem(List=explode_4.Vertices, Index=panel_55, Wrap=True)  # -> Item, Item1; disabled
panel_57 = Panel("1")  # disabled
item_37 = ListItem(List=explode_4.Vertices, Index=panel_56, Wrap=True)  # -> Item, Item1; disabled
avr_14 = Average(Input=[item_36.Item, item_36.Item1])  # disabled
avr_15 = Average(Input=[item_37.Item, item_37.Item1])  # disabled
item_38 = ListItem(List=cir_13, Index=panel_57, Wrap=True)  # disabled
item_39 = ListItem(List=cir_13, Index=0, Wrap=True)  # disabled
vec2pt_16 = Vector2Pt(PointA=item_36.Item, PointB=item_36.Item1, Unitize=False)  # -> Vector, Length; disabled
vec2pt_17 = Vector2Pt(PointA=item_37.Item, PointB=item_37.Item1, Unitize=False)  # -> Vector, Length; disabled
panel_58 = Panel("Pi")  # disabled
panel_59 = Panel("Pi")  # disabled
rot3d_9 = Rotate3D(Geometry=item_38, Angle=panel_58, Center=avr_14, Axis=vec2pt_16.Vector)  # -> Geometry, Transform; disabled
rot3d_10 = Rotate3D(Geometry=item_39, Angle=panel_59, Center=avr_15, Axis=vec2pt_17.Vector)  # -> Geometry, Transform; disabled

# ----
entwine_9 = Entwine(Branch0X=pt_17, Branch1X=pt_19, FlattenInputs=False)  # disabled
entwine_10 = Entwine(Branch0X=pshift_40, Branch1X=pshift_42, FlattenInputs=False)  # disabled
srf_22 = Surface(entwine_10)  # disabled
adjust_orient_roty_2 = AdjustOrientRotY(brep=graft(sort_2.ValuesA), pt=move_35.Geometry)  # -> S, pt_4; disabled
brep_7 = Brep(adjust_orient_roty_2.S)  # disabled
pt_20 = Point(adjust_orient_roty_2.pt_4)  # disabled
edges_7 = BrepEdges(Brep=brep_7)  # -> Naked, Interior, NonManifold; disabled
join_12 = JoinCurves(Curves=edges_7.Naked, Preserve=False)  # disabled
explode_7 = Explode(Curve=join_12, Recursive=True)  # -> Segments, Vertices; disabled
points = PointList(Points=explode_7.Vertices, Size=number_slider_7)  # disabled
item_40 = ListItem(List=explode_7.Vertices, Index=0, Wrap=True)  # -> Item, Item1; disabled
item_41 = ListItem(List=explode_7.Vertices, Index=panel_26, Wrap=True)  # -> Item, Item1; disabled
item_42 = ListItem(List=crv_14, Index=panel_57, Wrap=True)  # disabled
ln_12 = Line(StartPoint=item_40.Item, EndPoint=item_41.Item1)  # disabled
ln_13 = Line(StartPoint=item_40.Item1, EndPoint=item_41.Item)  # disabled
rot3d_11 = Rotate3D(Geometry=item_42, Angle=panel_58, Center=avr_14, Axis=vec2pt_16.Vector)  # -> Geometry, Transform; disabled
rot3d_12 = Rotate3D(Geometry=ln_3, Angle=panel_59, Center=avr_15, Axis=vec2pt_17.Vector)  # -> Geometry, Transform; disabled
curvepoint_6 = PointOnCurve(rot3d_12.Geometry, parameter=0.5)  # disabled
curvepoint_7 = PointOnCurve(rot3d_11.Geometry, parameter=0.5)  # disabled
item_43 = ListItem(List=explode_7.Segments, Index=panel_24, Wrap=True)  # disabled
scale_5 = Scale(Geometry=rot3d_12.Geometry, Center=curvepoint_6, Factor=panel_27)  # -> Geometry, Transform; disabled
merge_51 = Merge(Data1=ln_12, Data2=ln_13, Data3=item_43)  # -> simplify(Result); disabled
vec2pt_18 = Vector2Pt(PointA=curvepoint_7, PointB=avr_14, Unitize=False)  # -> Vector, Length; disabled
vec2pt_19 = Vector2Pt(PointA=curvepoint_6, PointB=avr_15, Unitize=False)  # -> Vector, Length; disabled
amp_11 = Amplitude(Vector=vec2pt_18.Vector, Amplitude=panel_29)  # disabled
amp_12 = Amplitude(Vector=vec2pt_19.Vector, Amplitude=panel_29)  # disabled
scale_6 = Scale(Geometry=rot3d_11.Geometry, Center=curvepoint_7, Factor=panel_27)  # -> Geometry, Transform; disabled
move_36 = Move(Geometry=scale_5.Geometry, Motion=amp_12)  # -> Geometry, Transform; disabled
move_37 = Move(Geometry=scale_6.Geometry, Motion=amp_11)  # -> Geometry, Transform; disabled
merge_52 = Merge(Data1=move_37.Geometry, Data2=move_36.Geometry)  # disabled
cull_i_17 = CullIndex(List=explode_7.Segments, Indices=panel_24, Wrap=True)  # disabled
end_6 = EndPoints(Curve=merge_52)  # -> Start, End; disabled
merge_53 = Merge(Data1=end_6.Start, Data2=end_6.End)  # disabled
pt_21 = Point(entwine_9)  # disabled
cp_5 = ClosestPoint(Point=merge_53, Cloud=[end_2.Start, end_2.End])  # -> ClosestPoint, CPIndex, Distance; disabled
join_13 = JoinCurves(Curves=cull_i_17, Preserve=False)  # disabled
ln_14 = Line(StartPoint=merge_53, EndPoint=cp_5.ClosestPoint)  # disabled
end_7 = EndPoints(Curve=join_13)  # -> Start, End; disabled
merge_54 = Merge(Data1=simplify(merge_52), Data2=simplify(join_5), Data3=simplify(ln_14))  # disabled
viewer_13 = ParamViewer(merge_51)  # disabled
move_38 = Move(Geometry=pt_21, Motion=Z_7)  # -> Geometry, Transform; disabled
lng_19 = ListLength(List=viewer_13)  # disabled
join_14 = JoinCurves(Curves=merge_54, Preserve=False)  # disabled
line_10 = LineSDL(Start=move_38.Geometry, Direction=rev_5, Length=panel_32)  # disabled
viewer_14 = ParamViewer(join_14)  # disabled
merge_55 = Merge(Data1=simplify(rot3d_9.Geometry), Data2=simplify(rot3d_10.Geometry), Data3=simplify(cir_13))  # disabled
lng_20 = ListLength(List=viewer_14)  # disabled
series_13 = Series(Start=lng_20, Step=1, Count=lng_19)  # disabled
int_9 = Integer(series_13)  # disabled
replace_3 = ReplacePaths(Data=merge_51, Search=viewer_13, Replace=int_9)  # disabled

srf_23 = Surface(entwine_10)  # disabled
lng_21 = ListLength(List=srf_23)  # disabled
viewer_15 = ParamViewer(srf_23)  # disabled
series_14 = Series(Start=0, Step=1, Count=lng_21)  # disabled
int_10 = Integer(series_14)  # disabled
evalsrf_7 = EvaluateSurface(Surface=reparameterize(srf_23), Point=pt_6)  # -> Point, Normal, Frame; disabled
concat_4 = Concatenate(FragmentA=graft(viewer_15), FragmentB=int_10)  # disabled
move_39 = Move(Geometry=evalsrf_7.Point, Motion=X_3)  # -> Geometry, Transform; disabled
tag_18 = TextTag3D(Location=evalsrf_7.Point, Text=concat_4, Size=number_slider_21, Colour=swatch_5, Justification=1)  # disabled

panel_60 = Panel(".5")  # disabled
cir_14 = Circle(Plane=pt_20, Radius=panel_60)  # disabled

# ---- group: mirror circles
panel_61 = Panel("6")  # disabled
panel_62 = Panel("2")  # disabled
item_44 = ListItem(List=explode_7.Vertices, Index=panel_61, Wrap=True)  # -> Item, Item1; disabled
item_45 = ListItem(List=explode_7.Vertices, Index=panel_62, Wrap=True)  # -> Item, Item1; disabled
panel_63 = Panel("1")  # disabled
avr_16 = Average(Input=[item_44.Item, item_44.Item1])  # disabled
avr_17 = Average(Input=[item_45.Item, item_45.Item1])  # disabled
item_46 = ListItem(List=cir_14, Index=0, Wrap=True)  # disabled
item_47 = ListItem(List=cir_14, Index=panel_63, Wrap=True)  # disabled
vec2pt_20 = Vector2Pt(PointA=item_44.Item, PointB=item_44.Item1, Unitize=False)  # -> Vector, Length; disabled
vec2pt_21 = Vector2Pt(PointA=item_45.Item, PointB=item_45.Item1, Unitize=False)  # -> Vector, Length; disabled
panel_64 = Panel("Pi")  # disabled
panel_65 = Panel("Pi")  # disabled
rot3d_13 = Rotate3D(Geometry=item_46, Angle=panel_64, Center=avr_16, Axis=vec2pt_20.Vector)  # -> Geometry, Transform; disabled
rot3d_14 = Rotate3D(Geometry=item_47, Angle=panel_65, Center=avr_17, Axis=vec2pt_21.Vector)  # -> Geometry, Transform; disabled

# ----
filter_4 = StreamFilter(Gate=pattern, Stream0=weave_5, Stream1=weave_6, Stream2=int_8)
divide_14 = DivideCurve(Curve=crv_23, Count=filter_4, Kinks=False)  # -> Points, Tangents, Parameters
xprod = CrossProduct(VectorA=divide_14.Tangents, VectorB=Z_13, Unitize=False)  # -> Vector, Length
bishift = DoubleShift(list=simplify(xprod.Vector), wrap=Toggle(False))  # -> graft(no_last), graft(no_first)
shatter_4 = Shatter(Curve=crv_23, Parameters=divide_14.Parameters)
avr_18 = Average(Input=[bishift.no_last, bishift.no_first])
pshift_43 = ShiftPaths(Data=avr_18, Offset=-1)

lng_22 = ListLength(List=shatter_4)
# substitution pattern (for the installation)
panel_66 = Panel("""True
False""")
parts_to_invert_all_staples_2 = Panel("""{0;3;0;0}
{1;0;0;0}
{1;0;0;1}
{1;1;0;0}
{1;2;1;0}
{1;2;1;1}
{1;3;1;0}
{1;3;1;1}
{1;3;2;1}""")
lng_23 = ListLength(List=lng_22)
dup_3 = DuplicateData(Data=panel_66, Number=lng_23, Order=True)  # -> simplify(Data)
parts_to_invert = Panel("""{1;2;1;0}
{1;3;1;0}""")
viewer_16 = ParamViewer(dup_3)
branch_4 = TreeBranch(Tree=simplify(dup_3), Path=parts_to_invert_all_staples_2, MaintainPaths=True)
panel_67 = Panel(viewer_16)
not = GateNot(A=branch_4)
mindex = MemberIndex(Set=panel_67, Member=parts_to_invert_all_staples_2)  # -> flatten(Index), Count
cull_i_18 = CullIndex(List=viewer_16, Indices=mindex.Index, Wrap=True)
branch_5 = TreeBranch(Tree=dup_3, Path=cull_i_18, MaintainPaths=True)
pattern_2 = ValueList({"Regular": 0, "Custom": 1}, selected="Regular")
merge_56 = Merge(Data1=branch_5, Data2=not)
filter_5 = StreamFilter(Gate=pattern_2, Stream0=dup_3, Stream1=merge_56)

# ----
# reparametrize + graft
# sub-list takes only the elements
# up to index 1
# another way of reversing lists
# or we can use a split list
# since we'll need also the
# other curves
edges_8 = BrepEdges(Brep=srf_22)  # -> Naked, Interior, NonManifold; disabled
len_6 = Length(Curve=edges_8.Naked)  # disabled
sort_8 = SortList(Keys=len_6, ValuesA=edges_8.Naked)  # -> Keys, reverse(ValuesA); disabled
panel_68 = Panel("2")  # disabled
panel_69 = Panel("1")  # disabled
split_4 = SplitList(List=sort_8.ValuesA, Index=panel_68)  # -> ListA, ListB; disabled
subset_2 = SubList(List=sort_8.ValuesA, Domain=panel_69, Wrap=True)  # -> List, Index; disabled
jig_length_2 = Slider(4, range=0..10)  # disabled
crv_26 = Curve(reparameterize(graft(split_4.ListA)))  # disabled
len_7 = Length(Curve=crv_26)  # disabled
division_7 = Division(A=len_7, B=jig_length_2)  # disabled
int_11 = Integer(division_7)  # disabled
divide_15 = DivideCurve(Curve=crv_26, Count=int_11, Kinks=False)  # -> Points, Tangents, Parameters; disabled
Z_15 = UnitZ(Factor=1)  # disabled
shatter_5 = Shatter(Curve=crv_26, Parameters=divide_15.Parameters)  # disabled
xprod_2 = CrossProduct(VectorA=divide_15.Tangents, VectorB=Z_15, Unitize=False)  # -> Vector, Length; disabled
toggle_7 = BooleanToggle(False)  # disabled
bishift_2 = DoubleShift(list=simplify(xprod_2.Vector), wrap=toggle_7)  # -> graft(no_last), graft(no_first); disabled
avr_19 = Average(Input=[bishift_2.no_last, bishift_2.no_first])  # disabled
pshift_44 = ShiftPaths(Data=avr_19, Offset=-1)  # disabled
number_slider_31 = Slider(1.1, range=1..1.2)  # disabled
crv_27 = Curve(simplify(split_4.ListB))  # disabled

swatch_11 = ColourSwatch(SwatchColor=RGB(0, 0, 0))  # disabled
number_slider_32 = Slider(13.732, range=0..20)  # disabled
crv_28 = Curve(split_4.ListA)  # disabled
curvepoint_8 = PointOnCurve(crv_28, parameter=0.5)  # disabled
panel_70 = Panel("""0
1""")  # disabled
tag_19 = TextTag3D(Location=curvepoint_8, Text=panel_70, Size=number_slider_32, Colour=swatch_11, Justification=5)  # disabled

mod_2 = Modulus(A=int_11, B=2)  # disabled
dispatch_12 = Dispatch(List=int_11, DispatchPattern=mod_2)  # -> ListA, ListB; disabled
addition_8 = Addition(A=dispatch_12.ListB, B=1)  # disabled
subtraction_9 = Subtraction(A=dispatch_12.ListA, B=1)  # disabled
weave_7 = Weave(Pattern=mod_2, Stream0=dispatch_12.ListB, Stream1=subtraction_9, NullGaps=False)  # disabled
weave_8 = Weave(Pattern=mod_2, Stream0=addition_8, Stream1=dispatch_12.ListA, NullGaps=False)  # disabled
all_odd_divisions_2 = Panel(weave_8)  # disabled
all_even_divisions_2 = Panel(weave_7)  # disabled

lng_24 = ListLength(List=shatter_5)  # disabled
panel_71 = Panel("""True
False""")  # disabled
lng_25 = ListLength(List=lng_24)  # disabled
dup_4 = DuplicateData(Data=panel_71, Number=lng_25, Order=True)  # -> simplify(Data); disabled
viewer_17 = ParamViewer(dup_4)  # disabled
parts_to_invert_2 = Panel("""{1;2;1;0}
{1;3;1;0}""")  # disabled
branch_6 = TreeBranch(Tree=simplify(shatter_5), Path=parts_to_invert_all_staples, MaintainPaths=True)  # disabled
branch_7 = TreeBranch(Tree=simplify(dup_4), Path=parts_to_invert_all_staples, MaintainPaths=True)  # disabled
panel_72 = Panel(viewer_17)  # disabled
not_2 = GateNot(A=branch_7)  # disabled
crv_29 = Curve(branch_6)  # disabled
mindex_2 = MemberIndex(Set=panel_72, Member=parts_to_invert_all_staples)  # -> flatten(Index), Count; disabled
cull_i_19 = CullIndex(List=viewer_17, Indices=mindex_2.Index, Wrap=True)  # disabled
branch_8 = TreeBranch(Tree=dup_4, Path=cull_i_19, MaintainPaths=True)  # disabled
merge_57 = Merge(Data1=branch_8, Data2=not_2)  # disabled

dispatch_13 = Dispatch(List=simplify(shatter_4), DispatchPattern=simplify(filter_5))  # -> ListA, ListB
dispatch_14 = Dispatch(List=simplify(pshift_43), DispatchPattern=simplify(filter_5))  # -> ListA, ListB
move_40 = Move(Geometry=dispatch_13.ListA, Motion=dispatch_14.ListA)  # -> Geometry, Transform
curvepoint_9 = PointOnCurve(move_40.Geometry, parameter=0.5)
scale_7 = Scale(Geometry=move_40.Geometry, Center=curvepoint_9, Factor=Slider(1.1, range=1..1.2))  # -> Geometry, Transform
end_8 = EndPoints(Curve=dispatch_13.ListA)  # -> Start, End
end_9 = EndPoints(Curve=scale_7.Geometry)  # -> Start, End
ln_15 = Line(StartPoint=end_8.Start, EndPoint=end_9.Start)
ln_16 = Line(StartPoint=end_8.End, EndPoint=end_9.End)
merge_58 = Merge(Data1=dispatch_13.ListB, Data2=ln_15, Data3=scale_7.Geometry, Data4=ln_16)
pshift_45 = ShiftPaths(Data=merge_58, Offset=-1)

merge_59 = Merge(Data1=pshift_45, Data2=crv_24)
join_15 = JoinCurves(Curves=merge_59, Preserve=False)  # -> simplify(Curves)

# ----
# jigsaws
previewlw_11 = CustomPreviewLineweights(Geometry=join_15, Shader=ColourSwatch(SwatchColor=RGB(255, 0, 0)), Thickness=Slider(2, range=1..3), Absolute=False)

viewer_18 = ParamViewer(join_15)

bool = Boolean(merge_57)  # disabled
rot3d_15 = Rotate3D(Geometry=ln_12, Angle=panel_64, Center=avr_16, Axis=vec2pt_20.Vector)  # -> Geometry, Transform; disabled
rot3d_16 = Rotate3D(Geometry=ln_13, Angle=panel_65, Center=avr_17, Axis=vec2pt_21.Vector)  # -> Geometry, Transform; disabled
curvepoint_10 = PointOnCurve(rot3d_16.Geometry, parameter=0.5)  # disabled
curvepoint_11 = PointOnCurve(rot3d_15.Geometry, parameter=0.5)  # disabled
scale_8 = Scale(Geometry=rot3d_16.Geometry, Center=curvepoint_10, Factor=panel_28)  # -> Geometry, Transform; disabled
vec2pt_22 = Vector2Pt(PointA=curvepoint_11, PointB=avr_16, Unitize=False)  # -> Vector, Length; disabled
vec2pt_23 = Vector2Pt(PointA=curvepoint_10, PointB=avr_17, Unitize=False)  # -> Vector, Length; disabled
vdisex_4 = VectorDisplayEx(Point=curvepoint_11, Vector=vec2pt_22.Vector, Colour=RGB(0, 0, 0), Width=2)  # disabled
amp_13 = Amplitude(Vector=vec2pt_22.Vector, Amplitude=panel_30)  # disabled
amp_14 = Amplitude(Vector=vec2pt_23.Vector, Amplitude=panel_30)  # disabled
scale_9 = Scale(Geometry=rot3d_15.Geometry, Center=curvepoint_11, Factor=panel_28)  # -> Geometry, Transform; disabled
move_41 = Move(Geometry=scale_9.Geometry, Motion=amp_13)  # -> Geometry, Transform; disabled
move_42 = Move(Geometry=scale_8.Geometry, Motion=amp_14)  # -> Geometry, Transform; disabled
merge_60 = Merge(Data1=move_41.Geometry, Data2=move_42.Geometry)  # disabled
match_6 = MatchTree(Tree=cir_14, Guide=simplify(rot3d_13.Geometry))  # disabled
end_10 = EndPoints(Curve=merge_60)  # -> Start, End; disabled
merge_61 = Merge(Data1=simplify(rot3d_13.Geometry), Data2=simplify(rot3d_14.Geometry), Data3=simplify(match_6))  # disabled
merge_62 = Merge(Data1=end_10.Start, Data2=end_10.End)  # disabled
cp_6 = ClosestPoint(Point=merge_62, Cloud=[end_7.Start, end_7.End])  # -> ClosestPoint, CPIndex, Distance; disabled
viewer_19 = ParamViewer(merge_61)  # disabled
ln_17 = Line(StartPoint=merge_62, EndPoint=cp_6.ClosestPoint)  # disabled
lng_26 = ListLength(List=viewer_19)  # disabled
series_15 = Series(Start=lng_20, Step=1, Count=lng_26)  # disabled
merge_63 = Merge(Data1=simplify(merge_60), Data2=simplify(join_13), Data3=simplify(ln_17))  # disabled
int_12 = Integer(series_15)  # disabled
join_16 = JoinCurves(Curves=merge_63, Preserve=False)  # disabled
replace_4 = ReplacePaths(Data=merge_61, Search=viewer_19, Replace=int_12)  # disabled
merge_64 = Merge(Data1=flatten(join_14), Data2=flatten(join_16))  # -> graft(Result); disabled
merge_65 = Merge(Data1=merge_55, Data2=replace_4)  # disabled

dispatch_15 = Dispatch(List=simplify(pshift_44), DispatchPattern=simplify(bool))  # -> ListA, ListB; disabled
dispatch_16 = Dispatch(List=simplify(shatter_5), DispatchPattern=simplify(bool))  # -> ListA, ListB; disabled
move_43 = Move(Geometry=dispatch_16.ListA, Motion=dispatch_15.ListA)  # -> Geometry, Transform; disabled
curvepoint_12 = PointOnCurve(move_43.Geometry, parameter=0.5)  # disabled
scale_10 = Scale(Geometry=move_43.Geometry, Center=curvepoint_12, Factor=number_slider_31)  # -> Geometry, Transform; disabled
end_11 = EndPoints(Curve=dispatch_16.ListA)  # -> Start, End; disabled
end_12 = EndPoints(Curve=scale_10.Geometry)  # -> Start, End; disabled
ln_18 = Line(StartPoint=end_11.Start, EndPoint=end_12.Start)  # disabled
ln_19 = Line(StartPoint=end_11.End, EndPoint=end_12.End)  # disabled
merge_66 = Merge(Data1=dispatch_16.ListB, Data2=ln_18, Data3=scale_10.Geometry, Data4=ln_19)  # disabled
pshift_46 = ShiftPaths(Data=merge_66, Offset=-1)  # disabled

curvepoint_13 = PointOnCurve(dispatch_16.ListB, parameter=0.5)  # disabled
pt_22 = Point(simplify(curvepoint_13))  # disabled
number_slider_33 = Slider(7, range=2..10)  # disabled
panel_73 = Panel("True")  # disabled
viewer_20 = ParamViewer(pt_22)  # disabled
not_3 = GateNot(A=panel_73)  # disabled
dispatch_17 = Dispatch(List=viewer_20, DispatchPattern=[True, False])  # -> ListA, ListB; disabled
repeat_2 = RepeatData(Data=not_3, Length=number_slider_33)  # -> flatten(Data); disabled
number_slider_34 = Slider(5, range=2..10)  # disabled
number_slider_35 = Slider(6, range=2..10)  # disabled
panel_74 = Panel("1")  # disabled
branch_9 = TreeBranch(Tree=pt_22, Path=dispatch_17.ListA, MaintainPaths=True)  # disabled
branch_10 = TreeBranch(Tree=pt_22, Path=dispatch_17.ListB, MaintainPaths=True)  # disabled
subtraction_10 = Subtraction(A=number_slider_33, B=panel_74)  # disabled
merge_67 = Merge(Data1=panel_73, Data2=repeat_2)  # disabled
path_mapper_2 = PathMapper(branch_10, source="{A;B;C;D}", target="{A;B;C;0}")  # disabled
shift_17 = ShiftList(List=merge_67, Shift=number_slider_34, Wrap=True)  # disabled
shift_18 = ShiftList(List=shift_17, Shift=number_slider_35, Wrap=True)  # disabled
panel_75 = Panel(shift_18)  # disabled
panel_76 = Panel(shift_17)  # disabled
panel_77 = Panel(merge_67)  # disabled
pt_23 = Point(reverse(path_mapper_2))  # disabled
merge_68 = Merge(Data1=graft(branch_9), Data2=graft(pt_23))  # disabled
entwine_11 = Entwine(Branch00=merge_67, Branch01=shift_17, Branch02=shift_18, FlattenInputs=True)  # disabled
viewer_21 = ParamViewer(entwine_11)  # disabled
pline_8 = PolyLine(Vertices=merge_68, Closed=False)  # disabled
pshift_47 = ShiftPaths(Data=pline_8, Offset=-1)  # -> simplify(Data); disabled
entwine_12 = Entwine(Branch0X=entwine_11, Branch1X=entwine_11, Branch2X=entwine_11, Branch3X=entwine_11, FlattenInputs=False)  # -> simplify(Result); disabled
entwine_13 = Entwine(Branch0X=entwine_12, Branch1X=entwine_12, FlattenInputs=False)  # disabled
viewer_22 = ParamViewer(pshift_47)  # disabled
join_17 = JoinCurves(Curves=pshift_46, Preserve=False)  # disabled
cull = CullPattern(List=pshift_47, CullPattern=entwine_13)  # disabled
viewer_23 = ParamViewer(entwine_13)  # disabled
item_48 = ListItem(List=join_17, Index=0, Wrap=True)  # -> Item, Item1; disabled
ccx = CurveCurve(CurveA=item_48.Item1, CurveB=cull)  # -> Points, ParamsA, ParamsB; disabled
ccx_2 = CurveCurve(CurveA=item_48.Item, CurveB=cull)  # -> Points, ParamsA, ParamsB; disabled
pshift_48 = ShiftPaths(Data=ccx.ParamsA, Offset=-1)  # disabled
pshift_49 = ShiftPaths(Data=ccx_2.ParamsA, Offset=-1)  # disabled
shatter_6 = Shatter(Curve=item_48.Item1, Parameters=pshift_48)  # -> reverse(simplify(Segments)); disabled
shatter_7 = Shatter(Curve=item_48.Item, Parameters=pshift_49)  # -> simplify(Segments); disabled
end_13 = EndPoints(Curve=shatter_6)  # -> Start, End; disabled
end_14 = EndPoints(Curve=shatter_7)  # -> Start, End; disabled
ln_20 = Line(StartPoint=end_14.End, EndPoint=end_13.Start)  # -> simplify(Line); disabled
ln_21 = Line(StartPoint=end_14.Start, EndPoint=end_13.End)  # -> simplify(Line); disabled
merge_69 = Merge(Data1=graft(shatter_7), Data2=graft(ln_21), Data3=graft(ln_20), Data4=graft(shatter_6))  # disabled
join_18 = JoinCurves(Curves=merge_69, Preserve=False)  # disabled
pshift_50 = ShiftPaths(Data=join_18, Offset=-2)  # -> simplify(Data); disabled

number_slider_36 = Slider(1, range=1..3)  # disabled
swatch_12 = ColourSwatch(SwatchColor=RGB(255, 255, 255))  # disabled
previewlw_12 = CustomPreviewLineweights(Geometry=join_18, Shader=swatch_12, Thickness=number_slider_36, Absolute=False)  # disabled

srf_24 = Surface(reparameterize(graft(entwine_10)))  # disabled
crv_30 = Curve(cull)  # disabled
end_15 = EndPoints(Curve=crv_30)  # -> Start, End; disabled
srf_cp = SurfaceClosestPoint(Point=end_15.Start, Surface=srf_24)  # -> Point, UVPoint, Distance; disabled
srf_cp_2 = SurfaceClosestPoint(Point=end_15.End, Surface=srf_24)  # -> Point, UVPoint, Distance; disabled
srf_25 = Surface(reparameterize(graft(entwine_5)))  # disabled
lng_27 = ListLength(List=srf_cp.UVPoint)  # disabled
repeat_3 = RepeatData(Data=srf_25, Length=lng_27)  # -> simplify(graft(Data)); disabled
merge_70 = Merge(Data1=graft(srf_cp.UVPoint), Data2=graft(srf_cp_2.UVPoint))  # disabled

merge_71 = Merge(Data1=pshift_46, Data2=crv_27)  # disabled
join_19 = JoinCurves(Curves=merge_71, Preserve=False)  # -> simplify(Curves); disabled
crv_31 = Curve(graft(pshift_50))  # disabled
srf_26 = Surface(crv_31)  # disabled
blx_2 = BrepLine(Brep=srf_26, Line=flatten(line_10), LimitToFirst=False)  # -> Curves, Points; disabled
pshift_51 = ShiftPaths(Data=blx_2.Points, Offset=-1)  # disabled
cir_15 = Circle(Plane=pshift_51, Radius=panel_33)  # disabled
crvsrf = CurveOnSurface(Surface=repeat_3, UVCoordinates=merge_70, Closed=False)  # -> Curve, Length, Domain; disabled
pshift_52 = ShiftPaths(Data=crvsrf.Curve, Offset=-1)  # disabled

viewer_24 = ParamViewer(join_19)  # disabled

number_slider_37 = Slider(2, range=1..3)  # disabled
swatch_13 = ColourSwatch(SwatchColor=RGB(255, 0, 0))  # disabled
previewlw_13 = CustomPreviewLineweights(Geometry=join_19, Shader=swatch_13, Thickness=number_slider_37, Absolute=False)  # disabled

# ----
# inter-beam connections
curvepoint_14 = PointOnCurve(dispatch_13.ListB, parameter=0.5)
not_4 = GateNot(A="True")
pt_24 = Point(simplify(curvepoint_14))
repeat_4 = RepeatData(Data=not_4, Length=Slider(7, range=2..10))  # -> flatten(Data)
merge_72 = Merge(Data1="True", Data2=repeat_4)
shift_19 = ShiftList(List=merge_72, Shift=Slider(5, range=2..10), Wrap=True)
shift_20 = ShiftList(List=shift_19, Shift=Slider(6, range=2..10), Wrap=True)
entwine_14 = Entwine(Branch00=merge_72, Branch01=shift_19, Branch02=shift_20, FlattenInputs=True)
viewer_25 = ParamViewer(entwine_14)
entwine_15 = Entwine(Branch0X=entwine_14, Branch1X=entwine_14, Branch2X=entwine_14, Branch3X=entwine_14, FlattenInputs=False)  # -> simplify(Result)
entwine_16 = Entwine(Branch0X=entwine_15, Branch1X=entwine_15, FlattenInputs=False)
viewer_26 = ParamViewer(entwine_16)
join_20 = JoinCurves(Curves=pshift_45, Preserve=False)
item_49 = ListItem(List=join_20, Index=0, Wrap=True)  # -> Item, Item1

# ----
# reverse list on left side to have symmetric lines
panel_78 = Panel("{<=0;*}")
split_5 = SplitTree(Data=pt_24, Masks=flatten(panel_78))  # -> Positive, Negative
rev_8 = ReverseList(List=split_5.Negative)
merge_73 = Merge(Data1=split_5.Positive, Data2=rev_8)

viewer_27 = ParamViewer(merge_73)
dispatch_18 = Dispatch(List=viewer_27, DispatchPattern=[True, False])  # -> ListA, ListB
branch_11 = TreeBranch(Tree=merge_73, Path=dispatch_18.ListA, MaintainPaths=True)
branch_12 = TreeBranch(Tree=merge_73, Path=dispatch_18.ListB, MaintainPaths=True)
path_mapper_3 = PathMapper(branch_12, source="{A;B;C;D}", target="{A;B;C;0}")
pt_25 = Point(reverse(path_mapper_3))
merge_74 = Merge(Data1=graft(branch_11), Data2=graft(pt_25))
pline_9 = PolyLine(Vertices=merge_74, Closed=False)
pshift_53 = ShiftPaths(Data=pline_9, Offset=-1)  # -> simplify(Data)
viewer_28 = ParamViewer(pshift_53)
cull_2 = CullPattern(List=pshift_53, CullPattern=entwine_16)
curvepoint_15 = PointOnCurve(cull_2, parameter=0.5)
scale_11 = Scale(Geometry=cull_2, Center=curvepoint_15, Factor=Slider(1.01, range=0..10))  # -> Geometry, Transform
ccx_3 = CurveCurve(CurveA=item_49.Item1, CurveB=scale_11.Geometry)  # -> Points, ParamsA, ParamsB
ccx_4 = CurveCurve(CurveA=item_49.Item, CurveB=scale_11.Geometry)  # -> Points, ParamsA, ParamsB
pshift_54 = ShiftPaths(Data=ccx_3.ParamsA, Offset=-1)
pshift_55 = ShiftPaths(Data=ccx_4.ParamsA, Offset=-1)
shatter_8 = Shatter(Curve=item_49.Item1, Parameters=pshift_54)  # -> reverse(simplify(Segments))
shatter_9 = Shatter(Curve=item_49.Item, Parameters=pshift_55)  # -> simplify(Segments)
end_16 = EndPoints(Curve=shatter_8)  # -> Start, End
end_17 = EndPoints(Curve=shatter_9)  # -> Start, End
ln_22 = Line(StartPoint=end_17.Start, EndPoint=end_16.End)  # -> simplify(Line)
ln_23 = Line(StartPoint=end_17.End, EndPoint=end_16.Start)  # -> simplify(Line)
merge_75 = Merge(Data1=graft(shatter_9), Data2=graft(ln_22), Data3=graft(ln_23), Data4=graft(shatter_8))
join_21 = JoinCurves(Curves=merge_75, Preserve=False)
pshift_56 = ShiftPaths(Data=join_21, Offset=-2)  # -> simplify(Data)

shift_21 = ShiftList(List=entwine_15, Shift=dup, Wrap=True)  # -> simplify(List)
rev_9 = ReverseList(List=shift_21)
entwine_17 = Entwine(Branch0X=shift_21, Branch1X=rev_9, FlattenInputs=False)
ccx_5 = CurveCurve(CurveA=graft(crv_22), CurveB=flatten(cull_2))  # -> Points, ParamsA, ParamsB
pshift_57 = ShiftPaths(Data=ccx_5.ParamsA, Offset=-1)
lng_28 = ListLength(List=pshift_57)
larger = LargerThan(FirstNumber=lng_28, SecondNumber="0")  # -> LargerThan, OrEqualTo
dispatch_19 = Dispatch(List=graft(crv_22), DispatchPattern=larger.LargerThan)  # -> ListA, ListB
shatter_10 = Shatter(Curve=dispatch_19.ListA, Parameters=pshift_57)
weave_9 = Weave(Pattern=larger.LargerThan, Stream0=dispatch_19.ListB, Stream1=shatter_10, NullGaps=False)  # -> flatten(Weave)
crv_32 = Curve(graft(weave_9))
curvepoint_16 = PointOnCurve(weave_9, parameter=0.5)

# ----
# SLOW
# > 30 sec
incurves = PointInCurves(Point=graft(curvepoint_16), Curves=flatten(join_21))  # -> Relationship, Index, Point

lng_29 = ListLength(List=flatten(join_21))

# ----
# sub-components
swatch_14 = ColourSwatch(SwatchColor=RGB(0, 0, 0))
previewlw_14 = CustomPreviewLineweights(Geometry=join_21, Shader=swatch_14, Thickness=Slider(1, range=1..3), Absolute=False)

series_16 = Series(Start=0, Step=1, Count=lng_29)
int_13 = Integer(series_16)
mindex_3 = MemberIndex(Set=flatten(incurves.Index), Member=int_13)  # -> Index, Count
item_50 = ListItem(List=weave_9, Index=mindex_3.Index, Wrap=True)
# tattoo unrolled and
# divided by sub-components
match_7 = MatchTree(Tree=item_50, Guide=join_21)  # -> simplify(Tree)

srf_27 = Surface(reparameterize(srf_17))
crv_33 = Curve(cull_2)
end_18 = EndPoints(Curve=crv_33)  # -> Start, End
srf_cp_3 = SurfaceClosestPoint(Point=end_18.Start, Surface=srf_27)  # -> Point, UVPoint, Distance
srf_cp_4 = SurfaceClosestPoint(Point=end_18.End, Surface=srf_27)  # -> Point, UVPoint, Distance
srf_28 = Surface(reparameterize(graft(srf_3)))
lng_30 = ListLength(List=srf_cp_3.UVPoint)
repeat_5 = RepeatData(Data=srf_28, Length=lng_30)  # -> simplify(graft(Data))
merge_76 = Merge(Data1=graft(srf_cp_3.UVPoint), Data2=graft(srf_cp_4.UVPoint))

crv_34 = Curve(graft(pshift_56))
srf_29 = Surface(crv_34)
crvsrf_2 = CurveOnSurface(Surface=repeat_5, UVCoordinates=merge_76, Closed=False)  # -> Curve, Length, Domain
blx_3 = BrepLine(Brep=srf_29, Line=flatten(line_7), LimitToFirst=False)  # -> Curves, Points
pshift_58 = ShiftPaths(Data=crvsrf_2.Curve, Offset=-1)
pshift_59 = ShiftPaths(Data=blx_3.Points, Offset=-1)
cir_16 = Circle(Plane=pshift_59, Radius=holes_radius)

# ----
# holes
previewlw_15 = CustomPreviewLineweights(Geometry=cir_16, Shader=ColourSwatch(SwatchColor=RGB(0, 0, 0)), Thickness=Slider(1, range=1..3), Absolute=False)

# ----
# tagging
crv_35 = Curve(pshift_56)
viewer_29 = ParamViewer(crv_35)
lng_31 = ListLength(List=crv_35)
disc_2 = Discontinuity(Curve=crv_35, Level=1)  # -> Points, Parameters
series_17 = Series(Start=0, Step=1, Count=lng_31)
int_14 = Integer(simplify(series_17))
font = ValueList({"Machine Tool Gothic", "Machine Tool SanSerif"}, selected="Machine Tool Gothic")
number_slider_38 = Slider(220, range=1..500)
number_slider_39 = Slider(1.5, range=0..100)

dpath_3 = DeconstructPath(Branch=viewer_29)
avr_20 = Average(Input=disc_2.Points)
pshift_60 = ShiftPaths(Data=avr_20, Offset=-1)

item_51 = ListItem(List=dpath_3, Index=0, Wrap=True)  # -> Item, Item1, Item2
expression_5 = Expression(x=item_51.Item, y=item_51.Item1, z=item_51.Item2, Expression="Format(\"{0}.{1}.{2}_\", x, y,z)")  # -> flatten(R)
concat_5 = Concatenate(FragmentA=graft(expression_5), FragmentB=int_14)
fpars = FontParser(S=concat_5, font=font, size=number_slider_39, prec=number_slider_38, P=pshift_60, J="4")  # -> out, C; inputs S: String, font: String, close: Boolean, size: Double, prec: Double, P: Plane, J: Int32
# ---------- fpars: C# ----------
        /*
    Font Parser
    Adaptation of code written by David Rutten, Giulio Piacentino et al.
    Adaptation for C# by Alessio Erioli - Co-de-iT
    */

    Component.Name = "Font Parser";
    Component.NickName = "FPars";
    Component.Description = "converts text into polylines - useful for fabrication";
    Component.Params.Input[0].Description = "text to convert";
    Component.Params.Input[1].Description = "text font";
    Component.Params.Input[2].Description = "close polylines (optional)";
    Component.Params.Input[3].Description = "text size";
    Component.Params.Input[4].Description = "sampling precision (usually 100-250 is ok)";
    Component.Params.Input[5].Description = "destination plane";
    Component.Params.Input[6].Description = "text justification (0-8)";


    float fS = size == 0 ? 1 : (float) size;
    System.Drawing.Font local_font = new System.Drawing.Font(font, (float) fS);

    System.Drawing.Drawing2D.GraphicsPath path = new System.Drawing.Drawing2D.GraphicsPath();
    path.AddString(S, local_font.FontFamily, (int) local_font.Style, local_font.Size, new PointF(0, 0), new StringFormat());

    System.Drawing.Drawing2D.Matrix matrix = new  System.Drawing.Drawing2D.Matrix(); // transformation matrix
    matrix.Reset(); // build identity matrix

    // ______________ text justification ______________

    RectangleF rec = path.GetBounds(); // bounding rectangle for text
    float dX = Convert.ToSingle(rec.Width * -0.5), dY = Convert.ToSingle(rec.Height * 0.5);
    switch(J){
      case 0:// top left
        dX = 0;
        dY = fS;
        break;
      case 1: // middle left
        dX = 0;
        dY = Convert.ToSingle((-rec.Height) * 0.5 + fS);
        break;
      case 2:  // bottom left
        dX = 0;
        dY = Convert.ToSingle(-rec.Height + fS * 0.5);
        break;
      case 3: // top center
        dX = Convert.ToSingle(rec.Width * -0.5);
        dY = fS;
        break;
      case 4: // middle center
        dX = Convert.ToSingle(rec.Width * -0.5);
        dY = Convert.ToSingle((-rec.Height) * 0.5 + fS);
        break;
      case 5: // bottom center
        dX = Convert.ToSingle(rec.Width * -0.5);
        dY = Convert.ToSingle(-rec.Height + fS * 0.5);
        break;
      case 6: // top right
        dX = Convert.ToSingle(rec.Width * -1);
        dY = fS;
        break;
      case 7: // middle right
        dX = Convert.ToSingle(rec.Width * -1);
        dY = Convert.ToSingle((-rec.Height) * 0.5 + fS);
        break;
      case 8: // bottom right
        dX = Convert.ToSingle(rec.Width * -1);
        dY = Convert.ToSingle(-rec.Height + fS * 0.5);
        break;

    }
    //float dX = Convert.ToSingle(rec.Width * -0.5);
    //float dY = Convert.ToSingle(rec.Height * 0.5);
    System.Drawing.Drawing2D.Matrix mTrans = new  System.Drawing.Drawing2D.Matrix(1, 0, 0, 1, dX, dY); // build transformation matrix
    path.Transform(mTrans); // transform text path

    // ______________ convert to polylines ______________

    path.Flatten(matrix, (float) (size / prec)); // turns the path into a polyline that approximates the path

    PointF[] pts = path.PathPoints; // get path points
    Byte[] tps = path.PathTypes;   // get path point types
    List<Polyline> strokes = new  List<Polyline>(); // List for strokes
    Polyline stroke = new Polyline();

    Byte typ_start = Convert.ToByte(System.Drawing.Drawing2D.PathPointType.Start);// find start points condition

    // the conversion loop
    for (int i = 0; i < pts.Length; i++){
      // if a start point is found, and the existing polyline is not null nor a single point,
      // add polyline to the strokes and create a new polyline
      if(tps[i] == typ_start){
        if (stroke != null && stroke.Count > 1) {
          if (close) stroke.Add(stroke[0]); // close polyline if necessary
          strokes.Add(stroke);}
        stroke = new Polyline();
      }
      // in any other case add the next point to a polyline
      stroke.Add(pts[i].X, -pts[i].Y + size, 0);
      // add last stroke to the list
      if (i == pts.Length - 1) {
        if (close) stroke.Add(stroke[0]); // and close it if necessary
        strokes.Add(stroke);
      }
    }


    // ______________ align strokes to given plane ______________

    Transform align = Transform.PlaneToPlane(Plane.WorldXY, P); // align transformation
    for(int j = 0; j < strokes.Count; j++){
      strokes[j].Transform(align);
    }

    C = strokes;
# ---------- end fpars ----------

# ----
# division curves (on model)
number_slider_40 = Slider(2, range=0..100)
tag_20 = TextTag3D(Location=pshift_60, Text=concat_5, Size=number_slider_40, Colour=ColourSwatch(SwatchColor=RGB(0, 0, 0)), Justification=5)

fpars_2 = FontParser(S=merge_27, font=font, size=number_slider_39, prec=number_slider_38, P=merge_28, J="4")  # -> out, C; inputs S: String, font: String, close: Boolean, size: Double, prec: Double, P: Plane, J: Int32; same code as fpars
crv_36 = Curve(simplify(fpars_2.C))
merge_77 = Merge(Data1=merge, Data2=replace_2, Data3=crv_36)
move_44 = Move(Geometry=merge_77, Motion=Y_2)  # -> Geometry, Transform

# ----
# beams
# automated layer separation and grouping for automated nesting
# outer cuts
# inner cuts
# engrave
# engrave text
crv_37 = Curve(crv_34)
crv_38 = Curve(cir_16)
crv_39 = Curve(match_7)
crv_40 = Curve(fpars.C)

# ----
# connectors
# outer cuts
# inner cuts
# engrave
# engrave text
crv_41 = Curve(move_19.Geometry)
crv_42 = Curve(move_20.Geometry)
crv_43 = Curve()
crv_44 = Curve(move_44.Geometry)

# ----
# curves
# the Bakery: obj - objects to bake
# name - objects names (optional)
# layer - objects layer (optional)
# color - objects color (optional)
# pWidth - polylines width (optional)
# wires
# material - objects material (optional)
# group_n - group number (mandatory if you want to bake in groups - see also note below)
# group - boolean toggle to bake in groups (one group for each tree branch)
# bake_iT - button: hit once to bake ALL
# NOTE: please erase all groups from the Rhino file before baking.
# If unsure copy the polylines in a new file before referencing them in this part of the definition to avoid previous groups.
# Insert here the polylines if not generated in this definition.
# 
# There should be one tree branch for each piece to be cut.
# 
# Example: 3 pieces (each with outer cuts, inner cuts, engraving and text)
# 
# For each of those works I'll have a datat tree with 3 branches, {0}, {1} e {2}.
# 
# In the "outer cuts" component I'll put all the polylines for outer cuts, in branch {0} the ones relative to the first component, branch {1} those relative to the second one and so on. Same structure for all other works.
# 
# Maintaining this order is necessary for a correct group bake and thus use Rhinonest
# outer cuts
# inner cuts
# engrave
# engrave text
lng_32 = ListLength(List=crv_37)
lng_33 = ListLength(List=crv_38)
lng_34 = ListLength(List=crv_39)
lng_35 = ListLength(List=crv_40)
swatch_15 = ColourSwatch(SwatchColor=RGB(0, 0, 255))
swatch_16 = ColourSwatch(SwatchColor=RGB(0, 0, 0))
layers_names = Panel("""be_outer_cut
be_inner_cut
be_engrave
be_engrave_txt""")
merge_78 = Merge(Data1=simplify(lng_32), Data2=simplify(lng_33), Data3=simplify(lng_34), Data4=simplify(lng_35))
merge_79 = Merge(Data1=simplify(crv_37), Data2=simplify(crv_38), Data3=simplify(crv_39), Data4=simplify(crv_40))
preview = CustomPreview(Geometry=crv_37, Shader=ColourSwatch(SwatchColor=RGB(255, 0, 0)))
preview_2 = CustomPreview(Geometry=crv_38, Shader=ColourSwatch(SwatchColor=RGB(0, 255, 0)))
preview_3 = CustomPreview(Geometry=crv_39, Shader=swatch_15)
preview_4 = CustomPreview(Geometry=crv_40, Shader=swatch_15)
tstat = TreeStatistics(Tree=merge_79)  # -> Paths, Length, Count
stack = StackData(Data=layers_names, Stack=merge_78)
series_18 = Series(Start=0, Step=1, Count=tstat.Count)
group_4 = BooleanToggle(True)
int_15 = Integer(simplify(graft(series_18)))
bakeatt = BakeAttributesEnhanced(obj=merge_79, layer=stack, group_n=int_15, group=group_4, bake_iT=bake)  # -> info, obj_out; inputs obj: GeometryBase, name: String, layer: String, color: Color, pWidth: Double, wires: Int32, group_n: Int32, group: Boolean, bake_iT: Boolean
# ---------- bakeatt: C# ----------
    //Inserts geometry into the Rhino document, with custom attributes
    //Written by Giulio Piacentino
    //Version written 2010 11 21 - for Grasshopper 0.8.002
    //Enhanced by Co-de-iT (Alessio) - now bakes on chosen layer(s) and in groups

    String eol = Environment.NewLine;
    Component.Name = "Bake Attributes Enhanced";
    Component.NickName = "BakeAtt++";
    Component.Message = "v1.1 _ by Giulio Piacentino" + eol + "enhanced by Co-de-iT";
    Component.Description = "Bakes objects with attributes such as color, material, layer, object name, wire density. Option to bake in groups";

    if (bake_iT)
    {
      if(obj == null)
      {
        Print("No object to bake");
        return;
      }

      //Make new attribute to set name
      Rhino.DocObjects.ObjectAttributes att = new Rhino.DocObjects.ObjectAttributes();

      //Set object name
      if(!string.IsNullOrEmpty(name))
      {
        att.Name = name;
      }

      //Set color
      if(!color.IsEmpty)
      {
        att.ColorSource = Rhino.DocObjects.ObjectColorSource.ColorFromObject; //Make the color type "by object"
        att.ObjectColor = color;

        att.PlotColorSource = Rhino.DocObjects.ObjectPlotColorSource.PlotColorFromObject; //Make the plot color type "by object"
        att.PlotColor = color;
      }

      // Set group

      if(group)
      {
        doc.Groups.Add(Convert.ToString(group_n));
        att.AddToGroup(group_n);

      }

      //Set layer
      if(!string.IsNullOrEmpty(layer) && Rhino.DocObjects.Layer.IsValidName(layer))
      {
        //Get the current layer index
        Rhino.DocObjects.Tables.LayerTable layerTable = doc.Layers;
        int layerIndex = layerTable.Find(layer, true);

        if(layerIndex < 0) //This layer does not exist, we add it
        {
          Rhino.DocObjects.Layer onlayer = new Rhino.DocObjects.Layer(); //Make a new layer
          onlayer.Name = layer;
          

          layerIndex = layerTable.Add(onlayer); //Add the layer to the layer table
          if (layerIndex > -1) //We manged to add layer!
          {
            att.LayerIndex = layerIndex;
            Print("Added new layer to the document at position " + layerIndex + " named " + layer + ". ");
          } else
            Print("Layer did not add. Try cleaning up your layers."); //This never happened to me.
        }
        else
          att.LayerIndex = layerIndex; //We simply add to the existing layer
      }


      //Set plotweight
      if(pWidth > 0)
      {
        att.PlotWeightSource = Rhino.DocObjects.ObjectPlotWeightSource.PlotWeightFromObject;
        att.PlotWeight = pWidth;
      }


      //Set material
      bool materialByName = !string.IsNullOrEmpty(material as string);
      Rhino.Display.DisplayMaterial inMaterial = material as Rhino.Display.DisplayMaterial;
      if(material is Color)
      {
        inMaterial = new Rhino.Display.DisplayMaterial((Color) material);
      }
      if(material != null && inMaterial == null && !materialByName)
      {
        if(!(material is string))
        {
          try //We also resort to try with IConvertible
          {
            inMaterial = (Rhino.Display.DisplayMaterial) Convert.ChangeType(material, typeof(Rhino.Display.DisplayMaterial));
          }
          catch(InvalidCastException)
          {
          }
        }
      }
      if(inMaterial != null || materialByName)
      {
        string matName;

        if(!materialByName)
        {
          matName = string.Format("A:{0}-D:{1}-E:{2}-S:{3},{4}-T:{5}",
            Format(inMaterial.Ambient),
            Format(inMaterial.Diffuse),
            Format(inMaterial.Emission),
            Format(inMaterial.Specular),
            inMaterial.Shine.ToString(),
            inMaterial.Transparency.ToString()
            );
        }
        else
        {
          matName = (string) material;
        }

        int materialIndex = doc.Materials.Find(matName, true);
        if(materialIndex < 0 && !materialByName) //Material does not exist and we have its specs
        {
          materialIndex = doc.Materials.Add(); //Let's add it
          if(materialIndex > -1)
          {
            Print("Added new material at position " + materialIndex + " named \"" + matName + "\". ");
            Rhino.DocObjects.Material m = doc.Materials[materialIndex];
            m.Name = matName;
            m.AmbientColor = inMaterial.Ambient;
            m.DiffuseColor = inMaterial.Diffuse;
            m.EmissionColor = inMaterial.Emission;
            //m.ReflectionColor = no equivalent
            m.SpecularColor = inMaterial.Specular;
            m.Shine = inMaterial.Shine;
            m.Transparency = inMaterial.Transparency;
            //m.TransparentColor = no equivalent
            m.CommitChanges();

            att.MaterialSource = Rhino.DocObjects.ObjectMaterialSource.MaterialFromObject;
            att.MaterialIndex = materialIndex;
          }
          else
            Print("Material did not add. Try cleaning up your materials."); //This never happened to me.
        }
        else if(materialIndex < 0 && materialByName) //Material does not exist and we do not have its specs. We do nothing
        {
          Print("Warning: material name not found. I cannot set the source to this material name. Add a material with name: " + matName);
        }
        else
        {
          //If this material exists, we do not replace it!
          att.MaterialSource = Rhino.DocObjects.ObjectMaterialSource.MaterialFromObject;
          att.MaterialIndex = materialIndex;
        }
      }


      //Set wire density
      if(wires == -1 || wires > 0)
      {
        att.WireDensity = wires;
      }


      //Bake to the right type of object
      switch(obj.ObjectType)
      {
        case Rhino.DocObjects.ObjectType.Brep:
          doc.Objects.AddBrep(obj as Brep, att);
          break;
        case Rhino.DocObjects.ObjectType.Curve:
          doc.Objects.AddCurve(obj as Curve, att);
          break;
        case Rhino.DocObjects.ObjectType.Point:
          doc.Objects.AddPoint((obj as Rhino.Geometry.Point).Location, att);
          break;
        case Rhino.DocObjects.ObjectType.Surface:
          doc.Objects.AddSurface(obj as Surface, att);
          break;
        case Rhino.DocObjects.ObjectType.Mesh:
          doc.Objects.AddMesh(obj as Mesh, att);
          break;
        case Rhino.DocObjects.ObjectType.Extrusion:
          typeof(Rhino.DocObjects.Tables.ObjectTable).InvokeMember("AddExtrusion", BindingFlags.Instance | BindingFlags.InvokeMethod, null, doc.Objects, new object[]{obj, att});
          break;
        case Rhino.DocObjects.ObjectType.PointSet:
          doc.Objects.AddPointCloud(obj as Rhino.Geometry.PointCloud, att); //This is a speculative entry
          break;
        default:
          Print("The script does not know how to handle this type of geometry: " + obj.GetType().FullName);
          break;
      }
      Print("Added " + obj.GetType().Name);

    }
    else
    {
      Print("Inactive");
    }
    obj_out = obj;
# ---------- bakeatt: C# additional code ----------
  static string Format(Color c)
  {
    return (new System.Text.StringBuilder("A")).Append(c.A.ToString()).Append("R").Append(c.R.ToString()).Append("G")
      .Append(c.G.ToString()).Append("B").Append(c.B.ToString()).ToString();
  }
# ---------- end bakeatt ----------

# ----
# curves
# NOTE: please erase all groups from the Rhino file before baking.
# If unsure copy the polylines in a new file before referencing them in this part of the definition to avoid previous groups.
# outer cuts
# inner cuts
# engrave
# engrave text
lng_36 = ListLength(List=crv_41)
lng_37 = ListLength(List=crv_42)
lng_38 = ListLength(List=crv_43)
lng_39 = ListLength(List=crv_44)
swatch_17 = ColourSwatch(SwatchColor=RGB(0, 0, 255))
swatch_18 = ColourSwatch(SwatchColor=RGB(255, 255, 255))
layers_names_2 = Panel("""c_outer_cut
c_inner_cut
c_engrave""")
merge_80 = Merge(Data1=simplify(lng_36), Data2=simplify(lng_37), Data3=simplify(lng_39))
merge_81 = Merge(Data1=simplify(crv_41), Data2=simplify(crv_42), Data3=simplify(crv_43), Data4=simplify(crv_44))
preview_5 = CustomPreview(Geometry=crv_41, Shader=ColourSwatch(SwatchColor=RGB(255, 0, 0)))
preview_6 = CustomPreview(Geometry=crv_42, Shader=ColourSwatch(SwatchColor=RGB(0, 255, 0)))
preview_7 = CustomPreview(Geometry=crv_43, Shader=swatch_17)
preview_8 = CustomPreview(Geometry=crv_44, Shader=swatch_17)
tstat_2 = TreeStatistics(Tree=merge_81)  # -> Paths, Length, Count
stack_2 = StackData(Data=layers_names_2, Stack=merge_80)
series_19 = Series(Start=0, Step=1, Count=tstat_2.Count)
group_5 = BooleanToggle(True)
int_16 = Integer(simplify(graft(series_19)))
bakeatt_2 = BakeAttributesEnhanced(obj=merge_81, layer=stack_2, group_n=int_16, group=group_5, bake_iT=bake)  # -> info, obj_out; inputs obj: GeometryBase, name: String, layer: String, color: Color, pWidth: Double, wires: Int32, group_n: Int32, group: Boolean, bake_iT: Boolean; same code as bakeatt

srf_cp_5 = SurfaceClosestPoint(Point=pshift_60, Surface=srf_18)  # -> Point, UVPoint, Distance
# component index on model
srf_30 = Surface(reparameterize(graft(srf_3)))
number_slider_41 = Slider(2, range=0..100)
evalsrf_8 = EvaluateSurface(Surface=srf_30, Point=srf_cp_5.UVPoint)  # -> Point, Normal, Frame
amp_15 = Amplitude(Vector=evalsrf_8.Normal, Amplitude=number_slider_41)
move_45 = Move(Geometry=evalsrf_8.Frame, Motion=amp_15)  # -> Geometry, Transform
multiplication_25 = Multiplication(A=number_slider_41, B=0.9)
swatch_19 = ColourSwatch(SwatchColor=RGB(148, 0, 0))
line_11 = LineSDL(Start=evalsrf_8.Frame, Direction=evalsrf_8.Normal, Length=multiplication_25)
previewlw_16 = CustomPreviewLineweights(Geometry=pshift_58, Shader=swatch_19, Absolute=False)
previewlw_17 = CustomPreviewLineweights(Geometry=line_11, Shader=swatch_19, Absolute=False)
tag_21 = TextTag3D(Location=move_45.Geometry, Text=concat_5, Size=number_slider_40, Colour=swatch_19, Justification=5)

srf_31 = Surface(reparameterize(graft(entwine_10)))  # disabled
crv_45 = Curve(pshift_50)  # disabled
viewer_30 = ParamViewer(crv_45)  # disabled
lng_40 = ListLength(List=crv_45)  # disabled
disc_3 = Discontinuity(Curve=crv_45, Level=1)  # -> Points, Parameters; disabled
series_20 = Series(Start=0, Step=1, Count=lng_40)  # disabled
int_17 = Integer(simplify(series_20))  # disabled
font_2 = ValueList({"Machine Tool Gothic", "Machine Tool SanSerif"}, selected="Machine Tool Gothic")  # disabled
number_slider_42 = Slider(220, range=1..500)  # disabled
number_slider_43 = Slider(1.5, range=0..100)  # disabled
panel_79 = Panel("4")  # disabled

fpars_3 = FontParser(S=merge_49, font=font_2, size=number_slider_43, prec=number_slider_42, P=merge_50, J=panel_79)  # -> out, C; inputs S: String, font: String, close: Boolean, size: Double, prec: Double, P: Plane, J: Int32; disabled; same code as fpars
dpath_4 = DeconstructPath(Branch=viewer_30)  # disabled
avr_21 = Average(Input=disc_3.Points)  # disabled
pshift_61 = ShiftPaths(Data=avr_21, Offset=-1)  # disabled
crv_46 = Curve(simplify(fpars_3.C))  # disabled
viewer_31 = ParamViewer(pshift_61)  # disabled
merge_82 = Merge(Data1=merge_2, Data2=replace_3, Data3=crv_46)  # disabled

item_52 = ListItem(List=dpath_4, Index=0, Wrap=True)  # -> Item, Item1, Item2; disabled
expression_6 = Expression(x=item_52.Item, y=item_52.Item1, z=item_52.Item2, Expression="Format(\"{0}.{1}.{2}_\", x, y,z)")  # -> flatten(R); disabled
concat_6 = Concatenate(FragmentA=graft(expression_6), FragmentB=int_17)  # disabled
fpars_4 = FontParser(S=concat_6, font=font_2, size=number_slider_43, prec=number_slider_42, P=pshift_61, J=panel_79)  # -> out, C; inputs S: String, font: String, close: Boolean, size: Double, prec: Double, P: Plane, J: Int32; disabled; same code as fpars

number_slider_44 = Slider(2, range=0..100)  # disabled
swatch_20 = ColourSwatch(SwatchColor=RGB(255, 255, 255))  # disabled
tag_22 = TextTag3D(Location=pshift_61, Text=concat_6, Size=number_slider_44, Colour=swatch_20, Justification=5)  # disabled

crv_47 = Curve(merge_64)  # disabled
crv_48 = Curve()  # disabled
crv_49 = Curve(merge_65)  # disabled
crv_50 = Curve(merge_82)  # disabled

# ----
# outer cuts
# inner cuts
# engrave
# engrave text
crv_51 = Curve(crv_31)  # disabled
crv_52 = Curve()  # disabled
crv_53 = Curve(cir_15)  # disabled
crv_54 = Curve(fpars_4.C)  # disabled

# ----
# NOTE: please erase all groups from the Rhino file before baking.
# If unsure copy the polylines in a new file before referencing them in this part of the definition to avoid previous groups.
lng_41 = ListLength(List=crv_47)  # disabled
lng_42 = ListLength(List=crv_49)  # disabled
lng_43 = ListLength(List=crv_48)  # disabled
lng_44 = ListLength(List=crv_50)  # disabled
swatch_21 = ColourSwatch(SwatchColor=RGB(255, 0, 0))  # disabled
swatch_22 = ColourSwatch(SwatchColor=RGB(0, 255, 0))  # disabled
swatch_23 = ColourSwatch(SwatchColor=RGB(0, 0, 255))  # disabled
swatch_24 = ColourSwatch(SwatchColor=RGB(255, 255, 255))  # disabled
layers_names_3 = Panel("""c_outer_cut
c_inner_cut
c_engrave""")  # disabled
merge_83 = Merge(Data1=simplify(lng_41), Data2=simplify(lng_42), Data3=simplify(lng_44))  # disabled
merge_84 = Merge(Data1=simplify(crv_47), Data2=simplify(crv_49), Data3=simplify(crv_48), Data4=simplify(crv_50))  # disabled
preview_9 = CustomPreview(Geometry=crv_47, Shader=swatch_21)  # disabled
preview_10 = CustomPreview(Geometry=crv_49, Shader=swatch_22)  # disabled
preview_11 = CustomPreview(Geometry=crv_48, Shader=swatch_23)  # disabled
preview_12 = CustomPreview(Geometry=crv_50, Shader=swatch_23)  # disabled
tstat_3 = TreeStatistics(Tree=merge_84)  # -> Paths, Length, Count; disabled
stack_3 = StackData(Data=layers_names_3, Stack=merge_83)  # disabled
series_21 = Series(Start=0, Step=1, Count=tstat_3.Count)  # disabled
group_6 = BooleanToggle(True)  # disabled
bake_2 = Button()  # disabled
int_18 = Integer(simplify(graft(series_21)))  # disabled
bakeatt_3 = BakeAttributesEnhanced(obj=merge_84, layer=stack_3, group_n=int_18, group=group_6, bake_iT=bake_2)  # -> info, obj_out; inputs obj: GeometryBase, name: String, layer: String, color: Color, pWidth: Double, wires: Int32, group_n: Int32, group: Boolean, bake_iT: Boolean; disabled; same code as bakeatt

# ----
# curves
# NOTE: please erase all groups from the Rhino file before baking.
# If unsure copy the polylines in a new file before referencing them in this part of the definition to avoid previous groups.
# outer cuts
# inner cuts
# engrave
# engrave text
lng_45 = ListLength(List=crv_51)  # disabled
lng_46 = ListLength(List=crv_53)  # disabled
lng_47 = ListLength(List=crv_52)  # disabled
lng_48 = ListLength(List=crv_54)  # disabled
swatch_25 = ColourSwatch(SwatchColor=RGB(255, 0, 0))  # disabled
swatch_26 = ColourSwatch(SwatchColor=RGB(0, 255, 0))  # disabled
swatch_27 = ColourSwatch(SwatchColor=RGB(0, 0, 255))  # disabled
swatch_28 = ColourSwatch(SwatchColor=RGB(255, 255, 255))  # disabled
layers_names_4 = Panel("""la_outer_cut
la_inner_cut
la_engrave""")  # disabled
merge_85 = Merge(Data1=simplify(lng_45), Data2=simplify(lng_46), Data3=simplify(lng_48))  # disabled
merge_86 = Merge(Data1=simplify(crv_51), Data2=simplify(crv_53), Data3=simplify(crv_52), Data4=simplify(crv_54))  # disabled
preview_13 = CustomPreview(Geometry=crv_51, Shader=swatch_25)  # disabled
preview_14 = CustomPreview(Geometry=crv_53, Shader=swatch_26)  # disabled
preview_15 = CustomPreview(Geometry=crv_52, Shader=swatch_27)  # disabled
preview_16 = CustomPreview(Geometry=crv_54, Shader=swatch_27)  # disabled
tstat_4 = TreeStatistics(Tree=merge_86)  # -> Paths, Length, Count; disabled
stack_4 = StackData(Data=layers_names_4, Stack=merge_85)  # disabled
series_22 = Series(Start=0, Step=1, Count=tstat_4.Count)  # disabled
group_7 = BooleanToggle(True)  # disabled
bake_3 = Button()  # disabled
int_19 = Integer(simplify(graft(series_22)))  # disabled
bakeatt_4 = BakeAttributesEnhanced(obj=merge_86, layer=stack_4, group_n=int_19, group=group_7, bake_iT=bake_3)  # -> info, obj_out; inputs obj: GeometryBase, name: String, layer: String, color: Color, pWidth: Double, wires: Int32, group_n: Int32, group: Boolean, bake_iT: Boolean; disabled; same code as bakeatt

srf_32 = Surface(reparameterize(graft(entwine_5)))  # disabled
srf_cp_6 = SurfaceClosestPoint(Point=pshift_61, Surface=srf_31)  # -> Point, UVPoint, Distance; disabled
number_slider_45 = Slider(2, range=0..100)  # disabled
evalsrf_9 = EvaluateSurface(Surface=srf_32, Point=srf_cp_6.UVPoint)  # -> Point, Normal, Frame; disabled
amp_16 = Amplitude(Vector=evalsrf_9.Normal, Amplitude=number_slider_45)  # disabled
move_46 = Move(Geometry=evalsrf_9.Frame, Motion=amp_16)  # -> Geometry, Transform; disabled
multiplication_26 = Multiplication(A=number_slider_45, B=0.9)  # disabled
line_12 = LineSDL(Start=evalsrf_9.Frame, Direction=evalsrf_9.Normal, Length=multiplication_26)  # disabled
tag_23 = TextTag3D(Location=move_46.Geometry, Text=concat_6, Size=number_slider_44, Colour=swatch, Justification=5)  # disabled
previewlw_18 = CustomPreviewLineweights(Geometry=line_12, Shader=swatch, Absolute=False)  # disabled

# ==== cluster DoubleShift: Shifts a list +1 and -1, wrap option available
list = ClusterInput()
wrap = ClusterInput()
shift = ShiftList(List=list, Shift=1, Wrap=wrap)
shift_2 = ShiftList(List=list, Shift="-1", Wrap=wrap)
no_last = ClusterOutput(shift_2)
no_first = ClusterOutput(shift)

# ==== cluster AdjustOrient
srf = ClusterInput()
pt = ClusterInput()
srf_2 = Surface(reparameterize(srf))
pt_2 = Point(Point(0.5, 0.5, 0))
pt_3 = Point(pt)
evalsrf = EvaluateSurface(Surface=srf_2, Point=pt_2)  # -> Point, Normal, Frame
Z = UnitZ(Factor=1)
angle = Angle(VectorA=evalsrf.Normal, VectorB=Z)  # -> Angle, Reflex
larger = LargerThan(FirstNumber=angle.Angle, SecondNumber=0.0001)  # -> LargerThan, OrEqualTo
dispatch = Dispatch(List=evalsrf.Point, DispatchPattern=larger.LargerThan)  # -> ListA, ListB
dispatch_2 = Dispatch(List=srf_2, DispatchPattern=larger.LargerThan)  # -> ListA, ListB
dispatch_3 = Dispatch(List=pt_3, DispatchPattern=larger.LargerThan)  # -> ListA, ListB
X = UnitX(Factor=1)
rot3d = Rotate3D(Geometry=dispatch_3.ListA, Angle="Pi", Center=dispatch.ListA, Axis=X)  # -> Geometry, Transform
rot3d_2 = Rotate3D(Geometry=dispatch_2.ListA, Angle="Pi", Center=dispatch.ListA, Axis=X)  # -> Geometry, Transform
weave = Weave(Pattern=larger.LargerThan, Stream0=dispatch_3.ListB, Stream1=rot3d.Geometry, NullGaps=False)
weave_2 = Weave(Pattern=larger.LargerThan, Stream0=dispatch_2.ListB, Stream1=rot3d_2.Geometry, NullGaps=False)
pt_4 = ClusterOutput(weave)
S = ClusterOutput(weave_2)

# ==== cluster AdjustOrientRotY
brep = ClusterInput()
pt = ClusterInput()
brep_2 = Brep(brep)
pt_2 = Point(Point(0.5, 0.5, 0))
debrep = DeconstructBrep(Brep=brep_2)  # -> Faces, Edges, Vertices
item = ListItem(List=debrep.Faces, Index=0, Wrap=True)
pt_3 = Point(pt)
Z = UnitZ(Factor=1)
pshift = ShiftPaths(Data=item, Offset=-1)
srf = Surface(reparameterize(pshift))
evalsrf = EvaluateSurface(Surface=srf, Point=pt_2)  # -> Point, Normal, Frame
angle = Angle(VectorA=evalsrf.Normal, VectorB=Z)  # -> Angle, Reflex
larger = LargerThan(FirstNumber=angle.Angle, SecondNumber=0.0001)  # -> LargerThan, OrEqualTo
dispatch = Dispatch(List=evalsrf.Point, DispatchPattern=larger.LargerThan)  # -> ListA, ListB
dispatch_2 = Dispatch(List=brep_2, DispatchPattern=larger.LargerThan)  # -> ListA, ListB
dispatch_3 = Dispatch(List=pt_3, DispatchPattern=graft(larger.LargerThan))  # -> ListA, ListB
Y = UnitY(Factor=1)
rot3d = Rotate3D(Geometry=dispatch_3.ListA, Angle="Pi", Center=graft(dispatch.ListA), Axis=Y)  # -> Geometry, Transform
rot3d_2 = Rotate3D(Geometry=dispatch_2.ListA, Angle="Pi", Center=dispatch.ListA, Axis=Y)  # -> Geometry, Transform
weave = Weave(Pattern=graft(larger.LargerThan), Stream0=dispatch_3.ListB, Stream1=rot3d.Geometry, NullGaps=False)
weave_2 = Weave(Pattern=larger.LargerThan, Stream0=dispatch_2.ListB, Stream1=rot3d_2.Geometry, NullGaps=False)
pt_4 = ClusterOutput(weave)
S = ClusterOutput(weave_2)

# ==== cluster AdjustUnrollOrient: Adjusts Unroll Orientation of surfaces to correct upside-down situations
brep = ClusterInput()
curves = ClusterInput()
pt = ClusterInput()
brep_2 = Brep(brep)
debrep = DeconstructBrep(Brep=brep_2)  # -> Faces, Edges, Vertices
item = ListItem(List=debrep.Faces, Index=0, Wrap=True)
pshift = ShiftPaths(Data=item, Offset=-1)
crv = Curve(curves)
pt_2 = Point(pt)
srf = Surface(reparameterize(pshift))
pt_3 = Point(Point(0.5, 0.5, 0))
evalsrf = EvaluateSurface(Surface=srf, Point=pt_3)  # -> Point, Normal, Frame
Z = UnitZ(Factor=1)
angle = Angle(VectorA=evalsrf.Normal, VectorB=Z)  # -> Angle, Reflex
Y = UnitY(Factor=1)
larger = LargerThan(FirstNumber=angle.Angle, SecondNumber=0.0001)  # -> LargerThan, OrEqualTo
dispatch = Dispatch(List=crv, DispatchPattern=graft(larger.LargerThan))  # -> ListA, ListB
dispatch_2 = Dispatch(List=pt_2, DispatchPattern=graft(larger.LargerThan))  # -> ListA, ListB
dispatch_3 = Dispatch(List=brep_2, DispatchPattern=larger.LargerThan)  # -> ListA, ListB
dispatch_4 = Dispatch(List=evalsrf.Point, DispatchPattern=larger.LargerThan)  # -> ListA, ListB
rot3d = Rotate3D(Geometry=dispatch.ListA, Angle="Pi", Center=graft(dispatch_4.ListA), Axis=Y)  # -> Geometry, Transform
rot3d_2 = Rotate3D(Geometry=dispatch_2.ListA, Angle="Pi", Center=graft(dispatch_4.ListA), Axis=Y)  # -> Geometry, Transform
rot3d_3 = Rotate3D(Geometry=dispatch_3.ListA, Angle="Pi", Center=dispatch_4.ListA, Axis=Y)  # -> Geometry, Transform
weave = Weave(Pattern=graft(larger.LargerThan), Stream0=dispatch.ListB, Stream1=rot3d.Geometry, NullGaps=False)
weave_2 = Weave(Pattern=graft(larger.LargerThan), Stream0=dispatch_2.ListB, Stream1=rot3d_2.Geometry, NullGaps=False)
weave_3 = Weave(Pattern=larger.LargerThan, Stream0=dispatch_3.ListB, Stream1=rot3d_3.Geometry, NullGaps=False)
S = ClusterOutput(weave_3)
curves_2 = ClusterOutput(weave)
pt_4 = ClusterOutput(weave_2)
