# Grasshopper definition SectionBox.gh (Grasshopper 0.9.76)
# plug-ins: Python Interpreter

# or use two points
pt = Point(<point referenced from the Rhino model>)
# RELIEF
# shape as structural device
# tutor: Alessio Erioli
# Thessaloniki . 10-16.05.2016
pt_2 = Point(<point referenced from the Rhino model>)
layername = Panel("clippingPlane")
# <title>
# 
# <description>
# 
# code by <author>
# 
# v <version>
# 
# © Co-de-iT 2016 _ Creative Commons Attribution-NonCommercial-ShareAlike 4.0 International License
# input a box in here
geo = Geometry()
box = Box2Pt(PointA=pt_2, PointB=pt, Plane=PlaneXY(0, 0, 0))
explode = BrepComponents(Brep=box)  # -> Faces, Edges, Vertices
explode_2 = BrepComponents(Brep=explode.Faces)  # -> Faces, Edges, simplify(Vertices)
join = JoinCurves(Curves=explode_2.Edges, Preserve=False)
planar = PlanarSrf(Edges=join)
explode_3 = BrepComponents(Brep=planar)  # -> Faces, Edges, reverse(simplify(Vertices))
item = ListItem(List=explode_3.Vertices, Index=1, Wrap=False)
item_2 = ListItem(List=explode_3.Vertices, Index=0, Wrap=False)
item_3 = ListItem(List=explode_3.Vertices, Index=2, Wrap=False)
item_4 = ListItem(List=explode_3.Vertices, Index=0, Wrap=True)
item_5 = ListItem(List=explode_3.Vertices, Index=1, Wrap=True)
item_6 = ListItem(List=explode_3.Vertices, Index=2, Wrap=True)
pt_3 = Point(flatten(item_4))
pt_4 = Point(flatten(item_5))
pt_5 = Point(flatten(item_6))
flip = BooleanToggle(True)
python_sectionboxer = PythonScript(p1=pt_3, p2=pt_4, p3=pt_5, activate=Toggle(True), flip=flip, clippingPlaneLayer=layername)  # -> out, a; inputs p1: list of Point3d, p2: list of Point3d, p3: list of Point3d
# ---------- python_sectionboxer: Python ----------
import math
import rhinoscriptsyntax as rs
import scriptcontext as sc
import Rhino
sc.doc = Rhino.RhinoDoc.ActiveDoc

layerName=clippingPlaneLayer
if activate:
    lay=rs.CurrentLayer()
    rs.AddLayer(layerName)
    rs.CurrentLayer(layerName)
    rs.LayerVisible(layerName,True,True)
    objectlist= rs.ObjectsByLayer(layerName)
    for j in range (0,len(objectlist)):
        if rs.ObjectType(objectlist[j])==536870912:
            rs.DeleteObject(objectlist[j])
    if flip:
        for i in range(0, len(p1)):
            rs.Command("-_ClippingPlane P " +str(p1[i])+" "+str(p3[i])+" "+str(p2[i])+" "+"_Enter")
    else:
        for i in range(0, len(p1)):
            rs.Command("-_ClippingPlane P " +str(p1[i])+" "+str(p2[i])+" "+str(p3[i])+" "+"_Enter")
    if rs.CurrentLayer(lay)==rs.CurrentLayer():
        rs.CurrentLayer("Default")
    else:
        rs.CurrentLayer(lay)
    rs.LayerVisible(layerName,False,False)
# ---------- end python_sectionboxer ----------
