# Grasshopper definition clipping plane anim.gh (Grasshopper 0.9.76)

# RELIEF
# shape as structural device
# tutor: Alessio Erioli
# Thessaloniki . 10-16.05.2016
animation_slider = Slider(1, range=0..1)
max_z = Slider(135, range=55..190)
min_z = Slider(120, range=50..180)
# <title>
# 
# <description>
# 
# code by <author>
# 
# v <version>
# 
# © Co-de-iT 2016 _ Creative Commons Attribution-NonCommercial-ShareAlike 4.0 International License
# easing animation
graph = GraphMapper(
    animation_slider,
    x0=0,
    x1=1,
    y0=0,
    y1=1,
    container_name="Bezier",
    cpx=[0, 0, 0.9923480749, 1],
    cpy=[0, 0.4933912754, 0.593565166, 1])
dom = Domain(DomainStart=min_z, DomainEnd=max_z)
# import a clipping plane
# from Rhino here
remap = RemapNumbers(Value=graph, Source=Domain(0, 1), Target=dom)  # -> Mapped, Clipped
pt = Point(Point(0, 0, 0))
pt_2 = Point(Point(1, 0, 0))
pt_3 = Point(Point(0, -1, 0))
# custom plane with
# negative Z
# to look down
pl_3pt = Plane3Pt(PointA=pt, PointB=pt_2, PointC=pt_3)

pt_4 = ConstructPoint(XCoordinate=Slider(122.11, range=-2..200), YCoordinate=Slider(2, range=-2..2), ZCoordinate=remap.Mapped)
# < move plane out of sight
pl_origin = PlaneOrigin(Base=pl_3pt, Origin=pt_4)

id = Guid(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)
c_script = CSharpScript(id=id, y=pl_origin)  # -> out, A; inputs id: Guid, y: Plane
# ---------- c_script: C# ----------
    Rhino.DocObjects.ObjRef obj = new Rhino.DocObjects.ObjRef(id);
    Rhino.DocObjects.ClippingPlaneObject cpObj = obj.Object() as Rhino.DocObjects.ClippingPlaneObject;
    cpObj.ClippingPlaneGeometry.Plane = y;
    cpObj.CommitChanges();
# ---------- end c_script ----------
