# Grasshopper definition parse curves in layers.gh (Grasshopper 0.9.76)
# Copyright: Co-de-iT
# plug-ins: MeshEdit Components, Weaverbird

geometry_type = ValueList({"Mesh": 0, "BRep (NURBS)": 1}, selected="BRep (NURBS)")
inner_holes = ValueList({"no": 0, "yes": 1}, selected="yes")
# <title>
# 
# <description>
# 
# code by <author>
# 
# v <version>
# 
# © Co-de-iT 2016 _ Creative Commons Attribution-NonCommercial-ShareAlike 4.0 International License
# RELIEF
# shape as structural device
# tutor: Alessio Erioli
# Thessaloniki . 10-16.05.2016
# NURBS planar geometries
# (ex from UnrollSrf)
brep = Brep([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])
# Mesh planar geometries
mesh = Mesh([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])
layout_text_size = Slider(0.5, range=0..1)
flap_scale_factor = Slider(0.7, range=0..1)
flap_offset_dist = Slider(0.5, range=0..1)
debrep = DeconstructBrep(Brep=brep)  # -> Faces, Edges, Vertices
explode = MeshExplode(Mesh=mesh, Interpolate=False)
edges = BrepEdges(Brep=brep)  # -> Naked, Interior, NonManifold
area = Area(Geometry=explode)  # -> Area, Centroid
area_2 = Area(Geometry=debrep.Faces)  # -> Area, Centroid
join = JoinCurves(Curves=edges.Naked, Preserve=False)  # -> flatten(Curves)
medges = MeshEdges(Mesh=mesh)  # -> NakedEdges, InteriorEdges, NonManifoldEdges
wbnaked = WeaverbirdsNakedBoundary(MeshClosedPolylines=mesh)
medges_2 = MeshEdges(Mesh=debrep.Faces)  # -> NakedEdges, InteriorEdges, NonManifoldEdges
wbnaked_2 = WeaverbirdsNakedBoundary(MeshClosedPolylines=explode)
join_2 = JoinCurves(Curves=medges_2.NakedEdges, Preserve=False)
cluster = Cluster(C=join)
pshift = ShiftPaths(Data=join_2, Offset=-2)
# outer edges
filter = StreamFilter(Gate=geometry_type, Stream0=wbnaked, Stream1=cluster)
# face centers
filter_2 = StreamFilter(Gate=geometry_type, Stream0=area.Centroid, Stream1=area_2.Centroid)
# inner edges
filter_3 = StreamFilter(Gate=geometry_type, Stream0=medges.InteriorEdges, Stream1=edges.Interior)
# inner holes
filter_4 = StreamFilter(Gate=geometry_type, Stream0=wbnaked_2, Stream1=pshift)
filter_5 = StreamFilter(Gate=inner_holes, Stream1=filter_4)
scale = Scale(Geometry=filter_5, Center=filter_2, Factor=Slider(0.394, range=0..1))  # -> Geometry, Transform
clean = CleanTree(RemoveNulls=True, RemoveInvalid=True, RemoveEmpty=False, Tree=scale.Geometry)  # -> simplify(Tree)
explode_2 = Explode(Curve=filter, Recursive=True)  # -> simplify(Segments), Vertices

lng = ListLength(List=flatten(filter))
# generate text labels
series = Series(Start=0, Step=1, Count=lng)
int = Integer(graft(series))
expression = Expression(x=int, y=".", Expression="Format(\"{0}{1}\", x, y)")
tag_text = Panel(expression)
item = ListItem(List=filter_2, Index=0, Wrap=True)
xy = XYPlane(Origin=item)
font = ValueList({"Machine Tool Gothic", "Machine Tool SanSerif"}, selected="Machine Tool Gothic")
number_slider = Slider(0, range=0..10)
number_slider_2 = Slider(0, range=0..10)
prot = RotatePlane(Plane=xy, Angle=Slider(0, range=0..1.571))
fpars = FontParser(S=graft(expression), font=font, size=layout_text_size, prec=Slider(220, range=1..500), P=prot, J="6")  # -> out, C; inputs S: String, font: String, close: Boolean, size: Double, prec: Double, P: Plane, J: Int32
# ---------- fpars: C# ----------
        /*
    Font Parser
    Adaptation of code written by David Rutten, Giulio Piacentino et al.
    Adaptation for C# by Alessio Erioli - Co-de-iT
    */

    Component.Name = "Font Parser";
    Component.NickName = "FPars";
    Component.Description = "converts text into polylines - useful for fabrication";
    Component.Params.Input[0].Description = "text to convert";
    Component.Params.Input[1].Description = "text font";
    Component.Params.Input[2].Description = "close polylines (optional)";
    Component.Params.Input[3].Description = "text size";
    Component.Params.Input[4].Description = "sampling precision (usually 100-250 is ok)";
    Component.Params.Input[5].Description = "destination plane";
    Component.Params.Input[6].Description = "text justification (0-8)";


    float fS = size == 0 ? 1 : (float) size;
    System.Drawing.Font local_font = new System.Drawing.Font(font, (float) fS);

    System.Drawing.Drawing2D.GraphicsPath path = new System.Drawing.Drawing2D.GraphicsPath();
    path.AddString(S, local_font.FontFamily, (int) local_font.Style, local_font.Size, new PointF(0, 0), new StringFormat());

    System.Drawing.Drawing2D.Matrix matrix = new  System.Drawing.Drawing2D.Matrix(); // transformation matrix
    matrix.Reset(); // build identity matrix

    // ______________ text justification ______________

    RectangleF rec = path.GetBounds(); // bounding rectangle for text
    float dX = Convert.ToSingle(rec.Width * -0.5), dY = Convert.ToSingle(rec.Height * 0.5);
    switch(J){
      case 0:// top left
        dX = 0;
        dY = fS;
        break;
      case 1: // middle left
        dX = 0;
        dY = Convert.ToSingle((-rec.Height) * 0.5 + fS);
        break;
      case 2:  // bottom left
        dX = 0;
        dY = Convert.ToSingle(-rec.Height + fS * 0.5);
        break;
      case 3: // top center
        dX = Convert.ToSingle(rec.Width * -0.5);
        dY = fS;
        break;
      case 4: // middle center
        dX = Convert.ToSingle(rec.Width * -0.5);
        dY = Convert.ToSingle((-rec.Height) * 0.5 + fS);
        break;
      case 5: // bottom center
        dX = Convert.ToSingle(rec.Width * -0.5);
        dY = Convert.ToSingle(-rec.Height + fS * 0.5);
        break;
      case 6: // top right
        dX = Convert.ToSingle(rec.Width * -1);
        dY = fS;
        break;
      case 7: // middle right
        dX = Convert.ToSingle(rec.Width * -1);
        dY = Convert.ToSingle((-rec.Height) * 0.5 + fS);
        break;
      case 8: // bottom right
        dX = Convert.ToSingle(rec.Width * -1);
        dY = Convert.ToSingle(-rec.Height + fS * 0.5);
        break;

    }
    //float dX = Convert.ToSingle(rec.Width * -0.5);
    //float dY = Convert.ToSingle(rec.Height * 0.5);
    System.Drawing.Drawing2D.Matrix mTrans = new  System.Drawing.Drawing2D.Matrix(1, 0, 0, 1, dX, dY); // build transformation matrix
    path.Transform(mTrans); // transform text path

    // ______________ convert to polylines ______________

    path.Flatten(matrix, (float) (size / prec)); // turns the path into a polyline that approximates the path

    PointF[] pts = path.PathPoints; // get path points
    Byte[] tps = path.PathTypes;   // get path point types
    List<Polyline> strokes = new  List<Polyline>(); // List for strokes
    Polyline stroke = new Polyline();

    Byte typ_start = Convert.ToByte(System.Drawing.Drawing2D.PathPointType.Start);// find start points condition

    // the conversion loop
    for (int i = 0; i < pts.Length; i++){
      // if a start point is found, and the existing polyline is not null nor a single point,
      // add polyline to the strokes and create a new polyline
      if(tps[i] == typ_start){
        if (stroke != null && stroke.Count > 1) {
          if (close) stroke.Add(stroke[0]); // close polyline if necessary
          strokes.Add(stroke);}
        stroke = new Polyline();
      }
      // in any other case add the next point to a polyline
      stroke.Add(pts[i].X, -pts[i].Y + size, 0);
      // add last stroke to the list
      if (i == pts.Length - 1) {
        if (close) stroke.Add(stroke[0]); // and close it if necessary
        strokes.Add(stroke);
      }
    }


    // ______________ align strokes to given plane ______________

    Transform align = Transform.PlaneToPlane(Plane.WorldXY, P); // align transformation
    for(int j = 0; j < strokes.Count; j++){
      strokes[j].Transform(align);
    }

    C = strokes;
# ---------- end fpars ----------
pshift_2 = ShiftPaths(Data=fpars.C, Offset=-1)  # -> simplify(Data)

# ----
# generate flaps
end = EndPoints(Curve=explode_2.Segments)  # -> Start, End
vec2pt = Vector2Pt(PointA=end.Start, PointB=end.End, Unitize=False)  # -> Vector, Length
Z = UnitZ(Factor=1)
xprod = CrossProduct(VectorA=vec2pt.Vector, VectorB=Z, Unitize=False)  # -> Vector, Length
neg = Negative(Value=flap_offset_dist)
amp = Amplitude(Vector=xprod.Vector, Amplitude=neg)
move = Move(Geometry=end.Start, Motion=amp)  # -> Geometry, Transform
move_2 = Move(Geometry=end.End, Motion=amp)  # -> Geometry, Transform
merge = Merge(Data1=graft(move.Geometry), Data2=graft(move_2.Geometry))
avr = Average(Input=merge)
pshift_3 = ShiftPaths(Data=avr, Offset=-1)
scale_2 = Scale(Geometry=move.Geometry, Center=pshift_3, Factor=flap_scale_factor)  # -> Geometry, Transform
scale_3 = Scale(Geometry=move_2.Geometry, Center=pshift_3, Factor=flap_scale_factor)  # -> Geometry, Transform
ln = Line(StartPoint=[end.Start, end.End], EndPoint=[scale_2.Geometry, scale_3.Geometry])
ln_2 = Line(StartPoint=scale_2.Geometry, EndPoint=scale_3.Geometry)
merge_2 = Merge(Data1=ln, Data2=ln_2)

join_3 = JoinCurves(Curves=merge_2, Preserve=False)
crv = Curve(simplify(filter_3))
pshift_4 = ShiftPaths(Data=join_3, Offset=-1)

# ----
# automated layer separation and grouping for automated nesting
# outer cuts
# inner cuts
# engrave
# engrave text
crv_2 = Curve(pshift_4)
crv_3 = Curve(clean)
crv_4 = Curve([crv, explode_2.Segments])
crv_5 = Curve(pshift_2)

# ----
# curves
# the Bakery: obj - objects to bake
# name - objects names (optional)
# layer - objects layer (optional)
# color - objects color (optional)
# pWidth - polylines width (optional)
# wires
# material - objects material (optional)
# group_n - group number (mandatory if you want to bake in groups - see also note below)
# group - boolean toggle to bake in groups (one group for each tree branch)
# bake_iT - button: hit once to bake ALL
# NOTE: please erase all groups from the Rhino file before baking.
# If unsure copy the polylines in a new file before referencing them in this part of the definition to avoid previous groups.
# Insert here the polylines if not generated in this definition.
# 
# There should be one tree branch for each piece to be cut.
# 
# Example: 3 pieces (each with outer cuts, inner cuts, engraving and text)
# 
# For each of those works I'll have a datat tree with 3 branches, {0}, {1} e {2}.
# 
# In the "outer cuts" component I'll put all the polylines for outer cuts, in branch {0} the ones relative to the first component, branch {1} those relative to the second one and so on. Same structure for all other works.
# 
# Maintaining this order is necessary for a correct group bake and thus use Rhinonest
# outer cuts
# inner cuts
# engrave
# engrave text
lng_2 = ListLength(List=crv_2)
lng_3 = ListLength(List=crv_3)
lng_4 = ListLength(List=crv_4)
lng_5 = ListLength(List=crv_5)
layers_names = Panel("""l_outer_cut
l_inner_cut
l_engrave
l_engrave_text""")
merge_3 = Merge(Data1=simplify(lng_2), Data2=simplify(lng_3), Data3=simplify(lng_4), Data4=simplify(lng_5))
merge_4 = Merge(Data1=simplify(crv_2), Data2=simplify(crv_3), Data3=simplify(crv_4), Data4=simplify(crv_5))
preview = CustomPreview(Geometry=crv_2, Shader=ColourSwatch(SwatchColor=RGB(0, 0, 0)))
preview_2 = CustomPreview(Geometry=crv_3, Shader=ColourSwatch(SwatchColor=RGB(153, 153, 153)))
preview_3 = CustomPreview(Geometry=crv_4, Shader=ColourSwatch(SwatchColor=RGB(255, 0, 0)))
preview_4 = CustomPreview(Geometry=crv_5, Shader=ColourSwatch(SwatchColor=RGB(255, 255, 255)))
tstat = TreeStatistics(Tree=merge_4)  # -> Paths, Length, Count
stack = StackData(Data=layers_names, Stack=merge_3)
series_2 = Series(Start=0, Step=1, Count=tstat.Count)
group = BooleanToggle(True)
bake = Button()
int_2 = Integer(simplify(graft(series_2)))
bakeatt = BakeAttributesEnhanced(obj=merge_4, layer=stack, group_n=int_2, group=group, bake_iT=bake)  # -> info, obj_out; inputs obj: GeometryBase, name: String, layer: String, color: Color, pWidth: Double, wires: Int32, group_n: Int32, group: Boolean, bake_iT: Boolean
# ---------- bakeatt: C# ----------
    //Inserts geometry into the Rhino document, with custom attributes
    //Written by Giulio Piacentino
    //Version written 2010 11 21 - for Grasshopper 0.8.002
    //Enhanced by Co-de-iT (Alessio) - now bakes on chosen layer(s) and in groups

    String eol = Environment.NewLine;
    Component.Name = "Bake Attributes Enhanced";
    Component.NickName = "BakeAtt++";
    Component.Message = "v1.1 _ by Giulio Piacentino" + eol + "enhanced by Co-de-iT";
    Component.Description = "Bakes objects with attributes such as color, material, layer, object name, wire density. Option to bake in groups";

    if (bake_iT)
    {
      if(obj == null)
      {
        Print("No object to bake");
        return;
      }

      //Make new attribute to set name
      Rhino.DocObjects.ObjectAttributes att = new Rhino.DocObjects.ObjectAttributes();

      //Set object name
      if(!string.IsNullOrEmpty(name))
      {
        att.Name = name;
      }

      //Set color
      if(!color.IsEmpty)
      {
        att.ColorSource = Rhino.DocObjects.ObjectColorSource.ColorFromObject; //Make the color type "by object"
        att.ObjectColor = color;

        att.PlotColorSource = Rhino.DocObjects.ObjectPlotColorSource.PlotColorFromObject; //Make the plot color type "by object"
        att.PlotColor = color;
      }

      // Set group

      if(group)
      {
        doc.Groups.Add(Convert.ToString(group_n));
        att.AddToGroup(group_n);

      }

      //Set layer
      if(!string.IsNullOrEmpty(layer) && Rhino.DocObjects.Layer.IsValidName(layer))
      {
        //Get the current layer index
        Rhino.DocObjects.Tables.LayerTable layerTable = doc.Layers;
        int layerIndex = layerTable.Find(layer, true);

        if(layerIndex < 0) //This layer does not exist, we add it
        {
          Rhino.DocObjects.Layer onlayer = new Rhino.DocObjects.Layer(); //Make a new layer
          onlayer.Name = layer;
          

          layerIndex = layerTable.Add(onlayer); //Add the layer to the layer table
          if (layerIndex > -1) //We manged to add layer!
          {
            att.LayerIndex = layerIndex;
            Print("Added new layer to the document at position " + layerIndex + " named " + layer + ". ");
          } else
            Print("Layer did not add. Try cleaning up your layers."); //This never happened to me.
        }
        else
          att.LayerIndex = layerIndex; //We simply add to the existing layer
      }


      //Set plotweight
      if(pWidth > 0)
      {
        att.PlotWeightSource = Rhino.DocObjects.ObjectPlotWeightSource.PlotWeightFromObject;
        att.PlotWeight = pWidth;
      }


      //Set material
      bool materialByName = !string.IsNullOrEmpty(material as string);
      Rhino.Display.DisplayMaterial inMaterial = material as Rhino.Display.DisplayMaterial;
      if(material is Color)
      {
        inMaterial = new Rhino.Display.DisplayMaterial((Color) material);
      }
      if(material != null && inMaterial == null && !materialByName)
      {
        if(!(material is string))
        {
          try //We also resort to try with IConvertible
          {
            inMaterial = (Rhino.Display.DisplayMaterial) Convert.ChangeType(material, typeof(Rhino.Display.DisplayMaterial));
          }
          catch(InvalidCastException)
          {
          }
        }
      }
      if(inMaterial != null || materialByName)
      {
        string matName;

        if(!materialByName)
        {
          matName = string.Format("A:{0}-D:{1}-E:{2}-S:{3},{4}-T:{5}",
            Format(inMaterial.Ambient),
            Format(inMaterial.Diffuse),
            Format(inMaterial.Emission),
            Format(inMaterial.Specular),
            inMaterial.Shine.ToString(),
            inMaterial.Transparency.ToString()
            );
        }
        else
        {
          matName = (string) material;
        }

        int materialIndex = doc.Materials.Find(matName, true);
        if(materialIndex < 0 && !materialByName) //Material does not exist and we have its specs
        {
          materialIndex = doc.Materials.Add(); //Let's add it
          if(materialIndex > -1)
          {
            Print("Added new material at position " + materialIndex + " named \"" + matName + "\". ");
            Rhino.DocObjects.Material m = doc.Materials[materialIndex];
            m.Name = matName;
            m.AmbientColor = inMaterial.Ambient;
            m.DiffuseColor = inMaterial.Diffuse;
            m.EmissionColor = inMaterial.Emission;
            //m.ReflectionColor = no equivalent
            m.SpecularColor = inMaterial.Specular;
            m.Shine = inMaterial.Shine;
            m.Transparency = inMaterial.Transparency;
            //m.TransparentColor = no equivalent
            m.CommitChanges();

            att.MaterialSource = Rhino.DocObjects.ObjectMaterialSource.MaterialFromObject;
            att.MaterialIndex = materialIndex;
          }
          else
            Print("Material did not add. Try cleaning up your materials."); //This never happened to me.
        }
        else if(materialIndex < 0 && materialByName) //Material does not exist and we do not have its specs. We do nothing
        {
          Print("Warning: material name not found. I cannot set the source to this material name. Add a material with name: " + matName);
        }
        else
        {
          //If this material exists, we do not replace it!
          att.MaterialSource = Rhino.DocObjects.ObjectMaterialSource.MaterialFromObject;
          att.MaterialIndex = materialIndex;
        }
      }


      //Set wire density
      if(wires == -1 || wires > 0)
      {
        att.WireDensity = wires;
      }


      //Bake to the right type of object
      switch(obj.ObjectType)
      {
        case Rhino.DocObjects.ObjectType.Brep:
          doc.Objects.AddBrep(obj as Brep, att);
          break;
        case Rhino.DocObjects.ObjectType.Curve:
          doc.Objects.AddCurve(obj as Curve, att);
          break;
        case Rhino.DocObjects.ObjectType.Point:
          doc.Objects.AddPoint((obj as Rhino.Geometry.Point).Location, att);
          break;
        case Rhino.DocObjects.ObjectType.Surface:
          doc.Objects.AddSurface(obj as Surface, att);
          break;
        case Rhino.DocObjects.ObjectType.Mesh:
          doc.Objects.AddMesh(obj as Mesh, att);
          break;
        case Rhino.DocObjects.ObjectType.Extrusion:
          typeof(Rhino.DocObjects.Tables.ObjectTable).InvokeMember("AddExtrusion", BindingFlags.Instance | BindingFlags.InvokeMethod, null, doc.Objects, new object[]{obj, att});
          break;
        case Rhino.DocObjects.ObjectType.PointSet:
          doc.Objects.AddPointCloud(obj as Rhino.Geometry.PointCloud, att); //This is a speculative entry
          break;
        default:
          Print("The script does not know how to handle this type of geometry: " + obj.GetType().FullName);
          break;
      }
      Print("Added " + obj.GetType().Name);

    }
    else
    {
      Print("Inactive");
    }
    obj_out = obj;
# ---------- bakeatt: C# additional code ----------
  static string Format(Color c)
  {
    return (new System.Text.StringBuilder("A")).Append(c.A.ToString()).Append("R").Append(c.R.ToString()).Append("G")
      .Append(c.G.ToString()).Append("B").Append(c.B.ToString()).ToString();
  }
# ---------- end bakeatt ----------

# ==== cluster Cluster
# this cluster ensures all curves will offset on the same side
C = ClusterInput()
panel = Panel(""".1
-.1""")
offset = Offset(Curve=graft(C), Distance=panel, Plane=PlaneXY(0, 0, 0), Corners=1)
pshift = ShiftPaths(Data=offset, Offset=-1)
panel_2 = Panel("""0
1""")
len = Length(Curve=pshift)
sort = SortList(Keys=len, ValuesA=pshift, ValuesB=panel_2)  # -> Keys, ValuesA, ValuesB
item = ListItem(List=sort.ValuesB, Index=0, Wrap=True)
dispatch = Dispatch(List=graft(C), DispatchPattern=item)  # -> ListA, ListB
flip = FlipCurve(Curve=dispatch.ListA)  # -> Curve, Flag
weave = Weave(Pattern=[0, 1], Stream0=dispatch.ListB, Stream1=flip.Curve, NullGaps=False)
curves = ClusterOutput(weave)
