# Grasshopper definition simplify polylines.gh (Grasshopper 0.9.76)
# Copyright: Co-de-iT
# plug-ins: Human

# RELIEF
# shape as structural device
# tutor: Alessio Erioli
# Thessaloniki . 10-16.05.2016
crv = Curve([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])
# <title>
# 
# <description>
# 
# code by <author>
# 
# v <version>
# 
# © Co-de-iT 2016 _ Creative Commons Attribution-NonCommercial-ShareAlike 4.0 International License
cp = ControlPoints(Curve=crv)  # -> Points, Weights, Knots
redpline = Reduce(Polyline=crv, Tolerance=Slider(0.2, range=0..1))  # -> Polyline, Reduction
cp_2 = ControlPoints(Curve=redpline.Polyline)  # -> Points, Weights, Knots
# original control points
preview = CustomPreview(Geometry=cp.Points, Shader=ColourSwatch(SwatchColor=RGB(54, 54, 54)))
# original polylines
preview_2 = CustomPreview(Geometry=crv, Shader=ColourSwatch(SwatchColor=RGB(120, 120, 120)))
# simplified polylines
preview_3 = CustomPreview(Geometry=redpline.Polyline, Shader=ColourSwatch(SwatchColor=RGB(97, 0, 0)))
# simplified control points
preview_4 = CustomPreview(Geometry=cp_2.Points, Shader=ColourSwatch(SwatchColor=RGB(255, 255, 255)))

# ----
# calculate max deviation
number_slider = Slider(317, range=2..500)  # disabled
divide = DivideCurve(Curve=crv, Count=number_slider, Kinks=False)  # -> Points, Tangents, Parameters; disabled
divide_2 = DivideCurve(Curve=redpline.Polyline, Count=number_slider, Kinks=False)  # -> Points, Tangents, Parameters; disabled
ln = Line(StartPoint=divide.Points, EndPoint=divide_2.Points)  # disabled
sort = SortList(Keys=ln, ValuesA=ln)  # -> Keys, ValuesA; disabled
panel = Panel("-1")  # disabled
item = ListItem(List=sort.ValuesA, Index=panel, Wrap=True)  # disabled
len = Length(Curve=item)  # disabled
swatch = ColourSwatch(SwatchColor=RGB(255, 0, 0))  # disabled
panel_2 = Panel("3")  # disabled
max_deviation = Panel(len)  # disabled
previewlw = CustomPreviewLineweights(Geometry=item, Shader=swatch, Thickness=panel_2, Absolute=False)  # disabled
