# Grasshopper definition slicing.gh (Grasshopper 0.9.76)
# Copyright: Co-de-iT
# plug-ins: Human

n_of_spheres = Slider(10, range=2..30)
sphere_max_radius = Slider(33.583, range=0..100)
# RELIEF
# shape as structural device
# tutor: Alessio Erioli
# Thessaloniki . 10-16.05.2016
# BRep geometry generation
# (just for demo - insert your geometry in 0)
number_slider = Slider(42.25, range=0..100)
pt = ConstructPoint(XCoordinate=number_slider, YCoordinate=Slider(64.606, range=0..100), ZCoordinate=Slider(100, range=0..100))
# <title>
# 
# <description>
# 
# code by <author>
# 
# v <version>
# 
# © Co-de-iT 2016 _ Creative Commons Attribution-NonCommercial-ShareAlike 4.0 International License
pt_2 = Point(Point(-100, -100, 0))
addition = Addition(A=pt_2, B=pt)
box = Box2Pt(PointA=pt_2, PointB=addition, Plane=PlaneXY(0, 0, 0))
random = Random(Range=Domain(0, 1), Number=n_of_spheres, Seed=n_of_spheres)
multiplication = Multiplication(A=sphere_max_radius, B=random)
pop3d = Populate3D(Region=box, Count=n_of_spheres, Seed=n_of_spheres)
# insert here your Brep geometry
# (single or multiple,
# even overlapping, objects)
sph = Sphere(Base=pop3d, Radius=multiplication)
mesh = MeshBrep(
    Brep=sph,
    Settings={GridMaxCount=0, GridMinCount=16, JaggedSeams=False, MaxEdgeLength=0, MinEdgeLength=0.0001, MinTolerance=0, Refine=True, RefineAngle=0, RelativeTolerance=0.65, SimplePlanes=True, Tolerance=0})

geometry_type = ValueList({"Brep": 0, "Mesh": 1}, selected="Brep")

# ----
# 0
brep = Brep(sph)
mesh_2 = Mesh(mesh)

filter = StreamFilter(Gate=geometry_type, Stream0=brep, Stream1=mesh_2)
slice_height = Slider(5, range=0.01..10)
bbox = BoundingBox(Content=filter, Plane=PlaneXY(0, 0, 0), UnionBox=True)  # -> Box, Box_2
# geometry preview
previewmat = CustomPreviewMaterials(Geometry=filter, DiffuseColor=RGB(255, 255, 255))
lng = ListLength(List=filter)
larger = LargerThan(FirstNumber=lng, SecondNumber="1")  # -> LargerThan, OrEqualTo
box_2 = EvaluateBox(Box=bbox.Box, UParameter="0", VParameter="0", WParameter="0")  # -> Plane, Point, Include
box_corners = BoxCorners(Box=bbox.Box)  # -> CornerA, CornerB, CornerC, CornerD, CornerE, CornerF, CornerG, CornerH
vec2pt = Vector2Pt(PointA=box_corners.CornerA, PointB=box_corners.CornerE, Unitize=False)  # -> Vector, Length
division = Division(A=vec2pt.Length, B=slice_height)
int = Integer(division)
pl = PlaneNormal(Origin=box_2.Point, ZAxis=vec2pt.Vector)
series = Series(Start=0, Step=slice_height, Count=expr("x+1", int))
amp = Amplitude(Vector=vec2pt.Vector, Amplitude=series)
move = Move(Geometry=pl, Motion=amp)  # -> graft(Geometry), Transform
sec = MeshPlane(Mesh=mesh_2, Plane=move.Geometry)
sec_2 = BrepPlane(Brep=brep, Plane=move.Geometry)  # -> Curves, Points
filter_2 = StreamFilter(Gate=geometry_type, Stream0=sec_2.Curves, Stream1=sec)
gate = StreamGate(Stream=filter_2, Gate=larger.LargerThan)  # -> Target0, Target1
pshift = ShiftPaths(Data=gate.Target1, Offset=-1)
crossref = CrossReference(ListA=pshift, ListB=pshift, CrossMode=5)  # -> ListA, ListB
ccx = CurveCurve(CurveA=crossref.ListA, CurveB=crossref.ListB)  # -> Points, ParamsA, ParamsB
lng_2 = ListLength(List=ccx.Points)
pshift_2 = ShiftPaths(Data=lng_2, Offset=-1)
ma = MassAddition(Input=pshift_2)  # -> Result, PartialResults
larger_2 = LargerThan(FirstNumber=ma.Result, SecondNumber="0")  # -> LargerThan, OrEqualTo
dispatch = Dispatch(List=pshift, DispatchPattern=larger_2.LargerThan)  # -> ListA, ListB
runion = RegionUnion(Curves=dispatch.ListA, Plane=move.Geometry)
weave = Weave(Pattern=larger_2.LargerThan, Stream0=dispatch.ListB, Stream1=runion, NullGaps=False)
filter_3 = StreamFilter(Gate=larger.LargerThan, Stream0=gate.Target0, Stream1=weave)
tstat = TreeStatistics(Tree=filter_3)  # -> Paths, Length, Count

cell_size_y = Slider(109.903, range=0..200)
cell_size_x = Slider(120, range=0..200)
n_of_rows = Slider(3, range=1..10)
expression = Expression(x=tstat.Count, y=n_of_rows, Expression="int(x/y +1)")
pt_3 = Point(Point(0, 0, 0))
recgrid = Rectangular(Plane=pt_3, SizeX=cell_size_x, SizeY=cell_size_y, ExtentX=expression, ExtentY=n_of_rows)  # -> Cells, Points
subtraction = Subtraction(A=tstat.Count, B="1")
# alignment grid
subset = SubList(List=flatten(recgrid.Points), Domain=subtraction, Wrap=True)  # -> graft(List), Index

# ----
# 1
orient = Orient(Geometry=filter_3, Source=move.Geometry, Target=subset.List)  # -> Geometry, Transform

lng_3 = ListLength(List=orient.Geometry)
series_2 = Series(Start=0, Step=1, Count=tstat.Count)  # -> graft(Series)
seq = Sequence(Count=lng_3, CharPool="abcdefghijklmnopqrstuvwxyz", Format="{0}")
int_2 = Integer(series_2)
concat = Concatenate(FragmentA=int_2, FragmentB="_")
area = Area(Geometry=orient.Geometry)  # -> Area, Centroid
concat_2 = Concatenate(FragmentA=concat, FragmentB=seq)
font = ValueList({"Machine Tool Gothic", "Machine Tool SanSerif"}, selected="Machine Tool Gothic")
text_size = Slider(3, range=0..100)
xy = XYPlane(Origin=area.Centroid)
# generate text code
fpars = FontParser(S=concat_2, font=font, size=text_size, prec="100", P=xy, J="6")  # -> out, C; inputs S: String, font: String, close: Boolean, size: Double, prec: Double, P: Plane, J: Int32
# ---------- fpars: C# ----------
        /*
    Font Parser
    Adaptation of code written by David Rutten, Giulio Piacentino et al.
    Adaptation for C# by Alessio Erioli - Co-de-iT
    */

    Component.Name = "Font Parser";
    Component.NickName = "FPars";
    Component.Description = "converts text into polylines - useful for fabrication";
    Component.Params.Input[0].Description = "text to convert";
    Component.Params.Input[1].Description = "text font";
    Component.Params.Input[2].Description = "close polylines (optional)";
    Component.Params.Input[3].Description = "text size";
    Component.Params.Input[4].Description = "sampling precision (usually 100-250 is ok)";
    Component.Params.Input[5].Description = "destination plane";
    Component.Params.Input[6].Description = "text justification (0-8)";


    float fS = size == 0 ? 1 : (float) size;
    System.Drawing.Font local_font = new System.Drawing.Font(font, (float) fS);

    System.Drawing.Drawing2D.GraphicsPath path = new System.Drawing.Drawing2D.GraphicsPath();
    path.AddString(S, local_font.FontFamily, (int) local_font.Style, local_font.Size, new PointF(0, 0), new StringFormat());

    System.Drawing.Drawing2D.Matrix matrix = new  System.Drawing.Drawing2D.Matrix(); // transformation matrix
    matrix.Reset(); // build identity matrix

    // ______________ text justification ______________

    RectangleF rec = path.GetBounds(); // bounding rectangle for text
    float dX = Convert.ToSingle(rec.Width * -0.5), dY = Convert.ToSingle(rec.Height * 0.5);
    switch(J){
      case 0:// top left
        dX = 0;
        dY = fS;
        break;
      case 1: // middle left
        dX = 0;
        dY = Convert.ToSingle((-rec.Height) * 0.5 + fS);
        break;
      case 2:  // bottom left
        dX = 0;
        dY = Convert.ToSingle(-rec.Height + fS * 0.5);
        break;
      case 3: // top center
        dX = Convert.ToSingle(rec.Width * -0.5);
        dY = fS;
        break;
      case 4: // middle center
        dX = Convert.ToSingle(rec.Width * -0.5);
        dY = Convert.ToSingle((-rec.Height) * 0.5 + fS);
        break;
      case 5: // bottom center
        dX = Convert.ToSingle(rec.Width * -0.5);
        dY = Convert.ToSingle(-rec.Height + fS * 0.5);
        break;
      case 6: // top right
        dX = Convert.ToSingle(rec.Width * -1);
        dY = fS;
        break;
      case 7: // middle right
        dX = Convert.ToSingle(rec.Width * -1);
        dY = Convert.ToSingle((-rec.Height) * 0.5 + fS);
        break;
      case 8: // bottom right
        dX = Convert.ToSingle(rec.Width * -1);
        dY = Convert.ToSingle(-rec.Height + fS * 0.5);
        break;

    }
    //float dX = Convert.ToSingle(rec.Width * -0.5);
    //float dY = Convert.ToSingle(rec.Height * 0.5);
    System.Drawing.Drawing2D.Matrix mTrans = new  System.Drawing.Drawing2D.Matrix(1, 0, 0, 1, dX, dY); // build transformation matrix
    path.Transform(mTrans); // transform text path

    // ______________ convert to polylines ______________

    path.Flatten(matrix, (float) (size / prec)); // turns the path into a polyline that approximates the path

    PointF[] pts = path.PathPoints; // get path points
    Byte[] tps = path.PathTypes;   // get path point types
    List<Polyline> strokes = new  List<Polyline>(); // List for strokes
    Polyline stroke = new Polyline();

    Byte typ_start = Convert.ToByte(System.Drawing.Drawing2D.PathPointType.Start);// find start points condition

    // the conversion loop
    for (int i = 0; i < pts.Length; i++){
      // if a start point is found, and the existing polyline is not null nor a single point,
      // add polyline to the strokes and create a new polyline
      if(tps[i] == typ_start){
        if (stroke != null && stroke.Count > 1) {
          if (close) stroke.Add(stroke[0]); // close polyline if necessary
          strokes.Add(stroke);}
        stroke = new Polyline();
      }
      // in any other case add the next point to a polyline
      stroke.Add(pts[i].X, -pts[i].Y + size, 0);
      // add last stroke to the list
      if (i == pts.Length - 1) {
        if (close) stroke.Add(stroke[0]); // and close it if necessary
        strokes.Add(stroke);
      }
    }


    // ______________ align strokes to given plane ______________

    Transform align = Transform.PlaneToPlane(Plane.WorldXY, P); // align transformation
    for(int j = 0; j < strokes.Count; j++){
      strokes[j].Transform(align);
    }

    C = strokes;
# ---------- end fpars ----------
pshift_3 = ShiftPaths(Data=fpars.C, Offset=-1)

deplane = DeconstructPlane(Plane=move.Geometry)  # -> Origin, XAxis, YAxis, ZAxis
amp_2 = Amplitude(Vector=deplane.XAxis, Amplitude=Slider(52.75, range=0..100))
multiplication_2 = Multiplication(A=amp_2, B=0.9)
move_2 = Move(Geometry=deplane.Origin, Motion=amp_2)  # -> Geometry, Transform
move_3 = Move(Geometry=deplane.Origin, Motion=multiplication_2)  # -> Geometry, Transform
range = Range(Domain=Domain(0, 1), Steps=expr("x-1", tstat.Count))
xz = XZPlane(Origin=move_2.Geometry)
ln = Line(StartPoint=deplane.Origin, EndPoint=move_3.Geometry)
gradient = Gradient(LowerLimit=0, UpperLimit=1, Parameter=range, stops=[0.0631: RGB(14, 26, 76), 0.946: RGB(137, 205, 240)])
# display layers on 3D model
text_size_2 = Slider(3, range=0..100)
preview = CustomPreview(Geometry=ln, Shader=graft(gradient))
tag = TextTag3D(Location=xz, Text=int_2, Size=text_size_2, Colour=graft(gradient), Justification=7)
preview_2 = CustomPreview(Geometry=filter_3, Shader=graft(gradient))

viewer = ParamViewer(filter_3)
cull_i = CullIndex(List=viewer, Indices="0", Wrap=True)
shift = ShiftList(List=flatten(subset.List), Shift="-1", Wrap=False)  # -> graft(List)
shift_2 = ShiftList(List=flatten(move.Geometry), Shift=1, Wrap=False)  # -> graft(List)
branch = TreeBranch(Tree=filter_3, Path=cull_i, MaintainPaths=False)
# display upper layer projection
orient_2 = Orient(Geometry=branch, Source=shift_2, Target=shift)  # -> Geometry, Transform
preview_3 = CustomPreview(Geometry=orient_2.Geometry, Shader=ColourSwatch(SwatchColor=RGB(97, 97, 97)))

crv = Curve(simplify(orient.Geometry))
end = EndPoints(Curve=crv)  # -> Start, End
crossref_2 = CrossReference(ListA=crv, ListB=crv, CrossMode=4)  # -> ListA, ListB
# separate contours/holes
incurves = PointInCurves(Point=end.Start, Curves=crossref_2.ListA)  # -> Relationship, Index, Point
equals = Equality(FirstNumber=incurves.Relationship, SecondNumber=2)  # -> Equality, Inequality
dispatch_2 = Dispatch(List=crv, DispatchPattern=equals.Equality)  # -> ListA, ListB

# ----
# display curves with height-based gradient
preview_4 = CustomPreview(Geometry=orient.Geometry, Shader=graft(gradient))

# ----
# automated layer separation and grouping for automated nesting
# outer cuts
# inner cuts
# engrave
# engrave text
crv_2 = Curve(simplify(dispatch_2.ListB))
crv_3 = Curve(simplify(dispatch_2.ListA))
crv_4 = Curve(simplify(orient_2.Geometry))
crv_5 = Curve(simplify(pshift_3))

# ----
# curves
# Insert here the polylines if not generated in this definition.
# 
# There should be one tree branch for each piece to be cut.
# 
# Example: 3 pieces (each with outer cuts, inner cuts, engraving and text)
# 
# For each of those works I'll have a datat tree with 3 branches, {0}, {1} e {2}.
# 
# In the "outer cuts" component I'll put all the polylines for outer cuts, in branch {0} the ones relative to the first component, branch {1} those relative to the second one and so on. Same structure for all other works.
# 
# Maintaining this order is necessary for a correct group bake and thus use Rhinonest
# please erase all groups from the Rhino file before baking.
# If unsure copy the polylines in a new file before referencing them in this part of the definition to avoid previous groups.
# outer cuts
# inner cuts
# engrave
# engrave text
# convex hull for each layer
number_slider_2 = Slider(63, range=10..100)
lng_4 = ListLength(List=crv_2)
lng_5 = ListLength(List=crv_3)
lng_6 = ListLength(List=crv_4)
lng_7 = ListLength(List=crv_5)
layers_names = Panel("""l_outer_cut
l_inner_cut
l_engrave
l_engrave_text""")
merge = Merge(Data1=simplify(lng_4), Data2=simplify(lng_5), Data3=simplify(lng_6), Data4=simplify(lng_7))
merge_2 = Merge(Data1=simplify(crv_2), Data2=simplify(crv_3), Data3=simplify(crv_4), Data4=simplify(crv_5))
divide = DivideCurve(Curve=merge_2, Count=number_slider_2, Kinks=False)  # -> Points, Tangents, Parameters
pshift_4 = ShiftPaths(Data=divide.Points, Offset=-1)
hull = ConvexHull(Points=pshift_4, Plane=PlaneXY(0, 0, 0))  # -> Hull, HullZ, Indices
avr = Average(Input=pshift_4)
scale = Scale(Geometry=hull.Hull, Center=avr, Factor=Slider(1.0713, range=1..1.1))  # -> Geometry, Transform
preview_5 = CustomPreview(Geometry=crv_2, Shader=ColourSwatch(SwatchColor=RGB(0, 0, 0)))
preview_6 = CustomPreview(Geometry=crv_3, Shader=ColourSwatch(SwatchColor=RGB(153, 153, 153)))
preview_7 = CustomPreview(Geometry=crv_4, Shader=ColourSwatch(SwatchColor=RGB(255, 0, 0)))
preview_8 = CustomPreview(Geometry=crv_5, Shader=ColourSwatch(SwatchColor=RGB(255, 255, 255)))
preview_9 = CustomPreview(Geometry=scale.Geometry, Shader=ColourSwatch(SwatchColor=RGB(0, 242, 255)))
tstat_2 = TreeStatistics(Tree=merge_2)  # -> Paths, Length, Count
stack = StackData(Data=layers_names, Stack=merge)
series_3 = Series(Start=0, Step=1, Count=tstat_2.Count)
group = BooleanToggle(True)
# 2
bake = Button()
int_3 = Integer(simplify(graft(series_3)))
bakeatt = BakeAttributesEnhanced(obj=merge_2, layer=stack, group_n=int_3, group=group, bake_iT=bake)  # -> info, obj_out; inputs obj: GeometryBase, name: String, layer: String, color: Color, pWidth: Double, wires: Int32, group_n: Int32, group: Boolean, bake_iT: Boolean
# ---------- bakeatt: C# ----------
    //Inserts geometry into the Rhino document, with custom attributes
    //Written by Giulio Piacentino
    //Version written 2010 11 21 - for Grasshopper 0.8.002
    //Enhanced by Co-de-iT (Alessio) - now bakes on chosen layer(s) and in groups

    String eol = Environment.NewLine;
    Component.Name = "Bake Attributes Enhanced";
    Component.NickName = "BakeAtt++";
    Component.Message = "v1.1 _ by Giulio Piacentino" + eol + "enhanced by Co-de-iT";
    Component.Description = "Bakes objects with attributes such as color, material, layer, object name, wire density. Option to bake in groups";

    if (bake_iT)
    {
      if(obj == null)
      {
        Print("No object to bake");
        return;
      }

      //Make new attribute to set name
      Rhino.DocObjects.ObjectAttributes att = new Rhino.DocObjects.ObjectAttributes();

      //Set object name
      if(!string.IsNullOrEmpty(name))
      {
        att.Name = name;
      }

      //Set color
      if(!color.IsEmpty)
      {
        att.ColorSource = Rhino.DocObjects.ObjectColorSource.ColorFromObject; //Make the color type "by object"
        att.ObjectColor = color;

        att.PlotColorSource = Rhino.DocObjects.ObjectPlotColorSource.PlotColorFromObject; //Make the plot color type "by object"
        att.PlotColor = color;
      }

      // Set group

      if(group)
      {
        doc.Groups.Add(Convert.ToString(group_n));
        att.AddToGroup(group_n);

      }

      //Set layer
      if(!string.IsNullOrEmpty(layer) && Rhino.DocObjects.Layer.IsValidName(layer))
      {
        //Get the current layer index
        Rhino.DocObjects.Tables.LayerTable layerTable = doc.Layers;
        int layerIndex = layerTable.Find(layer, true);

        if(layerIndex < 0) //This layer does not exist, we add it
        {
          Rhino.DocObjects.Layer onlayer = new Rhino.DocObjects.Layer(); //Make a new layer
          onlayer.Name = layer;
          

          layerIndex = layerTable.Add(onlayer); //Add the layer to the layer table
          if (layerIndex > -1) //We manged to add layer!
          {
            att.LayerIndex = layerIndex;
            Print("Added new layer to the document at position " + layerIndex + " named " + layer + ". ");
          } else
            Print("Layer did not add. Try cleaning up your layers."); //This never happened to me.
        }
        else
          att.LayerIndex = layerIndex; //We simply add to the existing layer
      }


      //Set plotweight
      if(pWidth > 0)
      {
        att.PlotWeightSource = Rhino.DocObjects.ObjectPlotWeightSource.PlotWeightFromObject;
        att.PlotWeight = pWidth;
      }


      //Set material
      bool materialByName = !string.IsNullOrEmpty(material as string);
      Rhino.Display.DisplayMaterial inMaterial = material as Rhino.Display.DisplayMaterial;
      if(material is Color)
      {
        inMaterial = new Rhino.Display.DisplayMaterial((Color) material);
      }
      if(material != null && inMaterial == null && !materialByName)
      {
        if(!(material is string))
        {
          try //We also resort to try with IConvertible
          {
            inMaterial = (Rhino.Display.DisplayMaterial) Convert.ChangeType(material, typeof(Rhino.Display.DisplayMaterial));
          }
          catch(InvalidCastException)
          {
          }
        }
      }
      if(inMaterial != null || materialByName)
      {
        string matName;

        if(!materialByName)
        {
          matName = string.Format("A:{0}-D:{1}-E:{2}-S:{3},{4}-T:{5}",
            Format(inMaterial.Ambient),
            Format(inMaterial.Diffuse),
            Format(inMaterial.Emission),
            Format(inMaterial.Specular),
            inMaterial.Shine.ToString(),
            inMaterial.Transparency.ToString()
            );
        }
        else
        {
          matName = (string) material;
        }

        int materialIndex = doc.Materials.Find(matName, true);
        if(materialIndex < 0 && !materialByName) //Material does not exist and we have its specs
        {
          materialIndex = doc.Materials.Add(); //Let's add it
          if(materialIndex > -1)
          {
            Print("Added new material at position " + materialIndex + " named \"" + matName + "\". ");
            Rhino.DocObjects.Material m = doc.Materials[materialIndex];
            m.Name = matName;
            m.AmbientColor = inMaterial.Ambient;
            m.DiffuseColor = inMaterial.Diffuse;
            m.EmissionColor = inMaterial.Emission;
            //m.ReflectionColor = no equivalent
            m.SpecularColor = inMaterial.Specular;
            m.Shine = inMaterial.Shine;
            m.Transparency = inMaterial.Transparency;
            //m.TransparentColor = no equivalent
            m.CommitChanges();

            att.MaterialSource = Rhino.DocObjects.ObjectMaterialSource.MaterialFromObject;
            att.MaterialIndex = materialIndex;
          }
          else
            Print("Material did not add. Try cleaning up your materials."); //This never happened to me.
        }
        else if(materialIndex < 0 && materialByName) //Material does not exist and we do not have its specs. We do nothing
        {
          Print("Warning: material name not found. I cannot set the source to this material name. Add a material with name: " + matName);
        }
        else
        {
          //If this material exists, we do not replace it!
          att.MaterialSource = Rhino.DocObjects.ObjectMaterialSource.MaterialFromObject;
          att.MaterialIndex = materialIndex;
        }
      }


      //Set wire density
      if(wires == -1 || wires > 0)
      {
        att.WireDensity = wires;
      }


      //Bake to the right type of object
      switch(obj.ObjectType)
      {
        case Rhino.DocObjects.ObjectType.Brep:
          doc.Objects.AddBrep(obj as Brep, att);
          break;
        case Rhino.DocObjects.ObjectType.Curve:
          doc.Objects.AddCurve(obj as Curve, att);
          break;
        case Rhino.DocObjects.ObjectType.Point:
          doc.Objects.AddPoint((obj as Rhino.Geometry.Point).Location, att);
          break;
        case Rhino.DocObjects.ObjectType.Surface:
          doc.Objects.AddSurface(obj as Surface, att);
          break;
        case Rhino.DocObjects.ObjectType.Mesh:
          doc.Objects.AddMesh(obj as Mesh, att);
          break;
        case Rhino.DocObjects.ObjectType.Extrusion:
          typeof(Rhino.DocObjects.Tables.ObjectTable).InvokeMember("AddExtrusion", BindingFlags.Instance | BindingFlags.InvokeMethod, null, doc.Objects, new object[]{obj, att});
          break;
        case Rhino.DocObjects.ObjectType.PointSet:
          doc.Objects.AddPointCloud(obj as Rhino.Geometry.PointCloud, att); //This is a speculative entry
          break;
        default:
          Print("The script does not know how to handle this type of geometry: " + obj.GetType().FullName);
          break;
      }
      Print("Added " + obj.GetType().Name);

    }
    else
    {
      Print("Inactive");
    }
    obj_out = obj;
# ---------- bakeatt: C# additional code ----------
  static string Format(Color c)
  {
    return (new System.Text.StringBuilder("A")).Append(c.A.ToString()).Append("R").Append(c.R.ToString()).Append("G")
      .Append(c.G.ToString()).Append("B").Append(c.B.ToString()).ToString();
  }
# ---------- end bakeatt ----------
