# Grasshopper definition 01_lists basics.gh (Grasshopper 0.9.76)
# Copyright: Co-de-iT

# <title>
# 
# <description>
# 
# code by <author>
# 
# v <version>
# 
# © Co-de-iT 2016 _ Creative Commons Attribution-NonCommercial-ShareAlike 4.0 International License
# RELIEF
# shape as structural device
# tutor: Alessio Erioli
# Thessaloniki . 10-16.05.2016
# 01 basic operations
# list item
series = Series(Start=0, Step=1, Count=10)
# merge
panel = Panel("5")
# dispatch/weave
series_2 = Series(Start=0, Step=1, Count=10)
panel_2 = Panel(series)
# split list
series_3 = Series(Start=0, Step=1, Count=10)
# sub list
series_4 = Series(Start=0, Step=1, Count=10)
# sort list
panel_3 = Panel("0 to 100")
# sift/combine
series_5 = Series(Start=0, Step=1, Count=10)
# insert/replace items
series_6 = Series(Start=0, Step=1, Count=10)
# shift list
series_7 = Series(Start=0, Step=1, Count=10)
series_8 = Series(Start="11", Step="10", Count=10)
# pick'n'choose
series_9 = Series(Start=0, Step=1, Count=10)
# partition list
series_10 = Series(Start=0, Step=1, Count=10)
panel_4 = Panel(series_3)
panel_5 = Panel(series_4)
panel_6 = Panel(series_5)
panel_7 = Panel(series_6)
panel_8 = Panel(series_2)
series_11 = Series(Start=0, Step=1, Count=panel)
series_12 = Series(Start=panel, Step=1, Count=panel)
panel_9 = Panel(series_7)
wrap = BooleanToggle(False)
panel_10 = Panel(series_9)
panel_11 = Panel(series_8)
random = Random(Range=panel_3, Number="10", Seed=2, Integers=True)
panel_12 = Panel(series_10)
domain_start = Slider(2, range=0..9)
panel_13 = Panel(series_11)
panel_14 = Panel(series_12)
domain_start_2 = Slider(6, range=0..9)
number_slider = Slider(0, range=0..20)
panel_15 = Panel("""0
0
1
1""")
wrap_2 = BooleanToggle(False)
panel_16 = Panel("""false
true""")
item = ListItem(List=series, Index=Slider(0, range=0..20), Wrap=wrap)

item_2 = ListItem(List=series, Index="0", Wrap="true")
item_3 = ListItem(List=series, Index="-1", Wrap="true")

panel_17 = Panel(random)

sift = SiftPattern(List=series_5, SiftPattern=panel_15)  # -> Output0, Output1
combine = CombineData(Input0=sift.Output0, Input1=sift.Output1)  # -> Result, Index

series_13 = Series(Start=0, Step=1, Count="10")
wrap_3 = BooleanToggle(False)
merge = Merge(Data1=series_11, Data2=series_12)
panel_18 = Panel(item_2)
panel_19 = Panel(item_3)
split = SplitList(List=series_3, Index=Slider(3, range=0..9))  # -> ListA, ListB
sort = SortList(Keys=random, ValuesA=series_13)  # -> Keys, ValuesA
random_2 = Random(Range=Domain(0, 1), Number=Slider(8, range=1..20), Seed=2, Integers=True)
shift = ShiftList(List=series_7, Shift=Slider(-2, range=-9..9), Wrap=wrap_2)
panel_20 = Panel(sift.Output0)
panel_21 = Panel(sift.Output1)
dom = ConstructDomain(DomainStart=domain_start, DomainEnd=domain_start_2)
dispatch = Dispatch(List=series_2, DispatchPattern=panel_16)  # -> ListA, ListB
panel_22 = Panel(merge)
element = Panel(item)
panel_23 = Panel("""3
2
1""")

ins = InsertItems(List=series_6, Item="42", Indices=number_slider, Wrap=wrap_3)
replace = ReplaceItems(List=series_6, Item="42", Indices=number_slider, Wrap=wrap_3)

int = Integer(sort.ValuesA)
# pick'n'choose
# 
# uses an index pattern (P)
# to compose a list from the
# respective input channels
# 
# the list is as long as
# the index pattern
p_n_c = PickNChoose(Pattern=random_2, Stream0=series_9, Stream1=series_8)
subset = SubList(List=series_4, Domain=dom, Wrap=True)  # -> List, Index
panel_24 = Panel(shift)
panel_25 = Panel(sort.Keys)
panel_26 = Panel(dispatch.ListA)
panel_27 = Panel(int)
panel_28 = Panel(dispatch.ListB)
partition = PartitionList(List=series_10, Size=panel_23)
panel_29 = Panel(random_2)
panel_30 = Panel(p_n_c)
insert = Panel(ins)
replace_2 = Panel(replace)
list_a = Panel(split.ListA)
list_b = Panel(split.ListB)
items = Panel(subset.List)
indices = Panel(subset.Index)
weave = Weave(Pattern=panel_16, Stream0=dispatch.ListB, Stream1=dispatch.ListA, NullGaps=False)
panel_31 = Panel(combine.Index)
panel_32 = Panel(combine.Result)
panel_33 = Panel(partition)
panel_34 = Panel(weave)
division_pts = Slider(64, range=2..150)
# 02 examples
crv = Curve(<curve referenced from the Rhino model>)
crv_2 = Curve(<curve referenced from the Rhino model>)
crv_3 = Curve(<curve referenced from the Rhino model>)
crv_4 = Curve(<curve referenced from the Rhino model>)
division_pts_2 = Slider(150, range=2..150)
pt = Point([Point(69, 51, 11.48105052), Point(68.96666667, 49.4, 11.40706153), Point(68.93333333, 47.8, 11.19529993), Point(68.9, 46.2, 10.86107379), Point(68.86666667, 44.6, 10.41969118), Point(68.83333333, 43, 9.886460168)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])
crv_5 = Curve(<curve referenced from the Rhino model>)
crv_6 = Curve(<curve referenced from the Rhino model>)
number_slider_2 = Slider(176, range=2..200)
division_pts_3 = Slider(64, range=2..150)
domain_start_3 = Slider(20, range=2..150)
domain_end = Slider(36, range=2..150)
crv_7 = Curve(<curve referenced from the Rhino model>)
division_pts_4 = Slider(64, range=2..150)
pdecon = Deconstruct(Point=pt)  # -> XComponent, YComponent, ZComponent
crv_8 = Curve(<curve referenced from the Rhino model>)
divide = DivideCurve(Curve=crv, Count=division_pts, Kinks=False)  # -> Points, Tangents, Parameters
wrap_4 = BooleanToggle(True)
item_index = Slider(27, range=0..150)
y_cells = Slider(46, range=2..200)
grid_size = Slider(52.533, range=0..100)
x_cells = Slider(46, range=2..200)
division_pts_5 = Slider(64, range=2..150)
pt_2 = Point(<point referenced from the Rhino model>)
crv_9 = Curve(<curve referenced from the Rhino model>)
crv_10 = Curve(<curve referenced from the Rhino model>)
crv_11 = Curve(<curve referenced from the Rhino model>)
crv_12 = Curve(<curve referenced from the Rhino model>)
divide_2 = DivideCurve(Curve=crv_2, Count=division_pts_2, Kinks=False)  # -> Points, Tangents, Parameters
y_cells_2 = Slider(14, range=2..200)
grid_size_2 = Slider(52.533, range=0..100)
x_cells_2 = Slider(54, range=2..200)
divide_3 = DivideCurve(Curve=crv_3, Count=division_pts_2, Kinks=False)  # -> Points, Tangents, Parameters
divide_4 = DivideCurve(Curve=crv_4, Count=division_pts_2, Kinks=False)  # -> Points, Tangents, Parameters
pt_3 = Point(<point referenced from the Rhino model>)
sort_2 = SortList(Keys=pdecon.ZComponent, ValuesA=pt)  # -> Keys, ValuesA
divide_5 = DivideCurve(Curve=crv_6, Count=number_slider_2, Kinks=False)  # -> Points, Tangents, Parameters
divide_6 = DivideCurve(Curve=crv_5, Count=number_slider_2, Kinks=False)  # -> Points, Tangents, Parameters
multiplication = Multiplication(A=Slider(0.521, range=0..1), B=division_pts_4)
cp = ControlPoints(Curve=crv_12)  # -> Points, Weights, Knots
divide_7 = DivideCurve(Curve=crv_7, Count=division_pts_3, Kinks=False)  # -> Points, Tangents, Parameters
cp_2 = ControlPoints(Curve=crv_11)  # -> Points, Weights, Knots
neg = Negative(Value=Slider(0, range=0..200))
addition = Addition(A=x_cells_2, B="1")
division = Division(A=grid_size, B=x_cells)
division_2 = Division(A=grid_size, B=y_cells)
divide_8 = DivideCurve(Curve=crv_9, Count=division_pts_5, Kinks=False)  # -> Points, Tangents, Parameters
lng = ListLength(List=divide.Points)
item_4 = ListItem(List=divide.Points, Index=item_index, Wrap=wrap_4)
bnd = Bounds(Numbers=sort_2.Keys)
divide_9 = DivideCurve(Curve=crv_10, Count=division_pts_5, Kinks=False)  # -> Points, Tangents, Parameters
tan_strength_b = Slider(-21.299, range=-100..0)
addition_2 = Addition(A=y_cells_2, B="1")
tan_strength_a = Slider(13.903, range=0..100)
random_3 = Random(Range="0 to 2", Number=division_pts_2, Seed=2, Integers=True)
dom_2 = ConstructDomain(DomainStart=domain_start_3, DomainEnd=domain_end)
division_3 = Division(A=grid_size_2, B=x_cells_2)
entwine = Entwine(Branch00=divide_2.Points, Branch01=divide_3.Points, Branch02=divide_4.Points, FlattenInputs=True)
division_4 = Division(A=grid_size_2, B=y_cells_2)
int_2 = Integer(multiplication)
pframes = PerpFrames(Curve=crv_8, Count=division_pts_4, Align=True)  # -> Frames, Parameters
pt_4 = Point(<point referenced from the Rhino model>)
cir = Circle(Plane=pt_4, Radius=1)
pt_5 = Point(<point referenced from the Rhino model>)

shift_2 = ShiftList(List=divide_5.Points, Shift=neg, Wrap=True)
shift_3 = ShiftList(List=divide_6.Points, Shift=Slider(39, range=0..200), Wrap=True)

dedomain = DeconstructDomain(Domain=bnd)  # -> Start, End
series_14 = Series(Start=0, Step=1, Count=addition)
index = Panel(int_2)
list_length = Panel(lng)
panel_35 = Panel("""5
3
4""")
flip = FlipMatrix(Data=entwine)
recgrid = Rectangular(Plane=pt_2, SizeX=division, SizeY=division_2, ExtentX=x_cells, ExtentY=y_cells)  # -> Cells, Points
ins_2 = InsertItems(List=cp_2.Points, Item=pt_4, Indices=Slider(5, range=0..5), Wrap=True)
cir_2 = Circle(Plane=pt_5, Radius=1)
p_n_c_2 = PickNChoose(Pattern=random_3, Stream0=divide_2.Points, Stream1=divide_3.Points, Stream2=divide_4.Points)  # -> graft(Result)
replace_3 = ReplaceItems(List=cp.Points, Item=pt_5, Indices=Slider(4, range=0..6), Wrap=False)
split_2 = SplitList(List=pframes.Frames, Index=int_2)  # -> ListA, ListB
recgrid_2 = Rectangular(Plane=pt_3, SizeX=division_3, SizeY=division_4, ExtentX=x_cells_2, ExtentY=y_cells_2)  # -> Cells, Points
gradient = Gradient(
    LowerLimit=dedomain.Start,
    UpperLimit=dedomain.End,
    Parameter=sort_2.Keys,
    stops=[0.011: RGB(191, 8, 8), 0.999: RGB(255, 255, 255)])
Z = UnitZ(Factor=1)
random_4 = Random(Range="0 to 2", Number=addition_2, Seed=series_14, Integers=True)
ln = Line(StartPoint=shift_2, EndPoint=shift_3)
series_15 = Series(Start=0, Step=1, Count=x_cells)  # -> graft(Series)

subset_2 = SubList(List=divide_7.Points, Domain=dom_2, Wrap=True)  # -> List, Index
subset_3 = SubList(List=divide_7.Tangents, Domain=dom_2, Wrap=True)  # -> List, Index

random_threshold = Slider(0.252, range=0..1)
avr = Average(Input=flip)
X = UnitX(Factor=tan_strength_b)

partition_2 = PartitionList(List=divide_9.Points, Size=panel_35)
partition_3 = PartitionList(List=divide_8.Points, Size=panel_35)
rev = ReverseList(List=partition_3)

pt_6 = Point(<point referenced from the Rhino model>)
points = PointList(Points=ins_2, Size=2)
points_2 = PointList(Points=replace_3, Size=2)
lng_2 = ListLength(List=recgrid.Cells)
explode = Explode(Curve=recgrid.Cells, Recursive=True)  # -> Segments, Vertices
polygon = Polygon(Plane=split_2.ListB, Radius="1.5", Segments=6, FilletRadius=0)  # -> Polygon, Length
line = LineSDL(Start=item_4, Direction=Z, Length=Slider(10, range=0..10))
item_5 = ListItem(List=ln, Index=0, Wrap=True)
cir_3 = Circle(Plane=split_2.ListA, Radius="1.5")
multiplication_2 = Multiplication(A=subset_3.List, B=tan_strength_a)
random_5 = Random(Range=Domain(0, 1), Number=lng_2, Seed=series_15)
swatch = ColourSwatch(SwatchColor=RGB(255, 255, 255))
nurbs = NurbsCurve(Vertices=ins_2, Degree=3, Periodic=False)  # -> Curve, Length, Domain
pline = PolyLine(Vertices=ins_2, Closed=False)
end = EndPoints(Curve=line)  # -> Start, End
multiplication_3 = Multiplication(A=division_3, B=Slider(1, range=0..1))
nurbs_2 = NurbsCurve(Vertices=replace_3, Degree=3, Periodic=False)  # -> Curve, Length, Domain
pline_2 = PolyLine(Vertices=flatten(avr), Closed=False)
pline_3 = PolyLine(Vertices=replace_3, Closed=False)
merge_2 = Merge(Data1=partition_2, Data2=rev)
ln_2 = Line(StartPoint=avr, EndPoint=p_n_c_2)
smaller = SmallerThan(FirstNumber=random_5, SecondNumber=random_threshold)  # -> graft(SmallerThan), OrEqualTo
preview = CustomPreview(Geometry=sort_2.ValuesA, Shader=gradient)
bzspan = BezierSpan(StartPoint=subset_2.List, StartTangent=multiplication_2, EndPoint=pt_6, EndTangent=X)  # -> Curve, Length, Domain
preview_2 = CustomPreview(Geometry=item_5, Shader=ColourSwatch(SwatchColor=RGB(255, 255, 255)))
preview_3 = CustomPreview(Geometry=line, Shader=swatch)
tag = TextTag3D(Location=end.End, Text=item_index, Size=1, Colour=swatch, Justification=7)
X_2 = UnitX(Factor=multiplication_3)
X_3 = UnitX(Factor=division_3)
preview_4 = CustomPreview(Geometry=cir_3, Shader=ColourSwatch(SwatchColor=RGB(255, 255, 255)))
dash = DashPattern(Curve=pline, Pattern="1")  # -> Dashes, Gaps
dispatch_2 = Dispatch(List=explode.Vertices, DispatchPattern=smaller.SmallerThan)  # -> ListA, ListB
nurbs_3 = NurbsCurve(Vertices=merge_2, Degree=3, Periodic=Toggle(True))  # -> Curve, Length, Domain
dash_2 = DashPattern(Curve=pline_3, Pattern="1")  # -> Dashes, Gaps
crv_13 = Curve([<curve referenced from the Rhino model> x2])
panel_36 = Panel("""0
2""")
panel_37 = Panel("""1
3""")
item_6 = ListItem(List=dispatch_2.ListB, Index=panel_37, Wrap=True)
item_7 = ListItem(List=dispatch_2.ListA, Index=panel_36, Wrap=True)
divide_10 = DivideCurve(Curve=crv_13, Count=Slider(71, range=2..100), Kinks=False)  # -> Points, Tangents, Parameters
pline_4 = PolyLine(Vertices=item_7, Closed=False)  # -> flatten(Polyline)
pline_5 = PolyLine(Vertices=item_6, Closed=False)  # -> flatten(Polyline)

curvature = Curvature(Curve=graft(crv_13), Parameter=divide_10.Parameters)  # -> P, K, C
darc = DeconstructArc(Arc=curvature.C)  # -> BasePlane, Radius, Angle
# points are moved
# along curvature direction
bnd_2 = Bounds(Numbers=darc.Radius)
# K
remap = RemapNumbers(Value=darc.Radius, Source=bnd_2, Target=Domain(0, 1))  # -> Mapped, Clipped
multiplication_4 = Multiplication(A=Slider(4.818, range=0.1..20), B=remap.Mapped)
amp = Amplitude(Vector=curvature.K, Amplitude=multiplication_4)

weave_2 = Weave(Pattern=flatten(smaller.SmallerThan), Stream0=pline_5, Stream1=pline_4, NullGaps=False)
preview_5 = CustomPreview(Geometry=weave_2, Shader=ColourSwatch(SwatchColor=RGB(0, 0, 0)))
grid_size_3 = Slider(52.533, range=0..100)
x_cells_3 = Slider(46, range=2..200)
y_cells_3 = Slider(46, range=2..200)
pt_7 = Point(<point referenced from the Rhino model>)
# T
move = Move(Geometry=divide_10.Points, Motion=amp)  # -> Geometry, Transform
flip_2 = FlipMatrix(Data=move.Geometry)
flip_3 = FlipMatrix(Data=divide_10.Points)
division_5 = Division(A=grid_size_3, B=x_cells_3)
division_6 = Division(A=grid_size_3, B=y_cells_3)
pline_6 = PolyLine(Vertices=flip_3, Closed=False)  # -> flatten(Polyline)
pline_7 = PolyLine(Vertices=flip_2, Closed=False)  # -> flatten(Polyline)
recgrid_3 = Rectangular(Plane=pt_7, SizeX=division_5, SizeY=division_6, ExtentX=x_cells_3, ExtentY=y_cells_3)  # -> Cells, Points
shift_4 = ShiftList(List=pline_7, Shift=1, Wrap=True)  # -> flatten(List)
merge_3 = Merge(Data1=graft(pline_6), Data2=graft(pline_7))
merge_4 = Merge(Data1=graft(pline_6), Data2=graft(shift_4))
lng_3 = ListLength(List=flatten(recgrid_3.Cells))
explode_2 = Explode(Curve=recgrid_3.Cells, Recursive=True)  # -> Segments, Vertices
panel_38 = Panel("""1
3""")
panel_39 = Panel("""0
2""")
random_threshold_2 = Slider(0.052, range=0..1)
random_6 = Random(Range=Domain(0, 1), Number=lng_3, Seed=2)
item_8 = ListItem(List=explode_2.Vertices, Index=panel_39, Wrap=True)
item_9 = ListItem(List=explode_2.Vertices, Index=panel_38, Wrap=True)
loft = Loft(Curves=merge_3, Options={Adjust=False, Closed=False, LoftEnds=0, LoftSimp=0, LoftType=3, Rebuild=10, Refit=0.01})
loft_2 = Loft(Curves=merge_4, Options={Adjust=False, Closed=False, LoftEnds=0, LoftSimp=0, LoftType=3, Rebuild=10, Refit=0.01})
panel_40 = Panel("0.5")
pline_8 = PolyLine(Vertices=item_8, Closed=False)  # -> flatten(Polyline)
pline_9 = PolyLine(Vertices=item_9, Closed=False)  # -> flatten(Polyline)
smaller_2 = SmallerThan(FirstNumber=random_6, SecondNumber=random_threshold_2)  # -> SmallerThan, OrEqualTo
preview_6 = CustomPreview(Geometry=loft_2, Shader=ColourSwatch(SwatchColor=RGB(168, 135, 0)))
preview_7 = CustomPreview(Geometry=loft, Shader=ColourSwatch(SwatchColor=RGB(255, 255, 255)))
p_n_c_3 = PickNChoose(Pattern=smaller_2.SmallerThan, Stream0=pline_8, Stream1=pline_9)
preview_8 = CustomPreview(Geometry=p_n_c_3, Shader=ColourSwatch(SwatchColor=RGB(0, 0, 0)))

sift_2 = SiftPattern(List=recgrid_2.Points, SiftPattern=random_4)  # -> Output0, Output1, Output2

move_2 = Move(Geometry=sift_2.Output1, Motion=X_2)  # -> Geometry, Transform
move_3 = Move(Geometry=sift_2.Output2, Motion=X_3)  # -> Geometry, Transform

combine_2 = CombineData(Input0=sift_2.Output0, Input1=move_2.Geometry, Input2=move_3.Geometry)  # -> Result, Index

pline_10 = PolyLine(Vertices=combine_2.Result, Closed=False)  # -> flatten(Polyline)
fillet = Fillet(Curve=pline_10, Radius=Slider(2, range=0..5))
