# Grasshopper definition 02_trees basics.gh (Grasshopper 0.9.76)
# Copyright: Co-de-iT

# RELIEF
# shape as structural device
# tutor: Alessio Erioli
# Thessaloniki . 10-16.05.2016
# 01. the tree structure
pt = Point(Point(0, 0, 0))
number_slider = Slider(3, range=1..5)
number_slider_2 = Slider(6.75, range=0..10)
number_slider_3 = Slider(0.433, range=0..1)
xx_the_point_list_source = Panel("you found it! :D")
series = Series(Start=0, Step=1, Count=10)
Y = UnitY(Factor=1)

Z = UnitZ(Factor=1)
# <title>
# 
# <description>
# 
# code by <author>
# 
# v <version>
# 
# © Co-de-iT 2016 _ Creative Commons Attribution-NonCommercial-ShareAlike 4.0 International License
line = LineSDL(Start=pt, Direction=Z, Length=number_slider_2)
divide = DivideCurve(Curve=line, Count=number_slider, Kinks=False)  # -> Points, Tangents, Parameters

# ----
# 02. random radius: points in the list are associated with random radius
random = Random(Range=Domain(0, 0.8), Number=10, Seed=2)
addition = Addition(A=series, B="5")
pt_2 = ConstructPoint(XCoordinate=addition, YCoordinate=series, ZCoordinate=0)
# 01. point list: a list of points enters here.
# 
# The cable display has been set to "hidden" here (right click on component > wire display), to discover where the data comes from, select it!
pt_3 = Point(pt_2)
multiplication = Multiplication(A=number_slider_2, B=number_slider_3)
# 02. basic operations
# original data list: the original data list
viewer = ParamViewer(pt_3)
viewer_2 = ParamViewer(pt_3)
panel = Panel(pt_3)

xprod = CrossProduct(VectorA=Z, VectorB=Y, Unitize=False)  # -> Vector, Length
line_2 = LineSDL(Start=divide.Points, Direction=xprod.Vector, Length=multiplication)
# second subdivision
divide_2 = DivideCurve(Curve=line_2, Count=number_slider, Kinks=False)  # -> Points, Tangents, Parameters

multiplication_2 = Multiplication(A=multiplication, B=number_slider_3)
# 03. different results: switch on or off alternatively to see how data is treated differently in both cases
# 03.1 embedded tree operations: flatten or graft can be activated on data input or output in components (right click to activate/deactivate graft or flatten in the components below).
cir = Circle(Plane=pt_3, Radius=random)
cir_2 = Circle(Plane=graft(pt_3), Radius=graft(random))

xprod_2 = CrossProduct(VectorA=xprod.Vector, VectorB=Y, Unitize=False)  # -> Vector, Length
# third subdivision
line_3 = LineSDL(Start=divide_2.Points, Direction=xprod_2.Vector, Length=multiplication_2)
divide_3 = DivideCurve(Curve=line_3, Count=number_slider, Kinks=False)  # -> Points, Tangents, Parameters

cir_3 = Circle(Plane=graft(pt_3), Radius=random)
# graft: graft: a path is built for each element
graft = GraftTree(Data=pt_3, IncludeEmptyLists=True, IncludeNullItems=True)
cir_4 = Circle(Plane=flatten(graft), Radius=random)
cir_5 = Circle(Plane=graft, Radius=graft(random))
viewer_3 = ParamViewer(graft)
viewer_4 = ParamViewer(graft)
panel_2 = Panel(graft)
cir_6 = Circle(Plane=graft, Radius=random)
# flatten: flatten: all data is squashed in one list
flatten = FlattenTree(Data=graft, Path="{0}")
viewer_5 = ParamViewer(flatten)
viewer_6 = ParamViewer(flatten)
panel_3 = Panel(flatten)
viewer_7 = ParamViewer(divide_2.Points)
# first subdivision
viewer_8 = ParamViewer(divide.Points)
viewer_9 = ParamViewer(divide_3.Points)
lng = ListLength(List=divide.Points)
lng_2 = ListLength(List=divide_2.Points)
lng_3 = ListLength(List=divide_3.Points)
series_2 = Series(Start=0, Step=1, Count=lng)
series_3 = Series(Start=0, Step=1, Count=lng_2)
series_4 = Series(Start=0, Step=1, Count=lng_3)
int = Integer(series_2)
int_2 = Integer(series_3)
int_3 = Integer(series_4)
concat = Concatenate(FragmentA=viewer_8, FragmentB=int)
xz = XZPlane(Origin=divide_3.Points)
xz_2 = XZPlane(Origin=divide_2.Points)
xz_3 = XZPlane(Origin=divide.Points)
concat_2 = Concatenate(FragmentA=graft(viewer_7), FragmentB=int_2)
concat_3 = Concatenate(FragmentA=graft(viewer_9), FragmentB=int_3)
prot = RotatePlane(Plane=xz_2, Angle=1.570796327)
tag = TextTag3D(
    Location=xz_3,
    Text=concat,
    Size=Slider(0.239, range=0..1),
    Colour=ColourSwatch(SwatchColor=RGB(255, 255, 255)),
    Justification=7)
tag_2 = TextTag3D(
    Location=prot,
    Text=concat_2,
    Size=Slider(0.112, range=0..1),
    Colour=ColourSwatch(SwatchColor=RGB(92, 92, 92)),
    Justification=7)
tag_3 = TextTag3D(
    Location=xz,
    Text=concat_3,
    Size=Slider(0.042, range=0..1),
    Colour=ColourSwatch(SwatchColor=RGB(0, 0, 0)),
    Justification=7)
