# Grasshopper definition 03_data tree studies.gh (Grasshopper 0.9.76)
# Copyright: Co-de-iT
# plug-ins: treesloth01

# ----
# RELIEF
# shape as structural device
# tutor: Alessio Erioli
# Thessaloniki . 10-16.05.2016
# 01_basic tree operations
# initial data: reference 2 or more curves in Rhino
# 2 ways of flipping (transpose) the data tree: with flip matrix component and path mapper
# tree statistics: get info on the data tree
# explode tree: individual branches as separate outputs
# flip last: flips only the last branch index with the item index
# relative item(s): select relative items in the same or from another data tree. Path/elements syntax is the same as for the replace path component
crv = Curve(reparameterize([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]))
loft = Loft(Curves=crv, Options={Adjust=False, Closed=False, LoftEnds=0, LoftSimp=0, LoftType=0, Rebuild=10, Refit=0.01})
font_size = Slider(0.51, range=0..10)
point_indexes = Panel("initial point indexes")
surface = Panel("create a loft surface")
u_div = Slider(4, range=2..30)
v_div = Slider(9, range=2..30)
offset = OffsetLoose(Surface=reparameterize(loft), Distance=Slider(2.35, range=0..10), Retrim=True)
sdivide = DivideSurface(Surface=reparameterize(loft), UCount=u_div, VCount=v_div)  # -> Points, Normals, Parameters
lng = ListLength(List=flatten(sdivide.Points))
wrap_items = BooleanToggle(False)
wrap_paths = BooleanToggle(False)
mask = Panel("""{0;0;1}(1)
{0;0;1}(-1)""")
points = PointList(Points=sdivide.Points, Tags=True, Lines=True, Size=font_size)
preview = CustomPreview(Geometry=loft, Shader=ColourSwatch(SwatchColor=RGB(59, 59, 59)))
sdivide_2 = DivideSurface(Surface=reparameterize(offset), UCount=u_div, VCount=v_div)  # -> Points, Normals, Parameters
# <title>
# 
# <description>
# 
# code by <author>
# 
# v <version>
# 
# © Co-de-iT 2016 _ Creative Commons Attribution-NonCommercial-ShareAlike 4.0 International License
initial_data = Panel(sdivide.Points)
viewer = ParamViewer(sdivide.Points)
pline = PolyLine(Vertices=sdivide.Points, Closed=False)
bang = ExplodeTree(Data=sdivide.Points)  # -> Branch0, Branch1, Branch2, Branch3, Branch4
tstat = TreeStatistics(Tree=sdivide.Points)  # -> Paths, Length, Count
relitem = RelativeItem(Tree=sdivide.Points, Offset=mask, WrapPaths=wrap_paths, WrapItems=wrap_items)  # -> ItemA, ItemB
random = Random(Range="0.3 to 0.7", Number=lng, Seed=2)
relitem2 = RelativeItems(TreeA=sdivide.Points, TreeB=sdivide_2.Points, Offset=mask, WrapPaths=False, WrapItems=False)  # -> ItemA, ItemB
preview_2 = CustomPreview(Geometry=pline, Shader=ColourSwatch(SwatchColor=RGB(108, 217, 199)))
ln = Line(StartPoint=relitem.ItemA, EndPoint=relitem.ItemB)
ln_2 = Line(StartPoint=relitem2.ItemA, EndPoint=relitem2.ItemB)
n_of_branches = Panel(tstat.Count)
lists_length = Panel(tstat.Length)
paths_as_list = Panel(tstat.Paths)
preview_3 = CustomPreview(
    Geometry=ln,
    Shader={ambient=RGB(0, 0, 0), diffuse=RGB(255, 105, 180), emission=RGB(76, 32, 54), shine=0.5, specular=RGB(255, 255, 255), transparency=0})
graft = GraftTree(Tree=sdivide.Points, IncludeEmptyLists=True, IncludeNullItems=True)
unflatten = UnflattenTree(Tree=random, Guide=graft)
graft_2 = Panel(graft)
viewer_2 = ParamViewer(graft)
msphere = MeshSphere(Base=sdivide.Points, Radius=unflatten, UCount=10, VCount=20)
preview_4 = CustomPreview(
    Geometry=ln_2,
    Shader={ambient=RGB(0, 0, 0), diffuse=RGB(255, 105, 180), emission=RGB(76, 32, 54), shine=0.5, specular=RGB(255, 255, 255), transparency=0})
preview_5 = CustomPreview(
    Geometry=msphere,
    Shader={ambient=RGB(0, 0, 0), diffuse=RGB(255, 105, 180), emission=RGB(76, 32, 54), shine=0.5, specular=RGB(255, 255, 255), transparency=0})
simplify = SimplifyTree(Tree=graft, Front=False)
simplify_2 = Panel(simplify)
viewer_3 = ParamViewer(simplify)
append_element = AppendElement(Data=sdivide.Points, Index="100")
prepend_element = PrependElement(Data=sdivide.Points, Index="100")
path_mapper = PathMapper(sdivide.Points, source="{A;B;C}(i)", target="{A;B;i}(C)")
branch = TreeBranch(Tree=simplify, Path=viewer_3, MaintainPaths=False)
extract_tree_branch = Panel(branch)
viewer_4 = ParamViewer(branch)
flip_last = FlipLast(Data=graft)
flip = FlipMatrix(Data=sdivide.Points)
viewer_5 = ParamViewer(append_element)
viewer_6 = ParamViewer(prepend_element)
item = TreeItem(Tree=branch, Path=viewer_4, Index=0, Wrap=False)
extract_tree_item = Panel(item)
viewer_7 = ParamViewer(item)
pline_2 = PolyLine(Vertices=flip, Closed=False)
viewer_8 = ParamViewer(flip)
pline_3 = PolyLine(Vertices=path_mapper, Closed=False)
viewer_9 = ParamViewer(path_mapper)
viewer_10 = ParamViewer(flip_last)
item_2 = TreeItem(Tree=simplify, Path=viewer_3, Index=0, Wrap=False)
more_tree_item = Panel(item_2)
viewer_11 = ParamViewer(item_2)
preview_6 = CustomPreview(Geometry=pline_2, Shader=ColourSwatch(SwatchColor=RGB(255, 255, 255)))
preview_7 = CustomPreview(Geometry=pline_3, Shader=ColourSwatch(SwatchColor=RGB(255, 255, 255)))

# ----
# shift paths: shift paths
# 
# one basic thing to know about data trees is that data is stored at the outmost ramification, the end of the branching path. Cutting away an index results in data compressed in the index of a higher lever.
# 
# Ex:
# 
# {0;0;1;1}(5) is a branch of a tree which has 5 elements in each branch
# 
# {0;0;1}   in his branch there are 5 elements * number of tree branch collapsed into the
data = Data(sdivide.Points)
# 03_shift index
original_data = Panel(data)
viewer_12 = ParamViewer(data)
pshift = ShiftPaths(Data=data, Offset="-1")
shift_path = Panel(pshift)
viewer_13 = ParamViewer(pshift)
pshift_2 = ShiftPaths(Data=data, Offset="1")
shift_path_2 = Panel(pshift_2)
viewer_14 = ParamViewer(pshift_2)

# ----
# 04_create branches
n_values = Slider(14, range=0..100)
series = Series(Start=0, Step=1, Count=n_values)
path_mapper_2 = PathMapper(series, source="{A;B}(i)", target="{A;B;floor((i/4))}")
path_mapper_3 = PathMapper(series, source="{A;B}(i)", target="{floor((i/4))}")
panel = Panel(path_mapper_3)
panel_2 = Panel(path_mapper_2)
viewer_15 = ParamViewer(path_mapper_3)
viewer_16 = ParamViewer(path_mapper_2)

flip_last_2 = Panel("append-prepend path element")

# ----
# associate elements to a respective category and build a tree out of it, one branch for each category
panel_3 = Panel("""copernicus
benjie
tim
jess
william
bernard
mcmoo""")
# 02.1_building a tree by category
panel_4 = Panel("""cat
dog
gerbil
cat
cat
dog
cow""")
panel_5 = Panel("""copernicus
benjie
tim
jess
william
bernard
mcmoo""")
panel_6 = Panel("""cat
dog
gerbil
cat
cat
dog
cow""")
sunion = SetUnion(SetA=panel_6, SetB=panel_6)
graft_3 = GraftTree(Tree=panel_5, IncludeEmptyLists=True, IncludeNullItems=True)
cset = CreateSet(List=panel_4)  # -> Set, Map
mindex = MemberIndex(Set=panel_6, Member=graft(sunion))  # -> Index, Count
viewer_17 = ParamViewer(graft_3)
item_3 = ListItem(List=panel_3, Index=mindex.Index, Wrap=True)
replace = ReplacePaths(Data=graft_3, Search=viewer_17, Replace=cset.Map)
panel_7 = Panel(replace)
# 06_ trees in C#
panel_8 = Panel(item_3)

panel_9 = Panel("n. of branches")
elements = Slider(4, range=0..9)
branches = Slider(5, range=0..9)

# ----
# replace branches: Find/Replace branch paths on a tree structure. This component support Path Masks, which are lines of text that represent allowed and disallowed path indices. Masks can support both single digits, digit ranges, digits groups and wildcards. Masks consists of alternating index qualifiers and index separators. Separators must be commas or semi-colons.
# 
# Index qualifiers denote which digits are allowed or disallowed at each index in the path. There are several kinds of qualifiers:
# 
# 
# Qualifier
#  Symbol
#  Meaning
# 
# Wildcard
#  * (Asterisk)
#  Represents any amount of allowed digits
# 
# Placeholder
#  ? (Question mark)
#  Represents any single digit
# 
# Digit
#  N (Integer)
#  Represents a specific single digit
# 
# Range
#  (A-B) (Brackets)
#  Represents a specific digit range between two extremes.
# 
# Group
#  (A,B,C,D) (Brackets)
#  Represents a specific set of (dis)allowed digits.
# 
# 
# 
# You can prepend equality operators (<, >, <=, >=) to Digit masks. In addition, you can also prepend an exclamation mark to negate the matching.
# 
# For example, let's assume we have a Tree with the following paths:
# A) {0;0;0;0}
# B) {0;0;0;1}
# C) {0;0;1;0}
# D) {0;0;1;1}
# E) {0;0;1;2}
# 
# If we process this tree with the following Mask/Path combo:
# Mask = "{0:0:1:?}"
# Path = {0;0;1;0}
# 
# We'll merge branches C, D and E into a single branch with a similar path to C. Or, if we use the following two Mask/Paths combos:
# Mask 1 = "{0:0:0:?}"
# Path 1 = {0}
# Mask 2 = "{0:0:1:?}"
# Path 2 = {1}
# 
# We'll merge branches A and B into a new branch with path {0}, and branches C, D and E will be merged into a new branch with path {1}.
# 
# Given the following Mask:
# 
# {(0-3);>=4;!(0,2,5);?}
# 
# the individual mask elements are explained by:
# Element
#  Meaning
# 
# (0-3)
#  Any number between and including zero and three.
# 
# >=4
#  Any number larger than or equal to four.
# 
# !(0,2,5)
#  Any number not equal to zero, two or five.
# 
# ?
#  Any single number
# search mask: search all branches between
# 
# {0;0;0} and {0;0;1}
# replace: put them in the single branch
# 
# {0;0;1}
initial_data_2 = Panel("")

# ----
# 1: the structure is a simple list
# 2: but, if we build up a tree-like empty data structure and feed in the list...
# 0: let's take a simple letter sequence
# this is the empty data structure.
n_of_total_data = Slider(12, range=0..60)
# n. of items in each branch
item_n = Slider(4, range=0..60)
seq = Sequence(Count=n_of_total_data, CharPool="ABCDEFGHIJKLMNOPQRSTUVWXYZ", Format="{0}")
# 02_building a tree
panel_10 = Panel(seq)
viewer_18 = ParamViewer(seq)
panel_11 = Panel("TAH-DAH!")

division = Division(A=n_of_total_data, B=item_n)

series_2 = Series(Start=0, Step=item_n, Count=division)
series_3 = Series(Start=series_2, Step=1, Count=item_n)
item_4 = TreeItem(Tree=seq, Path=viewer_18, Index=series_3, Wrap=False)
panel_12 = Panel(series_3)
viewer_19 = ParamViewer(series_3)
viewer_20 = ParamViewer(item_4)
panel_13 = Panel(item_4)

data_2 = Data(item_4)
# 05_replacing branches
viewer_21 = ParamViewer(data_2)
panel_14 = Panel(data_2)
viewer_22 = ParamViewer(data_2)
viewer_23 = ParamViewer(data_2)
replace_2 = ReplaceBranches(Data=data_2, Search="{0;0;(0,1)}", Replace="{0;0;1}")
viewer_24 = ParamViewer(replace_2)
viewer_25 = ParamViewer(replace_2)
panel_16 = Panel(replace_2)

# ----
# Trees in C#: Trees can be created and manipulated in C# components too. When we add data to a tree in C#, we need two pieces of information:
# 
# The data we are saving, such as a Point3d or an integer
# The path we are saving to
# The path is declared as a list of numbers denoting the sequence of the branches needed to access the list we are interested in. As some examples:
# 
# DataTree<Point3d> myTree = new DataTree<Point3d>();
# GH_Path pth = new GH_Path(2);
# myTree.Add(P, pth);
# 
# point P will be written to the list at the end of branch 2.
# 
# GH_Path pth = new GH_Path(i,j)
# point P will go down branch i, then be added to the list at the end of branch j
# 
# ////////////////////////////
# 
# Setting up a tree
# 
# You can either add to a tree on the fly – if you know that the data in the tree will be in the same order that you’ll be adding to it. But a more flexible way is to create a blank tree of the size you want, and then edit the values later.
# 
# Setting up a tree called boolTree (I am creating a tree based upon another tree called pts):
# 
# //declare tree
# DataTree<bool> boolTree = new DataTree<bool>();
# //set up tree
#  for(int i = 0; i < pts.BranchCount;i++)
#  {
#    GH_Path pth = new GH_Path(i);
#    for (int j = 0; j < pts.Branch(0).Count;j++)
#    {
#      boolTree.Add(false, pth);
#    }
#  }
# 
# 
# This has now created a tree filled with ‘false'.
# 
# ////////////////////////////
# 
# Editing values in the tree
# 
# boolTree.Branch(1,2)[5] = true;
# 
# This edits the 5th value of the list at the end of branch 1, sub-branch 2 to ‘true’.
series_4 = Series(Start=0, Step=1, Count=10)
treebuild = TreeBuilder(D=series_4, E=elements)  # -> out, Tree; inputs D: list, B: Int32, E: Int32
# ---------- treebuild: C# ----------
    String eol = Environment.NewLine;
    Component.Name = "Tree Builder";
    Component.NickName = "TreeBuild";
    Component.Message = "v0.1 _ by Alessio Erioli" + eol + "Co-de-iT";
    Component.Description = "Creates a data tree given number of elements and/or branches. If both are provided their product should match the data list length (i.e. B*E = length of D)";

    DataTree<System.Object> newTree = new DataTree<System.Object>();
    if (B == 0 && E == 0) {
      Print("input one value in B or E");
    }else if (E == 0){
      int el = (int) D.Count / B;
      int r_el = D.Count % B;
      Print(el.ToString() + " " + r_el.ToString());
      for (int i = 0; i < B; i++) {
        GH_Path path = new GH_Path(0, i);
        for (int j = 0; j < el; j++){
          newTree.Add(D[i + j], path);
        }
      }
      if (r_el != 0){
        GH_Path path = new GH_Path(0, B - 1);
        for (int i = 0; i < r_el; i++){
          newTree.Add(D[el * B + i], path);
        }
      }
      Print("I am GROOT!");
      Tree = newTree;

    } else if (B == 0){
      int br = -1;
      for (int i = 0; i < D.Count; i++){
        if (i % E == 0)br++;
        GH_Path path = new GH_Path(0, br);
        newTree.Add(D[i], path);
      }
      Print("I am GROOT!");
      Tree = newTree;

    }
    else if (B * E != D.Count){
      Print("non matching number of branches/elements with list length: " + (B * E) + " vs. " + D.Count);
    }else{
      // System.Object d1 = D[0];
      //foreach (System.Object dat in D)
      //{
      for (int i = 0; i < B; i++){
        GH_Path path = new GH_Path(0, i);
        for (int j = 0; j < E; j++){
          newTree.Add(D[i + j], path);
        }
      }
      //Print("I am GROOT!" + dat.ToString());
      //}
      Print("I am GROOT!");
      Tree = newTree;

    }
# ---------- end treebuild ----------
panel_17 = Panel(treebuild.Tree)
panel_18 = Panel(treebuild.out)

treebuild_2 = TreeBuilder(D=series_4, B=branches, E=0)  # -> out, Tree; inputs D: list, B: Int32, E: Int32; same code as treebuild

panel_19 = Panel(treebuild_2.Tree)
