# Grasshopper definition d01_01.gh (Grasshopper 0.9.76)
# Copyright: Co-de-iT

number_slider = Slider(0.522, range=0..1)
number_slider_2 = Slider(30.458, range=0..143)
number_slider_3 = Slider(10, range=0..10)
number_slider_4 = Slider(0, range=0..10)
number_slider_5 = Slider(0, range=0..10)
number_slider_6 = Slider(46, range=2..200)
crv = Curve(reparameterize([<curve referenced from the Rhino model> x2]))
pt = Point([<point referenced from the Rhino model> x3])
pt_2 = Point([<point referenced from the Rhino model> x3])
# 0<<10
# 0<10.0
number_slider_7 = Slider(10, range=1..10)
crv_2 = Curve([<curve referenced from the Rhino model> x5])
srf = Surface(<surface referenced from the Rhino model>)
brep = Brep(<brep referenced from the Rhino model>)
crv_3 = Curve(reparameterize(<curve referenced from the Rhino model>))
eval = EvaluateCurve(Curve=crv_3, Parameter=number_slider)  # -> Point, Tangent, Angle
panel = Panel(pt)
crv_4 = Curve([<curve referenced from the Rhino model> x2])
crv_5 = Curve(reparameterize(<curve referenced from the Rhino model>))
eval_2 = EvaluateCurve(Curve=crv_5, Parameter=number_slider)  # -> Point, Tangent, Angle
number_slider_8 = Slider(10, range=0..10)
# 0<10
eval_3 = EvaluateCurve(Curve=crv, Parameter=Slider(0.585, range=0..1))  # -> Point, Tangent, Angle
domain = Domain(crv)
panel_2 = Panel("10")
panel_3 = Panel(pt_2)
panel_4 = Panel(domain)
panel_5 = Panel(eval_3.Point)
ln = Line(StartPoint=pt, EndPoint=pt_2)
ccx = CurveCurve()  # -> Points, ParamsA, ParamsB
divlength = DivideLength(Curve=crv_4, Length=number_slider_7)  # -> Points, Tangents, Parameters
points = PointList(Points=pt_2, Size=number_slider_8)
points_2 = PointList(Points=pt, Size=number_slider_8)
divide = DivideCurve(Curve=crv_5, Count=number_slider_6, Kinks=False)  # -> Points, Tangents, Parameters
divide_2 = DivideCurve(Curve=crv_3, Count=number_slider_6, Kinks=False)  # -> Points, Tangents, Parameters
# Brep: BRep component takes polysurfaces (and surfaces)
panel_6 = Panel(brep)
dist = Distance(PointA=divide.Points, PointB=divide_2.Points)
divdist = DivideDistance()  # -> Points, Tangents, Parameters
number_slider_9 = Slider(100, range=0..100)
bnd = Bounds(Numbers=dist)
panel_7 = Panel(bnd)
dom = ConstructDomain(DomainStart=Slider(100, range=0..100), DomainEnd=Slider(108.8, range=0..1000))
ln_2 = Line(StartPoint=divide.Points, EndPoint=divide_2.Points)
# a:b=c:d
remap = RemapNumbers(Value=dist, Source=bnd, Target=dom)  # -> Mapped, Clipped
amp = Amplitude(Vector=divide_2.Tangents, Amplitude=remap.Mapped)
amp_2 = Amplitude(Vector=divide.Tangents, Amplitude=remap.Mapped)
bzspan = BezierSpan(StartPoint=divide.Points, StartTangent=amp_2, EndPoint=divide_2.Points, EndTangent=amp)  # -> Curve, Length, Domain
vdisex = VectorDisplayEx(Point=divide.Points, Vector=amp_2, Colour=RGB(0, 0, 0), Width=2)
loft = Loft(Curves=ln_2, Options={Adjust=False, Closed=False, LoftEnds=0, LoftSimp=0, LoftType=0, Rebuild=10, Refit=0.01})
