# Grasshopper definition d02_01.gh (Grasshopper 0.9.76)
# Copyright: Co-de-iT
# plug-ins: Human

srf = Surface(<surface referenced from the Rhino model>)
divide = DivideDomain²(Domain=srf, UCount=Slider(20, range=2..20), VCount=Slider(20, range=2..20))
mesh_uv = MeshSurface(Surface=srf, UCount=Slider(19, range=2..50), VCount=Slider(19, range=2..50), Overhang=True, Equalize=False)
subsrf = Isotrim(Surface=srf, Domain=divide)
srf_2 = Surface(<surface referenced from the Rhino model>)
demesh = DeconstructMesh(Mesh=mesh_uv)  # -> Vertices, Faces, Colours, Normals
panel = Panel(demesh.Faces)
sdivide = DivideSurface(Surface=subsrf, UCount="1", VCount="1")  # -> Points, Normals, Parameters
viewer = ParamViewer(sdivide.Points)
deface = DeconstructFace(Face=demesh.Faces)  # -> graft(CornerA), graft(CornerB), graft(CornerC), graft(CornerD)
panel_2 = Panel(sdivide.Points)
vdisex = VectorDisplayEx(Point=demesh.Vertices, Vector=demesh.Normals, Colour=RGB(0, 0, 0), Width=2)
merge = Merge(Data1=deface.CornerA, Data2=deface.CornerB, Data3=deface.CornerC, Data4=deface.CornerD)
panel_3 = Panel(merge)
path_mapper = PathMapper(sdivide.Points, source="{A;B;C;D}", target="{A;B;C}")
pshift = ShiftPaths(Data=sdivide.Points, Offset=-1)
viewer_2 = ParamViewer(path_mapper)
item = ListItem(List=demesh.Vertices, Index=merge, Wrap=True)
panel_4 = Panel(pshift)
item_2 = ListItem(List=pshift, Index=0, Wrap=True)  # -> Item, Item1, Item2, Item3
# 0
# 1
item_3 = ListItem(List=item, Index=0, Wrap=True)  # -> Item, Item1, Item2, Item3
points = PointList(Points=pshift, Size=Slider(3.249, range=0..10))
# 3
# 2
merge_2 = Merge(Data1=item_3.Item, Data2=item_3.Item1, Data3=item_3.Item3)
merge_3 = Merge(Data1=item_3.Item2, Data2=item_3.Item3, Data3=item_3.Item1)
merge_4 = Merge(Data1=item_2.Item3, Data2=item_2.Item1, Data3=item_2.Item2)
merge_5 = Merge(Data1=item_2.Item, Data2=item_2.Item2, Data3=item_2.Item1)
toggle = BooleanToggle(True)
toggle_2 = BooleanToggle(True)
number_slider = Slider(49.11, range=1..50)
crv = Curve(reparameterize(<curve referenced from the Rhino model>))
pline = PolyLine(Vertices=merge_3, Closed=toggle)
pline_2 = PolyLine(Vertices=merge_2, Closed=toggle)
pline_3 = PolyLine(Vertices=merge_5, Closed=toggle_2)
pline_4 = PolyLine(Vertices=merge_4, Closed=toggle_2)
eval = EvaluateCurve(Curve=crv, Parameter=Slider(0.411, range=0..1))  # -> Point, Tangent, Angle
cir = Circle(Plane=eval.Point, Radius=number_slider)
merge_6 = Merge(Data1=pline_2, Data2=pline)  # -> graft(Result)
merge_7 = Merge(Data1=pline_3, Data2=pline_4)  # -> graft(Result)
previewlw = CustomPreviewLineweights(Geometry=cir, Shader=ColourSwatch(SwatchColor=RGB(255, 255, 255)), Thickness=Slider(3, range=1..3), Absolute=False)
filter = StreamFilter(Gate=Slider(0, range=0..1), Stream0=merge_6, Stream1=merge_7)
pcen = PolygonCenter(Polyline=filter)  # -> CenterV, CenterE, CenterA
dist = Distance(PointA=pcen.CenterV, PointB=eval.Point)
min = Minimum(A=dist, B=number_slider)
bar_graph = BarGraph(min, BarColor=RGB(255, 0, 90))
bnd = Bounds(Numbers=flatten(min))
dom = ConstructDomain(DomainStart=Slider(0.624, range=0.001..0.99), DomainEnd=Slider(0.129, range=0.001..0.99))
remap = RemapNumbers(Value=min, Source=bnd, Target=dom)  # -> Mapped, Clipped
bar_graph_2 = BarGraph(remap.Mapped, BarColor=RGB(255, 0, 90))
graph = GraphMapper(
    remap.Mapped,
    x0=0,
    x1=1,
    y0=0,
    y1=1,
    container_name="Bezier",
    cpx=[0, 0.4744926095, 0.4373903275, 1],
    cpy=[0, 0.3376811743, 0.7828986049, 1])
scale = Scale(Geometry=filter, Center=pcen.CenterV, Factor=graph)  # -> Geometry, Transform
lng = ListLength(List=flatten(scale.Geometry))
number_slider_2 = Slider(26, range=1..50)
total_components = Panel(lng)
merge_8 = Merge(Data1=filter, Data2=scale.Geometry)
planar = Planar(Curve=scale.Geometry)  # -> Planar, Plane, Deviation
series = Series(Start=0, Step=1, Count=lng)
division = Division(A=lng, B=number_slider_2)
boundary = BoundarySurfaces(Edges=merge_8)  # disabled
int = Integer(graft(series))
round = Round(Number=division)  # -> Nearest, Floor, Ceiling
number_slider_3 = Slider(7.335, range=0..100)
tag = TextTag3D(Location=planar.Plane, Text=int, Size=1, Colour=ColourSwatch(SwatchColor=RGB(255, 255, 255)), Justification=7)
subtraction = Subtraction(A=lng, B="1")
recgrid = Rectangular(Plane=PlaneXY(0, 0, 0), SizeX=number_slider_3, SizeY=number_slider_3, ExtentX=round.Ceiling, ExtentY=number_slider_2)  # -> Cells, Points
pt = Point(flatten(recgrid.Points))
subset = SubList(List=pt, Domain=subtraction, Wrap=True)  # -> graft(List), Index
tag_2 = TextTag3D(Location=subset.List, Text=int, Size=1, Colour=ColourSwatch(SwatchColor=RGB(255, 255, 255)), Justification=7)
orient = Orient(Geometry=merge_8, Source=planar.Plane, Target=subset.List)  # -> Geometry, Transform
ln = Line(StartPoint=planar.Plane, EndPoint=subset.List)
item_4 = ListItem(List=orient.Geometry, Index=0, Wrap=True)
explode = Explode(Curve=item_4, Recursive=True)  # -> Segments, Vertices
offset_l = OffsetLoose(Curve=explode.Segments, Distance=Slider(0.742, range=0..1), Plane=subset.List)
curvepoint = PointOnCurve(offset_l, parameter=0.5)
scale_2 = Scale(Geometry=offset_l, Center=curvepoint, Factor=Slider(0.548, range=0.001..0.9))  # -> Geometry, Transform
end = EndPoints(Curve=explode.Segments)  # -> Start, End
end_2 = EndPoints(Curve=scale_2.Geometry)  # -> Start, End
ln_2 = Line(StartPoint=end.End, EndPoint=end_2.End)
ln_3 = Line(StartPoint=end.Start, EndPoint=end_2.Start)
merge_9 = Merge(Data1=ln_3, Data2=ln_2, Data3=scale_2.Geometry)
join = JoinCurves(Curves=merge_9, Preserve=False)
