# Grasshopper definition d02_02_sim.gh (Grasshopper 0.9.76)
# Copyright: Co-de-iT
# plug-ins: Human, Kangaroo Components, Weaverbird, Kangaroo2 Components

mesh = Mesh(<mesh referenced from the Rhino model>)
wbcatmullclark = WeaverbirdsCatmullClarkSubdivision(MeshCurves=mesh, Level=Slider(2, range=1..3), SmoothNakedEdges=Slider(2, range=0..2))
wbloop = WeaverbirdsLoopSubdivision(MeshCurves=mesh, Level=Slider(2, range=1..3), SmoothNakedEdges=1)
nv = NakedVertices(Mesh=wbloop)  # -> ClothedIndex, NakedIndex, ClothedPts, NakedPts
wbedges = WeaverbirdsMeshEdges(MeshOrPolylines=wbloop)
pt = Point(nv.ClothedPts)
Z = UnitZ(Factor=Slider(0, range=-10..0))
hingepoints = HingePoints(Mesh=wbloop)  # -> _1, _2, _3, _4
rad = Radians(Degrees=Slider(0, range=0..180))
len = Length(Curve=wbedges)
multiplication = Multiplication(A=len, B=Slider(1.261, range=0..2))
pt_2 = Point(nv.NakedPts)
anchor = Anchor(Point=pt_2, Strength=1000)
hinge = Hinge(
    FoldStart=hingepoints._1,
    FoldEnd=hingepoints._2,
    Tip1=hingepoints._3,
    Tip2=hingepoints._4,
    RestAngle=rad,
    Strength=Slider(12.405, range=1..100))
length_line = LengthLine(Line=wbedges, Length=multiplication, Strength=10)
show = Show(G=wbloop)
load = Load(Point=nv.ClothedPts, ForceVector=Z)
# sPring
toggle = BooleanToggle(False)
solver = Solver(GoalObjects=[show, anchor, length_line, load, hinge], Reset=Button(), Threshold=1e-15, Tolerance=0.01, On=toggle)  # -> I, V, O
# L
mesh_2 = Mesh(solver.O)
previewmat = CustomPreviewMaterials(Geometry=mesh_2, DiffuseColor=RGB(255, 255, 255))
