# Grasshopper definition d02_03.gh (Grasshopper 0.9.76)
# Copyright: Co-de-iT
# plug-ins: Unroller, Human

number_slider = Slider(12, range=2..100)
triangulated_mesh = BooleanToggle(True)
srf = Surface(<surface referenced from the Rhino model>)
mesh_uv = MeshSurface(Surface=srf, UCount=number_slider, VCount=number_slider, Overhang=True, Equalize=False)
# added triangulation option
tri = Triangulate(Mesh=mesh_uv)  # -> Mesh, Count

# ---- group: mesh by descent pattern
cluster = Cluster(M=mesh_uv)  # -> M_2, item_1, i
ln = Line(StartPoint=cluster.item_1, EndPoint=cluster.i)
mesh = Mesh(cluster.M_2)
previewlw = CustomPreviewLineweights(Geometry=ln, Shader=ColourSwatch(SwatchColor=RGB(255, 255, 255)), Absolute=False)

# ----
filter = StreamFilter(Gate=triangulated_mesh, Stream0=mesh_uv, Stream1=tri.Mesh)
demesh = DeconstructMesh(Mesh=filter)  # -> Vertices, Faces, Colours, Normals
crv = Curve(<curve referenced from the Rhino model>)
deface = DeconstructFace(Face=demesh.Faces)  # -> graft(CornerA), graft(CornerB), graft(CornerC), graft(CornerD)
crv_cp = CurveClosestPoint(Point=demesh.Vertices, Curve=crv)  # -> Point, Parameter, Distance
merge = Merge(Data1=deface.CornerA, Data2=deface.CornerB, Data3=deface.CornerC, Data4=deface.CornerD)
bnd = Bounds(Numbers=crv_cp.Distance)
remap = RemapNumbers(Value=crv_cp.Distance, Source=bnd, Target=Domain(0, 1))  # -> Mapped, Clipped
offset_max_distance = Slider(10, range=0..10)
graph = GraphMapper(
    remap.Mapped,
    x0=0,
    x1=1,
    y0=0,
    y1=1,
    container_name="Bezier",
    cpx=[0, 0.4913042486, 0, 1],
    cpy=[1, 1, 0.1739130616, 0.2434782982])
Z = UnitZ(Factor=1)
multiplication = Multiplication(A=graph, B=offset_max_distance)
amp = Amplitude(Vector=demesh.Normals, Amplitude=multiplication)
# these are already the vertices of the offset mesh, so no need to deconstruct it later: I can take the vertices from here
move = Move(Geometry=demesh.Vertices, Motion=amp)  # -> Geometry, Transform
conmesh = ConstructMesh(Vertices=move.Geometry, Faces=demesh.Faces)
item = ListItem(List=move.Geometry, Index=merge, Wrap=True)
item_2 = ListItem(List=demesh.Vertices, Index=merge, Wrap=True)
cull_i = CullIndex(List=item, Indices="-1", Wrap=True)
cull_i_2 = CullIndex(List=item_2, Indices="-1", Wrap=True)
filter_2 = StreamFilter(Gate=triangulated_mesh, Stream0=item, Stream1=cull_i)
toggle = BooleanToggle(True)
filter_3 = StreamFilter(Gate=triangulated_mesh, Stream0=item_2, Stream1=cull_i_2)
facen = FaceNormals(Mesh=filter)  # -> simplify(graft(Centers)), simplify(graft(Normals))
facen_2 = FaceNormals(Mesh=conmesh)  # -> simplify(graft(Centers)), simplify(graft(Normals))
amp_2 = Amplitude(Vector=facen_2.Normals, Amplitude=1)
pline = PolyLine(Vertices=filter_2, Closed=toggle)
pline_2 = PolyLine(Vertices=filter_3, Closed=toggle)
move_2 = Move(Geometry=facen_2.Centers, Motion=amp_2)  # -> Geometry, Transform
# data dam
# keep data flow on hold
# until play is pressed
extr = ExtrudePoint(Base=pline, Point=facen.Centers)
extr_2 = ExtrudePoint(Base=pline_2, Point=move_2.Geometry)

dam = DataDam(DataA=extr, BufferDelay=10000000, BufferMode=0)
dam_2 = DataDam(DataA=extr_2, BufferDelay=10000000, BufferMode=0)

# ----
# generate surfaces
split = SplitBrep(Brep=dam, Cutter=dam_2)
split_2 = SplitBrep(Brep=dam_2, Cutter=dam)
item_3 = ListItem(List=split_2, Index=0, Wrap=True)
item_4 = ListItem(List=split, Index=1, Wrap=True)
previewmat = CustomPreviewMaterials(Geometry=[item_3, item_4], DiffuseColor=RGB(255, 255, 255))

lng = ListLength(List=flatten(item_4))
number_slider_2 = Slider(19, range=2..50)
# unroll
unroller = Unroller(Brep=item_4)  # -> Brep, Curves, Points
number_slider_3 = Slider(23.925, range=1..200)
division = Division(A=lng, B=number_slider_2)
round = Round(Number=division)  # -> Nearest, Floor, Ceiling
subtraction = Subtraction(A=lng, B="1")
recgrid = Rectangular(Plane=PlaneXY(0, 0, 0), SizeX=number_slider_3, SizeY=number_slider_3, ExtentX=round.Ceiling, ExtentY=number_slider_2)  # -> Cells, Points
subset = SubList(List=flatten(recgrid.Points), Domain=subtraction, Wrap=True)  # -> graft(List), Index
orient = Orient(Geometry=unroller.Brep, Source=PlaneXY(0, 0, 0), Target=subset.List)  # -> Geometry, Transform

# ==== cluster Cluster
M = ClusterInput()
demesh = DeconstructMesh(Mesh=M)  # -> Vertices, Faces, Colours, Normals
deface = DeconstructFace(Face=demesh.Faces)  # -> graft(CornerA), graft(CornerB), graft(CornerC), graft(CornerD)
merge = Merge(Data1=deface.CornerA, Data2=deface.CornerB, Data3=deface.CornerC, Data4=deface.CornerD)
item = ListItem(List=demesh.Vertices, Index=merge, Wrap=True)
pdecon = Deconstruct(Point=item)  # -> XComponent, YComponent, ZComponent
panel = Panel("""0
1
2
3""")
sort = SortList(Keys=pdecon.ZComponent, ValuesA=item, ValuesB=merge, ValuesC=panel)  # -> Keys, ValuesA, ValuesB, ValuesC
# 0
# 3
# 2
# 1
item_2 = ListItem(List=sort.ValuesC, Index=0, Wrap=True)
item_3 = ListItem(List=merge, Index=item_2, Wrap=True)  # -> Item, Item1, Item2, Item3
item_4 = ListItem(List=sort.ValuesC, Index=0, Wrap=True)  # -> Item1, Item
expression = Expression(x=item_3.Item, y=item_3.Item1, z=item_3.Item2, u=item_3.Item3, Expression="Format(\"Q{{{0};{1};{2};{3}}}\", x, y,z,u)")
item_5 = ListItem(List=sort.ValuesA, Index=0, Wrap=True)  # -> Item1, Item
expression_2 = Expression(x=item_3.Item, y=item_3.Item1, z=item_3.Item2, Expression="Format(\"T{{{0};{1};{2}}}\", x, y,z)")
expression_3 = Expression(x=item_3.Item2, y=item_3.Item3, z=item_3.Item, Expression="Format(\"T{{{0};{1};{2}}}\", x, y,z)")
subtraction = Subtraction(A=item_4.Item1, B=item_4.Item)
item_1 = ClusterOutput(item_5.Item1)
i = ClusterOutput(item_5.Item)
abs = Absolute(Value=subtraction)
equals = Equality(FirstNumber=abs, SecondNumber="2")  # -> Equality, Inequality
merge_2 = Merge(Data1=expression_2, Data2=expression_3)
weave = Weave(Pattern=equals.Equality, Stream0=expression, Stream1=merge_2, NullGaps=False)  # -> flatten(Weave)
conmesh = ConstructMesh(Vertices=demesh.Vertices, Faces=weave)
M_2 = ClusterOutput(conmesh)
