# Grasshopper definition font parser v1.2.gh (Grasshopper 0.9.76)
# Copyright: Co-de-iT

# RELIEF
# shape as structural device
# tutor: Alessio Erioli
# Thessaloniki . 10-16.05.2016
monoline_fonts = ValueList({"Machine Tool Gothic": 119, "Machine Tool Grenadier": 120, "Machine Tool Handscript": 121, "Machine Tool SanSerif": 122, "Machine Tool Script": 123}, selected="Machine Tool Gothic")
monoline_fonts_2 = Panel("""Machine Tool Gothic
Machine Tool Grenadier
Machine Tool Handscript
Machine Tool SanSerif
Machine Tool Script""")
number_slider = Slider(125, range=0..500)
c_script = CSharpScript(fontIndex=monoline_fonts)  # -> fonts, font; inputs fontIndex: Int32
# ---------- c_script: C# ----------
    // by Peter Fotiadis

    List<string> fontNames = FontFamily.Families.Select(f => f.Name).ToList();
    fonts = fontNames;
    //if(fontIndex > fontNames.Count) fontIndex = fontNames.Count - 1;
    int index = fontIndex % fontNames.Count; // I prefer to have a "wrap" behavior - A.E.
    font = fontNames[index];
# ---------- end c_script ----------
lng = ListLength(List=c_script.fonts)
tmatch = MatchText(Text=c_script.fonts, Pattern=graft(monoline_fonts_2), Case=True)
series = Series(Start=0, Step=1, Count=lng)
dispatch = Dispatch(List=series, DispatchPattern=tmatch)  # -> ListA, ListB
panel = Panel(dispatch.ListA)
text_to_convert = Panel("""hello World!!!
.:;"£$%&/\|=?'^@#_-*+
<>()[]{}""")
# <title>
# 
# <description>
# 
# code by <author>
# 
# v <version>
# 
# © Co-de-iT 2016 _ Creative Commons Attribution-NonCommercial-ShareAlike 4.0 International License
system_fonts_table = Panel(c_script.fonts)
current_font = Panel(c_script.font)
text_size = Slider(10, range=0..100)
justify = ValueList({"top left": 0, "middle left": 1, "bottom left": 2, "top center": 3, "middle center": 4, "bottom center": 5, "top right": 6, "middle right": 7, "bottom right": 8}, selected="middle center")
pt = Point(Point(29.82669023, 54.54882936, 15.21262714))
close = BooleanToggle(False)
yz = YZPlane(Origin=pt)
fpars = FontParser(S=text_to_convert, font=current_font, close=close, size=text_size, prec="250", P=yz, J=justify)  # -> out, C; inputs S: String, font: String, close: Boolean, size: Double, prec: Double, P: Plane, J: Int32
# ---------- fpars: C# ----------
        /*
    Font Parser
    Adaptation of code written by David Rutten, Giulio Piacentino et al.
    Adaptation for C# by Alessio Erioli - Co-de-iT
    */

    Component.Name = "Font Parser";
    Component.NickName = "FPars";
    Component.Description = "converts text into polylines - useful for fabrication";
    Component.Params.Input[0].Description = "text to convert";
    Component.Params.Input[1].Description = "text font";
    Component.Params.Input[2].Description = "close polylines (optional)";
    Component.Params.Input[3].Description = "text size";
    Component.Params.Input[4].Description = "sampling precision (usually 100-250 is ok)";
    Component.Params.Input[5].Description = "destination plane";
    Component.Params.Input[6].Description = "text justification (0-8)";


    float fS = size == 0 ? 1 : (float) size;
    System.Drawing.Font local_font = new System.Drawing.Font(font, (float) fS);

    System.Drawing.Drawing2D.GraphicsPath path = new System.Drawing.Drawing2D.GraphicsPath();
    path.AddString(S, local_font.FontFamily, (int) local_font.Style, local_font.Size, new PointF(0, 0), new StringFormat());

    System.Drawing.Drawing2D.Matrix matrix = new  System.Drawing.Drawing2D.Matrix(); // transformation matrix
    matrix.Reset(); // build identity matrix

    // ______________ text justification ______________

    RectangleF rec = path.GetBounds(); // bounding rectangle for text
    float dX = Convert.ToSingle(rec.Width * -0.5), dY = Convert.ToSingle(rec.Height * 0.5);
    switch(J){
      case 0:// top left
        dX = 0;
        dY = fS;
        break;
      case 1: // middle left
        dX = 0;
        dY = Convert.ToSingle((-rec.Height) * 0.5 + fS);
        break;
      case 2:  // bottom left
        dX = 0;
        dY = Convert.ToSingle(-rec.Height + fS * 0.5);
        break;
      case 3: // top center
        dX = Convert.ToSingle(rec.Width * -0.5);
        dY = fS;
        break;
      case 4: // middle center
        dX = Convert.ToSingle(rec.Width * -0.5);
        dY = Convert.ToSingle((-rec.Height) * 0.5 + fS);
        break;
      case 5: // bottom center
        dX = Convert.ToSingle(rec.Width * -0.5);
        dY = Convert.ToSingle(-rec.Height + fS * 0.5);
        break;
      case 6: // top right
        dX = Convert.ToSingle(rec.Width * -1);
        dY = fS;
        break;
      case 7: // middle right
        dX = Convert.ToSingle(rec.Width * -1);
        dY = Convert.ToSingle((-rec.Height) * 0.5 + fS);
        break;
      case 8: // bottom right
        dX = Convert.ToSingle(rec.Width * -1);
        dY = Convert.ToSingle(-rec.Height + fS * 0.5);
        break;

    }
    //float dX = Convert.ToSingle(rec.Width * -0.5);
    //float dY = Convert.ToSingle(rec.Height * 0.5);
    System.Drawing.Drawing2D.Matrix mTrans = new  System.Drawing.Drawing2D.Matrix(1, 0, 0, 1, dX, dY); // build transformation matrix
    path.Transform(mTrans); // transform text path

    // ______________ convert to polylines ______________

    path.Flatten(matrix, (float) (size / prec)); // turns the path into a polyline that approximates the path

    PointF[] pts = path.PathPoints; // get path points
    Byte[] tps = path.PathTypes;   // get path point types
    List<Polyline> strokes = new  List<Polyline>(); // List for strokes
    Polyline stroke = new Polyline();

    Byte typ_start = Convert.ToByte(System.Drawing.Drawing2D.PathPointType.Start);// find start points condition

    // the conversion loop
    for (int i = 0; i < pts.Length; i++){
      // if a start point is found, and the existing polyline is not null nor a single point,
      // add polyline to the strokes and create a new polyline
      if(tps[i] == typ_start){
        if (stroke != null && stroke.Count > 1) {
          if (close) stroke.Add(stroke[0]); // close polyline if necessary
          strokes.Add(stroke);}
        stroke = new Polyline();
      }
      // in any other case add the next point to a polyline
      stroke.Add(pts[i].X, -pts[i].Y + size, 0);
      // add last stroke to the list
      if (i == pts.Length - 1) {
        if (close) stroke.Add(stroke[0]); // and close it if necessary
        strokes.Add(stroke);
      }
    }


    // ______________ align strokes to given plane ______________

    Transform align = Transform.PlaneToPlane(Plane.WorldXY, P); // align transformation
    for(int j = 0; j < strokes.Count; j++){
      strokes[j].Transform(align);
    }

    C = strokes;
# ---------- end fpars ----------
preview = CustomPreview(Geometry=fpars.C, Shader=ColourSwatch(SwatchColor=RGB(255, 255, 255)))
