# Grasshopper definition save string to file.gh (Grasshopper 0.9.76)
# Copyright: Co-de-iT

# <title>
# 
# <description>
# 
# code by <author>
# 
# v <version>
# 
# © Co-de-iT 2016 _ Creative Commons Attribution-NonCommercial-ShareAlike 4.0 International License
# RELIEF
# shape as structural device
# tutor: Alessio Erioli
# Thessaloniki . 10-16.05.2016
text_to_save = Panel("hello hard disk!")
dir_type = ValueList({"desktop": 0, "documents": 1, "C:": 2}, selected="desktop")
custom_subdir = Panel("myLousyDir")
file_name_extension = Panel("mySuperOriginalFileName.txt")
save = Button()
dir = CSharpScript(type=dir_type, dir=custom_subdir)  # -> out, A; inputs type: Int32, dir: String
# ---------- dir: C# ----------
    String S = "";
    String root = "";
    String end = "\\";
    switch(type){
      case 0:
        root = Environment.GetFolderPath(Environment.SpecialFolder.Desktop);
        S = "Desktop";
        break;
      case 1:
        root = Environment.GetFolderPath(Environment.SpecialFolder.MyDocuments);
        S = "Documents";
        break;
      case 2:
        root = "C:";
        S = root + end;
        break;
    }
    A = root + end + (dir != null ? (dir + end) : "");
    Component.Message = S;
# ---------- end dir ----------
destination_directory = Panel(dir.A)
savetofile = SaveToFile(S=text_to_save, dir=dir.A, file=file_name_extension, save=save)  # -> out; inputs S: list of String, dir: String, file: String, save: Boolean
# ---------- savetofile: C# ----------
    String eol = Environment.NewLine;
    Component.Message = "write to file";
    Component.Name = "Save to File";
    Component.NickName = "SaveToFile";
    Component.Description = "Saves a text sequence to a file";

    if (save){
      if (!Directory.Exists(dir)) Directory.CreateDirectory(dir);

      String target = dir + file;

        System.IO.File.WriteAllLines(target, S.ToArray());
        Print("file saved as: " + target);
    } else {
      Print("press save button to save pdl file");
    }
# ---------- end savetofile ----------
