# Grasshopper definition fab_plan_mesh_v090062_2 methods.gh (Grasshopper 0.9.76)
# plug-ins: Human, Weaverbird

mesh_geometry = ValueList({"Tower": 0, "Y node": 1}, selected="Tower")
# RELIEF
# shape as structural device
# tutor: Alessio Erioli
# Thessaloniki . 10-16.05.2016
# README first: You can select from this switch if using a base mesh (default) or a NURBS surface that is then converted to mesh first.
# 
# In order to see the geometries in Rhino turn on the "geometries" layer
geometry_type = ValueList({"mesh": 0, "surface": 1}, selected="mesh")

u_div = Slider(10, range=2..30)
v_div = Slider(10, range=2..30)
srf = Surface(<surface referenced from the Rhino model>)

# ----
# attractor parameters
attractor_range = Slider(34.705, range=0..50)
far_effect = Slider(0.6, range=0.5..0.9)
near_effect = Slider(0.1, range=0.1..0.5)

text_size = Slider(0.2, range=0..1)
text_y_offset = Slider(0.05, range=0..1)
text_size_on_model = Slider(0.162, range=0..1)
# fabrication parameters
cap_distance = Slider(0.5, range=0.1..1)
slant_scale = Slider(0.65, range=0..1)
text_x_offset = Slider(0.5, range=0..1)
text_dist_from_model = Slider(0.919, range=0..10)

mesh = Mesh(<mesh referenced from the Rhino model>)
mesh_2 = Mesh(<mesh referenced from the Rhino model>)
mesh_3 = Mesh(<mesh referenced from the Rhino model>)

attractor_range_2 = Slider(20.122, range=0..50)
far_opening = Slider(0.2, range=0.2..0.9)
max_opening = Slider(0.3, range=0..0.4)
text_size_on_model_2 = Slider(0.162, range=0..1)
joint_hole_radius = Slider(0.074, range=0..0.1)
overlap = Slider(0.5, range=0..0.5)
near_depth = Slider(0.731, range=0.1..0.8)
far_depth = Slider(0.2, range=0.2..0.9)
near_opening = Slider(0.9, range=0.1..0.9)
text_size_2 = Slider(0.275, range=0..1)

filter = StreamFilter(Gate=mesh_geometry, Stream0=mesh_3, Stream1=mesh_2)
# "invisible" wires: to obtain "invisible" wires like these, just hover on an input, right click with the mouse, choose Wire Display > Invisible Display
mesh_uv = MeshSurface(Surface=srf, UCount=u_div, VCount=v_div, Overhang=True, Equalize=False)
# <title>
# 
# <description>
# 
# code by <author>
# 
# v <version>
# 
# © Co-de-iT 2016 _ Creative Commons Attribution-NonCommercial-ShareAlike 4.0 International License
filter_2 = StreamFilter(Gate=geometry_type, Stream0=mesh, Stream1=mesh_uv)
mcomp = Decompose(Mesh=filter_2)  # -> Vertices, Faces, Colours, Normals
vertices = FaceVertices(Face=mcomp.Faces)  # -> CornerA, CornerB, CornerC, CornerD
panel = Panel(vertices.CornerA)

# ----
# points extraction + polylines & planes generation
item = ListItem(List=mcomp.Vertices, Index=graft(vertices.CornerA), Wrap=True)
item_2 = ListItem(List=mcomp.Vertices, Index=graft(vertices.CornerB), Wrap=True)
item_3 = ListItem(List=mcomp.Vertices, Index=graft(vertices.CornerC), Wrap=True)
item_4 = ListItem(List=mcomp.Vertices, Index=graft(vertices.CornerD), Wrap=True)
pl_3pt = Plane3Pt(PointA=item, PointB=item_2, PointC=item_3)
merge = Merge(Data1=item, Data2=item_2, Data3=item_3)
merge_2 = Merge(Data1=item, Data2=item_3, Data3=item_4)
pl_3pt_2 = Plane3Pt(PointA=item, PointB=item_3, PointC=item_4)
pline = PolyLine(Vertices=merge, Closed=True)
pline_2 = PolyLine(Vertices=merge_2, Closed=True)

# ----
# attractor logic
crv = Curve(reparameterize(<curve referenced from the Rhino model>))
crv_2 = Curve(reparameterize(<curve referenced from the Rhino model>))
param = Slider(0.219, range=0..1)
filter_3 = StreamFilter(Gate=geometry_type, Stream0=crv_2, Stream1=crv)
eval = EvaluateCurve(Curve=filter_3, Parameter=param)  # -> Point, Tangent, Angle

avr = Average(Input=merge)
avr_2 = Average(Input=merge_2)

# ----
# merge streams
merge_3 = Merge(Data1=pl_3pt, Data2=pl_3pt_2)
merge_4 = Merge(Data1=pline, Data2=pline_2)
merge_5 = Merge(Data1=avr, Data2=avr_2)

# ----
# attractor pont along curve
# sample by distance
# remap values to a min-max range
# use distance square
# control attractor range
dist = Distance(PointA=eval.Point, PointB=merge_5)
cir = Circle(Plane=eval.Point, Radius=attractor_range)
min = Minimum(A=dist, B=attractor_range)
pow = Power(A=min, B="2")
dom = Domain(DomainStart=near_effect, DomainEnd=far_effect)
bnd = Bounds(Numbers=flatten(pow))
remap = RemapNumbers(Value=pow, Source=bnd, Target=dom)  # -> Mapped, Clipped

preview = CustomPreview(
    Geometry=[cir, filter_3],
    Shader={ambient=RGB(128, 128, 128), diffuse=RGB(255, 255, 255), emission=RGB(255, 255, 255), shine=0.5, specular=RGB(255, 255, 255), transparency=0})
demesh = DeconstructMesh(Mesh=filter)  # -> Vertices, Faces, Colours, Normals
panel_2 = Panel("B\"")
panel_3 = Panel("A'")
panel_4 = Panel("C'")
panel_5 = Panel("C\"")
panel_6 = Panel("B'")
panel_7 = Panel("A\"")

# ----
# attractor logic
crv_3 = Curve(reparameterize(<curve referenced from the Rhino model>))
param_2 = Slider(0.219, range=0..1)
crv_4 = Curve(reparameterize(<curve referenced from the Rhino model>))
filter_4 = StreamFilter(Gate=mesh_geometry, Stream0=crv_3, Stream1=crv_4)
eval_2 = EvaluateCurve(Curve=filter_4, Parameter=param_2)  # -> Point, Tangent, Angle

deface = DeconstructFace(Face=graft(demesh.Faces))  # -> CornerA, CornerB, CornerC, CornerD
item_5 = ListItem(List=demesh.Vertices, Index=deface.CornerB, Wrap=True)
item_6 = ListItem(List=demesh.Vertices, Index=deface.CornerC, Wrap=True)
item_7 = ListItem(List=demesh.Vertices, Index=deface.CornerA, Wrap=True)
Z = UnitZ(Factor=1)
Z_2 = UnitZ(Factor=1)
Z_3 = UnitZ(Factor=1)

# ----
# attractor pont along curve
# sample by distance
# remap values to a min-max range
# use distance square
# control attractor range
dist_2 = Distance(PointA=eval_2.Point, PointB=demesh.Vertices)
pframe = PerpFrame(Curve=filter_4, Parameter=param_2)
cir_2 = Circle(Plane=pframe, Radius=attractor_range_2)
min_2 = Minimum(A=dist_2, B=attractor_range_2)
pow_2 = Power(A=min_2, B="2")
dom_2 = Domain(DomainStart=near_depth, DomainEnd=far_depth)
bnd_2 = Bounds(Numbers=flatten(pow_2))
remap_2 = RemapNumbers(Values=pow_2, Source=bnd_2, Target=dom_2)

preview_2 = CustomPreview(
    Geometry=[filter_4, cir_2],
    Shader={ambient=RGB(128, 128, 128), diffuse=RGB(255, 255, 255), emission=RGB(255, 255, 255), shine=0.5, specular=RGB(255, 255, 255), transparency=0})
vec2pt = Vector2Pt(PointA=item_7, PointB=item_5, Unitize=False)  # -> Vector, Length
vec2pt_2 = Vector2Pt(PointA=item_7, PointB=item_6, Unitize=False)  # -> Vector, Length
vec2pt_3 = Vector2Pt(PointA=item_5, PointB=item_6, Unitize=False)  # -> Vector, Length
vec2pt_4 = Vector2Pt(PointA=item_5, PointB=item_7, Unitize=False)  # -> Vector, Length
vec2pt_5 = Vector2Pt(PointA=item_6, PointB=item_7, Unitize=False)  # -> Vector, Length
vec2pt_6 = Vector2Pt(PointA=item_6, PointB=item_5, Unitize=False)  # -> Vector, Length
dom_3 = Domain(DomainStart=near_opening, DomainEnd=far_opening)
remap_3 = RemapNumbers(Values=pow_2, Source=bnd_2, Target=dom_3)
item_8 = ListItem(List=remap_3, Index=deface.CornerB, Wrap=True)
item_9 = ListItem(List=remap_3, Index=deface.CornerC, Wrap=True)
item_10 = ListItem(List=remap_3, Index=deface.CornerA, Wrap=True)
multiplication = Multiplication(A=item_10, B=max_opening)
multiplication_2 = Multiplication(A=item_8, B=max_opening)
multiplication_3 = Multiplication(A=item_9, B=max_opening)
multiplication_4 = Multiplication(A=item_10, B=max_opening)
multiplication_5 = Multiplication(A=item_8, B=max_opening)
multiplication_6 = Multiplication(A=item_9, B=max_opening)
justification = ValueList({"top left": 0, "middle left": 1, "bottom left": 2, "top center": 3, "middle center": 4, "bottom center": 5, "top right": 6, "middle right": 7, "bottom right": 8}, selected="bottom left")
item_11 = ListItem(List=remap_2, Index=deface.CornerB, Wrap=True)
item_12 = ListItem(List=remap_2, Index=deface.CornerC, Wrap=True)
item_13 = ListItem(List=remap_2, Index=deface.CornerA, Wrap=True)
facen = FaceNormals(Mesh=filter)  # -> graft(Centers), graft(Normals)
pl = PlaneNormal(Origin=facen.Centers, ZAxis=facen.Normals)
multiplication_7 = Multiplication(A=vec2pt.Vector, B=multiplication_4)
multiplication_8 = Multiplication(A=vec2pt_2.Vector, B=multiplication_4)
multiplication_9 = Multiplication(A=vec2pt_3.Vector, B=multiplication_5)
multiplication_10 = Multiplication(A=vec2pt_5.Vector, B=multiplication_6)
multiplication_11 = Multiplication(A=vec2pt_4.Vector, B=multiplication_5)
multiplication_12 = Multiplication(A=vec2pt_6.Vector, B=multiplication_6)
vec2pt_7 = Vector2Pt(PointA=item_7, PointB=facen.Centers, Unitize=False)  # -> Vector, Length
vec2pt_8 = Vector2Pt(PointA=item_5, PointB=facen.Centers, Unitize=False)  # -> Vector, Length
vec2pt_9 = Vector2Pt(PointA=item_6, PointB=facen.Centers, Unitize=False)  # -> Vector, Length
move = Move(Geometry=item_5, Motion=multiplication_11)  # -> Geometry, Transform
move_2 = Move(Geometry=item_5, Motion=multiplication_9)  # -> Geometry, Transform
move_3 = Move(Geometry=item_6, Motion=multiplication_12)  # -> Geometry, Transform
move_4 = Move(Geometry=item_7, Motion=multiplication_7)  # -> Geometry, Transform
move_5 = Move(Geometry=item_6, Motion=multiplication_10)  # -> Geometry, Transform
move_6 = Move(Geometry=item_7, Motion=multiplication_8)  # -> Geometry, Transform
ln = Line(StartPoint=move_4.Geometry, EndPoint=move.Geometry)
ln_2 = Line(StartPoint=move_2.Geometry, EndPoint=move_3.Geometry)
ln_3 = Line(StartPoint=move_6.Geometry, EndPoint=move_5.Geometry)
multiplication_13 = Multiplication(A=item_11, B=vec2pt_8.Vector)
multiplication_14 = Multiplication(A=item_12, B=vec2pt_9.Vector)
multiplication_15 = Multiplication(A=item_13, B=vec2pt_7.Vector)
move_7 = Move(Geometry=item_5, Motion=multiplication_13)  # -> Geometry, Transform
move_8 = Move(Geometry=item_6, Motion=multiplication_14)  # -> Geometry, Transform
move_9 = Move(Geometry=item_7, Motion=multiplication_15)  # -> Geometry, Transform
justification_2 = ValueList({"top left": 0, "middle left": 1, "bottom left": 2, "top center": 3, "middle center": 4, "bottom center": 5, "top right": 6, "middle right": 7, "bottom right": 8}, selected="middle center")
merge_6 = Merge(Data1=move_4.Geometry, Data2=move_9.Geometry, Data3=move_7.Geometry, Data4=move.Geometry)
merge_7 = Merge(Data1=move_6.Geometry, Data2=move_5.Geometry, Data3=move_8.Geometry, Data4=move_9.Geometry)
merge_8 = Merge(Data1=move_8.Geometry, Data2=move_7.Geometry, Data3=move_2.Geometry, Data4=move_3.Geometry)
merge_9 = Merge(Data1=move_3.Geometry, Data2=move_2.Geometry, Data3=move_7.Geometry, Data4=move_8.Geometry)
merge_10 = Merge(Data1=move_8.Geometry, Data2=move_7.Geometry, Data3=move_9.Geometry)
conmesh = ConstructMesh(Vertices=merge_10, Faces="T{0;1;2}")
conmesh_2 = ConstructMesh(Vertices=merge_7, Faces={A=0, B=1, C=2, D=3})
conmesh_3 = ConstructMesh(Vertices=merge_6, Faces={A=0, B=1, C=2, D=3})
conmesh_4 = ConstructMesh(Vertices=merge_9, Faces={A=0, B=1, C=2, D=3})
wbjoin = WeaverbirdsJoinMeshesAndWeld(Mesh=flatten([conmesh, conmesh_3, conmesh_2, conmesh_4]), Weld=True)
medges = MeshEdges(Mesh=wbjoin)  # -> NakedEdges, InteriorEdges, NonManifoldEdges
previewmat = CustomPreviewMaterials(Geometry=wbjoin, DiffuseColor=RGB(255, 255, 255))
previewlw = CustomPreviewLineweights(Geometry=medges.InteriorEdges, Shader=ColourSwatch(SwatchColor=RGB(130, 130, 130)), Absolute=False)
previewlw_2 = CustomPreviewLineweights(Geometry=medges.NakedEdges, Shader=ColourSwatch(SwatchColor=RGB(0, 90, 97)), Absolute=False)

# ----
# orienting geometries
wbfacepolys = WeaverbirdsFacePolylines(Mesh=filter)  # -> graft(Polygons)
planar = Planar(Curve=wbfacepolys)  # -> Planar, Plane, Deviation

lng = ListLength(List=flatten(wbfacepolys))
x_spacing = Slider(7.078, range=0..20)
y_spacing = Slider(6.473, range=0..20)
n_of_rows = Slider(16, range=1..50)
# orient grid & text tag generation
pt = Point(<point referenced from the Rhino model>)
series = Series(Start=0, Step=1, Count=lng)  # -> graft(Series)
expression = Expression(x=lng, y=n_of_rows, Expression="Int(Round(x*2/y))")
expression_2 = Expression(x=lng, Expression="Int(x*2-1)")
int = Integer(series)
recgrid = Rectangular(Plane=pt, SizeX=x_spacing, SizeY=y_spacing, ExtentX=expression, ExtentY=expr("x-1", n_of_rows))  # -> Cells, Points

subset = SubList(List=flatten(recgrid.Points), Domain=lng, Cycle=False)  # -> List, Index

graft = GraftTree(Data=subset.List, IncludeEmptyLists=True, IncludeNullItems=True)
orient = Orient(Geometry=wbfacepolys, Source=planar.Plane, Target=graft)  # -> Geometry, Transform
explode = Explode(Curve=orient.Geometry, Recursive=True)  # -> Segments, Vertices

item_14 = ListItem(List=explode.Vertices, Index="1", Wrap=True)
item_15 = ListItem(List=explode.Vertices, Index="2", Wrap=True)
item_16 = ListItem(List=explode.Vertices, Index="0", Wrap=True)
tag = TextTag(Location=item_16, Text="0")
tag_2 = TextTag(Location=item_14, Text="1")
tag_3 = TextTag(Location=item_15, Text="2")
vec2pt_10 = Vector2Pt(PointA=item_16, PointB=item_14, Unitize=False)  # -> Vector, Length
vdisex = VectorDisplayEx(Point=item_16, Vector=vec2pt_10.Vector, Colour=ColourSwatch(SwatchColor=RGB(255, 0, 0)), Width=2)
vec2pt_11 = Vector2Pt(PointA=item_16, PointB=item_15, Unitize=False)  # -> Vector, Length
vec2pt_12 = Vector2Pt(PointA=item_14, PointB=item_16, Unitize=False)  # -> Vector, Length
vec2pt_13 = Vector2Pt(PointA=item_14, PointB=item_15, Unitize=False)  # -> Vector, Length
vdisex_2 = VectorDisplayEx(Point=item_14, Vector=vec2pt_13.Vector, Colour=ColourSwatch(SwatchColor=RGB(0, 17, 255)), Width=2)
vec2pt_14 = Vector2Pt(PointA=item_15, PointB=item_16, Unitize=False)  # -> Vector, Length
vdisex_3 = VectorDisplayEx(Point=item_15, Vector=vec2pt_14.Vector, Colour=ColourSwatch(SwatchColor=RGB(30, 255, 0)), Width=2)
vec2pt_15 = Vector2Pt(PointA=item_15, PointB=item_14, Unitize=False)  # -> Vector, Length
multiplication_16 = Multiplication(A=vec2pt_10.Vector, B=multiplication)
multiplication_17 = Multiplication(A=vec2pt_11.Vector, B=multiplication)
multiplication_18 = Multiplication(A=vec2pt_12.Vector, B=multiplication_2)
multiplication_19 = Multiplication(A=vec2pt_15.Vector, B=multiplication_3)
multiplication_20 = Multiplication(A=vec2pt_13.Vector, B=multiplication_2)
multiplication_21 = Multiplication(A=vec2pt_14.Vector, B=multiplication_3)
move_10 = Move(Geometry=item_14, Motion=multiplication_18)  # -> Geometry, Transform
move_11 = Move(Geometry=item_14, Motion=multiplication_20)  # -> Geometry, Transform
move_12 = Move(Geometry=item_15, Motion=multiplication_19)  # -> Geometry, Transform
move_13 = Move(Geometry=item_16, Motion=multiplication_16)  # -> Geometry, Transform
move_14 = Move(Geometry=item_15, Motion=multiplication_21)  # -> Geometry, Transform
move_15 = Move(Geometry=item_16, Motion=multiplication_17)  # -> Geometry, Transform
expression_3 = Expression(x=item_16, y=item_14, Expression="(x+y)/2")
expression_4 = Expression(x=item_14, y=item_15, Expression="(x+y)/2")
expression_5 = Expression(x=item_15, y=item_16, Expression="(x+y)/2")
ln_4 = Line(StartPoint=move_13.Geometry, EndPoint=move_10.Geometry)
ln_5 = Line(StartPoint=move_11.Geometry, EndPoint=move_12.Geometry)
ln_6 = Line(StartPoint=move_15.Geometry, EndPoint=move_14.Geometry)
vrot = Rotate(Vector=vec2pt_15.Vector, Axis=Z, Angle="PI/2")
vrot_2 = Rotate(Vector=vec2pt_12.Vector, Axis=Z_2, Angle="PI/2")
vrot_3 = Rotate(Vector=vec2pt_11.Vector, Axis=Z_3, Angle="PI/2")
unit = UnitVector(Vector=vrot)
unit_2 = UnitVector(Vector=vrot_2)
unit_3 = UnitVector(Vector=vrot_3)
multiplication_22 = Multiplication(A=overlap, B=unit)
multiplication_23 = Multiplication(A=overlap, B=unit_2)
multiplication_24 = Multiplication(A=overlap, B=unit_3)
move_16 = Move(Geometry=expression_3, Motion=multiplication_23)  # -> Geometry, Transform
move_17 = Move(Geometry=expression_4, Motion=multiplication_22)  # -> Geometry, Transform
move_18 = Move(Geometry=expression_5, Motion=multiplication_24)  # -> Geometry, Transform
merge_11 = Merge(Data1=move_13.Geometry, Data2=move_16.Geometry, Data3=move_10.Geometry)
merge_12 = Merge(Data1=move_11.Geometry, Data2=move_17.Geometry, Data3=move_12.Geometry)
merge_13 = Merge(Data1=move_14.Geometry, Data2=move_18.Geometry, Data3=move_15.Geometry)
pline_3 = PolyLine(Vertices=merge_11, Closed=False)
pline_4 = PolyLine(Vertices=merge_12, Closed=False)
pline_5 = PolyLine(Vertices=merge_13, Closed=False)
pcen = PolygonCenter(Polyline=orient.Geometry)  # -> CenterV, CenterE, CenterA
vec2pt_16 = Vector2Pt(PointA=item_16, PointB=pcen.CenterV, Unitize=False)  # -> Vector, Length
vec2pt_17 = Vector2Pt(PointA=item_14, PointB=pcen.CenterV, Unitize=False)  # -> Vector, Length
vec2pt_18 = Vector2Pt(PointA=item_15, PointB=pcen.CenterV, Unitize=False)  # -> Vector, Length
multiplication_25 = Multiplication(A=item_13, B=vec2pt_16.Vector)
multiplication_26 = Multiplication(A=item_12, B=vec2pt_18.Vector)
multiplication_27 = Multiplication(A=item_11, B=vec2pt_17.Vector)
move_19 = Move(Geometry=item_16, Motion=multiplication_25)  # -> Geometry, Transform
move_20 = Move(Geometry=item_14, Motion=multiplication_27)  # -> Geometry, Transform
move_21 = Move(Geometry=item_15, Motion=multiplication_26)  # -> Geometry, Transform
merge_14 = Merge(Data1=move_13.Geometry, Data2=move_19.Geometry, Data3=move_15.Geometry)
merge_15 = Merge(Data1=move_11.Geometry, Data2=move_20.Geometry, Data3=move_10.Geometry)
merge_16 = Merge(Data1=move_14.Geometry, Data2=move_21.Geometry, Data3=move_12.Geometry)
pline_6 = PolyLine(Vertices=merge_14, Closed=False)
pline_7 = PolyLine(Vertices=merge_15, Closed=False)
pline_8 = PolyLine(Vertices=merge_16, Closed=False)
merge_17 = Merge(Data1=expression_3, Data2=expression_4, Data3=expression_5)
panel_14 = Panel(int)
# flaps generation + tags for assembly
merge_18 = Merge(Data1=pline_6, Data2=pline_7, Data3=pline_8, Data4=pline_3, Data5=pline_4, Data6=pline_5)
merge_19 = Merge(Data1=ln_4, Data2=ln_5, Data3=ln_6)
cir_3 = Circle(Plane=merge_17, Radius=joint_hole_radius)

# ----
# < turn on to see indexes on mesh
swatch = ColourSwatch(SwatchColor=RGB(222, 89, 177))
tag_4 = TextTag3D(Location=pl, Text=int, Size=text_size_on_model_2, Colour=swatch, Justification=7)

fpars = FontParser(S=graft(panel_14), font="Machine Tool SanSerif", size=text_size_2, prec="100", P=pcen.CenterV, J=justification_2)  # -> out, C; inputs S: String, font: String, close: Boolean, size: Double, prec: Double, P: Plane, J: Int32
# ---------- fpars: C# ----------
        /*
    Font Parser
    Adaptation of code written by David Rutten, Giulio Piacentino et al.
    Adaptation for C# by Alessio Erioli - Co-de-iT
    */

    Component.Name = "Font Parser";
    Component.NickName = "FPars";
    Component.Description = "converts text into polylines - useful for fabrication";
    Component.Params.Input[0].Description = "text to convert";
    Component.Params.Input[1].Description = "text font";
    Component.Params.Input[2].Description = "close polylines (optional)";
    Component.Params.Input[3].Description = "text size";
    Component.Params.Input[4].Description = "sampling precision (usually 100-250 is ok)";
    Component.Params.Input[5].Description = "destination plane";
    Component.Params.Input[6].Description = "text justification (0-8)";


    float fS = size == 0 ? 1 : (float) size;
    System.Drawing.Font local_font = new System.Drawing.Font(font, (float) fS);

    System.Drawing.Drawing2D.GraphicsPath path = new System.Drawing.Drawing2D.GraphicsPath();
    path.AddString(S, local_font.FontFamily, (int) local_font.Style, local_font.Size, new PointF(0, 0), new StringFormat());

    System.Drawing.Drawing2D.Matrix matrix = new  System.Drawing.Drawing2D.Matrix(); // transformation matrix
    matrix.Reset(); // build identity matrix

    // ______________ text justification ______________

    RectangleF rec = path.GetBounds(); // bounding rectangle for text
    float dX = Convert.ToSingle(rec.Width * -0.5), dY = Convert.ToSingle(rec.Height * 0.5);
    switch(J){
      case 0:// top left
        dX = 0;
        dY = fS;
        break;
      case 1: // middle left
        dX = 0;
        dY = Convert.ToSingle((-rec.Height) * 0.5 + fS);
        break;
      case 2:  // bottom left
        dX = 0;
        dY = Convert.ToSingle(-rec.Height + fS * 0.5);
        break;
      case 3: // top center
        dX = Convert.ToSingle(rec.Width * -0.5);
        dY = fS;
        break;
      case 4: // middle center
        dX = Convert.ToSingle(rec.Width * -0.5);
        dY = Convert.ToSingle((-rec.Height) * 0.5 + fS);
        break;
      case 5: // bottom center
        dX = Convert.ToSingle(rec.Width * -0.5);
        dY = Convert.ToSingle(-rec.Height + fS * 0.5);
        break;
      case 6: // top right
        dX = Convert.ToSingle(rec.Width * -1);
        dY = fS;
        break;
      case 7: // middle right
        dX = Convert.ToSingle(rec.Width * -1);
        dY = Convert.ToSingle((-rec.Height) * 0.5 + fS);
        break;
      case 8: // bottom right
        dX = Convert.ToSingle(rec.Width * -1);
        dY = Convert.ToSingle(-rec.Height + fS * 0.5);
        break;

    }
    //float dX = Convert.ToSingle(rec.Width * -0.5);
    //float dY = Convert.ToSingle(rec.Height * 0.5);
    System.Drawing.Drawing2D.Matrix mTrans = new  System.Drawing.Drawing2D.Matrix(1, 0, 0, 1, dX, dY); // build transformation matrix
    path.Transform(mTrans); // transform text path

    // ______________ convert to polylines ______________

    path.Flatten(matrix, (float) (size / prec)); // turns the path into a polyline that approximates the path

    PointF[] pts = path.PathPoints; // get path points
    Byte[] tps = path.PathTypes;   // get path point types
    List<Polyline> strokes = new  List<Polyline>(); // List for strokes
    Polyline stroke = new Polyline();

    Byte typ_start = Convert.ToByte(System.Drawing.Drawing2D.PathPointType.Start);// find start points condition

    // the conversion loop
    for (int i = 0; i < pts.Length; i++){
      // if a start point is found, and the existing polyline is not null nor a single point,
      // add polyline to the strokes and create a new polyline
      if(tps[i] == typ_start){
        if (stroke != null && stroke.Count > 1) {
          if (close) stroke.Add(stroke[0]); // close polyline if necessary
          strokes.Add(stroke);}
        stroke = new Polyline();
      }
      // in any other case add the next point to a polyline
      stroke.Add(pts[i].X, -pts[i].Y + size, 0);
      // add last stroke to the list
      if (i == pts.Length - 1) {
        if (close) stroke.Add(stroke[0]); // and close it if necessary
        strokes.Add(stroke);
      }
    }


    // ______________ align strokes to given plane ______________

    Transform align = Transform.PlaneToPlane(Plane.WorldXY, P); // align transformation
    for(int j = 0; j < strokes.Count; j++){
      strokes[j].Transform(align);
    }

    C = strokes;
# ---------- end fpars ----------
join = JoinCurves(Curves=flatten(merge_18), Preserve=False)
crv_5 = Curve(cir_3)
crv_6 = Curve(merge_19)

preview_3 = CustomPreview(Geometry=[join, crv_5], Shader=ColourSwatch(SwatchColor=RGB(112, 0, 0)))

preview_4 = CustomPreview(Geometry=crv_6, Shader=ColourSwatch(SwatchColor=RGB(255, 102, 102)))

preview_5 = CustomPreview(Geometry=fpars.C, Shader=ColourSwatch(SwatchColor=RGB(255, 255, 255)))

lng_2 = ListLength(List=mcomp.Faces)
x_spacing_2 = Slider(10, range=0..20)
y_spacing_2 = Slider(7, range=0..20)
n_of_rows_2 = Slider(20, range=1..50)
# orient grid & text tag generation
pt_2 = Point(<point referenced from the Rhino model>)
panel_15 = Panel("""  _ a.
  _ b.""")
series_2 = Series(Start=0, Step=1, Count=lng_2)  # -> graft(Series)
expression_6 = Expression(x=lng_2, y=n_of_rows_2, Expression="Int(Round(x*2/y))")
int_2 = Integer(series_2)
expression_7 = Expression(x=lng_2, Expression="Int(x*2-1)")
recgrid_2 = Rectangular(Plane=pt_2, SizeX=x_spacing_2, SizeY=y_spacing_2, ExtentX=expression_6, ExtentY=expr("x-1", n_of_rows_2))  # -> Cells, Points
# path mapper explained: this component rebuilds the tree structure so to match the other inputs in the next steps, organizing the list of elements in a tree with 2 elements in each branch.
# 
# i is the index of elements in the list
# A, B, C are the tree structure levels
# 
# floor(i/2) takes the lower integer of i divided by 2
# 
# ex.
# floor(1.7) = 1
# floor(3/2) = floor (1.5) = 1
# 
# check the tree structure before and after here below:
concat = Concatenate(A=panel_15, B=int_2)
pl_origin = PlaneOrigin(Base=merge_3, Origin=merge_5)
pcomp = PlaneComponents(Plane=pl_origin)  # -> Origin, XAxis, YAxis, ZAxis
Z_4 = UnitZ(Factor=1)
angle = Angle(VectorA=pcomp.YAxis, VectorB=Z_4, Plane=pl_origin)  # -> Angle, Reflex
multiplication_28 = Multiplication(A=pcomp.ZAxis, B=text_dist_from_model)
prot = RotatePlane(Plane=pl_origin, Angle=angle.Angle)
line = LineSDL(Start=pcomp.Origin, Direction=pcomp.ZAxis, Length=text_dist_from_model)
move_22 = Move(Geometry=prot, Motion=multiplication_28)  # -> Geometry, Transform

subset_2 = SubList(List=flatten(recgrid_2.Points), Domain=expression_7, Cycle=False)  # -> List, Index
viewer = ParamViewer(subset_2.List)
viewer_2 = ParamViewer(subset_2.List)

path_mapper = PathMapper(subset_2.List, source="{A;B;C}(i)", target="{B;C; floor(i/2)}")

# ----
# orienting geometries
scale = Scale(Geometry=merge_4, Center=merge_5, Factor=remap.Mapped)  # -> Geometry, Transform
graft_2 = GraftTree(Data=path_mapper, IncludeEmptyLists=True, IncludeNullItems=True)
graft_3 = GraftTree(Data=merge_3, IncludeEmptyLists=True, IncludeNullItems=True)
graft_4 = GraftTree(Data=merge_4, IncludeEmptyLists=True, IncludeNullItems=True)
graft_5 = GraftTree(Data=scale.Geometry, IncludeEmptyLists=True, IncludeNullItems=True)
xy = XYPlane(Origin=graft_2)
orient_2 = Orient(Geometry=graft_4, Source=graft_3, Target=xy)  # -> Geometry, Transform
orient_3 = Orient(Geometry=graft_5, Source=graft_3, Target=xy)  # -> Geometry, Transform

viewer_3 = ParamViewer(path_mapper)
viewer_4 = ParamViewer(path_mapper)

# ----
# flaps generation + tags for assembly
explode_2 = Explode(Curve=orient_2.Geometry, Recursive=True)  # -> Segments, Vertices
cull_i = CullIndex(List=explode_2.Vertices, Indices=-1, Wrap=True)
shift = ShiftList(List=cull_i, Shift=1, Wrap=True)
shift_2 = ShiftList(List=cull_i, Shift=-1, Wrap=True)
offset_l = OffsetLoose(Curve=graft(explode_2.Segments), Distance=cap_distance, Plane=xy)
vec2pt_19 = Vector2Pt(PointA=cull_i, PointB=shift, Unitize=False)  # -> Vector, Length
vec2pt_20 = Vector2Pt(PointA=cull_i, PointB=shift_2, Unitize=False)  # -> Vector, Length
angle_2 = Angle(VectorA=vec2pt_19.Vector, VectorB=vec2pt_20.Vector)  # -> Angle, Reflex
eval_3 = EvaluateCurve(Curve=reparameterize(offset_l), Parameter="0.5")  # -> Point, Tangent, Angle
sort = SortList(Keys=angle_2.Angle, ValuesA=cull_i)  # -> Keys, ValuesA
sort_2 = SortList(Keys=angle_2.Angle, ValuesA=vec2pt_19.Vector)  # -> Keys, ValuesA
sort_3 = SortList(Keys=angle_2.Angle, ValuesA=vec2pt_20.Vector)  # -> Keys, ValuesA
scale_2 = Scale(Geometry=offset_l, Center=eval_3.Point, Factor=slant_scale)  # -> Geometry, Transform
item_17 = ListItem(List=sort.ValuesA, Index=0, Wrap=True)
item_18 = ListItem(List=sort_2.ValuesA, Index=0, Wrap=True)
item_19 = ListItem(List=sort_3.ValuesA, Index=0, Wrap=True)
end = EndPoints(Curve=explode_2.Segments)  # -> Start, End
end_2 = EndPoints(Curve=scale_2.Geometry)  # -> Start, End
pl_2 = Plane(Origin=item_17, XAxis=item_18, YAxis=item_19)
pshift = ShiftPaths(Data=pl_2, Offset=-3)
ln_7 = Line(PointA=flatten(end.Start), PointB=flatten(end_2.Start))
ln_8 = Line(PointA=flatten(end.End), PointB=flatten(end_2.End))

Z_5 = UnitZ(Factor=1)
# Vector direction check & orient coloration
angle_3 = Angle(VectorA=pcomp.ZAxis, VectorB=Z_5)  # -> Angle, Reflex
gradient = Gradient(LowerLimit=0, UpperLimit=3.141592654, Parameter=angle_3.Angle, stops=[0.00292: RGB(255, 237, 241), 1: RGB(88, 0, 94)])
vdisex_4 = VectorDisplayEx(Point=merge_5, Vector=pcomp.ZAxis, Colour=gradient, Width=1)

deplane = DeconstructPlane(Plane=pshift)  # -> Origin, XAxis, YAxis, ZAxis
amp = Amplitude(Vector=deplane.XAxis, Amplitude=text_x_offset)
amp_2 = Amplitude(Vector=deplane.YAxis, Amplitude=text_y_offset)
addition = Addition(A=amp, B=amp_2)

fpars_2 = FontParser(S=graft(concat), font="Machine Tool SanSerif", size=text_size, prec="100", P=pshift, J=justification)  # -> out, C; inputs S: String, font: String, close: Boolean, size: Double, prec: Double, P: Plane, J: Int32; same code as fpars
join_2 = JoinCurves(Curves=flatten([ln_7, ln_8, scale_2.Geometry]), Preserve=False)
crv_7 = Curve(orient_3.Geometry)
crv_8 = Curve(orient_2.Geometry)

move_23 = Move(Geometry=fpars_2.C, Motion=addition)  # -> Geometry, Transform

# ----
# cap curves (cut)
# hole curves (cut)
swatch_2 = ColourSwatch(SwatchColor=RGB(112, 0, 0))
preview_6 = CustomPreview(Geometry=[join_2, crv_7], Shader=swatch_2)

# ----
# perimeter curves (dash)
# text (engrave)
swatch_3 = ColourSwatch(SwatchColor=RGB(255, 102, 102))
preview_7 = CustomPreview(Geometry=crv_8, Shader=swatch_3)

preview_8 = CustomPreview(Geometry=move_23.Geometry, Shader=ColourSwatch(SwatchColor=RGB(255, 255, 255)))

# ----
# colored components on mesh
gradient_2 = Gradient(LowerLimit=near_effect, UpperLimit=far_effect, Parameter=remap.Mapped, stops=[0: RGB(199, 199, 199), 1: RGB(0, 0, 0)])
swatch_4 = ColourSwatch(SwatchColor=RGB(222, 89, 177))
preview_9 = CustomPreview(Geometry=line, Shader=swatch_4)

planar_2 = PlanarSrf(Edges=[graft_4, graft_5])
loft = Loft(
    Section=[graft_4, graft_5],
    Options={Adjust=False, Closed=False, LoftEnds=0, LoftSimp=0, LoftType=0, Rebuild=10, Refit=0.01})  # disabled
tag_5 = TextTag3D(Location=merge_3, Text=concat, Size=text_size_on_model, Colour=swatch_4, Justification=7)

tag_6 = TextTag3D(Location=move_22.Geometry, Text=concat, Size=text_size_on_model, Colour=swatch_4, Justification=7)

preview_10 = CustomPreview(Geometry=planar_2, Shader=graft(gradient_2))
