# Grasshopper definition Relief final geometry 20160516_unroll_recut nest 4 staples.gh (Grasshopper 0.9.76)
# Copyright: Co-de-iT
# plug-ins: Heteroptera, Unroller, Human, horsterCameraControl

configuration = ValueList({"configurator": 0, "final": 1}, selected="final")
shorten = Slider(0, range=0..0.4)

# ----
# animate
number_slider = Slider(1, range=0..1)
crv = Curve(reparameterize(<curve referenced from the Rhino model>))
crv_2 = Curve(reparameterize(<curve referenced from the Rhino model>))
bbox = BoundingBox(Content=crv, Plane=PlaneXY(0, 0, 0))  # -> Box, Box_2
box = EvaluateBox(Box=bbox.Box, UParameter=0.5, VParameter=0.5, WParameter=0.5)  # -> Plane, Point, Include
cir = Circle(Plane=box.Point, Radius=Slider(2, range=0..50))
area = Area(Geometry=crv_2)  # -> Area, Centroid
flip = FlipCurve(Curve=cir)  # -> Curve, Flag
eval = EvaluateCurve(Curve=reparameterize(flip.Curve), Parameter=number_slider)  # -> Point, Tangent, Angle
eval_2 = EvaluateCurve(Curve=crv_2, Parameter=number_slider)  # -> Point, Tangent, Angle
setcam = SetCamera(
    CameraLocation=eval_2.Point,
    TargetLocation=area.Centroid,
    LensLength=Slider(27, range=0..100),
    UpDirection=eval_2.Tangent,
    Activate=Toggle(False))

# ----
# curves_left
crv_3 = Curve(reparameterize([<curve referenced from the Rhino model> x2]))
# surface for Z regulation
srf = Surface(<surface referenced from the Rhino model>)
# curves_right
crv_4 = Curve(reparameterize([<curve referenced from the Rhino model> x2]))
# medial axis
crv_5 = Curve(<curve referenced from the Rhino model>)
subtraction = Subtraction(A=1, B=shorten)
dom = ConstructDomain(DomainStart=shorten, DomainEnd=subtraction)
sampling = Slider(20, range=2..200)
fill_curves = Slider(4, range=2..50)
number_slider_2 = Slider(-16.1, range=-30..0)
number_slider_3 = Slider(-0.161, range=-2..0.001)
number_slider_4 = Slider(-1, range=-100..0)
number_slider_5 = Slider(-0.161, range=-2..0.001)
number_slider_6 = Slider(-1, range=-100..0)
srf_2 = Surface(<surface referenced from the Rhino model>)
Z = UnitZ(Factor=1)
Z_2 = UnitZ(Factor=-1)
Z_3 = UnitZ(Factor=1)
Z_4 = UnitZ(Factor=-1)
int = Integer(fill_curves)
int_2 = Integer(fill_curves)
merge = Merge(Data1="0", Data2=int)
merge_2 = Merge(Data1="0", Data2=int_2)
toggle = BooleanToggle(False)
toggle_2 = BooleanToggle(False)
number_slider_7 = Slider(69, range=0..100)
dom_2 = ConstructDomain(DomainStart=0, DomainEnd=Slider(0.6, range=0..1))
dom_3 = ConstructDomain(DomainStart=0, DomainEnd=Slider(0.6, range=0..1))
toggle_3 = BooleanToggle(False)
toggle_4 = BooleanToggle(False)

# ---- group: left
crv_6 = Curve(Tree({0;0}: [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], {0;1}: [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], {0;2}: [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], {0;3}: [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], {0;4}: [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], {0;5}: [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]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))

# ---- group: right
# pattern
crv_7 = Curve(Tree({0;0}: [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], {0;1}: [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], {0;2}: [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], {0;3}: [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], {0;4}: [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], {0;5}: [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]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))

# ----
parts_to_invert_all_staples = Panel("""{0;3;0;0}
{1;0;0;0}
{1;0;0;1}
{1;1;0;0}
{1;2;1;0}
{1;2;1;1}
{1;3;1;0}
{1;3;1;1}
{1;3;2;1}""")
number_slider_8 = Slider(5, range=0..10)
panel = Panel("""0
-1""")

# ---- group: mid axis
crv_8 = Curve(reparameterize(<curve referenced from the Rhino model>))

# ----
number_slider_9 = Slider(2, range=0..10)
Z_5 = UnitZ(Factor=1)
Z_6 = UnitZ(Factor=1)
rev = Reverse(Vector=Z_6)
panel_2 = Panel("""c.r
c.m
c.f""")
Y = UnitY(Factor="100")

# ---- group: from file
brep = Brep([<brep referenced from the Rhino model> x3])
brep_2 = Brep([<brep referenced from the Rhino model> x3])

# ----
debrep = DeconstructBrep(Brep=brep_2)  # -> Faces, Edges, Vertices

# ---- group: previous unroll from file
crv_9 = Curve([<curve referenced from the Rhino model> x1908])

# ----
X = UnitX(Factor="1500")
move = Move(Geometry=crv_9, Motion=X)  # -> Geometry, Transform
previewlw = CustomPreviewLineweights(
    Geometry=move.Geometry,
    Shader={ambient=RGB(0, 0, 0), diffuse=RGB(255, 105, 180), emission=RGB(76, 32, 54), shine=0.5, specular=RGB(255, 255, 255), transparency=0},
    Absolute=False)

pt = Point(Point(0.5, 0.5, 0))
item = ListItem(List=debrep.Faces, Index=0, Wrap=True)  # -> flatten(Item)
evalsrf = EvaluateSurface(Surface=reparameterize(item), Point=pt)  # -> Point, Normal, Frame
pdecon = Deconstruct(Point=evalsrf.Point)  # -> XComponent, YComponent, ZComponent
# unrolled connector tag
sort = SortList(Keys=pdecon.XComponent, ValuesA=brep_2)  # -> Keys, ValuesA

# ----
# unrolled connector tag
join = BrepJoin(Breps=brep)  # -> Breps, Closed
area_2 = Area(Geometry=join.Breps)  # -> Area, flatten(Centroid)
tag = TextTag3D(Location=area_2.Centroid, Text=panel_2, Size=Slider(2, range=0..100), Justification=5)

edges = BrepEdges(Brep=brep)  # -> Naked, Interior, NonManifold
join_2 = JoinCurves(Curves=edges.Naked, Preserve=False)
disc = Discontinuity(Curve=edges.Naked, Level=1)  # -> Points, Parameters
swatch = ColourSwatch(SwatchColor=RGB(0, 0, 0))
explode = Explode(Curve=join_2, Recursive=True)  # -> Segments, Vertices
crv_10 = Curve(edges.Interior)
panel_3 = Panel("""2
6""")
panel_4 = Panel("""2
6""")
item_2 = ListItem(List=explode.Vertices, Index=0, Wrap=True)  # -> Item, Item1
item_3 = ListItem(List=explode.Vertices, Index="4", Wrap=True)  # -> Item, Item1
item_4 = ListItem(List=crv_10, Index=0, Wrap=True)
ln = Line(StartPoint=item_2.Item, EndPoint=item_3.Item1)
ln_2 = Line(StartPoint=item_2.Item1, EndPoint=item_3.Item)
item_5 = ListItem(List=explode.Segments, Index=panel_3, Wrap=True)
merge_3 = Merge(Data1=ln, Data2=ln_2, Data3=item_5)  # -> simplify(Result)
panel_5 = Panel("0.3")
cull_i = CullIndex(List=explode.Segments, Indices=panel_3, Wrap=True)
join_3 = JoinCurves(Curves=cull_i, Preserve=False)
end = EndPoints(Curve=join_3)  # -> Start, End

srf_3 = Surface(<surface referenced from the Rhino model>)
srfpt = SurfacePoints(Surface=srf_3)  # -> Points, Weights, Greville, UCount, VCount
area_3 = Area(Geometry=srf_3)  # -> Area, Centroid
dist = Distance(PointA=srfpt.Points, PointB=area_3.Centroid)
cp = ControlPoints(Curve=crv_3)  # -> Points, Weights, Knots
# configurator
cp_2 = ControlPoints(Curve=crv_4)  # -> Points, Weights, Knots
one_over_x = OneOverX(Value=dist)
vec2pt = Vector2Pt(PointA=cp_2.Points, PointB=area_3.Centroid, Unitize=False)  # -> Vector, Length
vec2pt_2 = Vector2Pt(PointA=cp.Points, PointB=area_3.Centroid, Unitize=False)  # -> Vector, Length
pow = Power(A=one_over_x, B=Slider(5, range=1..5))
bnd = Bounds(Numbers=pow)
one_over_x_2 = OneOverX(Value=vec2pt_2.Length)
one_over_x_3 = OneOverX(Value=vec2pt.Length)
pow_2 = Power(A=vec2pt.Length, B=Slider(1, range=1..5))
remap = RemapNumbers(Value=pow, Source=bnd, Target=Domain(0, 1))  # -> Mapped, Clipped
pow_3 = Power(A=vec2pt_2.Length, B=Slider(1, range=1..5))
bnd_2 = Bounds(Numbers=flatten(pow_3))
bnd_3 = Bounds(Numbers=flatten(pow_2))
graph = GraphMapper(remap.Mapped, x0=0, x1=1, y0=0, y1=1, container_name="Sine", Equation_px=[0, 0.498550415], Equation_py=[0, 0.9828977585])
remap_2 = RemapNumbers(Value=pow_3, Source=bnd_2, Target=Domain(0, 1))  # -> Mapped, Clipped
remap_3 = RemapNumbers(Value=pow_2, Source=bnd_3, Target=Domain(0, 1))  # -> Mapped, Clipped
graph_2 = GraphMapper(remap_2.Mapped, x0=0, x1=1, y0=0, y1=1, container_name="Sine", Equation_px=[0, 0.2862318754], Equation_py=[0, 1])
rev_2 = Reverse(Vector=vec2pt_2.Vector)
multiplication = Multiplication(A=remap.Mapped, B=Slider(90.781, range=-100..1000))
Z_7 = UnitZ(Factor=multiplication)
rev_3 = Reverse(Vector=vec2pt.Vector)
multiplication_2 = Multiplication(A=graph_2, B=Slider(61.627, range=-10..100))
rev_4 = Reverse(Vector=Z_7)
amp = Amplitude(Vector=rev_2, Amplitude=multiplication_2)
move_2 = Move(Geometry=srfpt.Points, Motion=rev_4)  # -> Geometry, Transform
move_3 = Move(Geometry=cp.Points, Motion=amp)  # -> Geometry, Transform
srfgrid = SurfaceFromPoints(Points=move_2.Geometry, UCount=srfpt.UCount, Interpolate=False)
nurbs = NurbsCurve(Vertices=move_3.Geometry, Degree=3, Periodic=False)  # -> flatten(Curve), Length, Domain
crv_11 = Curve(reparameterize(nurbs.Curve))

graph_3 = GraphMapper(remap_3.Mapped, x0=0, x1=1, y0=0, y1=1, container_name="Sine", Equation_px=[0, 0.2862318754], Equation_py=[0, 1])

multiplication_3 = Multiplication(A=graph_3, B=Slider(34.688, range=-10..100))
amp_2 = Amplitude(Vector=rev_3, Amplitude=multiplication_3)
# RELIEF
# shape as structural device
# tutor: Alessio Erioli
# Thessaloniki . 10-16.05.2016
move_4 = Move(Geometry=cp_2.Points, Motion=amp_2)  # -> Geometry, Transform
nurbs_2 = NurbsCurve(Vertices=move_4.Geometry, Degree=3, Periodic=False)  # -> flatten(Curve), Length, Domain
crv_12 = Curve(reparameterize(nurbs_2.Curve))

filter = StreamFilter(Gate=configuration, Stream0=crv_12, Stream1=crv_4)
filter_2 = StreamFilter(Gate=configuration, Stream0=crv_11, Stream1=crv_3)
filter_3 = StreamFilter(Gate=configuration, Stream0=srfgrid, Stream1=srf)
subcrv = SubCurve(BaseCurve=filter, Domain=dom)
subcrv_2 = SubCurve(BaseCurve=filter_2, Domain=dom)
divide = DivideCurve(Curve=subcrv_2, Count=sampling, Kinks=False)  # -> Points, Tangents, Parameters
flip_2 = FlipMatrix(Data=divide.Points)
pline = PolyLine(Vertices=flip_2, Closed=False)
# ceiling definition
# 
# final definition for ceiling generation. Thin corrugated cardboard, laser cut fabrication
# 
# code by Alessio Erioli and the workshop students
# 
# v  1.0
# 
# © Co-de-iT 2016 _ Creative Commons Attribution-NonCommercial-ShareAlike 4.0 International License
divide_2 = DivideCurve(Curve=subcrv, Count=sampling, Kinks=False)  # -> Points, Tangents, Parameters
explode_2 = Explode(Curve=pline, Recursive=True)  # -> Segments, Vertices
flip_3 = FlipMatrix(Data=divide_2.Points)

number_slider_10 = Slider(0.21, range=0..1)  # disabled
crv_13 = Curve(reparameterize(<curve referenced from the Rhino model>))  # disabled
eval_3 = EvaluateCurve(Curve=crv_13, Parameter=number_slider_10)  # -> Point, Tangent, Angle; disabled
number_slider_11 = Slider(10, range=0..30)  # disabled
divide_3 = DivideCurve(Curve=crv_13, Count=number_slider_11, Kinks=False)  # -> Points, Tangents, Parameters; disabled
vec2pt_3 = Vector2Pt(PointA=flip_2, PointB=eval_3.Point, Unitize=False)  # -> Vector, Length; disabled
vdis = VectorDisplay(Anchor=divide_3.Points, Vector=vec2pt_3.Vector)  # disabled

divide_4 = DivideCurve(Curve=explode_2.Segments, Count=fill_curves, Kinks=False)  # -> Points, Tangents, Parameters
pline_2 = PolyLine(Vertices=flip_3, Closed=False)
pshift = ShiftPaths(Data=divide_4.Points, Offset=-1)
explode_3 = Explode(Curve=pline_2, Recursive=True)  # -> Segments, Vertices
flip_4 = FlipMatrix(Data=pshift)
lng = ListLength(List=flip_4)  # -> expr("x-1", Length)
range = Range(Domain=Domain(0, 1), Steps=lng)
graph_4 = GraphMapper(range, x0=0, x1=1, y0=0, y1=1, container_name="Sine", Equation_px=[0, 0.5223546624], Equation_py=[0.1705827117, 1])
divide_5 = DivideCurve(Curve=explode_3.Segments, Count=fill_curves, Kinks=False)  # -> Points, Tangents, Parameters
pshift_2 = ShiftPaths(Data=divide_5.Points, Offset=-1)
multiplication_4 = Multiplication(A=graph_4, B=number_slider_2)
flip_5 = FlipMatrix(Data=pshift_2)
lng_2 = ListLength(List=flip_5)  # -> expr("x-1", Length)
range_2 = Range(Domain=Domain(0, 1), Steps=lng_2)
graph_5 = GraphMapper(range_2, x0=0, x1=1, y0=0, y1=1, container_name="Sine", Equation_px=[0, 0.5223546624], Equation_py=[0.1705827117, 1])
Z_8 = UnitZ(Factor=multiplication_4)
move_5 = Move(Geometry=flip_4, Motion=Z_8)  # -> Geometry, Transform
multiplication_5 = Multiplication(A=graph_5, B=number_slider_2)
Z_9 = UnitZ(Factor=multiplication_5)
intcrv = Interpolate(Vertices=flip_4, Degree=3, Periodic=False, KnotStyle=1)  # -> flatten(Curve), Length, Domain
intcrv_2 = Interpolate(Vertices=move_5.Geometry, Degree=3, Periodic=False, KnotStyle=1)  # -> flatten(Curve), Length, Domain
move_6 = Move(Geometry=flip_5, Motion=Z_9)  # -> Geometry, Transform
intcrv_3 = Interpolate(Vertices=flip_5, Degree=3, Periodic=False, KnotStyle=1)  # -> flatten(Curve), Length, Domain
intcrv_4 = Interpolate(Vertices=move_6.Geometry, Degree=3, Periodic=False, KnotStyle=1)  # -> Curve, Length, Domain
divide_6 = DivideCurve(Curve=intcrv_3.Curve, Count=10, Kinks=False)  # -> Points, Tangents, Parameters
project = Project(Curve=intcrv_4.Curve, Brep=filter_3, Direction=Z)
line = LineSDL(Start=divide_6.Points, Direction=Z_2, Length="100")
divide_7 = DivideCurve(Curve=intcrv.Curve, Count=10, Kinks=False)  # -> Points, Tangents, Parameters
scx = SurfaceCurve(Surface=filter_3, Curve=line)  # -> Curves, Points, UVPoints, Normals, Parameters, Tangents
project_2 = Project(Curve=intcrv_2.Curve, Brep=srf_2, Direction=Z_3)
line_2 = LineSDL(Start=divide_7.Points, Direction=Z_4, Length="100")
pshift_3 = ShiftPaths(Data=scx.Points, Offset=-1)
scx_2 = SurfaceCurve(Surface=filter_3, Curve=line_2)  # -> Curves, Points, UVPoints, Normals, Parameters, Tangents
pshift_4 = ShiftPaths(Data=scx_2.Points, Offset=-1)
nurbs_3 = NurbsCurve(Vertices=pshift_4, Degree=3, Periodic=False)  # -> Curve, Length, Domain
divide_8 = DivideCurve(Curve=nurbs_3.Curve, Count=10, Kinks=False)  # -> Points, Tangents, Parameters
nurbs_4 = NurbsCurve(Vertices=pshift_3, Degree=3, Periodic=False)  # -> Curve, Length, Domain
flip_6 = FlipMatrix(Data=divide_8.Points)
divide_9 = DivideCurve(Curve=nurbs_4.Curve, Count=10, Kinks=False)  # -> Points, Tangents, Parameters
replace = ReplaceItems(List=intcrv.Curve, Item=subcrv_2, Indices=merge, Wrap=False)  # -> flatten(List)
replace_2 = ReplaceItems(List=intcrv_3.Curve, Item=subcrv, Indices=merge_2, Wrap=False)  # -> flatten(List)
flip_7 = FlipMatrix(Data=divide_9.Points)
shift = ShiftList(List=flip_7, Shift="1", Wrap=toggle)  # -> graft(List)
shift_2 = ShiftList(List=flip_6, Shift="1", Wrap=toggle_2)  # -> graft(List)
shift_3 = ShiftList(List=flip_7, Shift="-1", Wrap=toggle)  # -> graft(List)
shift_4 = ShiftList(List=flip_6, Shift="-1", Wrap=toggle_2)  # -> graft(List)

# ---- group: top curves - right
crv_14 = Curve(reparameterize(intcrv_3.Curve))

# ---- group: top curves - left
crv_15 = Curve(reparameterize(intcrv.Curve))

# ----
avr = Average(Input=[shift, shift_3])
avr_2 = Average(Input=[shift_2, shift_4])
vec2pt_4 = Vector2Pt(PointA=shift_3, PointB=shift, Unitize=False)  # -> Vector, Length
crv_cp = CurveClosestPoint(Point=avr, Curve=crv_5)  # -> Point, Parameter, Distance
crv_cp_2 = CurveClosestPoint(Point=avr_2, Curve=crv_5)  # -> Point, Parameter, Distance
vec2pt_5 = Vector2Pt(PointA=shift_4, PointB=shift_2, Unitize=False)  # -> Vector, Length
bar_graph = BarGraph(crv_cp.Distance, BarColor=RGB(255, 0, 90))
bar_graph_2 = BarGraph(crv_cp_2.Distance, BarColor=RGB(255, 0, 90))
min = Minimum(A=crv_cp.Distance, B=number_slider_7)
min_2 = Minimum(A=crv_cp_2.Distance, B=number_slider_7)
bnd_4 = Bounds(Numbers=flatten(min))
bnd_5 = Bounds(Numbers=flatten(min_2))
remap_4 = RemapNumbers(Value=min_2, Source=bnd_5, Target=dom_3)  # -> Mapped, Clipped
multiplication_6 = Multiplication(A=vec2pt_5.Vector, B=remap_4.Clipped)
remap_5 = RemapNumbers(Value=min, Source=bnd_4, Target=dom_2)  # -> Mapped, Clipped
multiplication_7 = Multiplication(A=vec2pt_4.Vector, B=remap_5.Clipped)
multiplication_8 = Multiplication(A=multiplication_6, B=-1)
move_7 = Move(Geometry=avr, Motion=multiplication_7)  # -> Geometry, Transform
vdisex = VectorDisplayEx(Point=avr, Vector=multiplication_7, Colour=RGB(0, 0, 0), Width=2)
move_8 = Move(Geometry=avr_2, Motion=multiplication_8)  # -> Geometry, Transform
shift_5 = ShiftList(List=crv_15, Shift="1", Wrap=toggle_4)  # -> simplify(graft(List))
shift_6 = ShiftList(List=crv_14, Shift="1", Wrap=toggle_3)  # -> simplify(graft(List))
shift_7 = ShiftList(List=crv_14, Shift="-1", Wrap=toggle_3)  # -> simplify(graft(List))
shift_8 = ShiftList(List=crv_15, Shift="-1", Wrap=toggle_4)  # -> simplify(graft(List))
vdisex_2 = VectorDisplayEx(Point=avr_2, Vector=multiplication_8, Colour=RGB(0, 0, 0), Width=2)
pshift_5 = ShiftPaths(Data=move_7.Geometry, Offset=-1)  # -> simplify(Data)
pshift_6 = ShiftPaths(Data=move_8.Geometry, Offset=-1)  # -> simplify(Data)
flip_8 = FlipMatrix(Data=pshift_5)
flip_9 = FlipMatrix(Data=pshift_6)

# ---- group: bottom curves
intcrv_5 = Interpolate(Vertices=flip_9, Degree=3, Periodic=False, KnotStyle=1)  # -> simplify(graft(Curve)), Length, Domain

intcrv_6 = Interpolate(Vertices=flip_8, Degree=3, Periodic=False, KnotStyle=1)  # -> simplify(graft(Curve)), Length, Domain

# ----
merge_4 = Merge(Data1=shift_8, Data2=shift_5)
merge_5 = Merge(Data1=shift_7, Data2=shift_6)
merge_6 = Merge(Data1=intcrv_5.Curve, Data2=shift_8)
merge_7 = Merge(Data1=intcrv_6.Curve, Data2=shift_7)
# left
# top surf
loft = Loft(Curves=merge_4, Options={Adjust=False, Closed=False, LoftEnds=0, LoftSimp=0, LoftType=0, Rebuild=10, Refit=0.01})
# right surf
loft_2 = Loft(Curves=merge_6, Options={Adjust=False, Closed=False, LoftEnds=0, LoftSimp=0, LoftType=0, Rebuild=10, Refit=0.01})
# left surf
loft_3 = Loft(
    Curves=[shift_5, intcrv_5.Curve],
    Options={Adjust=False, Closed=False, LoftEnds=0, LoftSimp=0, LoftType=0, Rebuild=10, Refit=0.01})
# left surf
loft_4 = Loft(
    Curves=[shift_6, intcrv_6.Curve],
    Options={Adjust=False, Closed=False, LoftEnds=0, LoftSimp=0, LoftType=0, Rebuild=10, Refit=0.01})
# right surf
loft_5 = Loft(Curves=merge_7, Options={Adjust=False, Closed=False, LoftEnds=0, LoftSimp=0, LoftType=0, Rebuild=10, Refit=0.01})
# right
# top surf
loft_6 = Loft(Curves=merge_5, Options={Adjust=False, Closed=False, LoftEnds=0, LoftSimp=0, LoftType=0, Rebuild=10, Refit=0.01})
merge_8 = Merge(Data1=loft, Data2=loft_3, Data3=loft_2)

merge_9 = Merge(Data1=loft_6, Data2=loft_4, Data3=loft_5)
entwine = Entwine(Branch0X=merge_9, Branch1X=merge_8, FlattenInputs=False)
srf_4 = Surface(entwine)

edges_2 = BrepEdges(Brep=[merge_9, merge_8])  # -> Naked, Interior, NonManifold

previewmat = CustomPreviewMaterials(Geometry=merge_9, DiffuseColor=RGB(255, 255, 255))
previewmat_2 = CustomPreviewMaterials(Geometry=merge_8, DiffuseColor=RGB(255, 255, 255))
previewlw_2 = CustomPreviewLineweights(Geometry=edges_2.Naked, Shader=ColourSwatch(SwatchColor=RGB(0, 0, 0)), Absolute=False)

viewer = ParamViewer(srf_4)

# ----
# tag beams
# on model
srf_5 = Surface(entwine)
lng_3 = ListLength(List=srf_5)
viewer_2 = ParamViewer(srf_5)
series = Series(Start=0, Step=1, Count=lng_3)
pt_2 = Point(Point(0.5, 0.5, 0))
int_3 = Integer(series)
evalsrf_2 = EvaluateSurface(Surface=reparameterize(srf_5), Point=pt_2)  # -> Point, Normal, Frame
concat = Concatenate(FragmentA=graft(viewer_2), FragmentB=int_3)
tag_2 = TextTag3D(
    Location=evalsrf_2.Point,
    Text=concat,
    Size=Slider(5.435, range=0..100),
    Colour=ColourSwatch(SwatchColor=RGB(255, 82, 82)),
    Justification=5)

crv_16 = Curve(crv_15)
crv_17 = Curve(crv_14)
cull_i_2 = CullIndex(List=crv_17, Indices=panel, Wrap=True)
cull_i_3 = CullIndex(List=crv_16, Indices=panel, Wrap=True)
merge_10 = Merge(Data1=cull_i_2, Data2=cull_i_3)  # -> graft(Result)

# ----
# reorganize paths
panel_6 = Panel("{0;0;<3}")
split = SplitTree(Data=merge_10, Masks=flatten(panel_6))  # -> Positive, Negative
viewer_3 = ParamViewer(split.Negative)
branch = TreeBranch(Tree=split.Negative, Path=viewer_3, MaintainPaths=False)
entwine_2 = Entwine(Branch0X=simplify(split.Positive), Branch1X=simplify(branch), FlattenInputs=False)

# ----
# top surf
# left surf
srf_6 = Surface(loft)
# right
# top surf
# left surf
srf_7 = Surface(loft_6)
# right surf
srf_8 = Surface(loft_4)
# left
srf_9 = Surface(loft_5)
# right surf
srf_10 = Surface(loft_3)
srf_11 = Surface(loft_2)
shift_9 = ShiftList(List=flatten(srf_10), Shift="-1", Wrap=False)
shift_10 = ShiftList(List=flatten(srf_11), Shift="1", Wrap=False)
shift_11 = ShiftList(List=flatten(srf_8), Shift="-1", Wrap=False)
shift_12 = ShiftList(List=flatten(srf_9), Shift="1", Wrap=False)
merge_11 = Merge(Data1=graft(shift_9), Data2=graft(shift_10))
merge_12 = Merge(Data1=graft(shift_11), Data2=graft(shift_12))
entwine_3 = Entwine(Branch0X=simplify(merge_12), Branch1X=simplify(merge_11), FlattenInputs=False)
# all others
item_6 = ListItem(List=entwine_3, Index=0, Wrap=True)  # -> Item, Item1
crv_18 = Curve(entwine_2)

# ---- group: just the bottom surfaces
srf_12 = Surface(srf_4)
cull_i_4 = CullIndex(List=srf_12, Indices="0", Wrap=True)  # -> flatten(List)

# ----
Y_2 = UnitY(Factor=Slider(579.459, range=0..1500))

pt_3 = Point(Point(0.5, 0.5, 0))
X_2 = UnitX(Factor="-1500")

resolution = Slider(190, range=2..200)
divide_10 = DivideCurve(Curve=intcrv_5.Curve, Count=resolution, Kinks=False)  # -> Points, Tangents, Parameters
Z_10 = UnitZ(Factor=1)
divide_11 = DivideCurve(Curve=intcrv_6.Curve, Count=resolution, Kinks=False)  # -> Points, Tangents, Parameters
line_3 = LineSDL(Start=divide_10.Points, Direction=Z_10, Length=1)
srf_13 = Surface([merge_9, merge_8])
join_4 = BrepJoin(Breps=flatten(loft))  # -> Breps, Closed
area_4 = Area(Geometry=flatten(srf_13))  # -> Area, Centroid
line_4 = LineSDL(Start=divide_11.Points, Direction=Z_10, Length=1)
join_5 = BrepJoin(Breps=flatten(loft_6))  # -> Breps, Closed
blx = BrepLine(Brep=join_4.Breps, Line=line_3, LimitToFirst=False)  # -> Curves, Points
blx_2 = BrepLine(Brep=join_5.Breps, Line=line_4, LimitToFirst=False)  # -> Curves, Points
sheet_area_mq = Panel("0.7")
ma = MassAddition(Input=area_4.Area)  # -> Result, PartialResults
ln_3 = Line(StartPoint=graft(divide_10.Points), EndPoint=blx.Points)
dist_2 = Distance(PointA=graft(divide_10.Points), PointB=blx.Points)  # -> flatten(Distance)
# counts
dist_3 = Distance(PointA=graft(divide_11.Points), PointB=blx_2.Points)  # -> flatten(Distance)
ln_4 = Line(StartPoint=graft(divide_11.Points), EndPoint=blx_2.Points)
extremums = MinMax(Number=[dist_3, dist_2])  # -> Minimum, Maximum
min_max_depth_cm = Panel([extremums.Minimum, extremums.Maximum])

multiplication_9 = Multiplication(A=ma.Result, B=0.0001)

multiplication_10 = Multiplication(A=multiplication_9, B=2)
division = Division(A=multiplication_10, B=sheet_area_mq)
# deviation
int_4 = Integer(division)
total_area_sqm = Panel(multiplication_9)
n_of_sheets = Panel(int_4)

area_5 = Area(Geometry=flatten(merge_8))  # -> Area, Centroid
area_6 = Area(Geometry=flatten(merge_9))  # -> Area, Centroid
lng_4 = ListLength(List=area_5.Centroid)
lng_5 = ListLength(List=area_6.Centroid)
series_2 = Series(Start=0, Step=1, Count=lng_4)
series_3 = Series(Start=0, Step=1, Count=lng_5)
tag_3 = TextTag3D(Location=area_5.Centroid, Text=series_2, Size=Slider(2.399, range=0..100), Justification=7)
tag_4 = TextTag3D(Location=area_6.Centroid, Text=series_3, Size=Slider(2.399, range=0..100), Justification=7)

panel_7 = Panel("""0
1""")

# ----
# reparametrize + graft
# sub-list takes only the elements
# up to index 1
# another way of reversing lists
# or we can use a split list
# since we'll need also the
# other curves
panel_8 = Panel("2")
jig_length = Slider(4, range=0..10)
Z_11 = UnitZ(Factor=1)

# ----
# connection frames
number_slider_12 = Slider(0.475, range=0..1)
panel_9 = Panel("""0
-1""")
# beam2beam connectors
panel_10 = Panel("""0
-1""")
item_7 = ListItem(List=crv_14, Index=-1, Wrap=True)
cull_i_5 = CullIndex(List=crv_15, Indices=panel_9, Wrap=True)
cull_i_6 = CullIndex(List=crv_14, Indices=panel_10, Wrap=True)
eval_4 = EvaluateCurve(Curve=crv_14, Parameter=number_slider_12)  # -> Point, Tangent, Angle
item_8 = ListItem(List=crv_15, Index=0, Wrap=True)
item_9 = ListItem(List=eval_4.Point, Index=-1, Wrap=True)
crv_cp_3 = CurveClosestPoint(Point=item_9, Curve=item_8)  # -> Point, Parameter, Distance
shatter = Shatter(Curve=cull_i_6, Parameters=number_slider_12)
shatter_2 = Shatter(Curve=cull_i_5, Parameters=crv_cp_3.Parameter)
dispatch = Dispatch(List=shatter, DispatchPattern=[True, False])  # -> ListA, ListB
flip_10 = FlipCurve(Curve=dispatch.ListA)  # -> Curve, Flag
dispatch_2 = Dispatch(List=shatter_2, DispatchPattern=[True, False])  # -> ListA, ListB
number_slider_13 = Slider(0.5, range=0..1)
flip_11 = FlipCurve(Curve=dispatch_2.ListA)  # -> Curve, Flag
weave = Weave(Pattern=[0, 1], Stream0=dispatch.ListB, Stream1=flip_10.Curve, NullGaps=False)
len = Length(Curve=weave)
weave_2 = Weave(Pattern=[0, 1], Stream0=dispatch_2.ListB, Stream1=flip_11.Curve, NullGaps=False)
division_2 = Division(A=len, B=number_slider_13)
range_3 = Range(Domain=Domain(0, 1), Steps=Slider(5, range=2..8))
int_5 = Integer(division_2)
cull_i_7 = CullIndex(List=range_3, Indices=-1, Wrap=True)
divlength = DivideLength(Curve=weave_2, Length=number_slider_13)  # -> Points, Tangents, Parameters
divlength_2 = DivideLength(Curve=weave, Length=number_slider_13)  # -> Points, Tangents, Parameters
graph_6 = GraphMapper(
    cull_i_7,
    x0=0,
    x1=1,
    y0=0,
    y1=1,
    container_name="Bezier",
    cpx=[0, 0.2869572341, 0.6637688279, 1],
    cpy=[0, 0.4768119454, 0.9695655704, 1])
number_slider_14 = Slider(0.03, range=0..1)
pframe = PerpFrame(Curve=reparameterize(graft(weave)), Parameter=graph_6)
pframe_2 = PerpFrame(Curve=reparameterize(graft(weave_2)), Parameter=graph_6)
eval_5 = EvaluateCurve(Curve=reparameterize(graft(weave)), Parameter=graph_6)  # -> Point, Tangent, Angle
eval_6 = EvaluateCurve(Curve=reparameterize(graft(weave_2)), Parameter=graph_6)  # -> Point, Tangent, Angle
Z_12 = UnitZ(Factor=1)
subtraction_2 = Subtraction(A="1", B=number_slider_14)
item_10 = ListItem(List=crv_15, Index=0, Wrap=True)
align = AlignPlane(Plane=pframe, Direction=Z_12)  # -> Plane, Angle
align_2 = AlignPlane(Plane=pframe_2, Direction=Z_12)  # -> Plane, Angle
merge_13 = Merge(Data1=number_slider_14, Data2=subtraction_2)
pframe_3 = PerpFrame(Curve=reparameterize(graft(item_10)), Parameter=merge_13)
pframe_4 = PerpFrame(Curve=item_7, Parameter=number_slider_12)
pshift_7 = ShiftPaths(Data=align_2.Plane, Offset=-1)
pshift_8 = ShiftPaths(Data=align.Plane, Offset=-1)
align_3 = AlignPlane(Plane=pframe_4, Direction=Z_12)  # -> Plane, Angle
align_4 = AlignPlane(Plane=pframe_3, Direction=Z_12)  # -> Plane, Angle

cull_i_8 = CullIndex(List=pshift_7, Indices=0, Wrap=True)
cull_i_9 = CullIndex(List=pshift_8, Indices=0, Wrap=True)

lng_6 = ListLength(List=flatten([cull_i_9, cull_i_8, align_3.Plane, align_4.Plane]))
sec = BrepPlane(Brep=graft(merge_9), Plane=flatten(cull_i_9))  # -> Curves, Points; disabled

pln = Plane([cull_i_9, cull_i_8, align_3.Plane, align_4.Plane])
sph = Sphere(Base=pln, Radius=number_slider_8)  # -> flatten(Sphere)
bcx = BrepCurve(Brep=sph, Curve=entwine_2)  # -> Curves, Points
pshift_9 = ShiftPaths(Data=bcx.Points, Offset=-1)
crv_cp_4 = CurveClosestPoint(Point=pshift_9, Curve=entwine_2)  # -> Point, Parameter, Distance
# parameter t
sort_2 = SortList(Keys=crv_cp_4.Parameter)  # -> Keys, ValuesA
# frames
pframe_5 = PerpFrame(Curve=entwine_2, Parameter=sort_2.Keys)

# ----
# depth control
pi = Pi(Factor=1)
multiplication_11 = Multiplication(A=sort_2.Keys, B=pi)
number_slider_15 = Slider(8, range=0..10)
sin = Sine(Value=multiplication_11)
multiplication_12 = Multiplication(A=sin, B=Slider(4, range=0..10))
addition = Addition(A=number_slider_15, B=multiplication_12)
bar_graph_3 = BarGraph(addition, BarColor=RGB(255, 0, 90))

merge_14 = Merge(Data1=align_3.Plane, Data2=align_4.Plane)
sph_2 = Sphere(Base=merge_14, Radius=number_slider_8)  # -> flatten(Sphere)
bcx_2 = BrepCurve(Brep=sph_2, Curve=crv_8)  # -> Curves, Points
cir_2 = Circle(Plane=pframe_5, Radius=addition)

crv_cp_5 = CurveClosestPoint(Point=flatten(bcx_2.Points), Curve=crv_8)  # -> Point, Parameter, Distance
sort_3 = SortList(Keys=crv_cp_5.Parameter)  # -> Keys, ValuesA
dispatch_3 = Dispatch(List=sort_3.Keys, DispatchPattern=[True, False])  # -> ListA, ListB
merge_15 = Merge(Data1=graft(dispatch_3.ListA), Data2=graft(dispatch_3.ListB))
avr_3 = Average(Input=merge_15)  # -> flatten(ArithmeticMean)
pframe_6 = PerpFrame(Curve=crv_8, Parameter=avr_3)

item_11 = ListItem(List=flatten(srf_8), Index="-1", Wrap=True)
item_12 = ListItem(List=flatten(srf_11), Index=0, Wrap=True)
# center line
pframe_7 = PerpFrame(Curve=crv_8, Parameter=merge_15)
merge_16 = Merge(Data1=item_11, Data2=item_12)
cir_3 = Circle(Plane=pframe_7, Radius=number_slider_15)
bcx_3 = BrepCurve(Brep=merge_16, Curve=graft(cir_3))  # -> Curves, Points
pt_4 = Point(graft(pframe_7))
pshift_10 = ShiftPaths(Data=bcx_3.Points, Offset=-1)
merge_17 = Merge(Data1=pt_4, Data2=pshift_10)
pline_3 = PolyLine(Vertices=merge_17, Closed=True)
pshift_11 = ShiftPaths(Data=pline_3, Offset=-1)

bcx_4 = BrepCurve(Brep=item_6.Item, Curve=cir_2)  # -> Curves, Points
bcx_5 = BrepCurve(Brep=item_6.Item1, Curve=cir_2)  # -> Curves, Points
pt_5 = Point(graft(pframe_5))
merge_18 = Merge(Data1=bcx_4.Points, Data2=bcx_5.Points)
dispatch_4 = Dispatch(List=sort_2.Keys, DispatchPattern=[True, False])  # -> ListA, ListB
merge_19 = Merge(Data1=pt_5, Data2=merge_18)
merge_20 = Merge(Data1=graft(dispatch_4.ListA), Data2=graft(dispatch_4.ListB))
pline_4 = PolyLine(Vertices=merge_19, Closed=True)
avr_4 = Average(Input=merge_20)
pshift_12 = ShiftPaths(Data=pline_4, Offset=-1)
pshift_13 = ShiftPaths(Data=avr_4, Offset=-1)
dispatch_5 = Dispatch(List=pshift_12, DispatchPattern=[True, False])  # -> ListA, ListB
pframe_8 = PerpFrame(Curve=crv_18, Parameter=pshift_13)
merge_21 = Merge(Data1=graft(dispatch_5.ListA), Data2=graft(dispatch_5.ListB))

# ---- group: all other circles
cir_4 = Circle(Plane=pframe_8, Radius=number_slider_9)

# ---- group: surfaces on model
loft_7 = Loft(Curves=pshift_11, Options={Adjust=False, Closed=False, LoftEnds=0, LoftSimp=0, LoftType=0, Rebuild=10, Refit=0.01})

# ---- group: center circles
cir_5 = Circle(Plane=pframe_6, Radius=number_slider_9)

# ---- group: surfaces on model
loft_8 = Loft(Curves=merge_21, Options={Adjust=False, Closed=False, LoftEnds=0, LoftSimp=0, LoftType=0, Rebuild=10, Refit=0.01})

# ----
# hanging lines
number_slider_16 = Slider(410, range=0..500)
Z_13 = UnitZ(Factor=number_slider_16)
xy = XYPlane(Origin=Z_13)
project_3 = Project(Geometry=pframe_8, Plane=xy)  # -> Geometry, Transform
xy_2 = XYPlane(Origin=project_3.Geometry)
prot = RotatePlane(Plane=xy_2, Angle="Pi*.5")
ln_5 = Line(StartPoint=pframe_8, EndPoint=project_3.Geometry)
len_2 = Length(Curve=ln_5)
expression = Expression(x=len_2, Expression="round(x,1)")
tag_5 = TextTag3D(Location=prot, Text=expression, Size=Slider(3, range=0..10), Justification=7)

# ---- group: points for unroll on connectors
bcx_6 = BrepCurve(Brep=flatten(loft_7), Curve=graft(cir_5))  # -> Curves, Points
pshift_14 = ShiftPaths(Data=bcx_6.Points, Offset=-1)

bcx_7 = BrepCurve(Brep=flatten(loft_8), Curve=graft(cir_4))  # -> Curves, Points
pshift_15 = ShiftPaths(Data=bcx_7.Points, Offset=-1)

# ----
# connector tag & callout
callout_extent = Slider(10, range=0..100)
vec2pt_6 = Vector2Pt(PointA=graft(pframe_8), PointB=pshift_15, Unitize=False)  # -> Vector, Length
avr_5 = Average(Input=vec2pt_6.Vector)
rev_5 = Reverse(Vector=avr_5)
amp_3 = Amplitude(Vector=rev_5, Amplitude=callout_extent)
move_9 = Move(Geometry=graft(pframe_8), Motion=amp_3)  # -> Geometry, Transform
viewer_4 = ParamViewer(move_9.Geometry)
xy_3 = XYPlane(Origin=move_9.Geometry)
txt = Text(graft(viewer_4))
swatch_2 = ColourSwatch(SwatchColor=RGB(138, 138, 138))
multiplication_13 = Multiplication(A=callout_extent, B="0.9")
match = MatchTree(Tree=txt, Guide=move_9.Geometry)
line_5 = LineSDL(Start=graft(pframe_8), Direction=rev_5, Length=multiplication_13)
tag_6 = TextTag3D(Location=xy_3, Text=match, Size=Slider(2, range=0..50), Colour=swatch_2, Justification=7)
previewlw_3 = CustomPreviewLineweights(Geometry=line_5, Shader=swatch_2, Absolute=False)

# ----
# connector tag & callout
callout_extent_2 = Slider(20, range=0..100)
amp_4 = Amplitude(Vector=Z_5, Amplitude=callout_extent_2)
move_10 = Move(Geometry=graft(pframe_6), Motion=amp_4)  # -> Geometry, Transform
xy_4 = XYPlane(Origin=move_10.Geometry)  # -> flatten(Plane)
swatch_3 = ColourSwatch(SwatchColor=RGB(255, 0, 234))
multiplication_14 = Multiplication(A=callout_extent_2, B="0.9")
line_6 = LineSDL(Start=pframe_6, Direction=Z_5, Length=multiplication_14)
tag_7 = TextTag3D(Location=xy_4, Text=panel_2, Size=Slider(2, range=0..50), Colour=swatch_2, Justification=7)
previewlw_4 = CustomPreviewLineweights(Geometry=line_6, Shader=swatch_2, Absolute=False)

brep_3 = Brep([loft_7, loft_8])
lng_7 = ListLength(List=flatten(loft_7))
lng_8 = ListLength(List=flatten(loft_8))
series_4 = Series(Start=0, Step=Slider(54.505, range=0..100), Count=lng_7)
unroller = Unroller(Brep=loft_7, Points=pshift_14)  # -> Brep, Curves, Points
series_5 = Series(Start=0, Step=Slider(15.662, range=0..100), Count=lng_8)
unroller_2 = Unroller(Brep=loft_8, Points=pshift_15)  # -> Brep, Curves, Points
X_3 = UnitX(Factor=graft(series_4))
X_4 = UnitX(Factor=graft(series_5))
addition_2 = Addition(A=X_3, B=Y)

move_11 = Move(Geometry=unroller.Brep, Motion=addition_2)  # -> Geometry, Transform
move_12 = Move(Geometry=unroller_2.Brep, Motion=X_4)  # -> Geometry, Transform

# ---- group: points
move_13 = Move(Geometry=unroller.Points, Motion=addition_2)  # -> Geometry, Transform

move_14 = Move(Geometry=unroller_2.Points, Motion=X_4)  # -> Geometry, Transform

# ----
area_7 = Area(Geometry=[move_11.Geometry, move_12.Geometry])  # -> Area, Centroid
ma_2 = MassAddition(Input=flatten(area_7.Area))  # -> Result, PartialResults
multiplication_15 = Multiplication(A="70", B="100")
subtraction_3 = Subtraction(A=multiplication_15, B=ma_2.Result)
panel_11 = Panel(subtraction_3)

# ---- group: all circles
merge_22 = Merge(Data1=cir_5, Data2=cir_4)  # -> flatten(Result)

# ----
dpath = DeconstructPath(Branch=viewer_4)
item_13 = ListItem(List=dpath, Index=0, Wrap=True)  # -> Item, Item1, Item2
expression_2 = Expression(x=item_13.Item, y=item_13.Item1, z=item_13.Item2, Expression="Format(\"{0}.{1}_{2}\", x, y,z)")  # -> flatten(R)
area_8 = Area(Geometry=sort.ValuesA)  # -> Area, flatten(Centroid)
tag_8 = TextTag3D(Location=area_8.Centroid, Text=expression_2, Size=Slider(2, range=0..100), Justification=5)

adjust_orient_roty = AdjustOrientRotY(brep=graft(sort.ValuesA), pt=move_14.Geometry)  # -> S, pt_4
brep_4 = Brep(adjust_orient_roty.S)
pt_6 = Point(adjust_orient_roty.pt_4)
edges_3 = BrepEdges(Brep=brep_4)  # -> Naked, Interior, NonManifold
pt_7 = Point(move_13.Geometry)
join_6 = JoinCurves(Curves=edges_3.Naked, Preserve=False)
explode_4 = Explode(Curve=join_6, Recursive=True)  # -> Segments, Vertices
points = PointList(Points=explode_4.Vertices, Size=Slider(6.639, range=0..10))
item_14 = ListItem(List=explode_4.Vertices, Index=0, Wrap=True)  # -> Item, Item1
item_15 = ListItem(List=explode_4.Vertices, Index="4", Wrap=True)  # -> Item, Item1
merge_23 = Merge(Data1=panel_2, Data2=expression_2)
merge_24 = Merge(Data1=area_2.Centroid, Data2=area_8.Centroid)

cir_6 = Circle(Plane=pt_7, Radius=".5")

# ---- group: mirror circles
item_16 = ListItem(List=explode.Vertices, Index="6", Wrap=True)  # -> Item, Item1
panel_12 = Panel("1")
item_17 = ListItem(List=explode.Vertices, Index="2", Wrap=True)  # -> Item, Item1
avr_6 = Average(Input=[item_16.Item, item_16.Item1])
avr_7 = Average(Input=[item_17.Item, item_17.Item1])
item_18 = ListItem(List=cir_6, Index=panel_12, Wrap=True)
item_19 = ListItem(List=cir_6, Index=0, Wrap=True)
vec2pt_7 = Vector2Pt(PointA=item_16.Item, PointB=item_16.Item1, Unitize=False)  # -> Vector, Length
vec2pt_8 = Vector2Pt(PointA=item_17.Item, PointB=item_17.Item1, Unitize=False)  # -> Vector, Length
panel_13 = Panel("Pi")
panel_14 = Panel("Pi")
rot3d = Rotate3D(Geometry=item_18, Angle=panel_13, Center=avr_6, Axis=vec2pt_7.Vector)  # -> Geometry, Transform
rot3d_2 = Rotate3D(Geometry=item_19, Angle=panel_14, Center=avr_7, Axis=vec2pt_8.Vector)  # -> Geometry, Transform

# ----
cir_7 = Circle(Plane=pt_6, Radius=".5")

# ---- group: mirror circles
item_20 = ListItem(List=explode_4.Vertices, Index="6", Wrap=True)  # -> Item, Item1
item_21 = ListItem(List=explode_4.Vertices, Index="2", Wrap=True)  # -> Item, Item1
avr_8 = Average(Input=[item_20.Item, item_20.Item1])
avr_9 = Average(Input=[item_21.Item, item_21.Item1])
item_22 = ListItem(List=cir_7, Index=0, Wrap=True)
item_23 = ListItem(List=cir_7, Index="1", Wrap=True)
vec2pt_9 = Vector2Pt(PointA=item_20.Item, PointB=item_20.Item1, Unitize=False)  # -> Vector, Length
vec2pt_10 = Vector2Pt(PointA=item_21.Item, PointB=item_21.Item1, Unitize=False)  # -> Vector, Length
panel_15 = Panel("Pi")
panel_16 = Panel("Pi")
rot3d_3 = Rotate3D(Geometry=item_22, Angle=panel_15, Center=avr_8, Axis=vec2pt_9.Vector)  # -> Geometry, Transform
rot3d_4 = Rotate3D(Geometry=item_23, Angle=panel_16, Center=avr_9, Axis=vec2pt_10.Vector)  # -> Geometry, Transform

# ----
item_24 = ListItem(List=crv_10, Index=panel_12, Wrap=True)
ln_6 = Line(StartPoint=item_14.Item, EndPoint=item_15.Item1)
ln_7 = Line(StartPoint=item_14.Item1, EndPoint=item_15.Item)
rot3d_5 = Rotate3D(Geometry=item_24, Angle=panel_13, Center=avr_6, Axis=vec2pt_7.Vector)  # -> Geometry, Transform
rot3d_6 = Rotate3D(Geometry=ln, Angle=panel_14, Center=avr_7, Axis=vec2pt_8.Vector)  # -> Geometry, Transform
rot3d_7 = Rotate3D(Geometry=ln_6, Angle=panel_15, Center=avr_8, Axis=vec2pt_9.Vector)  # -> Geometry, Transform
rot3d_8 = Rotate3D(Geometry=ln_7, Angle=panel_16, Center=avr_9, Axis=vec2pt_10.Vector)  # -> Geometry, Transform
curvepoint = PointOnCurve(rot3d_6.Geometry, parameter=0.5)
curvepoint_2 = PointOnCurve(rot3d_5.Geometry, parameter=0.5)
item_25 = ListItem(List=explode_4.Segments, Index=panel_4, Wrap=True)
curvepoint_3 = PointOnCurve(rot3d_8.Geometry, parameter=0.5)
curvepoint_4 = PointOnCurve(rot3d_7.Geometry, parameter=0.5)
scale = Scale(Geometry=rot3d_6.Geometry, Center=curvepoint, Factor="0.9")  # -> Geometry, Transform
merge_25 = Merge(Data1=ln_6, Data2=ln_7, Data3=item_25)  # -> simplify(Result)
vec2pt_11 = Vector2Pt(PointA=curvepoint_2, PointB=avr_6, Unitize=False)  # -> Vector, Length
vec2pt_12 = Vector2Pt(PointA=curvepoint, PointB=avr_7, Unitize=False)  # -> Vector, Length
amp_5 = Amplitude(Vector=vec2pt_11.Vector, Amplitude="-1")
amp_6 = Amplitude(Vector=vec2pt_12.Vector, Amplitude="-1")
scale_2 = Scale(Geometry=rot3d_5.Geometry, Center=curvepoint_2, Factor="0.9")  # -> Geometry, Transform
scale_3 = Scale(Geometry=rot3d_8.Geometry, Center=curvepoint_3, Factor="0.9")  # -> Geometry, Transform
vec2pt_13 = Vector2Pt(PointA=curvepoint_4, PointB=avr_8, Unitize=False)  # -> Vector, Length
vec2pt_14 = Vector2Pt(PointA=curvepoint_3, PointB=avr_9, Unitize=False)  # -> Vector, Length
move_15 = Move(Geometry=scale.Geometry, Motion=amp_6)  # -> Geometry, Transform
move_16 = Move(Geometry=scale_2.Geometry, Motion=amp_5)  # -> Geometry, Transform
vdisex_3 = VectorDisplayEx(Point=curvepoint_4, Vector=vec2pt_13.Vector, Colour=RGB(0, 0, 0), Width=2)
amp_7 = Amplitude(Vector=vec2pt_13.Vector, Amplitude="-1")
amp_8 = Amplitude(Vector=vec2pt_14.Vector, Amplitude="-1")
scale_4 = Scale(Geometry=rot3d_7.Geometry, Center=curvepoint_4, Factor="0.9")  # -> Geometry, Transform
merge_26 = Merge(Data1=move_16.Geometry, Data2=move_15.Geometry)
move_17 = Move(Geometry=scale_4.Geometry, Motion=amp_7)  # -> Geometry, Transform
move_18 = Move(Geometry=scale_3.Geometry, Motion=amp_8)  # -> Geometry, Transform
cull_i_10 = CullIndex(List=explode_4.Segments, Indices=panel_4, Wrap=True)
end_2 = EndPoints(Curve=merge_26)  # -> Start, End
merge_27 = Merge(Data1=end_2.Start, Data2=end_2.End)
cp_3 = ClosestPoint(Point=merge_27, Cloud=[end.Start, end.End])  # -> ClosestPoint, CPIndex, Distance
join_7 = JoinCurves(Curves=cull_i_10, Preserve=False)
merge_28 = Merge(Data1=move_17.Geometry, Data2=move_18.Geometry)
ln_8 = Line(StartPoint=merge_27, EndPoint=cp_3.ClosestPoint)
match_2 = MatchTree(Tree=cir_7, Guide=simplify(rot3d_3.Geometry))
end_3 = EndPoints(Curve=join_7)  # -> Start, End
end_4 = EndPoints(Curve=merge_28)  # -> Start, End
merge_29 = Merge(Data1=simplify(merge_26), Data2=simplify(join_3), Data3=simplify(ln_8))
viewer_5 = ParamViewer(merge_25)
merge_30 = Merge(Data1=simplify(rot3d_3.Geometry), Data2=simplify(rot3d_4.Geometry), Data3=simplify(match_2))
merge_31 = Merge(Data1=end_4.Start, Data2=end_4.End)
lng_9 = ListLength(List=viewer_5)
cp_4 = ClosestPoint(Point=merge_31, Cloud=[end_3.Start, end_3.End])  # -> ClosestPoint, CPIndex, Distance
join_8 = JoinCurves(Curves=merge_29, Preserve=False)
viewer_6 = ParamViewer(merge_30)
viewer_7 = ParamViewer(join_8)
ln_9 = Line(StartPoint=merge_31, EndPoint=cp_4.ClosestPoint)
lng_10 = ListLength(List=viewer_6)
merge_32 = Merge(Data1=simplify(rot3d.Geometry), Data2=simplify(rot3d_2.Geometry), Data3=simplify(cir_6))
lng_11 = ListLength(List=viewer_7)
series_6 = Series(Start=lng_11, Step=1, Count=lng_9)
int_6 = Integer(series_6)
replace_3 = ReplacePaths(Data=merge_25, Search=viewer_5, Replace=int_6)
series_7 = Series(Start=lng_11, Step=1, Count=lng_10)
merge_33 = Merge(Data1=simplify(merge_28), Data2=simplify(join_7), Data3=simplify(ln_9))
int_7 = Integer(series_7)
join_9 = JoinCurves(Curves=merge_33, Preserve=False)
replace_4 = ReplacePaths(Data=merge_30, Search=viewer_6, Replace=int_7)
merge_34 = Merge(Data1=flatten(join_8), Data2=flatten(join_9))  # -> graft(Result)
merge_35 = Merge(Data1=merge_32, Data2=replace_4)

# ----
# substitution pattern
panel_17 = Panel("""True
False""")
parts_to_invert = Panel("""{1;2;1;0}
{1;3;1;0}""")

number_slider_17 = Slider(7, range=2..10)
not = GateNot(A="True")
repeat = RepeatData(Data=not, Length=number_slider_17)  # -> flatten(Data)
subtraction_4 = Subtraction(A=number_slider_17, B="1")
merge_36 = Merge(Data1="True", Data2=repeat)
shift_13 = ShiftList(List=merge_36, Shift=Slider(5, range=2..10), Wrap=True)
shift_14 = ShiftList(List=shift_13, Shift=Slider(6, range=2..10), Wrap=True)
panel_18 = Panel(shift_14)
panel_19 = Panel(shift_13)
panel_20 = Panel(merge_36)
entwine_4 = Entwine(Branch00=merge_36, Branch01=shift_13, Branch02=shift_14, FlattenInputs=True)
viewer_8 = ParamViewer(entwine_4)
entwine_5 = Entwine(Branch0X=entwine_4, Branch1X=entwine_4, Branch2X=entwine_4, Branch3X=entwine_4, FlattenInputs=False)  # -> simplify(Result)
entwine_6 = Entwine(Branch0X=entwine_5, Branch1X=entwine_5, FlattenInputs=False)
viewer_9 = ParamViewer(entwine_6)

# ----
# sub-components
swatch_4 = ColourSwatch(SwatchColor=RGB(255, 255, 255))

number_slider_18 = Slider(2, range=0..100)

font = ValueList({"Machine Tool Gothic", "Machine Tool SanSerif"}, selected="Machine Tool Gothic")
number_slider_19 = Slider(220, range=1..500)
number_slider_20 = Slider(1.5, range=0..100)

fpars = FontParser(S=merge_23, font=font, size=number_slider_20, prec=number_slider_19, P=merge_24, J="4")  # -> out, C; inputs S: String, font: String, close: Boolean, size: Double, prec: Double, P: Plane, J: Int32
# ---------- fpars: C# ----------
        /*
    Font Parser
    Adaptation of code written by David Rutten, Giulio Piacentino et al.
    Adaptation for C# by Alessio Erioli - Co-de-iT
    */

    Component.Name = "Font Parser";
    Component.NickName = "FPars";
    Component.Description = "converts text into polylines - useful for fabrication";
    Component.Params.Input[0].Description = "text to convert";
    Component.Params.Input[1].Description = "text font";
    Component.Params.Input[2].Description = "close polylines (optional)";
    Component.Params.Input[3].Description = "text size";
    Component.Params.Input[4].Description = "sampling precision (usually 100-250 is ok)";
    Component.Params.Input[5].Description = "destination plane";
    Component.Params.Input[6].Description = "text justification (0-8)";


    float fS = size == 0 ? 1 : (float) size;
    System.Drawing.Font local_font = new System.Drawing.Font(font, (float) fS);

    System.Drawing.Drawing2D.GraphicsPath path = new System.Drawing.Drawing2D.GraphicsPath();
    path.AddString(S, local_font.FontFamily, (int) local_font.Style, local_font.Size, new PointF(0, 0), new StringFormat());

    System.Drawing.Drawing2D.Matrix matrix = new  System.Drawing.Drawing2D.Matrix(); // transformation matrix
    matrix.Reset(); // build identity matrix

    // ______________ text justification ______________

    RectangleF rec = path.GetBounds(); // bounding rectangle for text
    float dX = Convert.ToSingle(rec.Width * -0.5), dY = Convert.ToSingle(rec.Height * 0.5);
    switch(J){
      case 0:// top left
        dX = 0;
        dY = fS;
        break;
      case 1: // middle left
        dX = 0;
        dY = Convert.ToSingle((-rec.Height) * 0.5 + fS);
        break;
      case 2:  // bottom left
        dX = 0;
        dY = Convert.ToSingle(-rec.Height + fS * 0.5);
        break;
      case 3: // top center
        dX = Convert.ToSingle(rec.Width * -0.5);
        dY = fS;
        break;
      case 4: // middle center
        dX = Convert.ToSingle(rec.Width * -0.5);
        dY = Convert.ToSingle((-rec.Height) * 0.5 + fS);
        break;
      case 5: // bottom center
        dX = Convert.ToSingle(rec.Width * -0.5);
        dY = Convert.ToSingle(-rec.Height + fS * 0.5);
        break;
      case 6: // top right
        dX = Convert.ToSingle(rec.Width * -1);
        dY = fS;
        break;
      case 7: // middle right
        dX = Convert.ToSingle(rec.Width * -1);
        dY = Convert.ToSingle((-rec.Height) * 0.5 + fS);
        break;
      case 8: // bottom right
        dX = Convert.ToSingle(rec.Width * -1);
        dY = Convert.ToSingle(-rec.Height + fS * 0.5);
        break;

    }
    //float dX = Convert.ToSingle(rec.Width * -0.5);
    //float dY = Convert.ToSingle(rec.Height * 0.5);
    System.Drawing.Drawing2D.Matrix mTrans = new  System.Drawing.Drawing2D.Matrix(1, 0, 0, 1, dX, dY); // build transformation matrix
    path.Transform(mTrans); // transform text path

    // ______________ convert to polylines ______________

    path.Flatten(matrix, (float) (size / prec)); // turns the path into a polyline that approximates the path

    PointF[] pts = path.PathPoints; // get path points
    Byte[] tps = path.PathTypes;   // get path point types
    List<Polyline> strokes = new  List<Polyline>(); // List for strokes
    Polyline stroke = new Polyline();

    Byte typ_start = Convert.ToByte(System.Drawing.Drawing2D.PathPointType.Start);// find start points condition

    // the conversion loop
    for (int i = 0; i < pts.Length; i++){
      // if a start point is found, and the existing polyline is not null nor a single point,
      // add polyline to the strokes and create a new polyline
      if(tps[i] == typ_start){
        if (stroke != null && stroke.Count > 1) {
          if (close) stroke.Add(stroke[0]); // close polyline if necessary
          strokes.Add(stroke);}
        stroke = new Polyline();
      }
      // in any other case add the next point to a polyline
      stroke.Add(pts[i].X, -pts[i].Y + size, 0);
      // add last stroke to the list
      if (i == pts.Length - 1) {
        if (close) stroke.Add(stroke[0]); // and close it if necessary
        strokes.Add(stroke);
      }
    }


    // ______________ align strokes to given plane ______________

    Transform align = Transform.PlaneToPlane(Plane.WorldXY, P); // align transformation
    for(int j = 0; j < strokes.Count; j++){
      strokes[j].Transform(align);
    }

    C = strokes;
# ---------- end fpars ----------
crv_19 = Curve(simplify(fpars.C))
merge_37 = Merge(Data1=merge_3, Data2=replace_3, Data3=crv_19)

# ----
# outer cuts
# inner cuts
# engrave
# engrave text
crv_20 = Curve(merge_34)
crv_21 = Curve(merge_35)
crv_22 = Curve()
crv_23 = Curve(merge_37)

# ----
# curves
# NOTE: please erase all groups from the Rhino file before baking.
# If unsure copy the polylines in a new file before referencing them in this part of the definition to avoid previous groups.
# outer cuts
# inner cuts
# engrave
# engrave text
lng_12 = ListLength(List=crv_20)
lng_13 = ListLength(List=crv_21)
lng_14 = ListLength(List=crv_22)
lng_15 = ListLength(List=crv_23)
swatch_5 = ColourSwatch(SwatchColor=RGB(0, 0, 255))
swatch_6 = ColourSwatch(SwatchColor=RGB(255, 255, 255))
layers_names = Panel("""c_outer_cut
c_inner_cut
c_engrave""")
merge_38 = Merge(Data1=simplify(lng_12), Data2=simplify(lng_13), Data3=simplify(lng_15))
merge_39 = Merge(Data1=simplify(crv_20), Data2=simplify(crv_21), Data3=simplify(crv_22), Data4=simplify(crv_23))
preview = CustomPreview(Geometry=crv_20, Shader=ColourSwatch(SwatchColor=RGB(255, 0, 0)))
preview_2 = CustomPreview(Geometry=crv_21, Shader=ColourSwatch(SwatchColor=RGB(0, 255, 0)))
preview_3 = CustomPreview(Geometry=crv_22, Shader=swatch_5)
preview_4 = CustomPreview(Geometry=crv_23, Shader=swatch_5)
tstat = TreeStatistics(Tree=merge_39)  # -> Paths, Length, Count
stack = StackData(Data=layers_names, Stack=merge_38)
series_8 = Series(Start=0, Step=1, Count=tstat.Count)
group = BooleanToggle(True)
bake = Button()
int_8 = Integer(simplify(graft(series_8)))
bakeatt = BakeAttributesEnhanced(obj=merge_39, layer=stack, group_n=int_8, group=group, bake_iT=bake)  # -> info, obj_out; inputs obj: GeometryBase, name: String, layer: String, color: Color, pWidth: Double, wires: Int32, group_n: Int32, group: Boolean, bake_iT: Boolean
# ---------- bakeatt: C# ----------
    //Inserts geometry into the Rhino document, with custom attributes
    //Written by Giulio Piacentino
    //Version written 2010 11 21 - for Grasshopper 0.8.002
    //Enhanced by Co-de-iT (Alessio) - now bakes on chosen layer(s) and in groups

    String eol = Environment.NewLine;
    Component.Name = "Bake Attributes Enhanced";
    Component.NickName = "BakeAtt++";
    Component.Message = "v1.1 _ by Giulio Piacentino" + eol + "enhanced by Co-de-iT";
    Component.Description = "Bakes objects with attributes such as color, material, layer, object name, wire density. Option to bake in groups";

    if (bake_iT)
    {
      if(obj == null)
      {
        Print("No object to bake");
        return;
      }

      //Make new attribute to set name
      Rhino.DocObjects.ObjectAttributes att = new Rhino.DocObjects.ObjectAttributes();

      //Set object name
      if(!string.IsNullOrEmpty(name))
      {
        att.Name = name;
      }

      //Set color
      if(!color.IsEmpty)
      {
        att.ColorSource = Rhino.DocObjects.ObjectColorSource.ColorFromObject; //Make the color type "by object"
        att.ObjectColor = color;

        att.PlotColorSource = Rhino.DocObjects.ObjectPlotColorSource.PlotColorFromObject; //Make the plot color type "by object"
        att.PlotColor = color;
      }

      // Set group

      if(group)
      {
        doc.Groups.Add(Convert.ToString(group_n));
        att.AddToGroup(group_n);

      }

      //Set layer
      if(!string.IsNullOrEmpty(layer) && Rhino.DocObjects.Layer.IsValidName(layer))
      {
        //Get the current layer index
        Rhino.DocObjects.Tables.LayerTable layerTable = doc.Layers;
        int layerIndex = layerTable.Find(layer, true);

        if(layerIndex < 0) //This layer does not exist, we add it
        {
          Rhino.DocObjects.Layer onlayer = new Rhino.DocObjects.Layer(); //Make a new layer
          onlayer.Name = layer;
          

          layerIndex = layerTable.Add(onlayer); //Add the layer to the layer table
          if (layerIndex > -1) //We manged to add layer!
          {
            att.LayerIndex = layerIndex;
            Print("Added new layer to the document at position " + layerIndex + " named " + layer + ". ");
          } else
            Print("Layer did not add. Try cleaning up your layers."); //This never happened to me.
        }
        else
          att.LayerIndex = layerIndex; //We simply add to the existing layer
      }


      //Set plotweight
      if(pWidth > 0)
      {
        att.PlotWeightSource = Rhino.DocObjects.ObjectPlotWeightSource.PlotWeightFromObject;
        att.PlotWeight = pWidth;
      }


      //Set material
      bool materialByName = !string.IsNullOrEmpty(material as string);
      Rhino.Display.DisplayMaterial inMaterial = material as Rhino.Display.DisplayMaterial;
      if(material is Color)
      {
        inMaterial = new Rhino.Display.DisplayMaterial((Color) material);
      }
      if(material != null && inMaterial == null && !materialByName)
      {
        if(!(material is string))
        {
          try //We also resort to try with IConvertible
          {
            inMaterial = (Rhino.Display.DisplayMaterial) Convert.ChangeType(material, typeof(Rhino.Display.DisplayMaterial));
          }
          catch(InvalidCastException)
          {
          }
        }
      }
      if(inMaterial != null || materialByName)
      {
        string matName;

        if(!materialByName)
        {
          matName = string.Format("A:{0}-D:{1}-E:{2}-S:{3},{4}-T:{5}",
            Format(inMaterial.Ambient),
            Format(inMaterial.Diffuse),
            Format(inMaterial.Emission),
            Format(inMaterial.Specular),
            inMaterial.Shine.ToString(),
            inMaterial.Transparency.ToString()
            );
        }
        else
        {
          matName = (string) material;
        }

        int materialIndex = doc.Materials.Find(matName, true);
        if(materialIndex < 0 && !materialByName) //Material does not exist and we have its specs
        {
          materialIndex = doc.Materials.Add(); //Let's add it
          if(materialIndex > -1)
          {
            Print("Added new material at position " + materialIndex + " named \"" + matName + "\". ");
            Rhino.DocObjects.Material m = doc.Materials[materialIndex];
            m.Name = matName;
            m.AmbientColor = inMaterial.Ambient;
            m.DiffuseColor = inMaterial.Diffuse;
            m.EmissionColor = inMaterial.Emission;
            //m.ReflectionColor = no equivalent
            m.SpecularColor = inMaterial.Specular;
            m.Shine = inMaterial.Shine;
            m.Transparency = inMaterial.Transparency;
            //m.TransparentColor = no equivalent
            m.CommitChanges();

            att.MaterialSource = Rhino.DocObjects.ObjectMaterialSource.MaterialFromObject;
            att.MaterialIndex = materialIndex;
          }
          else
            Print("Material did not add. Try cleaning up your materials."); //This never happened to me.
        }
        else if(materialIndex < 0 && materialByName) //Material does not exist and we do not have its specs. We do nothing
        {
          Print("Warning: material name not found. I cannot set the source to this material name. Add a material with name: " + matName);
        }
        else
        {
          //If this material exists, we do not replace it!
          att.MaterialSource = Rhino.DocObjects.ObjectMaterialSource.MaterialFromObject;
          att.MaterialIndex = materialIndex;
        }
      }


      //Set wire density
      if(wires == -1 || wires > 0)
      {
        att.WireDensity = wires;
      }


      //Bake to the right type of object
      switch(obj.ObjectType)
      {
        case Rhino.DocObjects.ObjectType.Brep:
          doc.Objects.AddBrep(obj as Brep, att);
          break;
        case Rhino.DocObjects.ObjectType.Curve:
          doc.Objects.AddCurve(obj as Curve, att);
          break;
        case Rhino.DocObjects.ObjectType.Point:
          doc.Objects.AddPoint((obj as Rhino.Geometry.Point).Location, att);
          break;
        case Rhino.DocObjects.ObjectType.Surface:
          doc.Objects.AddSurface(obj as Surface, att);
          break;
        case Rhino.DocObjects.ObjectType.Mesh:
          doc.Objects.AddMesh(obj as Mesh, att);
          break;
        case Rhino.DocObjects.ObjectType.Extrusion:
          typeof(Rhino.DocObjects.Tables.ObjectTable).InvokeMember("AddExtrusion", BindingFlags.Instance | BindingFlags.InvokeMethod, null, doc.Objects, new object[]{obj, att});
          break;
        case Rhino.DocObjects.ObjectType.PointSet:
          doc.Objects.AddPointCloud(obj as Rhino.Geometry.PointCloud, att); //This is a speculative entry
          break;
        default:
          Print("The script does not know how to handle this type of geometry: " + obj.GetType().FullName);
          break;
      }
      Print("Added " + obj.GetType().Name);

    }
    else
    {
      Print("Inactive");
    }
    obj_out = obj;
# ---------- bakeatt: C# additional code ----------
  static string Format(Color c)
  {
    return (new System.Text.StringBuilder("A")).Append(c.A.ToString()).Append("R").Append(c.R.ToString()).Append("G")
      .Append(c.G.ToString()).Append("B").Append(c.B.ToString()).ToString();
  }
# ---------- end bakeatt ----------

srf_14 = Surface(graft(srf_4))
bcx_8 = BrepCurve(Brep=srf_14, Curve=merge_22)  # -> Curves, Points

# ---- group: points fo unroll on surfaces
pshift_16 = ShiftPaths(Data=bcx_8.Points, Offset=-1)

# ----
pt_8 = Point(pshift_16)

split_2 = SplitTree(Data=pt_8, Masks=flatten("{0;*}"))  # -> Positive, Negative
path_mapper = PathMapper(split_2.Negative, source="{A;B;C}", target="{0;B;C}")

# ----
# unroll beam surfaces
# right
unroller_3 = Unroller(Brep=graft(merge_9), Points=split_2.Positive)  # -> simplify(Brep), Curves, simplify(Points)
lng_16 = ListLength(List=flatten(unroller_3.Brep))  # -> expr("x-1", Length)
range_4 = Range(Domain=Slider(1139.98, range=0..1500), Steps=lng_16)  # -> graft(Range)
X_5 = UnitX(Factor=range_4)
move_19 = Move(Geometry=unroller_3.Points, Motion=X_5)  # -> Geometry, Transform
move_20 = Move(Geometry=unroller_3.Brep, Motion=X_5)  # -> Geometry, Transform
srf_15 = Surface(reparameterize(move_20.Geometry))
adjust_orient = AdjustOrient(srf=srf_15, pt=move_19.Geometry)  # -> S, pt_4
pt_9 = Point(adjust_orient.pt_4)
pshift_17 = ShiftPaths(Data=adjust_orient.S, Offset=-1)

viewer_10 = ParamViewer(pshift_16)

# ----
# left
unroller_4 = Unroller(Brep=graft(merge_8), Points=path_mapper)  # -> simplify(Brep), Curves, simplify(Points)
lng_17 = ListLength(List=flatten(unroller_4.Brep))  # -> expr("x-1", Length)
range_5 = Range(Domain=Slider(1139.98, range=0..1500), Steps=lng_17)  # -> graft(Range)
X_6 = UnitX(Factor=range_5)

addition_3 = Addition(A=X_6, B=Y_2)

move_21 = Move(Geometry=unroller_4.Points, Motion=addition_3)  # -> Geometry, Transform
move_22 = Move(Geometry=unroller_4.Brep, Motion=addition_3)  # -> Geometry, Transform
srf_16 = Surface(reparameterize(move_22.Geometry))
adjust_orient_2 = AdjustOrient(srf=srf_16, pt=move_21.Geometry)  # -> S, pt_4
pshift_18 = ShiftPaths(Data=adjust_orient_2.S, Offset=-1)
pt_10 = Point(adjust_orient_2.pt_4)

# ----
# points
entwine_7 = Entwine(Branch0X=pt_9, Branch1X=pt_10, FlattenInputs=False)
# surfs
entwine_8 = Entwine(Branch0X=pshift_17, Branch1X=pshift_18, FlattenInputs=False)

# ----
# unrolled
srf_17 = Surface(entwine_8)
lng_18 = ListLength(List=srf_17)
viewer_11 = ParamViewer(srf_17)
series_9 = Series(Start=0, Step=1, Count=lng_18)
int_9 = Integer(series_9)
evalsrf_3 = EvaluateSurface(Surface=reparameterize(srf_17), Point=pt_3)  # -> Point, Normal, Frame
concat_2 = Concatenate(FragmentA=graft(viewer_11), FragmentB=int_9)
move_23 = Move(Geometry=evalsrf_3.Point, Motion=X_2)  # -> Geometry, Transform
tag_9 = TextTag3D(
    Location=evalsrf_3.Point,
    Text=concat_2,
    Size=Slider(20, range=0..100),
    Colour=ColourSwatch(SwatchColor=RGB(255, 255, 255)),
    Justification=5)

srf_18 = Surface(entwine_8)
pt_11 = Point(entwine_7)
move_24 = Move(Geometry=pt_11, Motion=Z_6)  # -> Geometry, Transform
line_7 = LineSDL(Start=move_24.Geometry, Direction=rev, Length="2")

edges_4 = BrepEdges(Brep=srf_18)  # -> Naked, Interior, NonManifold
# create jigsaw contours
len_3 = Length(Curve=edges_4.Naked)
sort_4 = SortList(Keys=len_3, ValuesA=edges_4.Naked)  # -> Keys, reverse(ValuesA)
split_3 = SplitList(List=sort_4.ValuesA, Index=panel_8)  # -> ListA, ListB
subset = SubList(List=sort_4.ValuesA, Domain="1", Wrap=True)  # -> List, Index
crv_24 = Curve(reparameterize(graft(split_3.ListA)))
len_4 = Length(Curve=crv_24)
division_3 = Division(A=len_4, B=jig_length)
int_10 = Integer(division_3)
divide_12 = DivideCurve(Curve=crv_24, Count=int_10, Kinks=False)  # -> Points, Tangents, Parameters
shatter_3 = Shatter(Curve=crv_24, Parameters=divide_12.Parameters)
xprod = CrossProduct(VectorA=divide_12.Tangents, VectorB=Z_11, Unitize=False)  # -> Vector, Length
bishift = DoubleShift(list=simplify(xprod.Vector), wrap=Toggle(False))  # -> graft(no_last), graft(no_first)
avr_10 = Average(Input=[bishift.no_last, bishift.no_first])
pshift_19 = ShiftPaths(Data=avr_10, Offset=-1)
crv_25 = Curve(simplify(split_3.ListB))

# ----
# tag curve side
crv_26 = Curve(split_3.ListA)
curvepoint_5 = PointOnCurve(crv_26, parameter=0.5)
tag_10 = TextTag3D(
    Location=curvepoint_5,
    Text=panel_7,
    Size=Slider(13.732, range=0..20),
    Colour=ColourSwatch(SwatchColor=RGB(0, 0, 0)),
    Justification=5)

# ----
# NOTE: in order for the jigsaw technique to work, the number of divisions should be ALWAYS EVEN
mod = Modulus(A=int_10, B=2)
dispatch_6 = Dispatch(List=int_10, DispatchPattern=mod)  # -> ListA, ListB
subtraction_5 = Subtraction(A=dispatch_6.ListA, B=1)
weave_3 = Weave(Pattern=mod, Stream0=dispatch_6.ListB, Stream1=subtraction_5, NullGaps=False)
divisions = Panel(weave_3)

lng_19 = ListLength(List=shatter_3)
lng_20 = ListLength(List=lng_19)
dup = DuplicateData(Data=panel_17, Number=lng_20, Order=True)  # -> simplify(Data)
viewer_12 = ParamViewer(dup)
branch_2 = TreeBranch(Tree=simplify(shatter_3), Path=parts_to_invert_all_staples, MaintainPaths=True)
branch_3 = TreeBranch(Tree=simplify(dup), Path=parts_to_invert_all_staples, MaintainPaths=True)
panel_21 = Panel(viewer_12)
not_2 = GateNot(A=branch_3)
crv_27 = Curve(branch_2)
mindex = MemberIndex(Set=panel_21, Member=parts_to_invert_all_staples)  # -> flatten(Index), Count
cull_i_11 = CullIndex(List=viewer_12, Indices=mindex.Index, Wrap=True)
branch_4 = TreeBranch(Tree=dup, Path=cull_i_11, MaintainPaths=True)
merge_40 = Merge(Data1=branch_4, Data2=not_2)

bool = Boolean(merge_40)

area_9 = Area(Geometry=flatten(unroller_4.Brep))  # -> Area, Centroid
area_10 = Area(Geometry=flatten(unroller_3.Brep))  # -> Area, Centroid
subtraction_6 = Subtraction(A=area_5.Area, B=area_9.Area)
subtraction_7 = Subtraction(A=area_6.Area, B=area_10.Area)
abs = Absolute(Value=subtraction_6)
abs_2 = Absolute(Value=subtraction_7)
division_4 = Division(A=abs, B=area_5.Area)
division_5 = Division(A=abs_2, B=area_6.Area)
multiplication_16 = Multiplication(A=division_4, B=100)
multiplication_17 = Multiplication(A=division_5, B=100)
panel_22 = Panel(multiplication_17)
panel_23 = Panel(multiplication_16)
bar_graph_4 = BarGraph(multiplication_17, BarColor=RGB(255, 0, 90))
bar_graph_5 = BarGraph(multiplication_16, BarColor=RGB(255, 0, 90))

bnd_6 = Bounds(Numbers=[subtraction_6, subtraction_7])

remap_6 = RemapNumbers(Value=subtraction_6, Source=bnd_6, Target=Domain(0, 1))  # -> Mapped, Clipped
remap_7 = RemapNumbers(Value=subtraction_7, Source=bnd_6, Target=Domain(0, 1))  # -> Mapped, Clipped
gradient = Gradient(LowerLimit=0, UpperLimit=1, Parameter=remap_6.Mapped, stops=[0: RGB(255, 0, 0), 1: RGB(255, 255, 255)])
gradient_2 = Gradient(LowerLimit=0, UpperLimit=1, Parameter=remap_7.Mapped, stops=[0: RGB(255, 0, 0), 1: RGB(255, 255, 255)])
previewmat_3 = CustomPreviewMaterials(Geometry=flatten(merge_9), DiffuseColor=gradient_2)
previewmat_4 = CustomPreviewMaterials(Geometry=flatten(merge_8), DiffuseColor=gradient)

dispatch_7 = Dispatch(List=simplify(pshift_19), DispatchPattern=simplify(bool))  # -> ListA, ListB
dispatch_8 = Dispatch(List=simplify(shatter_3), DispatchPattern=simplify(bool))  # -> ListA, ListB
move_25 = Move(Geometry=dispatch_8.ListA, Motion=dispatch_7.ListA)  # -> Geometry, Transform
curvepoint_6 = PointOnCurve(move_25.Geometry, parameter=0.5)
scale_5 = Scale(Geometry=move_25.Geometry, Center=curvepoint_6, Factor=Slider(1.1, range=1..1.2))  # -> Geometry, Transform
end_5 = EndPoints(Curve=dispatch_8.ListA)  # -> Start, End
end_6 = EndPoints(Curve=scale_5.Geometry)  # -> Start, End
ln_10 = Line(StartPoint=end_5.Start, EndPoint=end_6.Start)
ln_11 = Line(StartPoint=end_5.End, EndPoint=end_6.End)
merge_41 = Merge(Data1=dispatch_8.ListB, Data2=ln_10, Data3=scale_5.Geometry, Data4=ln_11)
pshift_20 = ShiftPaths(Data=merge_41, Offset=-1)

pshift_21 = ShiftPaths(Data=pshift_20, Offset=-1)
merge_42 = Merge(Data1=pshift_20, Data2=crv_25)
join_10 = JoinCurves(Curves=merge_42, Preserve=False)  # -> simplify(Curves)

viewer_13 = ParamViewer(join_10)

# ----
# inter-beam connections
curvepoint_7 = PointOnCurve(dispatch_8.ListB, parameter=0.5)
pt_12 = Point(simplify(curvepoint_7))
viewer_14 = ParamViewer(pt_12)
dispatch_9 = Dispatch(List=viewer_14, DispatchPattern=[True, False])  # -> ListA, ListB
branch_5 = TreeBranch(Tree=pt_12, Path=dispatch_9.ListA, MaintainPaths=True)
branch_6 = TreeBranch(Tree=pt_12, Path=dispatch_9.ListB, MaintainPaths=True)
path_mapper_2 = PathMapper(branch_6, source="{A;B;C;D}", target="{A;B;C;0}")
pt_13 = Point(reverse(path_mapper_2))
merge_43 = Merge(Data1=graft(branch_5), Data2=graft(pt_13))
pline_5 = PolyLine(Vertices=merge_43, Closed=False)
pshift_22 = ShiftPaths(Data=pline_5, Offset=-1)  # -> simplify(Data)
viewer_15 = ParamViewer(pshift_22)
join_11 = JoinCurves(Curves=pshift_20, Preserve=False)
cull = CullPattern(List=pshift_22, CullPattern=entwine_6)
item_26 = ListItem(List=join_11, Index=0, Wrap=True)  # -> Item, Item1
ccx = CurveCurve(CurveA=item_26.Item1, CurveB=cull)  # -> Points, ParamsA, ParamsB
ccx_2 = CurveCurve(CurveA=item_26.Item, CurveB=cull)  # -> Points, ParamsA, ParamsB
pshift_23 = ShiftPaths(Data=ccx.ParamsA, Offset=-1)
pshift_24 = ShiftPaths(Data=ccx_2.ParamsA, Offset=-1)
shatter_4 = Shatter(Curve=item_26.Item1, Parameters=pshift_23)  # -> reverse(simplify(Segments))
shatter_5 = Shatter(Curve=item_26.Item, Parameters=pshift_24)  # -> simplify(Segments)
end_7 = EndPoints(Curve=shatter_4)  # -> Start, End
end_8 = EndPoints(Curve=shatter_5)  # -> Start, End
ln_12 = Line(StartPoint=end_8.End, EndPoint=end_7.Start)  # -> simplify(Line)
ln_13 = Line(StartPoint=end_8.Start, EndPoint=end_7.End)  # -> simplify(Line)
merge_44 = Merge(Data1=graft(shatter_5), Data2=graft(ln_13), Data3=graft(ln_12), Data4=graft(shatter_4))
join_12 = JoinCurves(Curves=merge_44, Preserve=False)
pshift_25 = ShiftPaths(Data=join_12, Offset=-2)  # -> simplify(Data)

# ----
# jigsaws
previewlw_5 = CustomPreviewLineweights(Geometry=join_10, Shader=ColourSwatch(SwatchColor=RGB(255, 0, 0)), Thickness=Slider(2, range=1..3), Absolute=False)

previewlw_6 = CustomPreviewLineweights(Geometry=join_12, Shader=swatch_4, Thickness=Slider(1, range=1..3), Absolute=False)

crv_28 = Curve(graft(pshift_25))
srf_19 = Surface(crv_28)
blx_3 = BrepLine(Brep=srf_19, Line=flatten(line_7), LimitToFirst=False)  # -> Curves, Points
pshift_26 = ShiftPaths(Data=blx_3.Points, Offset=-1)
cir_8 = Circle(Plane=pshift_26, Radius=".5")

# ----
# division curves (on model)
srf_20 = Surface(reparameterize(graft(entwine_8)))
crv_29 = Curve(cull)
end_9 = EndPoints(Curve=crv_29)  # -> Start, End
srf_cp = SurfaceClosestPoint(Point=end_9.Start, Surface=srf_20)  # -> Point, UVPoint, Distance
srf_cp_2 = SurfaceClosestPoint(Point=end_9.End, Surface=srf_20)  # -> Point, UVPoint, Distance
srf_21 = Surface(reparameterize(graft(entwine)))
lng_21 = ListLength(List=srf_cp.UVPoint)
repeat_2 = RepeatData(Data=srf_21, Length=lng_21)  # -> simplify(graft(Data))
merge_45 = Merge(Data1=graft(srf_cp.UVPoint), Data2=graft(srf_cp_2.UVPoint))

crvsrf = CurveOnSurface(Surface=repeat_2, UVCoordinates=merge_45, Closed=False)  # -> Curve, Length, Domain
pshift_27 = ShiftPaths(Data=crvsrf.Curve, Offset=-1)

srf_22 = Surface(reparameterize(graft(entwine_8)))
# tagging
crv_30 = Curve(pshift_25)
viewer_16 = ParamViewer(crv_30)
lng_22 = ListLength(List=crv_30)
disc_2 = Discontinuity(Curve=crv_30, Level=1)  # -> Points, Parameters
series_10 = Series(Start=0, Step=1, Count=lng_22)
int_11 = Integer(simplify(series_10))

dpath_2 = DeconstructPath(Branch=viewer_16)
avr_11 = Average(Input=disc_2.Points)
pshift_28 = ShiftPaths(Data=avr_11, Offset=-1)

item_27 = ListItem(List=dpath_2, Index=0, Wrap=True)  # -> Item, Item1, Item2
expression_3 = Expression(x=item_27.Item, y=item_27.Item1, z=item_27.Item2, Expression="Format(\"{0}.{1}.{2}_\", x, y,z)")  # -> flatten(R)
concat_3 = Concatenate(FragmentA=graft(expression_3), FragmentB=int_11)
fpars_2 = FontParser(S=concat_3, font=font, size=number_slider_20, prec=number_slider_19, P=pshift_28, J="4")  # -> out, C; inputs S: String, font: String, close: Boolean, size: Double, prec: Double, P: Plane, J: Int32; same code as fpars

tag_11 = TextTag3D(
    Location=pshift_28,
    Text=concat_3,
    Size=number_slider_18,
    Colour=ColourSwatch(SwatchColor=RGB(255, 255, 255)),
    Justification=5)

viewer_17 = ParamViewer(pshift_28)

# ----
# automated layer separation and grouping for automated nesting
# outer cuts
# inner cuts
# engrave
# engrave text
crv_31 = Curve(crv_28)
crv_32 = Curve(cir_8)
crv_33 = Curve()
crv_34 = Curve(fpars_2.C)

# ----
# curves
# the Bakery: obj - objects to bake
# name - objects names (optional)
# layer - objects layer (optional)
# color - objects color (optional)
# pWidth - polylines width (optional)
# wires
# material - objects material (optional)
# group_n - group number (mandatory if you want to bake in groups - see also note below)
# group - boolean toggle to bake in groups (one group for each tree branch)
# bake_iT - button: hit once to bake ALL
# NOTE: please erase all groups from the Rhino file before baking.
# If unsure copy the polylines in a new file before referencing them in this part of the definition to avoid previous groups.
# Insert here the polylines if not generated in this definition.
# 
# There should be one tree branch for each piece to be cut.
# 
# Example: 3 pieces (each with outer cuts, inner cuts, engraving and text)
# 
# For each of those works I'll have a datat tree with 3 branches, {0}, {1} e {2}.
# 
# In the "outer cuts" component I'll put all the polylines for outer cuts, in branch {0} the ones relative to the first component, branch {1} those relative to the second one and so on. Same structure for all other works.
# 
# Maintaining this order is necessary for a correct group bake and thus use Rhinonest
# outer cuts
# inner cuts
# engrave
# engrave text
lng_23 = ListLength(List=crv_31)
lng_24 = ListLength(List=crv_32)
lng_25 = ListLength(List=crv_33)
lng_26 = ListLength(List=crv_34)
swatch_7 = ColourSwatch(SwatchColor=RGB(0, 0, 255))
swatch_8 = ColourSwatch(SwatchColor=RGB(255, 255, 255))
layers_names_2 = Panel("""re_outer_cut
re_inner_cut
re_engrave""")
merge_46 = Merge(Data1=simplify(lng_23), Data2=simplify(lng_24), Data3=simplify(lng_26))
merge_47 = Merge(Data1=simplify(crv_31), Data2=simplify(crv_32), Data3=simplify(crv_33), Data4=simplify(crv_34))
preview_5 = CustomPreview(Geometry=crv_31, Shader=ColourSwatch(SwatchColor=RGB(255, 0, 0)))
preview_6 = CustomPreview(Geometry=crv_32, Shader=ColourSwatch(SwatchColor=RGB(0, 255, 0)))
preview_7 = CustomPreview(Geometry=crv_33, Shader=swatch_7)
preview_8 = CustomPreview(Geometry=crv_34, Shader=swatch_7)
tstat_2 = TreeStatistics(Tree=merge_47)  # -> Paths, Length, Count
stack_2 = StackData(Data=layers_names_2, Stack=merge_46)
series_11 = Series(Start=0, Step=1, Count=tstat_2.Count)
group_2 = BooleanToggle(True)
bake_2 = Button()
int_12 = Integer(simplify(graft(series_11)))
bakeatt_2 = BakeAttributesEnhanced(obj=merge_47, layer=stack_2, group_n=int_12, group=group_2, bake_iT=bake_2)  # -> info, obj_out; inputs obj: GeometryBase, name: String, layer: String, color: Color, pWidth: Double, wires: Int32, group_n: Int32, group: Boolean, bake_iT: Boolean; same code as bakeatt

# ----
# component index on model
srf_23 = Surface(reparameterize(graft(entwine)))
number_slider_21 = Slider(2, range=0..100)
srf_cp_3 = SurfaceClosestPoint(Point=pshift_28, Surface=srf_22)  # -> Point, UVPoint, Distance
evalsrf_4 = EvaluateSurface(Surface=srf_23, Point=srf_cp_3.UVPoint)  # -> Point, Normal, Frame
amp_9 = Amplitude(Vector=evalsrf_4.Normal, Amplitude=number_slider_21)
move_26 = Move(Geometry=evalsrf_4.Frame, Motion=amp_9)  # -> Geometry, Transform
multiplication_18 = Multiplication(A=number_slider_21, B=0.9)
line_8 = LineSDL(Start=evalsrf_4.Frame, Direction=evalsrf_4.Normal, Length=multiplication_18)
tag_12 = TextTag3D(Location=move_26.Geometry, Text=concat_3, Size=number_slider_18, Colour=swatch, Justification=5)
previewlw_7 = CustomPreviewLineweights(Geometry=line_8, Shader=swatch, Absolute=False)

# ==== cluster DoubleShift: Shifts a list +1 and -1, wrap option available
list = ClusterInput()
wrap = ClusterInput()
shift = ShiftList(List=list, Shift=1, Wrap=wrap)
shift_2 = ShiftList(List=list, Shift="-1", Wrap=wrap)
no_last = ClusterOutput(shift_2)
no_first = ClusterOutput(shift)

# ==== cluster AdjustOrient
srf = ClusterInput()
pt = ClusterInput()
srf_2 = Surface(reparameterize(srf))
pt_2 = Point(Point(0.5, 0.5, 0))
pt_3 = Point(pt)
evalsrf = EvaluateSurface(Surface=srf_2, Point=pt_2)  # -> Point, Normal, Frame
Z = UnitZ(Factor=1)
angle = Angle(VectorA=evalsrf.Normal, VectorB=Z)  # -> Angle, Reflex
larger = LargerThan(FirstNumber=angle.Angle, SecondNumber=0.0001)  # -> LargerThan, OrEqualTo
dispatch = Dispatch(List=evalsrf.Point, DispatchPattern=larger.LargerThan)  # -> ListA, ListB
dispatch_2 = Dispatch(List=srf_2, DispatchPattern=larger.LargerThan)  # -> ListA, ListB
dispatch_3 = Dispatch(List=pt_3, DispatchPattern=larger.LargerThan)  # -> ListA, ListB
X = UnitX(Factor=1)
rot3d = Rotate3D(Geometry=dispatch_3.ListA, Angle="Pi", Center=dispatch.ListA, Axis=X)  # -> Geometry, Transform
rot3d_2 = Rotate3D(Geometry=dispatch_2.ListA, Angle="Pi", Center=dispatch.ListA, Axis=X)  # -> Geometry, Transform
weave = Weave(Pattern=larger.LargerThan, Stream0=dispatch_3.ListB, Stream1=rot3d.Geometry, NullGaps=False)
weave_2 = Weave(Pattern=larger.LargerThan, Stream0=dispatch_2.ListB, Stream1=rot3d_2.Geometry, NullGaps=False)
pt_4 = ClusterOutput(weave)
S = ClusterOutput(weave_2)

# ==== cluster AdjustOrientRotY
brep = ClusterInput()
pt = ClusterInput()
brep_2 = Brep(brep)
pt_2 = Point(Point(0.5, 0.5, 0))
debrep = DeconstructBrep(Brep=brep_2)  # -> Faces, Edges, Vertices
item = ListItem(List=debrep.Faces, Index=0, Wrap=True)
pt_3 = Point(pt)
Z = UnitZ(Factor=1)
pshift = ShiftPaths(Data=item, Offset=-1)
srf = Surface(reparameterize(pshift))
evalsrf = EvaluateSurface(Surface=srf, Point=pt_2)  # -> Point, Normal, Frame
angle = Angle(VectorA=evalsrf.Normal, VectorB=Z)  # -> Angle, Reflex
larger = LargerThan(FirstNumber=angle.Angle, SecondNumber=0.0001)  # -> LargerThan, OrEqualTo
dispatch = Dispatch(List=evalsrf.Point, DispatchPattern=larger.LargerThan)  # -> ListA, ListB
dispatch_2 = Dispatch(List=brep_2, DispatchPattern=larger.LargerThan)  # -> ListA, ListB
dispatch_3 = Dispatch(List=pt_3, DispatchPattern=graft(larger.LargerThan))  # -> ListA, ListB
Y = UnitY(Factor=1)
rot3d = Rotate3D(Geometry=dispatch_3.ListA, Angle="Pi", Center=graft(dispatch.ListA), Axis=Y)  # -> Geometry, Transform
rot3d_2 = Rotate3D(Geometry=dispatch_2.ListA, Angle="Pi", Center=dispatch.ListA, Axis=Y)  # -> Geometry, Transform
weave = Weave(Pattern=graft(larger.LargerThan), Stream0=dispatch_3.ListB, Stream1=rot3d.Geometry, NullGaps=False)
weave_2 = Weave(Pattern=larger.LargerThan, Stream0=dispatch_2.ListB, Stream1=rot3d_2.Geometry, NullGaps=False)
pt_4 = ClusterOutput(weave)
S = ClusterOutput(weave_2)
