# Grasshopper definition beam-2-beam connections.gh (Grasshopper 0.9.76)
# Copyright: Co-de-iT
# plug-ins: Heteroptera, Unroller, Human

shorten = Slider(0, range=0..0.4)
subtraction = Subtraction(A=1, B=shorten)
dom = ConstructDomain(DomainStart=shorten, DomainEnd=subtraction)
# curves_right
crv = Curve(reparameterize([<curve referenced from the Rhino model> x2]))
# curves_left
crv_2 = Curve(reparameterize([<curve referenced from the Rhino model> x2]))
sampling = Slider(20, range=2..200)
fill_curves = Slider(4, range=2..50)

# ---- group: medial axis
crv_3 = Curve(<curve referenced from the Rhino model>)

# ---- group: surface for Z regulation
srf = Surface(<surface referenced from the Rhino model>)

# ----
subcrv = SubCurve(BaseCurve=crv, Domain=dom)
subcrv_2 = SubCurve(BaseCurve=crv_2, Domain=dom)
divide = DivideCurve(Curve=subcrv_2, Count=sampling, Kinks=False)  # -> Points, Tangents, Parameters
flip = FlipMatrix(Data=divide.Points)
pline = PolyLine(Vertices=flip, Closed=False)
divide_2 = DivideCurve(Curve=subcrv, Count=sampling, Kinks=False)  # -> Points, Tangents, Parameters
explode = Explode(Curve=pline, Recursive=True)  # -> Segments, Vertices
flip_2 = FlipMatrix(Data=divide_2.Points)

number_slider = Slider(0.21, range=0..1)  # disabled
crv_4 = Curve(reparameterize(<curve referenced from the Rhino model>))  # disabled
eval = EvaluateCurve(Curve=crv_4, Parameter=number_slider)  # -> Point, Tangent, Angle; disabled
number_slider_2 = Slider(10, range=0..30)  # disabled
divide_3 = DivideCurve(Curve=crv_4, Count=number_slider_2, Kinks=False)  # -> Points, Tangents, Parameters; disabled
vec2pt = Vector2Pt(PointA=flip, PointB=eval.Point, Unitize=False)  # -> Vector, Length; disabled
vdis = VectorDisplay(Anchor=divide_3.Points, Vector=vec2pt.Vector)  # disabled

divide_4 = DivideCurve(Curve=explode.Segments, Count=fill_curves, Kinks=False)  # -> Points, Tangents, Parameters
pline_2 = PolyLine(Vertices=flip_2, Closed=False)
pshift = ShiftPaths(Data=divide_4.Points, Offset=-1)
number_slider_3 = Slider(-16.1, range=-30..0)
explode_2 = Explode(Curve=pline_2, Recursive=True)  # -> Segments, Vertices
number_slider_4 = Slider(-0.161, range=-2..0.001)
number_slider_5 = Slider(-1, range=-100..0)
flip_3 = FlipMatrix(Data=pshift)
lng = ListLength(List=flip_3)  # -> expr("x-1", Length)
range = Range(Domain=Domain(0, 1), Steps=lng)
graph = GraphMapper(range, x0=0, x1=1, y0=0, y1=1, container_name="Sine", Equation_px=[0, 0.5223546624], Equation_py=[0.1705827117, 1])
divide_5 = DivideCurve(Curve=explode_2.Segments, Count=fill_curves, Kinks=False)  # -> Points, Tangents, Parameters
number_slider_6 = Slider(-0.161, range=-2..0.001)
pshift_2 = ShiftPaths(Data=divide_5.Points, Offset=-1)
multiplication = Multiplication(A=graph, B=number_slider_3)
number_slider_7 = Slider(-1, range=-100..0)
flip_4 = FlipMatrix(Data=pshift_2)
lng_2 = ListLength(List=flip_4)  # -> expr("x-1", Length)
range_2 = Range(Domain=Domain(0, 1), Steps=lng_2)
graph_2 = GraphMapper(range_2, x0=0, x1=1, y0=0, y1=1, container_name="Sine", Equation_px=[0, 0.5223546624], Equation_py=[0.1705827117, 1])
Z = UnitZ(Factor=multiplication)
move = Move(Geometry=flip_3, Motion=Z)  # -> Geometry, Transform
multiplication_2 = Multiplication(A=graph_2, B=number_slider_3)
Z_2 = UnitZ(Factor=multiplication_2)
intcrv = Interpolate(Vertices=flip_3, Degree=3, Periodic=False, KnotStyle=1)  # -> flatten(Curve), Length, Domain
intcrv_2 = Interpolate(Vertices=move.Geometry, Degree=3, Periodic=False, KnotStyle=1)  # -> flatten(Curve), Length, Domain
move_2 = Move(Geometry=flip_4, Motion=Z_2)  # -> Geometry, Transform
intcrv_3 = Interpolate(Vertices=flip_4, Degree=3, Periodic=False, KnotStyle=1)  # -> flatten(Curve), Length, Domain
intcrv_4 = Interpolate(Vertices=move_2.Geometry, Degree=3, Periodic=False, KnotStyle=1)  # -> Curve, Length, Domain
srf_2 = Surface(<surface referenced from the Rhino model>)
divide_6 = DivideCurve(Curve=intcrv_3.Curve, Count=10, Kinks=False)  # -> Points, Tangents, Parameters
Z_3 = UnitZ(Factor=1)
Z_4 = UnitZ(Factor=-1)
project = Project(Curve=intcrv_4.Curve, Brep=srf, Direction=Z_3)
Z_5 = UnitZ(Factor=1)
line = LineSDL(Start=divide_6.Points, Direction=Z_4, Length="100")
divide_7 = DivideCurve(Curve=intcrv.Curve, Count=10, Kinks=False)  # -> Points, Tangents, Parameters
Z_6 = UnitZ(Factor=-1)
scx = SurfaceCurve(Surface=srf, Curve=line)  # -> Curves, Points, UVPoints, Normals, Parameters, Tangents
project_2 = Project(Curve=intcrv_2.Curve, Brep=srf_2, Direction=Z_5)
line_2 = LineSDL(Start=divide_7.Points, Direction=Z_6, Length="100")
pshift_3 = ShiftPaths(Data=scx.Points, Offset=-1)
scx_2 = SurfaceCurve(Surface=srf, Curve=line_2)  # -> Curves, Points, UVPoints, Normals, Parameters, Tangents
pshift_4 = ShiftPaths(Data=scx_2.Points, Offset=-1)
srf_3 = Surface(<surface referenced from the Rhino model>)
srf_4 = Surface(<surface referenced from the Rhino model>)
nurbs = NurbsCurve(Vertices=pshift_4, Degree=3, Periodic=False)  # -> Curve, Length, Domain
bbx = BrepBrep(BrepA=srf_4, BrepB=srf_3)  # -> reparameterize(Curves), Points
divide_8 = DivideCurve(Curve=nurbs.Curve, Count=10, Kinks=False)  # -> Points, Tangents, Parameters
eval_2 = EvaluateCurve(Curve=bbx.Curves, Parameter=Slider(0.225, range=0..1))  # -> Point, Tangent, Angle
int = Integer(fill_curves)
divide_9 = DivideCurve(Curve=bbx.Curves, Count=Slider(11, range=1..20), Kinks=False)  # -> Points, Tangents, Parameters
nurbs_2 = NurbsCurve(Vertices=pshift_3, Degree=3, Periodic=False)  # -> Curve, Length, Domain
flip_5 = FlipMatrix(Data=divide_8.Points)
merge = Merge(Data1="0", Data2=int)
int_2 = Integer(fill_curves)

# ---- group: offset
number_slider_8 = Slider(0.009, range=0..0.01)
cull_i = CullIndex(List=divide_9.Points, Indices=[Slider(0, range=0..20), Slider(11, range=0..11)], Wrap=True)
crv_cp = CurveClosestPoint(Point=cull_i, Curve=bbx.Curves)  # -> Point, Parameter, Distance
addition = Addition(A=crv_cp.Parameter, B=number_slider_8)
subtraction_2 = Subtraction(A=crv_cp.Parameter, B=number_slider_8)
eval_3 = EvaluateCurve(Curve=bbx.Curves, Parameter=addition)  # -> Point, Tangent, Angle
eval_4 = EvaluateCurve(Curve=bbx.Curves, Parameter=subtraction_2)  # -> Point, Tangent, Angle

# ----
merge_2 = Merge(Data1="0", Data2=int_2)
toggle = BooleanToggle(False)
divide_10 = DivideCurve(Curve=nurbs_2.Curve, Count=10, Kinks=False)  # -> Points, Tangents, Parameters
toggle_2 = BooleanToggle(False)
replace = ReplaceItems(List=intcrv.Curve, Item=subcrv_2, Indices=merge, Wrap=False)  # -> flatten(List)
replace_2 = ReplaceItems(List=intcrv_3.Curve, Item=subcrv, Indices=merge_2, Wrap=False)  # -> flatten(List)
flip_6 = FlipMatrix(Data=divide_10.Points)
shift = ShiftList(List=flip_6, Shift="1", Wrap=toggle)  # -> graft(List)
shift_2 = ShiftList(List=flip_5, Shift="1", Wrap=toggle_2)  # -> graft(List)
shift_3 = ShiftList(List=flip_6, Shift="-1", Wrap=toggle)  # -> graft(List)
shift_4 = ShiftList(List=flip_5, Shift="-1", Wrap=toggle_2)  # -> graft(List)
number_slider_9 = Slider(69, range=0..100)

# ---- group: top curves - right
crv_5 = Curve(reparameterize(intcrv_3.Curve))

# ---- group: top curves - left
crv_6 = Curve(reparameterize(intcrv.Curve))

# ----
avr = Average(Input=[shift, shift_3])
avr_2 = Average(Input=[shift_2, shift_4])
vec2pt_2 = Vector2Pt(PointA=shift_3, PointB=shift, Unitize=False)  # -> Vector, Length
crv_cp_2 = CurveClosestPoint(Point=avr, Curve=crv_3)  # -> Point, Parameter, Distance
crv_cp_3 = CurveClosestPoint(Point=avr_2, Curve=crv_3)  # -> Point, Parameter, Distance
vec2pt_3 = Vector2Pt(PointA=shift_4, PointB=shift_2, Unitize=False)  # -> Vector, Length
bar_graph = BarGraph(crv_cp_2.Distance, BarColor=RGB(255, 0, 90))
bar_graph_2 = BarGraph(crv_cp_3.Distance, BarColor=RGB(255, 0, 90))
min = Minimum(A=crv_cp_2.Distance, B=number_slider_9)
min_2 = Minimum(A=crv_cp_3.Distance, B=number_slider_9)
bnd = Bounds(Numbers=flatten(min))
bnd_2 = Bounds(Numbers=flatten(min_2))
dom_2 = ConstructDomain(DomainStart=0, DomainEnd=Slider(0.6, range=0..1))
dom_3 = ConstructDomain(DomainStart=0, DomainEnd=Slider(0.6, range=0..1))
toggle_3 = BooleanToggle(False)
toggle_4 = BooleanToggle(False)
remap = RemapNumbers(Value=min_2, Source=bnd_2, Target=dom_3)  # -> Mapped, Clipped
multiplication_3 = Multiplication(A=vec2pt_3.Vector, B=remap.Clipped)
remap_2 = RemapNumbers(Value=min, Source=bnd, Target=dom_2)  # -> Mapped, Clipped
multiplication_4 = Multiplication(A=vec2pt_2.Vector, B=remap_2.Clipped)
multiplication_5 = Multiplication(A=multiplication_3, B=-1)
move_3 = Move(Geometry=avr, Motion=multiplication_4)  # -> Geometry, Transform
vdisex = VectorDisplayEx(Point=avr, Vector=multiplication_4, Colour=RGB(0, 0, 0), Width=2)
move_4 = Move(Geometry=avr_2, Motion=multiplication_5)  # -> Geometry, Transform
shift_5 = ShiftList(List=crv_6, Shift="1", Wrap=toggle_4)  # -> simplify(graft(List))
shift_6 = ShiftList(List=crv_5, Shift="1", Wrap=toggle_3)  # -> simplify(graft(List))
shift_7 = ShiftList(List=crv_5, Shift="-1", Wrap=toggle_3)  # -> simplify(graft(List))
shift_8 = ShiftList(List=crv_6, Shift="-1", Wrap=toggle_4)  # -> simplify(graft(List))
vdisex_2 = VectorDisplayEx(Point=avr_2, Vector=multiplication_5, Colour=RGB(0, 0, 0), Width=2)
pshift_5 = ShiftPaths(Data=move_3.Geometry, Offset=-1)  # -> simplify(Data)
pshift_6 = ShiftPaths(Data=move_4.Geometry, Offset=-1)  # -> simplify(Data)
flip_7 = FlipMatrix(Data=pshift_5)
flip_8 = FlipMatrix(Data=pshift_6)

# ---- group: bottom curves
intcrv_5 = Interpolate(Vertices=flip_8, Degree=3, Periodic=False, KnotStyle=1)  # -> simplify(graft(Curve)), Length, Domain

intcrv_6 = Interpolate(Vertices=flip_7, Degree=3, Periodic=False, KnotStyle=1)  # -> simplify(graft(Curve)), Length, Domain

# ----
merge_3 = Merge(Data1=shift_8, Data2=shift_5)
merge_4 = Merge(Data1=shift_7, Data2=shift_6)
merge_5 = Merge(Data1=intcrv_6.Curve, Data2=shift_7)
merge_6 = Merge(Data1=intcrv_5.Curve, Data2=shift_8)

# ----
# right
# top surf
# left surf
# right surf
# left
# top surf
# left surf
# right surf
loft = Loft(Curves=merge_3, Options={Adjust=False, Closed=False, LoftEnds=0, LoftSimp=0, LoftType=0, Rebuild=10, Refit=0.01})
loft_2 = Loft(Curves=merge_6, Options={Adjust=False, Closed=False, LoftEnds=0, LoftSimp=0, LoftType=0, Rebuild=10, Refit=0.01})
loft_3 = Loft(
    Curves=[shift_5, intcrv_5.Curve],
    Options={Adjust=False, Closed=False, LoftEnds=0, LoftSimp=0, LoftType=0, Rebuild=10, Refit=0.01})
loft_4 = Loft(
    Curves=[shift_6, intcrv_6.Curve],
    Options={Adjust=False, Closed=False, LoftEnds=0, LoftSimp=0, LoftType=0, Rebuild=10, Refit=0.01})
loft_5 = Loft(Curves=merge_5, Options={Adjust=False, Closed=False, LoftEnds=0, LoftSimp=0, LoftType=0, Rebuild=10, Refit=0.01})
loft_6 = Loft(Curves=merge_4, Options={Adjust=False, Closed=False, LoftEnds=0, LoftSimp=0, LoftType=0, Rebuild=10, Refit=0.01})

merge_7 = Merge(Data1=loft, Data2=loft_3, Data3=loft_2)

merge_8 = Merge(Data1=loft_6, Data2=loft_4, Data3=loft_5)
entwine = Entwine(Branch0X=merge_8, Branch1X=merge_7, FlattenInputs=False)
srf_5 = Surface(entwine)

previewmat = CustomPreviewMaterials(Geometry=merge_8, DiffuseColor=RGB(255, 255, 255))
previewmat_2 = CustomPreviewMaterials(Geometry=merge_7, DiffuseColor=RGB(255, 255, 255))

# ----
# tag surfaces
srf_6 = Surface(entwine)
lng_3 = ListLength(List=srf_6)
viewer = ParamViewer(srf_6)
series = Series(Start=0, Step=1, Count=lng_3)
pt = Point(Point(0.5, 0.5, 0))
int_3 = Integer(flatten(series))
evalsrf = EvaluateSurface(Surface=reparameterize(flatten(srf_6)), Point=pt)  # -> Point, Normal, Frame
concat = Concatenate(FragmentA=viewer, FragmentB=int_3)
tag = TextTag3D(
    Location=evalsrf.Point,
    Text=concat,
    Size=Slider(5.435, range=0..100),
    Colour=ColourSwatch(SwatchColor=RGB(255, 82, 82)),
    Justification=5)

viewer_2 = ParamViewer(srf_5)
unroller = Unroller()  # -> Brep, Curves, Points
pshift_7 = ShiftPaths(Offset=-1)
lng_4 = ListLength(List=flatten(pshift_7))  # -> expr("x-1", Length)
pshift_8 = ShiftPaths(Offset=-1)
lng_5 = ListLength(List=flatten(pshift_8))  # -> expr("x-1", Length)
range_3 = Range(Domain=Slider(1252.48, range=0..1500), Steps=lng_4)
range_4 = Range(Domain=Slider(1139.98, range=0..1500), Steps=lng_5)
Y = UnitY(Factor=Slider(579.459, range=0..1500))
path_mapper = PathMapper(range_3, source="{A;B}(i)", target="{A;floor(i/3)}")
X = UnitX(Factor=simplify(path_mapper))
path_mapper_2 = PathMapper(range_4, source="{A;B}(i)", target="{A;floor(i/3)}")
X_2 = UnitX(Factor=simplify(path_mapper_2))
addition_2 = Addition(A=X, B=Y)
move_5 = Move(Geometry=pshift_7, Motion=addition_2)  # -> Geometry, Transform
move_6 = Move(Geometry=pshift_8, Motion=X_2)  # -> Geometry, Transform
entwine_2 = Entwine(Branch0X=move_6.Geometry, Branch1X=move_5.Geometry, FlattenInputs=False)
srf_7 = Surface(reparameterize(entwine_2))
adjust_orient = AdjustOrient(srf=srf_7)

srf_8 = Surface(adjust_orient)
lng_6 = ListLength(List=srf_8)
viewer_3 = ParamViewer(srf_8)
series_2 = Series(Start=0, Step=1, Count=lng_6)
pt_2 = Point(Point(0.5, 0.5, 0))
int_4 = Integer(flatten(series_2))
evalsrf_2 = EvaluateSurface(Surface=reparameterize(flatten(srf_8)), Point=pt_2)  # -> Point, Normal, Frame
concat_2 = Concatenate(FragmentA=viewer_3, FragmentB=int_4)
tag_2 = TextTag3D(
    Location=evalsrf_2.Point,
    Text=concat_2,
    Size=Slider(5.435, range=0..100),
    Colour=ColourSwatch(SwatchColor=RGB(255, 82, 82)),
    Justification=5)

srf_9 = Surface(adjust_orient)
srf_10 = Surface(<surface referenced from the Rhino model>)
srf_11 = Surface(<surface referenced from the Rhino model>)
bbx_2 = BrepBrep(BrepA=srf_11, BrepB=srf_10)  # -> reparameterize(Curves), Points
eval_5 = EvaluateCurve(Curve=bbx_2.Curves, Parameter=Slider(0.225, range=0..1))  # -> Point, Tangent, Angle
srf_12 = Surface(<surface referenced from the Rhino model>)
divide_11 = DivideCurve(Curve=bbx_2.Curves, Count=Slider(11, range=1..20), Kinks=False)  # -> Points, Tangents, Parameters
srf_13 = Surface(<surface referenced from the Rhino model>)
mesh_uv = MeshSurface(Surface=srf_12, UCount=5, VCount=5, Overhang=True, Equalize=False)

# ---- group: offset
number_slider_10 = Slider(0.009, range=0..0.01)
cull_i_2 = CullIndex(List=divide_11.Points, Indices=[Slider(0, range=0..20), Slider(11, range=0..11)], Wrap=True)
crv_cp_4 = CurveClosestPoint(Point=cull_i_2, Curve=bbx_2.Curves)  # -> Point, Parameter, Distance
addition_3 = Addition(A=crv_cp_4.Parameter, B=number_slider_10)
subtraction_3 = Subtraction(A=crv_cp_4.Parameter, B=number_slider_10)
eval_6 = EvaluateCurve(Curve=bbx_2.Curves, Parameter=subtraction_3)  # -> Point, Tangent, Angle
eval_7 = EvaluateCurve(Curve=bbx_2.Curves, Parameter=addition_3)  # -> Point, Tangent, Angle

# ----
mesh_uv_2 = MeshSurface(Surface=srf_13, UCount=5, VCount=5, Overhang=True, Equalize=False)
Z_7 = UnitZ(Factor=1)
xy = XYPlane(Origin=[eval_7.Point, eval_6.Point])
pl = ConstructPlane(Origin=[eval_7.Point, eval_6.Point], XAxis=Z_7, YAxis=Vector(0, 1, 0))
rotate = Rotate(Geometry=pl, Angle=degrees("90"), Plane=xy)  # -> Geometry, Transform
sec = BrepPlane(Brep=srf_13, Plane=rotate.Geometry)  # -> Curves, Points
sec_2 = BrepPlane(Brep=srf_12, Plane=rotate.Geometry)  # -> Curves, Points
crv_7 = Curve(reparameterize(sec.Curves))
eval_8 = EvaluateCurve(Curve=crv_7, Parameter=Slider(0.44, range=0..1))  # -> Point, Tangent, Angle

merge_9 = Merge(Data1=eval_7.Point, Data2=eval_6.Point)
ln = Line(StartPoint=graft(merge_9), EndPoint=graft(eval_8.Point))
partition = PartitionList(List=flatten(ln), Size="10")
flip_9 = FlipMatrix(Data=partition)
loft_7 = Loft(Curves=flip_9, Options={Adjust=False, Closed=False, LoftEnds=0, LoftSimp=0, LoftType=0, Rebuild=10, Refit=0.01})

number_slider_11 = Slider(5, range=0..10)
xy_2 = XYPlane(Origin=eval_8.Point)
crv_8 = Curve(crv_6)
crv_9 = Curve(crv_5)
panel = Panel("""0
-1""")
ppx = PlanePlane(PlaneA=rotate.Geometry, PlaneB=xy_2)
cull_i_3 = CullIndex(List=crv_9, Indices=panel, Wrap=True)
cull_i_4 = CullIndex(List=crv_8, Indices=panel, Wrap=True)
merge_10 = Merge(Data1=cull_i_3, Data2=cull_i_4)  # -> graft(Result)
clx = CurveLine(Curve=sec_2.Curves, Line=ppx)  # -> Points, Params, Count

shift_9 = ShiftList(List=clx.Points, Shift=1, Wrap=True)  # disabled
pline_3 = PolyLine(Vertices=flatten(clx.Points), Closed=False)  # disabled
number_slider_12 = Slider(17.5, range=0..20)  # disabled
vec2pt_4 = Vector2Pt(PointA=clx.Points, PointB=shift_9, Unitize=False)  # -> Vector, Length; disabled
number_slider_13 = Slider(0.421, range=0..1)  # disabled
division = Division(A=vec2pt_4.Length, B=number_slider_13)  # disabled
vdisex_3 = VectorDisplayEx(Point=clx.Points, Vector=vec2pt_4.Vector, Colour=RGB(0, 0, 0), Width=number_slider_12)  # disabled
amp = Amplitude(Vector=vec2pt_4.Vector, Amplitude=division)  # disabled
move_7 = Move(Geometry=clx.Points, Motion=amp)  # -> Geometry, Transform; disabled

ln_2 = Line(StartPoint=flatten(eval_8.Point), EndPoint=flatten(clx.Points))  # -> graft(Line)
number_slider_14 = Slider(10, range=0..10)
partition_2 = PartitionList(List=flatten(ln_2), Size="10")
ssln = SubSetWithLengthN(
    Data=ln_2,
    Integer=2,
    Boolean=False,
    Data_2=ln_2,
    Integer_2=2,
    Boolean_2=False,
    Start=0,
    Step=ssln.Integer,
    Count=ssln.Stream,
    DomainStart=ssln.Series,
    DomainEnd=expr("x-1", ssln.Result),
    A=ssln.Series,
    B=ssln.Integer,
    List=ssln.Data,
    List_2=ssln.Data,
    Interval=ssln.Domain,
    Cycle=False,
    A_2=ssln.Length,
    B_2=ssln.Integer,
    SubSetLength=ssln.Integer,
    Data_3=ssln.Data,
    Number=expr("Ceiling(x)", ssln.Result),
    Gate=ssln.Boolean,
    Stream0=ssln.Number,
    Stream1=ssln.Result,
    A_3=ssln.Length,
    B_3=ssln.Integer,
    CullRemainder=ssln.Boolean,
    List_3=ssln.List,
    Index=ssln.Index,
    InternalDocument_plugin_version=(0, 9, 76),
    InternalDocument_DocumentHeader_PreviewMeshType=1,
    InternalDocument_DocumentHeader_PreviewNormal=RGBA(150, 0, 0, 100),
    InternalDocument_DocumentHeader_PreviewSelected=RGBA(0, 120, 0, 100),
    InternalDocument_DefinitionProperties_Projection_Zoom=0.8000000119)  # -> List, Index, List_2, Index_2
flip_10 = FlipMatrix(Data=partition_2)
# right
# left surf
loft_8 = Loft(
    Curves=[shift_6, intcrv_6.Curve],
    Options={Adjust=False, Closed=False, LoftEnds=0, LoftSimp=0, LoftType=0, Rebuild=10, Refit=0.01})
# right surf
loft_9 = Loft(Curves=merge_5, Options={Adjust=False, Closed=False, LoftEnds=0, LoftSimp=0, LoftType=0, Rebuild=10, Refit=0.01})
# right surf
loft_10 = Loft(Curves=merge_6, Options={Adjust=False, Closed=False, LoftEnds=0, LoftSimp=0, LoftType=0, Rebuild=10, Refit=0.01})
# left
# left surf
loft_11 = Loft(
    Curves=[shift_5, intcrv_5.Curve],
    Options={Adjust=False, Closed=False, LoftEnds=0, LoftSimp=0, LoftType=0, Rebuild=10, Refit=0.01})

merge_11 = Merge(Data1=eval_7.Point, Data2=eval_6.Point)
ln_3 = Line(StartPoint=merge_11, EndPoint=flatten(clx.Points))
partition_3 = PartitionList(List=flatten(ln_3), Size="10")
flip_11 = FlipMatrix(Data=partition_3)
loft_12 = Loft(Curves=flip_11, Options={Adjust=False, Closed=False, LoftEnds=0, LoftSimp=0, LoftType=0, Rebuild=10, Refit=0.01})

panel_2 = Panel(partition_2)
loft_13 = Loft(Curves=flip_10, Options={Adjust=False, Closed=False, LoftEnds=0, LoftSimp=0, LoftType=0, Rebuild=10, Refit=0.01})
shift_10 = ShiftList(List=flatten(loft_8), Shift="-1", Wrap=False)
shift_11 = ShiftList(List=flatten(loft_9), Shift="1", Wrap=False)
shift_12 = ShiftList(List=flatten(loft_11), Shift="-1", Wrap=False)
shift_13 = ShiftList(List=flatten(loft_10), Shift="1", Wrap=False)
merge_12 = Merge(Data1=graft(shift_12), Data2=graft(shift_13))
merge_13 = Merge(Data1=graft(shift_10), Data2=graft(shift_11))

# ---- group: mid axis
crv_10 = Curve(reparameterize(<curve referenced from the Rhino model>))

# ----
entwine_3 = Entwine(Branch0X=simplify(merge_13), Branch1X=simplify(merge_12), FlattenInputs=False)
pi = Pi(Factor=1)
number_slider_15 = Slider(8, range=0..10)
# left
# top surf
loft_14 = Loft(Curves=merge_3, Options={Adjust=False, Closed=False, LoftEnds=0, LoftSimp=0, LoftType=0, Rebuild=10, Refit=0.01})
# right surf
loft_15 = Loft(Curves=merge_6, Options={Adjust=False, Closed=False, LoftEnds=0, LoftSimp=0, LoftType=0, Rebuild=10, Refit=0.01})
# left surf
loft_16 = Loft(
    Curves=[shift_5, intcrv_5.Curve],
    Options={Adjust=False, Closed=False, LoftEnds=0, LoftSimp=0, LoftType=0, Rebuild=10, Refit=0.01})
item = ListItem(List=entwine_3, Index=0, Wrap=True)  # -> Item, Item1
item_2 = ListItem(List=flatten(loft_8), Index="-1", Wrap=True)
item_3 = ListItem(List=flatten(loft_10), Index=0, Wrap=True)
merge_14 = Merge(Data1=item_2, Data2=item_3)
number_slider_16 = Slider(2, range=0..10)
Y_2 = UnitY(Factor=Slider(35.958, range=0..100))
multiplication_6 = Multiplication(A="70", B="100")

# ----
# reparametrize + graft
# sub-list takes only the elements
# up to index 1
# another way of reversing lists
# or we can use a split list
# since we'll need also the
# other curves
edges = BrepEdges(Brep=srf_9)  # -> Naked, Interior, NonManifold
# create jigsaw contours
len = Length(Curve=edges.Naked)
sort = SortList(Keys=len, ValuesA=edges.Naked)  # -> Keys, reverse(ValuesA)
split = SplitList(List=sort.ValuesA, Index="2")  # -> ListA, ListB
subset = SubList(List=sort.ValuesA, Domain="1", Wrap=True)  # -> List, Index
crv_11 = Curve(reparameterize(graft(split.ListA)))
jig_length = Slider(4, range=0..10)
len_2 = Length(Curve=crv_11)
division_2 = Division(A=len_2, B=jig_length)
int_5 = Integer(division_2)
divide_12 = DivideCurve(Curve=crv_11, Count=int_5, Kinks=False)  # -> Points, Tangents, Parameters
Z_8 = UnitZ(Factor=1)
shatter = Shatter(Curve=crv_11, Parameters=divide_12.Parameters)
xprod = CrossProduct(VectorA=divide_12.Tangents, VectorB=Z_8, Unitize=False)  # -> Vector, Length
bishift = DoubleShift(list=simplify(xprod.Vector), wrap=Toggle(False))  # -> graft(no_last), graft(no_first)
avr_3 = Average(Input=[bishift.no_last, bishift.no_first])
pshift_9 = ShiftPaths(Data=avr_3, Offset=-1)
dispatch = Dispatch(List=pshift_9, DispatchPattern=[True, False])  # -> ListA, ListB
dispatch_2 = Dispatch(List=shatter, DispatchPattern=[True, False])  # -> ListA, ListB
move_8 = Move(Geometry=dispatch_2.ListA, Motion=dispatch.ListA)  # -> Geometry, Transform
curvepoint = PointOnCurve(move_8.Geometry, parameter=0.5)
scale = Scale(Geometry=move_8.Geometry, Center=curvepoint, Factor=Slider(1.1, range=1..1.2))  # -> Geometry, Transform
end = EndPoints(Curve=dispatch_2.ListA)  # -> Start, End
end_2 = EndPoints(Curve=scale.Geometry)  # -> Start, End
ln_4 = Line(StartPoint=end.Start, EndPoint=end_2.Start)
ln_5 = Line(StartPoint=end.End, EndPoint=end_2.End)
merge_15 = Merge(Data1=dispatch_2.ListB, Data2=ln_4, Data3=scale.Geometry, Data4=ln_5)
crv_12 = Curve(simplify(split.ListB))
pshift_10 = ShiftPaths(Data=merge_15, Offset=-1)

pshift_11 = ShiftPaths(Data=simplify(pshift_10), Offset=-1)
merge_16 = Merge(Data1=pshift_11, Data2=crv_12)
join = JoinCurves(Curves=merge_16, Preserve=False)  # -> simplify(Curves)

viewer_4 = ParamViewer(join)
previewlw = CustomPreviewLineweights(Geometry=join, Shader=ColourSwatch(SwatchColor=RGB(255, 255, 255)), Thickness=Slider(2, range=1..3), Absolute=False)

# ----
# connection frames
number_slider_17 = Slider(0.475, range=0..1)
panel_3 = Panel("""0
-1""")
# beam2beam connectors
panel_4 = Panel("""0
-1""")
item_4 = ListItem(List=crv_5, Index=-1, Wrap=True)
cull_i_5 = CullIndex(List=crv_6, Indices=panel_3, Wrap=True)
cull_i_6 = CullIndex(List=crv_5, Indices=panel_4, Wrap=True)
item_5 = ListItem(List=crv_6, Index=0, Wrap=True)
eval_9 = EvaluateCurve(Curve=crv_5, Parameter=number_slider_17)  # -> Point, Tangent, Angle
item_6 = ListItem(List=eval_9.Point, Index=-1, Wrap=True)
crv_cp_5 = CurveClosestPoint(Point=item_6, Curve=item_5)  # -> Point, Parameter, Distance
shatter_2 = Shatter(Curve=cull_i_6, Parameters=number_slider_17)
shatter_3 = Shatter(Curve=cull_i_5, Parameters=crv_cp_5.Parameter)
dispatch_3 = Dispatch(List=shatter_2, DispatchPattern=[True, False])  # -> ListA, ListB
flip_12 = FlipCurve(Curve=dispatch_3.ListA)  # -> Curve, Flag
dispatch_4 = Dispatch(List=shatter_3, DispatchPattern=[True, False])  # -> ListA, ListB
number_slider_18 = Slider(0.5, range=0..1)
flip_13 = FlipCurve(Curve=dispatch_4.ListA)  # -> Curve, Flag
weave = Weave(Pattern=[0, 1], Stream0=dispatch_3.ListB, Stream1=flip_12.Curve, NullGaps=False)
len_3 = Length(Curve=weave)
weave_2 = Weave(Pattern=[0, 1], Stream0=dispatch_4.ListB, Stream1=flip_13.Curve, NullGaps=False)
division_3 = Division(A=len_3, B=number_slider_18)
range_5 = Range(Domain=Domain(0, 1), Steps=Slider(5, range=2..8))
int_6 = Integer(division_3)
cull_i_7 = CullIndex(List=range_5, Indices=-1, Wrap=True)
divlength = DivideLength(Curve=weave_2, Length=number_slider_18)  # -> Points, Tangents, Parameters
divlength_2 = DivideLength(Curve=weave, Length=number_slider_18)  # -> Points, Tangents, Parameters
graph_3 = GraphMapper(
    cull_i_7,
    x0=0,
    x1=1,
    y0=0,
    y1=1,
    container_name="Bezier",
    cpx=[0, 0.2869572341, 0.6637688279, 1],
    cpy=[0, 0.4768119454, 0.9695655704, 1])
number_slider_19 = Slider(0.03, range=0..1)
pframe = PerpFrame(Curve=reparameterize(graft(weave)), Parameter=graph_3)
pframe_2 = PerpFrame(Curve=reparameterize(graft(weave_2)), Parameter=graph_3)
eval_10 = EvaluateCurve(Curve=reparameterize(graft(weave)), Parameter=graph_3)  # -> Point, Tangent, Angle
eval_11 = EvaluateCurve(Curve=reparameterize(graft(weave_2)), Parameter=graph_3)  # -> Point, Tangent, Angle
Z_9 = UnitZ(Factor=1)
subtraction_4 = Subtraction(A="1", B=number_slider_19)
item_7 = ListItem(List=crv_6, Index=0, Wrap=True)
align = AlignPlane(Plane=pframe, Direction=Z_9)  # -> Plane, Angle
merge_17 = Merge(Data1=number_slider_19, Data2=subtraction_4)
align_2 = AlignPlane(Plane=pframe_2, Direction=Z_9)  # -> Plane, Angle
pframe_3 = PerpFrame(Curve=reparameterize(graft(item_7)), Parameter=merge_17)
pframe_4 = PerpFrame(Curve=item_4, Parameter=number_slider_17)
pshift_12 = ShiftPaths(Data=align_2.Plane, Offset=-1)
pshift_13 = ShiftPaths(Data=align.Plane, Offset=-1)
dam = DataDam(DataA=merge_8, BufferDelay=10000000, BufferMode=0)
align_3 = AlignPlane(Plane=pframe_4, Direction=Z_9)  # -> Plane, Angle
align_4 = AlignPlane(Plane=pframe_3, Direction=Z_9)  # -> Plane, Angle

cull_i_8 = CullIndex(List=pshift_12, Indices=0, Wrap=True)
cull_i_9 = CullIndex(List=pshift_13, Indices=0, Wrap=True)

lng_7 = ListLength(List=flatten([cull_i_9, cull_i_8, align_3.Plane, align_4.Plane]))
sec_3 = BrepPlane(Brep=graft(dam), Plane=flatten(cull_i_9))  # -> Curves, Points; disabled

pln = Plane([cull_i_9, cull_i_8, align_3.Plane, align_4.Plane])
sph = Sphere(Base=pln, Radius=number_slider_11)  # -> flatten(Sphere)
bcx = BrepCurve(Brep=sph, Curve=merge_10)  # -> Curves, Points
pshift_14 = ShiftPaths(Data=bcx.Points, Offset=-1)
crv_cp_6 = CurveClosestPoint(Point=pshift_14, Curve=merge_10)  # -> Point, Parameter, Distance
sort_2 = SortList(Keys=crv_cp_6.Parameter)  # -> Keys, ValuesA
pframe_5 = PerpFrame(Curve=merge_10, Parameter=sort_2.Keys)

# ----
# parameter t
panel_5 = Panel("{0;0;<3}")
split_2 = SplitTree(Data=sort_2.Keys, Masks=flatten(panel_5))  # -> Positive, Negative
viewer_5 = ParamViewer(split_2.Negative)
branch = TreeBranch(Tree=split_2.Negative, Path=viewer_5, MaintainPaths=False)
entwine_4 = Entwine(Branch0X=simplify(split_2.Positive), Branch1X=simplify(branch), FlattenInputs=False)

# ----
# frames
panel_6 = Panel("{0;0;<3}")
split_3 = SplitTree(Data=pframe_5, Masks=flatten(panel_6))  # -> Positive, Negative
viewer_6 = ParamViewer(split_3.Negative)
branch_2 = TreeBranch(Tree=split_3.Negative, Path=viewer_6, MaintainPaths=False)
entwine_5 = Entwine(Branch0X=simplify(split_3.Positive), Branch1X=simplify(branch_2), FlattenInputs=False)

merge_18 = Merge(Data1=align_3.Plane, Data2=align_4.Plane)
sph_2 = Sphere(Base=merge_18, Radius=number_slider_11)  # -> flatten(Sphere)
bcx_2 = BrepCurve(Brep=sph_2, Curve=crv_10)  # -> Curves, Points
multiplication_7 = Multiplication(A=entwine_4, B=pi)
sin = Sine(Value=multiplication_7)
multiplication_8 = Multiplication(A=sin, B=Slider(4, range=0..10))
crv_cp_7 = CurveClosestPoint(Point=flatten(bcx_2.Points), Curve=crv_10)  # -> Point, Parameter, Distance
addition_4 = Addition(A=number_slider_15, B=multiplication_8)
cir = Circle(Plane=entwine_5, Radius=addition_4)
bar_graph_3 = BarGraph(addition_4, BarColor=RGB(255, 0, 90))
sort_3 = SortList(Keys=crv_cp_7.Parameter)  # -> Keys, ValuesA
dispatch_5 = Dispatch(List=sort_3.Keys, DispatchPattern=[True, False])  # -> ListA, ListB
panel_7 = Panel(addition_4)
merge_19 = Merge(Data1=graft(dispatch_5.ListA), Data2=graft(dispatch_5.ListB))
bcx_3 = BrepCurve(Brep=item.Item, Curve=cir)  # -> Curves, Points
bcx_4 = BrepCurve(Brep=item.Item1, Curve=cir)  # -> Curves, Points
avr_4 = Average(Input=merge_19)  # -> flatten(ArithmeticMean)
pframe_6 = PerpFrame(Curve=crv_10, Parameter=merge_19)
dispatch_6 = Dispatch(List=entwine_4, DispatchPattern=[True, False])  # -> ListA, ListB
merge_20 = Merge(Data1=bcx_3.Points, Data2=bcx_4.Points)
pt_3 = Point(graft(entwine_5))
pframe_7 = PerpFrame(Curve=crv_10, Parameter=avr_4)
merge_21 = Merge(Data1=graft(dispatch_6.ListA), Data2=graft(dispatch_6.ListB))
merge_22 = Merge(Data1=merge_20, Data2=pt_3)
cir_2 = Circle(Plane=pframe_7, Radius=number_slider_16)
cir_3 = Circle(Plane=pframe_6, Radius=number_slider_15)
avr_5 = Average(Input=merge_21)
bcx_5 = BrepCurve(Brep=merge_14, Curve=graft(cir_3))  # -> Curves, Points
pshift_15 = ShiftPaths(Data=avr_5, Offset=-1)
pline_4 = PolyLine(Vertices=merge_22, Closed=True)
pshift_16 = ShiftPaths(Data=bcx_5.Points, Offset=-1)
pt_4 = Point(graft(pframe_6))
pframe_8 = PerpFrame(Curve=merge_10, Parameter=pshift_15)

path_mapper_3 = PathMapper(pline_4, source="{A;B}", target="{A}")
pshift_17 = ShiftPaths(Data=pline_4, Offset=-1)

merge_23 = Merge(Data1=pt_4, Data2=pshift_16)
cir_4 = Circle(Plane=pframe_8, Radius=number_slider_16)
dispatch_7 = Dispatch(List=pshift_17, DispatchPattern=[True, False])  # -> ListA, ListB
pline_5 = PolyLine(Vertices=merge_23, Closed=True)
viewer_7 = ParamViewer(dispatch_7.ListA)
pshift_18 = ShiftPaths(Data=pline_5, Offset=-1)
merge_24 = Merge(Data1=graft(dispatch_7.ListA), Data2=graft(dispatch_7.ListB))
viewer_8 = ParamViewer(merge_24)
loft_17 = Loft(Curves=pshift_18, Options={Adjust=False, Closed=False, LoftEnds=0, LoftSimp=0, LoftType=0, Rebuild=10, Refit=0.01})
loft_18 = Loft(Curves=merge_24, Options={Adjust=False, Closed=False, LoftEnds=0, LoftSimp=0, LoftType=0, Rebuild=10, Refit=0.01})
unroller_2 = Unroller(Brep=loft_18)  # -> Brep, Curves, Points
lng_8 = ListLength(List=flatten(loft_17))
lng_9 = ListLength(List=flatten(loft_18))
series_3 = Series(Start=0, Step=Slider(15.662, range=0..100), Count=lng_8)
series_4 = Series(Start=0, Step=Slider(15.662, range=0..100), Count=lng_9)
unroller_3 = Unroller(Brep=loft_17)  # -> Brep, Curves, Points
X_3 = UnitX(Factor=graft(series_3))
X_4 = UnitX(Factor=graft(series_4))
addition_5 = Addition(A=X_3, B=Y_2)
move_9 = Move(Geometry=unroller_3.Brep, Motion=addition_5)  # -> Geometry, Transform
move_10 = Move(Geometry=unroller_2.Brep, Motion=X_4)  # -> Geometry, Transform
area = Area(Geometry=[move_9.Geometry, move_10.Geometry])  # -> Area, Centroid
ma = MassAddition(Input=flatten(area.Area))  # -> Result, PartialResults
subtraction_5 = Subtraction(A=multiplication_6, B=ma.Result)
panel_8 = Panel(subtraction_5)

resolution = Slider(190, range=2..200)
divide_13 = DivideCurve(Curve=intcrv_5.Curve, Count=resolution, Kinks=False)  # -> Points, Tangents, Parameters
Z_10 = UnitZ(Factor=1)
divide_14 = DivideCurve(Curve=intcrv_6.Curve, Count=resolution, Kinks=False)  # -> Points, Tangents, Parameters
line_3 = LineSDL(Start=divide_13.Points, Direction=Z_10, Length=1)
srf_14 = Surface([merge_8, merge_7])
join_2 = BrepJoin(Breps=flatten(loft))  # -> Breps, Closed
area_2 = Area(Geometry=flatten(srf_14))  # -> Area, Centroid
line_4 = LineSDL(Start=divide_14.Points, Direction=Z_10, Length=1)
join_3 = BrepJoin(Breps=flatten(loft_6))  # -> Breps, Closed
blx = BrepLine(Brep=join_2.Breps, Line=line_3, LimitToFirst=False)  # -> Curves, Points
blx_2 = BrepLine(Brep=join_3.Breps, Line=line_4, LimitToFirst=False)  # -> Curves, Points
sheet_area_mq = Panel("0.7")
ma_2 = MassAddition(Input=area_2.Area)  # -> Result, PartialResults
ln_6 = Line(StartPoint=graft(divide_13.Points), EndPoint=blx.Points)
dist = Distance(PointA=graft(divide_13.Points), PointB=blx.Points)  # -> flatten(Distance)
# counts
dist_2 = Distance(PointA=graft(divide_14.Points), PointB=blx_2.Points)  # -> flatten(Distance)
ln_7 = Line(StartPoint=graft(divide_14.Points), EndPoint=blx_2.Points)
extremums = MinMax(Number=[dist_2, dist])  # -> Minimum, Maximum
min_max_depth_cm = Panel([extremums.Minimum, extremums.Maximum])

multiplication_9 = Multiplication(A=ma_2.Result, B=0.0001)

multiplication_10 = Multiplication(A=multiplication_9, B=2)
division_4 = Division(A=multiplication_10, B=sheet_area_mq)
# deviation
int_7 = Integer(division_4)
total_area_sqm = Panel(multiplication_9)
n_of_sheets = Panel(int_7)

area_3 = Area(Geometry=flatten(merge_7))  # -> Area, Centroid
area_4 = Area(Geometry=flatten(pshift_7))  # -> Area, Centroid
area_5 = Area(Geometry=flatten(merge_8))  # -> Area, Centroid
area_6 = Area(Geometry=flatten(pshift_8))  # -> Area, Centroid
subtraction_6 = Subtraction(A=area_3.Area, B=area_4.Area)
lng_10 = ListLength(List=area_3.Centroid)
lng_11 = ListLength(List=area_5.Centroid)
subtraction_7 = Subtraction(A=area_5.Area, B=area_6.Area)
series_5 = Series(Start=0, Step=1, Count=lng_10)
abs = Absolute(Value=subtraction_6)
abs_2 = Absolute(Value=subtraction_7)
series_6 = Series(Start=0, Step=1, Count=lng_11)
division_5 = Division(A=abs, B=area_3.Area)
division_6 = Division(A=abs_2, B=area_5.Area)
multiplication_11 = Multiplication(A=division_5, B=100)
multiplication_12 = Multiplication(A=division_6, B=100)
panel_9 = Panel(multiplication_12)
panel_10 = Panel(multiplication_11)
tag_3 = TextTag3D(Location=area_3.Centroid, Text=series_5, Size=Slider(2.399, range=0..100), Justification=7)
tag_4 = TextTag3D(Location=area_5.Centroid, Text=series_6, Size=Slider(2.399, range=0..100), Justification=7)
bar_graph_4 = BarGraph(multiplication_12, BarColor=RGB(255, 0, 90))
bar_graph_5 = BarGraph(multiplication_11, BarColor=RGB(255, 0, 90))

bnd_3 = Bounds(Numbers=[subtraction_6, subtraction_7])

remap_3 = RemapNumbers(Value=subtraction_6, Source=bnd_3, Target=Domain(0, 1))  # -> Mapped, Clipped
remap_4 = RemapNumbers(Value=subtraction_7, Source=bnd_3, Target=Domain(0, 1))  # -> Mapped, Clipped
gradient = Gradient(LowerLimit=0, UpperLimit=1, Parameter=remap_3.Mapped, stops=[0: RGB(255, 0, 0), 1: RGB(255, 255, 255)])
gradient_2 = Gradient(LowerLimit=0, UpperLimit=1, Parameter=remap_4.Mapped, stops=[0: RGB(255, 0, 0), 1: RGB(255, 255, 255)])
previewmat_3 = CustomPreviewMaterials(Geometry=flatten(merge_8), DiffuseColor=gradient_2)
previewmat_4 = CustomPreviewMaterials(Geometry=flatten(merge_7), DiffuseColor=gradient)

# ==== cluster DoubleShift: Shifts a list +1 and -1, wrap option available
list = ClusterInput()
wrap = ClusterInput()
shift = ShiftList(List=list, Shift=1, Wrap=wrap)
shift_2 = ShiftList(List=list, Shift="-1", Wrap=wrap)
no_last = ClusterOutput(shift_2)
no_first = ClusterOutput(shift)

# ==== cluster AdjustOrient
srf = ClusterInput()
srf_2 = Surface(reparameterize(srf))
pt = Point(Point(0.5, 0.5, 0))
evalsrf = EvaluateSurface(Surface=srf_2, Point=pt)  # -> Point, Normal, Frame
Z = UnitZ(Factor=1)
angle = Angle(VectorA=evalsrf.Normal, VectorB=Z)  # -> Angle, Reflex
larger = LargerThan(FirstNumber=angle.Angle, SecondNumber=0.0001)  # -> LargerThan, OrEqualTo
dispatch = Dispatch(List=evalsrf.Point, DispatchPattern=larger.LargerThan)  # -> ListA, ListB
dispatch_2 = Dispatch(List=srf_2, DispatchPattern=larger.LargerThan)  # -> ListA, ListB
X = UnitX(Factor=1)
rot3d = Rotate3D(Geometry=dispatch_2.ListA, Angle="Pi", Center=dispatch.ListA, Axis=X)  # -> Geometry, Transform
weave = Weave(Pattern=larger.LargerThan, Stream0=dispatch_2.ListB, Stream1=rot3d.Geometry, NullGaps=False)
W = ClusterOutput(weave)
