# Grasshopper definition Relief final geometry 20160514_02.gh (Grasshopper 0.9.76)
# Copyright: Co-de-iT
# plug-ins: Heteroptera, Unroller, Human

shorten = Slider(0, range=0..0.4)
subtraction = Subtraction(A=1, B=shorten)
dom = ConstructDomain(DomainStart=shorten, DomainEnd=subtraction)
# curves_right
crv = Curve(reparameterize([<curve referenced from the Rhino model> x2]))
# curves_left
crv_2 = Curve(reparameterize([<curve referenced from the Rhino model> x2]))
sampling = Slider(20, range=2..200)
fill_curves = Slider(4, range=2..50)

# ---- group: medial axis
crv_3 = Curve(<curve referenced from the Rhino model>)

# ---- group: surface for Z regulation
srf = Surface(<surface referenced from the Rhino model>)

# ----
subcrv = SubCurve(BaseCurve=crv, Domain=dom)
subcrv_2 = SubCurve(BaseCurve=crv_2, Domain=dom)
divide = DivideCurve(Curve=subcrv_2, Count=sampling, Kinks=False)  # -> Points, Tangents, Parameters
flip = FlipMatrix(Data=divide.Points)
pline = PolyLine(Vertices=flip, Closed=False)
divide_2 = DivideCurve(Curve=subcrv, Count=sampling, Kinks=False)  # -> Points, Tangents, Parameters
explode = Explode(Curve=pline, Recursive=True)  # -> Segments, Vertices
flip_2 = FlipMatrix(Data=divide_2.Points)

number_slider = Slider(0.21, range=0..1)  # disabled
crv_4 = Curve(reparameterize(<curve referenced from the Rhino model>))  # disabled
eval = EvaluateCurve(Curve=crv_4, Parameter=number_slider)  # -> Point, Tangent, Angle; disabled
number_slider_2 = Slider(10, range=0..30)  # disabled
divide_3 = DivideCurve(Curve=crv_4, Count=number_slider_2, Kinks=False)  # -> Points, Tangents, Parameters; disabled
vec2pt = Vector2Pt(PointA=flip, PointB=eval.Point, Unitize=False)  # -> Vector, Length; disabled
vdis = VectorDisplay(Anchor=divide_3.Points, Vector=vec2pt.Vector)  # disabled

divide_4 = DivideCurve(Curve=explode.Segments, Count=fill_curves, Kinks=False)  # -> Points, Tangents, Parameters
pline_2 = PolyLine(Vertices=flip_2, Closed=False)
pshift = ShiftPaths(Data=divide_4.Points, Offset=-1)
number_slider_3 = Slider(-16.1, range=-30..0)
number_slider_4 = Slider(-0.161, range=-2..0.001)
number_slider_5 = Slider(-1, range=-100..0)
explode_2 = Explode(Curve=pline_2, Recursive=True)  # -> Segments, Vertices
flip_3 = FlipMatrix(Data=pshift)
lng = ListLength(List=flip_3)  # -> expr("x-1", Length)
range = Range(Domain=Domain(0, 1), Steps=lng)
graph = GraphMapper(range, x0=0, x1=1, y0=0, y1=1, container_name="Sine", Equation_px=[0, 0.5223546624], Equation_py=[0.1705827117, 1])
divide_5 = DivideCurve(Curve=explode_2.Segments, Count=fill_curves, Kinks=False)  # -> Points, Tangents, Parameters
number_slider_6 = Slider(-0.161, range=-2..0.001)
pshift_2 = ShiftPaths(Data=divide_5.Points, Offset=-1)
multiplication = Multiplication(A=graph, B=number_slider_3)
number_slider_7 = Slider(-1, range=-100..0)
flip_4 = FlipMatrix(Data=pshift_2)
lng_2 = ListLength(List=flip_4)  # -> expr("x-1", Length)
range_2 = Range(Domain=Domain(0, 1), Steps=lng_2)
graph_2 = GraphMapper(range_2, x0=0, x1=1, y0=0, y1=1, container_name="Sine", Equation_px=[0, 0.5223546624], Equation_py=[0.1705827117, 1])
Z = UnitZ(Factor=multiplication)
move = Move(Geometry=flip_3, Motion=Z)  # -> Geometry, Transform
multiplication_2 = Multiplication(A=graph_2, B=number_slider_3)
Z_2 = UnitZ(Factor=multiplication_2)
intcrv = Interpolate(Vertices=flip_3, Degree=3, Periodic=False, KnotStyle=1)  # -> flatten(Curve), Length, Domain
intcrv_2 = Interpolate(Vertices=move.Geometry, Degree=3, Periodic=False, KnotStyle=1)  # -> flatten(Curve), Length, Domain
move_2 = Move(Geometry=flip_4, Motion=Z_2)  # -> Geometry, Transform
intcrv_3 = Interpolate(Vertices=flip_4, Degree=3, Periodic=False, KnotStyle=1)  # -> flatten(Curve), Length, Domain
intcrv_4 = Interpolate(Vertices=move_2.Geometry, Degree=3, Periodic=False, KnotStyle=1)  # -> Curve, Length, Domain
srf_2 = Surface(<surface referenced from the Rhino model>)
divide_6 = DivideCurve(Curve=intcrv_3.Curve, Count=10, Kinks=False)  # -> Points, Tangents, Parameters
Z_3 = UnitZ(Factor=1)
Z_4 = UnitZ(Factor=-1)
project = Project(Curve=intcrv_4.Curve, Brep=srf, Direction=Z_3)
Z_5 = UnitZ(Factor=1)
line = LineSDL(Start=divide_6.Points, Direction=Z_4, Length="100")
divide_7 = DivideCurve(Curve=intcrv.Curve, Count=10, Kinks=False)  # -> Points, Tangents, Parameters
Z_6 = UnitZ(Factor=-1)
scx = SurfaceCurve(Surface=srf, Curve=line)  # -> Curves, Points, UVPoints, Normals, Parameters, Tangents
project_2 = Project(Curve=intcrv_2.Curve, Brep=srf_2, Direction=Z_5)
line_2 = LineSDL(Start=divide_7.Points, Direction=Z_6, Length="100")
pshift_3 = ShiftPaths(Data=scx.Points, Offset=-1)
scx_2 = SurfaceCurve(Surface=srf, Curve=line_2)  # -> Curves, Points, UVPoints, Normals, Parameters, Tangents
pshift_4 = ShiftPaths(Data=scx_2.Points, Offset=-1)
nurbs = NurbsCurve(Vertices=pshift_4, Degree=3, Periodic=False)  # -> Curve, Length, Domain
divide_8 = DivideCurve(Curve=nurbs.Curve, Count=10, Kinks=False)  # -> Points, Tangents, Parameters
int = Integer(fill_curves)
nurbs_2 = NurbsCurve(Vertices=pshift_3, Degree=3, Periodic=False)  # -> Curve, Length, Domain
flip_5 = FlipMatrix(Data=divide_8.Points)
int_2 = Integer(fill_curves)
merge = Merge(Data1="0", Data2=int)
merge_2 = Merge(Data1="0", Data2=int_2)
toggle = BooleanToggle(False)
toggle_2 = BooleanToggle(False)
divide_9 = DivideCurve(Curve=nurbs_2.Curve, Count=10, Kinks=False)  # -> Points, Tangents, Parameters
replace = ReplaceItems(List=intcrv.Curve, Item=subcrv_2, Indices=merge, Wrap=False)  # -> flatten(List)
replace_2 = ReplaceItems(List=intcrv_3.Curve, Item=subcrv, Indices=merge_2, Wrap=False)  # -> flatten(List)
flip_6 = FlipMatrix(Data=divide_9.Points)
shift = ShiftList(List=flip_6, Shift="1", Wrap=toggle)  # -> graft(List)
shift_2 = ShiftList(List=flip_5, Shift="1", Wrap=toggle_2)  # -> graft(List)
shift_3 = ShiftList(List=flip_6, Shift="-1", Wrap=toggle)  # -> graft(List)
shift_4 = ShiftList(List=flip_5, Shift="-1", Wrap=toggle_2)  # -> graft(List)
number_slider_8 = Slider(69, range=0..100)

# ---- group: top curves - right
crv_5 = Curve(reparameterize(intcrv_3.Curve))

# ---- group: top curves - left
crv_6 = Curve(reparameterize(intcrv.Curve))

# ----
avr = Average(Input=[shift, shift_3])
avr_2 = Average(Input=[shift_2, shift_4])
vec2pt_2 = Vector2Pt(PointA=shift_3, PointB=shift, Unitize=False)  # -> Vector, Length
crv_cp = CurveClosestPoint(Point=avr, Curve=crv_3)  # -> Point, Parameter, Distance
crv_cp_2 = CurveClosestPoint(Point=avr_2, Curve=crv_3)  # -> Point, Parameter, Distance
vec2pt_3 = Vector2Pt(PointA=shift_4, PointB=shift_2, Unitize=False)  # -> Vector, Length
bar_graph = BarGraph(crv_cp.Distance, BarColor=RGB(255, 0, 90))
bar_graph_2 = BarGraph(crv_cp_2.Distance, BarColor=RGB(255, 0, 90))
min = Minimum(A=crv_cp.Distance, B=number_slider_8)
min_2 = Minimum(A=crv_cp_2.Distance, B=number_slider_8)
bnd = Bounds(Numbers=flatten(min))
bnd_2 = Bounds(Numbers=flatten(min_2))
dom_2 = ConstructDomain(DomainStart=0, DomainEnd=Slider(0.6, range=0..1))
dom_3 = ConstructDomain(DomainStart=0, DomainEnd=Slider(0.6, range=0..1))
toggle_3 = BooleanToggle(False)
toggle_4 = BooleanToggle(False)
remap = RemapNumbers(Value=min_2, Source=bnd_2, Target=dom_3)  # -> Mapped, Clipped
multiplication_3 = Multiplication(A=vec2pt_3.Vector, B=remap.Clipped)
remap_2 = RemapNumbers(Value=min, Source=bnd, Target=dom_2)  # -> Mapped, Clipped
multiplication_4 = Multiplication(A=vec2pt_2.Vector, B=remap_2.Clipped)
multiplication_5 = Multiplication(A=multiplication_3, B=-1)
move_3 = Move(Geometry=avr, Motion=multiplication_4)  # -> Geometry, Transform
vdisex = VectorDisplayEx(Point=avr, Vector=multiplication_4, Colour=RGB(0, 0, 0), Width=2)
move_4 = Move(Geometry=avr_2, Motion=multiplication_5)  # -> Geometry, Transform
shift_5 = ShiftList(List=crv_6, Shift="1", Wrap=toggle_4)  # -> simplify(graft(List))
shift_6 = ShiftList(List=crv_5, Shift="1", Wrap=toggle_3)  # -> simplify(graft(List))
shift_7 = ShiftList(List=crv_5, Shift="-1", Wrap=toggle_3)  # -> simplify(graft(List))
shift_8 = ShiftList(List=crv_6, Shift="-1", Wrap=toggle_4)  # -> simplify(graft(List))
vdisex_2 = VectorDisplayEx(Point=avr_2, Vector=multiplication_5, Colour=RGB(0, 0, 0), Width=2)
pshift_5 = ShiftPaths(Data=move_3.Geometry, Offset=-1)  # -> simplify(Data)
pshift_6 = ShiftPaths(Data=move_4.Geometry, Offset=-1)  # -> simplify(Data)
flip_7 = FlipMatrix(Data=pshift_5)
flip_8 = FlipMatrix(Data=pshift_6)

# ---- group: bottom curves
intcrv_5 = Interpolate(Vertices=flip_8, Degree=3, Periodic=False, KnotStyle=1)  # -> simplify(graft(Curve)), Length, Domain

intcrv_6 = Interpolate(Vertices=flip_7, Degree=3, Periodic=False, KnotStyle=1)  # -> simplify(graft(Curve)), Length, Domain

# ----
merge_3 = Merge(Data1=shift_8, Data2=shift_5)
merge_4 = Merge(Data1=shift_7, Data2=shift_6)
merge_5 = Merge(Data1=intcrv_5.Curve, Data2=shift_8)
merge_6 = Merge(Data1=intcrv_6.Curve, Data2=shift_7)
# left
# top surf
loft = Loft(Curves=merge_3, Options={Adjust=False, Closed=False, LoftEnds=0, LoftSimp=0, LoftType=0, Rebuild=10, Refit=0.01})
# right surf
loft_2 = Loft(Curves=merge_5, Options={Adjust=False, Closed=False, LoftEnds=0, LoftSimp=0, LoftType=0, Rebuild=10, Refit=0.01})
# left surf
loft_3 = Loft(
    Curves=[shift_5, intcrv_5.Curve],
    Options={Adjust=False, Closed=False, LoftEnds=0, LoftSimp=0, LoftType=0, Rebuild=10, Refit=0.01})
# left surf
loft_4 = Loft(
    Curves=[shift_6, intcrv_6.Curve],
    Options={Adjust=False, Closed=False, LoftEnds=0, LoftSimp=0, LoftType=0, Rebuild=10, Refit=0.01})
# right surf
loft_5 = Loft(Curves=merge_6, Options={Adjust=False, Closed=False, LoftEnds=0, LoftSimp=0, LoftType=0, Rebuild=10, Refit=0.01})
# right
# top surf
loft_6 = Loft(Curves=merge_4, Options={Adjust=False, Closed=False, LoftEnds=0, LoftSimp=0, LoftType=0, Rebuild=10, Refit=0.01})
merge_7 = Merge(Data1=loft, Data2=loft_3, Data3=loft_2)

merge_8 = Merge(Data1=loft_6, Data2=loft_4, Data3=loft_5)
entwine = Entwine(Branch0X=merge_8, Branch1X=merge_7, FlattenInputs=False)
srf_3 = Surface(entwine)

# ----
# tag surfaces
srf_4 = Surface(entwine)
lng_3 = ListLength(List=srf_4)
viewer = ParamViewer(srf_4)
series = Series(Start=0, Step=1, Count=lng_3)
pt = Point(Point(0.5, 0.5, 0))
int_3 = Integer(flatten(series))
evalsrf = EvaluateSurface(Surface=reparameterize(flatten(srf_4)), Point=pt)  # -> Point, Normal, Frame
concat = Concatenate(FragmentA=viewer, FragmentB=int_3)
tag = TextTag3D(
    Location=evalsrf.Point,
    Text=concat,
    Size=Slider(5.435, range=0..100),
    Colour=ColourSwatch(SwatchColor=RGB(255, 82, 82)),
    Justification=5)

previewmat = CustomPreviewMaterials(Geometry=merge_8, DiffuseColor=RGB(255, 255, 255))
previewmat_2 = CustomPreviewMaterials(Geometry=merge_7, DiffuseColor=RGB(255, 255, 255))

viewer_2 = ParamViewer(srf_3)
unroller = Unroller(Brep=merge_7)  # -> Brep, Curves, Points
unroller_2 = Unroller(Brep=merge_8)  # -> Brep, Curves, Points
pshift_7 = ShiftPaths(Data=unroller.Brep, Offset=-1)
lng_4 = ListLength(List=flatten(pshift_7))  # -> expr("x-1", Length)
pshift_8 = ShiftPaths(Data=unroller_2.Brep, Offset=-1)
lng_5 = ListLength(List=flatten(pshift_8))  # -> expr("x-1", Length)
range_3 = Range(Domain=Slider(1252.48, range=0..1500), Steps=lng_4)
range_4 = Range(Domain=Slider(1139.98, range=0..1500), Steps=lng_5)
Y = UnitY(Factor=Slider(579.459, range=0..1500))
path_mapper = PathMapper(range_3, source="{A;B}(i)", target="{A;floor(i/3)}")
X = UnitX(Factor=simplify(path_mapper))
path_mapper_2 = PathMapper(range_4, source="{A;B}(i)", target="{A;floor(i/3)}")
X_2 = UnitX(Factor=simplify(path_mapper_2))
addition = Addition(A=X, B=Y)
move_5 = Move(Geometry=pshift_7, Motion=addition)  # -> Geometry, Transform
move_6 = Move(Geometry=pshift_8, Motion=X_2)  # -> Geometry, Transform
entwine_2 = Entwine(Branch0X=move_6.Geometry, Branch1X=move_5.Geometry, FlattenInputs=False)
srf_5 = Surface(reparameterize(entwine_2))
adjust_orient = AdjustOrient(srf=srf_5)

srf_6 = Surface(adjust_orient)
lng_6 = ListLength(List=srf_6)
viewer_3 = ParamViewer(srf_6)
series_2 = Series(Start=0, Step=1, Count=lng_6)
pt_2 = Point(Point(0.5, 0.5, 0))
int_4 = Integer(flatten(series_2))
evalsrf_2 = EvaluateSurface(Surface=reparameterize(flatten(srf_6)), Point=pt_2)  # -> Point, Normal, Frame
concat_2 = Concatenate(FragmentA=viewer_3, FragmentB=int_4)
tag_2 = TextTag3D(
    Location=evalsrf_2.Point,
    Text=concat_2,
    Size=Slider(5.435, range=0..100),
    Colour=ColourSwatch(SwatchColor=RGB(255, 82, 82)),
    Justification=5)

srf_7 = Surface(adjust_orient)
number_slider_9 = Slider(5, range=0..10)
crv_7 = Curve(crv_6)
crv_8 = Curve(crv_5)
panel = Panel("""0
-1""")
cull_i = CullIndex(List=crv_8, Indices=panel, Wrap=True)
cull_i_2 = CullIndex(List=crv_7, Indices=panel, Wrap=True)
merge_9 = Merge(Data1=cull_i, Data2=cull_i_2)  # -> graft(Result)
# right
# top surf
# left surf
srf_8 = Surface(loft_6)
# right surf
srf_9 = Surface(loft_4)
# top surf
# left surf
srf_10 = Surface(loft)
srf_11 = Surface(loft_2)
# left
srf_12 = Surface(loft_5)
# right surf
srf_13 = Surface(loft_3)
shift_9 = ShiftList(List=flatten(srf_13), Shift="-1", Wrap=False)
shift_10 = ShiftList(List=flatten(srf_11), Shift="1", Wrap=False)
shift_11 = ShiftList(List=flatten(srf_9), Shift="-1", Wrap=False)
shift_12 = ShiftList(List=flatten(srf_12), Shift="1", Wrap=False)
merge_10 = Merge(Data1=graft(shift_9), Data2=graft(shift_10))
merge_11 = Merge(Data1=graft(shift_11), Data2=graft(shift_12))
entwine_3 = Entwine(Branch0X=simplify(merge_11), Branch1X=simplify(merge_10), FlattenInputs=False)

# ---- group: mid axis
crv_9 = Curve(reparameterize(<curve referenced from the Rhino model>))

# ----
# all others
item = ListItem(List=entwine_3, Index=0, Wrap=True)  # -> Item, Item1
number_slider_10 = Slider(2, range=0..10)
font = ValueList({"Machine Tool Gothic", "Machine Tool SanSerif"}, selected="Machine Tool Gothic")
Y_2 = UnitY(Factor=Slider(35.958, range=0..100))
multiplication_6 = Multiplication(A="70", B="100")

# ----
# reparametrize + graft
# sub-list takes only the elements
# up to index 1
# another way of reversing lists
# or we can use a split list
# since we'll need also the
# other curves
edges = BrepEdges(Brep=srf_7)  # -> Naked, Interior, NonManifold
# create jigsaw contours
len = Length(Curve=edges.Naked)
sort = SortList(Keys=len, ValuesA=edges.Naked)  # -> Keys, reverse(ValuesA)
split = SplitList(List=sort.ValuesA, Index="2")  # -> ListA, ListB
subset = SubList(List=sort.ValuesA, Domain="1", Wrap=True)  # -> List, Index
crv_10 = Curve(reparameterize(graft(split.ListA)))
jig_length = Slider(4, range=0..10)
len_2 = Length(Curve=crv_10)
division = Division(A=len_2, B=jig_length)
int_5 = Integer(division)
divide_10 = DivideCurve(Curve=crv_10, Count=int_5, Kinks=False)  # -> Points, Tangents, Parameters
Z_7 = UnitZ(Factor=1)
shatter = Shatter(Curve=crv_10, Parameters=divide_10.Parameters)
xprod = CrossProduct(VectorA=divide_10.Tangents, VectorB=Z_7, Unitize=False)  # -> Vector, Length
bishift = DoubleShift(list=simplify(xprod.Vector), wrap=Toggle(False))  # -> graft(no_last), graft(no_first)
avr_3 = Average(Input=[bishift.no_last, bishift.no_first])
pshift_9 = ShiftPaths(Data=avr_3, Offset=-1)
dispatch = Dispatch(List=pshift_9, DispatchPattern=[True, False])  # -> ListA, ListB
dispatch_2 = Dispatch(List=shatter, DispatchPattern=[True, False])  # -> ListA, ListB
move_7 = Move(Geometry=dispatch_2.ListA, Motion=dispatch.ListA)  # -> Geometry, Transform
curvepoint = PointOnCurve(move_7.Geometry, parameter=0.5)
scale = Scale(Geometry=move_7.Geometry, Center=curvepoint, Factor=Slider(1.1, range=1..1.2))  # -> Geometry, Transform
end = EndPoints(Curve=dispatch_2.ListA)  # -> Start, End
end_2 = EndPoints(Curve=scale.Geometry)  # -> Start, End
ln = Line(StartPoint=end.Start, EndPoint=end_2.Start)
ln_2 = Line(StartPoint=end.End, EndPoint=end_2.End)
merge_12 = Merge(Data1=dispatch_2.ListB, Data2=ln, Data3=scale.Geometry, Data4=ln_2)
crv_11 = Curve(simplify(split.ListB))
pshift_10 = ShiftPaths(Data=merge_12, Offset=-1)

pshift_11 = ShiftPaths(Data=simplify(pshift_10), Offset=-1)
merge_13 = Merge(Data1=pshift_11, Data2=crv_11)
join = JoinCurves(Curves=merge_13, Preserve=False)  # -> simplify(Curves)

viewer_4 = ParamViewer(join)
previewlw = CustomPreviewLineweights(Geometry=join, Shader=ColourSwatch(SwatchColor=RGB(255, 255, 255)), Thickness=Slider(2, range=1..3), Absolute=False)

# ----
# inter-beam connections
curvepoint_2 = PointOnCurve(dispatch_2.ListB, parameter=0.5)
pt_3 = Point(simplify(curvepoint_2))
number_slider_11 = Slider(7, range=2..10)
viewer_5 = ParamViewer(pt_3)
not = GateNot(A="True")
dispatch_3 = Dispatch(List=viewer_5, DispatchPattern=[True, False])  # -> ListA, ListB
repeat = RepeatData(Data=not, Length=number_slider_11)  # -> flatten(Data)
branch = TreeBranch(Tree=pt_3, Path=dispatch_3.ListA, MaintainPaths=True)
branch_2 = TreeBranch(Tree=pt_3, Path=dispatch_3.ListB, MaintainPaths=True)
subtraction_2 = Subtraction(A=number_slider_11, B="1")
merge_14 = Merge(Data1="True", Data2=repeat)
path_mapper_3 = PathMapper(branch_2, source="{A;B;C;D}", target="{A;B;C;0}")
shift_13 = ShiftList(List=merge_14, Shift=Slider(5, range=2..10), Wrap=True)
shift_14 = ShiftList(List=shift_13, Shift=Slider(6, range=2..10), Wrap=True)
panel_2 = Panel(shift_14)
panel_3 = Panel(shift_13)
panel_4 = Panel(merge_14)
pt_4 = Point(reverse(path_mapper_3))
merge_15 = Merge(Data1=graft(branch), Data2=graft(pt_4))
entwine_4 = Entwine(Branch00=merge_14, Branch01=shift_13, Branch02=shift_14, FlattenInputs=True)
viewer_6 = ParamViewer(entwine_4)
pline_3 = PolyLine(Vertices=merge_15, Closed=False)
pshift_12 = ShiftPaths(Data=pline_3, Offset=-1)  # -> simplify(Data)
entwine_5 = Entwine(Branch0X=entwine_4, Branch1X=entwine_4, Branch2X=entwine_4, Branch3X=entwine_4, FlattenInputs=False)  # -> simplify(Result)
entwine_6 = Entwine(Branch0X=entwine_5, Branch1X=entwine_5, FlattenInputs=False)
viewer_7 = ParamViewer(pshift_12)
join_2 = JoinCurves(Curves=pshift_11, Preserve=False)
cull = CullPattern(List=pshift_12, CullPattern=entwine_6)
viewer_8 = ParamViewer(entwine_6)
item_2 = ListItem(List=join_2, Index=0, Wrap=True)  # -> Item, Item1
ccx = CurveCurve(CurveA=item_2.Item1, CurveB=cull)  # -> Points, ParamsA, ParamsB
ccx_2 = CurveCurve(CurveA=item_2.Item, CurveB=cull)  # -> Points, ParamsA, ParamsB
pshift_13 = ShiftPaths(Data=ccx.ParamsA, Offset=-1)
pshift_14 = ShiftPaths(Data=ccx_2.ParamsA, Offset=-1)
shatter_2 = Shatter(Curve=item_2.Item1, Parameters=pshift_13)  # -> reverse(simplify(Segments))
shatter_3 = Shatter(Curve=item_2.Item, Parameters=pshift_14)  # -> simplify(Segments)
end_3 = EndPoints(Curve=shatter_2)  # -> Start, End
end_4 = EndPoints(Curve=shatter_3)  # -> Start, End
ln_3 = Line(StartPoint=end_4.End, EndPoint=end_3.Start)  # -> simplify(Line)
ln_4 = Line(StartPoint=end_4.Start, EndPoint=end_3.End)  # -> simplify(Line)
merge_16 = Merge(Data1=graft(shatter_3), Data2=graft(ln_4), Data3=graft(ln_3), Data4=graft(shatter_2))
join_3 = JoinCurves(Curves=merge_16, Preserve=False)
pshift_15 = ShiftPaths(Data=join_3, Offset=-2)  # -> simplify(Data)
previewlw_2 = CustomPreviewLineweights(Geometry=join_3, Shader=ColourSwatch(SwatchColor=RGB(255, 255, 255)), Thickness=Slider(2, range=1..3), Absolute=False)

# ----
# connection frames
number_slider_12 = Slider(0.475, range=0..1)
panel_5 = Panel("""0
-1""")
# beam2beam connectors
panel_6 = Panel("""0
-1""")
item_3 = ListItem(List=crv_5, Index=-1, Wrap=True)
cull_i_3 = CullIndex(List=crv_6, Indices=panel_5, Wrap=True)
cull_i_4 = CullIndex(List=crv_5, Indices=panel_6, Wrap=True)
eval_2 = EvaluateCurve(Curve=crv_5, Parameter=number_slider_12)  # -> Point, Tangent, Angle
item_4 = ListItem(List=crv_6, Index=0, Wrap=True)
item_5 = ListItem(List=eval_2.Point, Index=-1, Wrap=True)
crv_cp_3 = CurveClosestPoint(Point=item_5, Curve=item_4)  # -> Point, Parameter, Distance
shatter_4 = Shatter(Curve=cull_i_4, Parameters=number_slider_12)
shatter_5 = Shatter(Curve=cull_i_3, Parameters=crv_cp_3.Parameter)
dispatch_4 = Dispatch(List=shatter_4, DispatchPattern=[True, False])  # -> ListA, ListB
flip_9 = FlipCurve(Curve=dispatch_4.ListA)  # -> Curve, Flag
dispatch_5 = Dispatch(List=shatter_5, DispatchPattern=[True, False])  # -> ListA, ListB
number_slider_13 = Slider(0.5, range=0..1)
flip_10 = FlipCurve(Curve=dispatch_5.ListA)  # -> Curve, Flag
weave = Weave(Pattern=[0, 1], Stream0=dispatch_4.ListB, Stream1=flip_9.Curve, NullGaps=False)
len_3 = Length(Curve=weave)
weave_2 = Weave(Pattern=[0, 1], Stream0=dispatch_5.ListB, Stream1=flip_10.Curve, NullGaps=False)
division_2 = Division(A=len_3, B=number_slider_13)
range_5 = Range(Domain=Domain(0, 1), Steps=Slider(5, range=2..8))
int_6 = Integer(division_2)
cull_i_5 = CullIndex(List=range_5, Indices=-1, Wrap=True)
divlength = DivideLength(Curve=weave_2, Length=number_slider_13)  # -> Points, Tangents, Parameters
divlength_2 = DivideLength(Curve=weave, Length=number_slider_13)  # -> Points, Tangents, Parameters
graph_3 = GraphMapper(
    cull_i_5,
    x0=0,
    x1=1,
    y0=0,
    y1=1,
    container_name="Bezier",
    cpx=[0, 0.2869572341, 0.6637688279, 1],
    cpy=[0, 0.4768119454, 0.9695655704, 1])
number_slider_14 = Slider(0.03, range=0..1)
pframe = PerpFrame(Curve=reparameterize(graft(weave)), Parameter=graph_3)
pframe_2 = PerpFrame(Curve=reparameterize(graft(weave_2)), Parameter=graph_3)
eval_3 = EvaluateCurve(Curve=reparameterize(graft(weave)), Parameter=graph_3)  # -> Point, Tangent, Angle
eval_4 = EvaluateCurve(Curve=reparameterize(graft(weave_2)), Parameter=graph_3)  # -> Point, Tangent, Angle
Z_8 = UnitZ(Factor=1)
subtraction_3 = Subtraction(A="1", B=number_slider_14)
item_6 = ListItem(List=crv_6, Index=0, Wrap=True)
align = AlignPlane(Plane=pframe, Direction=Z_8)  # -> Plane, Angle
align_2 = AlignPlane(Plane=pframe_2, Direction=Z_8)  # -> Plane, Angle
merge_17 = Merge(Data1=number_slider_14, Data2=subtraction_3)
pframe_3 = PerpFrame(Curve=reparameterize(graft(item_6)), Parameter=merge_17)
pframe_4 = PerpFrame(Curve=item_3, Parameter=number_slider_12)
pshift_16 = ShiftPaths(Data=align_2.Plane, Offset=-1)
pshift_17 = ShiftPaths(Data=align.Plane, Offset=-1)
dam = DataDam(DataA=merge_8, BufferDelay=10000000, BufferMode=0)
align_3 = AlignPlane(Plane=pframe_4, Direction=Z_8)  # -> Plane, Angle
align_4 = AlignPlane(Plane=pframe_3, Direction=Z_8)  # -> Plane, Angle

cull_i_6 = CullIndex(List=pshift_16, Indices=0, Wrap=True)
cull_i_7 = CullIndex(List=pshift_17, Indices=0, Wrap=True)

lng_7 = ListLength(List=flatten([cull_i_7, cull_i_6, align_3.Plane, align_4.Plane]))
sec = BrepPlane(Brep=graft(dam), Plane=flatten(cull_i_7))  # -> Curves, Points; disabled

pln = Plane([cull_i_7, cull_i_6, align_3.Plane, align_4.Plane])
sph = Sphere(Base=pln, Radius=number_slider_9)  # -> flatten(Sphere)
bcx = BrepCurve(Brep=sph, Curve=merge_9)  # -> Curves, Points
pshift_18 = ShiftPaths(Data=bcx.Points, Offset=-1)
crv_cp_4 = CurveClosestPoint(Point=pshift_18, Curve=merge_9)  # -> Point, Parameter, Distance
sort_2 = SortList(Keys=crv_cp_4.Parameter)  # -> Keys, ValuesA
pframe_5 = PerpFrame(Curve=merge_9, Parameter=sort_2.Keys)

# ----
# parameter t
panel_7 = Panel("{0;0;<3}")
split_2 = SplitTree(Data=sort_2.Keys, Masks=flatten(panel_7))  # -> Positive, Negative
viewer_9 = ParamViewer(split_2.Negative)
branch_3 = TreeBranch(Tree=split_2.Negative, Path=viewer_9, MaintainPaths=False)
entwine_7 = Entwine(Branch0X=simplify(split_2.Positive), Branch1X=simplify(branch_3), FlattenInputs=False)

# ----
# frames
panel_8 = Panel("{0;0;<3}")
split_3 = SplitTree(Data=pframe_5, Masks=flatten(panel_8))  # -> Positive, Negative
viewer_10 = ParamViewer(split_3.Negative)
branch_4 = TreeBranch(Tree=split_3.Negative, Path=viewer_10, MaintainPaths=False)
entwine_8 = Entwine(Branch0X=simplify(split_3.Positive), Branch1X=simplify(branch_4), FlattenInputs=False)

# ----
# depth control
pi = Pi(Factor=1)
multiplication_7 = Multiplication(A=entwine_7, B=pi)
number_slider_15 = Slider(8, range=0..10)
sin = Sine(Value=multiplication_7)
multiplication_8 = Multiplication(A=sin, B=Slider(4, range=0..10))
addition_2 = Addition(A=number_slider_15, B=multiplication_8)
bar_graph_3 = BarGraph(addition_2, BarColor=RGB(255, 0, 90))

merge_18 = Merge(Data1=align_3.Plane, Data2=align_4.Plane)
sph_2 = Sphere(Base=merge_18, Radius=number_slider_9)  # -> flatten(Sphere)
bcx_2 = BrepCurve(Brep=sph_2, Curve=crv_9)  # -> Curves, Points
cir = Circle(Plane=entwine_8, Radius=addition_2)

crv_cp_5 = CurveClosestPoint(Point=flatten(bcx_2.Points), Curve=crv_9)  # -> Point, Parameter, Distance
sort_3 = SortList(Keys=crv_cp_5.Parameter)  # -> Keys, ValuesA
dispatch_6 = Dispatch(List=sort_3.Keys, DispatchPattern=[True, False])  # -> ListA, ListB
merge_19 = Merge(Data1=graft(dispatch_6.ListA), Data2=graft(dispatch_6.ListB))
avr_4 = Average(Input=merge_19)  # -> flatten(ArithmeticMean)
pframe_6 = PerpFrame(Curve=crv_9, Parameter=avr_4)

# ----
# center line
pframe_7 = PerpFrame(Curve=crv_9, Parameter=merge_19)
item_7 = ListItem(List=flatten(srf_9), Index="-1", Wrap=True)
item_8 = ListItem(List=flatten(srf_11), Index=0, Wrap=True)
merge_20 = Merge(Data1=item_7, Data2=item_8)
cir_2 = Circle(Plane=pframe_7, Radius=number_slider_15)
bcx_3 = BrepCurve(Brep=merge_20, Curve=graft(cir_2))  # -> Curves, Points
pshift_19 = ShiftPaths(Data=bcx_3.Points, Offset=-1)
pt_5 = Point(graft(pframe_7))
merge_21 = Merge(Data1=pt_5, Data2=pshift_19)
pline_4 = PolyLine(Vertices=merge_21, Closed=True)
pshift_20 = ShiftPaths(Data=pline_4, Offset=-1)

bcx_4 = BrepCurve(Brep=item.Item, Curve=cir)  # -> Curves, Points
bcx_5 = BrepCurve(Brep=item.Item1, Curve=cir)  # -> Curves, Points
merge_22 = Merge(Data1=bcx_4.Points, Data2=bcx_5.Points)
pt_6 = Point(graft(entwine_8))
merge_23 = Merge(Data1=merge_22, Data2=pt_6)
dispatch_7 = Dispatch(List=entwine_7, DispatchPattern=[True, False])  # -> ListA, ListB
merge_24 = Merge(Data1=graft(dispatch_7.ListA), Data2=graft(dispatch_7.ListB))
pline_5 = PolyLine(Vertices=merge_23, Closed=True)
avr_5 = Average(Input=merge_24)
pshift_21 = ShiftPaths(Data=pline_5, Offset=-1)
pshift_22 = ShiftPaths(Data=avr_5, Offset=-1)
dispatch_8 = Dispatch(List=pshift_21, DispatchPattern=[True, False])  # -> ListA, ListB
pframe_8 = PerpFrame(Curve=merge_9, Parameter=pshift_22)
merge_25 = Merge(Data1=graft(dispatch_8.ListA), Data2=graft(dispatch_8.ListB))
loft_7 = Loft(Curves=pshift_20, Options={Adjust=False, Closed=False, LoftEnds=0, LoftSimp=0, LoftType=0, Rebuild=10, Refit=0.01})
cir_3 = Circle(Plane=pframe_6, Radius=number_slider_10)
loft_8 = Loft(Curves=merge_25, Options={Adjust=False, Closed=False, LoftEnds=0, LoftSimp=0, LoftType=0, Rebuild=10, Refit=0.01})
cir_4 = Circle(Plane=pframe_8, Radius=number_slider_10)
lng_8 = ListLength(List=flatten(loft_7))
lng_9 = ListLength(List=flatten(loft_8))
series_3 = Series(Start=0, Step=Slider(54.505, range=0..100), Count=lng_8)
unroller_3 = Unroller(Brep=loft_7)  # -> Brep, Curves, Points
series_4 = Series(Start=0, Step=Slider(15.662, range=0..100), Count=lng_9)
unroller_4 = Unroller(Brep=loft_8)  # -> Brep, Curves, Points
X_3 = UnitX(Factor=graft(series_3))
X_4 = UnitX(Factor=graft(series_4))
addition_3 = Addition(A=X_3, B=Y_2)

move_8 = Move(Geometry=unroller_3.Brep, Motion=addition_3)  # -> Geometry, Transform
move_9 = Move(Geometry=unroller_4.Brep, Motion=X_4)  # -> Geometry, Transform

area = Area(Geometry=[move_8.Geometry, move_9.Geometry])  # -> Area, Centroid
ma = MassAddition(Input=flatten(area.Area))  # -> Result, PartialResults
subtraction_4 = Subtraction(A=multiplication_6, B=ma.Result)
panel_9 = Panel(subtraction_4)

resolution = Slider(190, range=2..200)
divide_11 = DivideCurve(Curve=intcrv_5.Curve, Count=resolution, Kinks=False)  # -> Points, Tangents, Parameters
Z_9 = UnitZ(Factor=1)
divide_12 = DivideCurve(Curve=intcrv_6.Curve, Count=resolution, Kinks=False)  # -> Points, Tangents, Parameters
line_3 = LineSDL(Start=divide_11.Points, Direction=Z_9, Length=1)
srf_14 = Surface([merge_8, merge_7])
join_4 = BrepJoin(Breps=flatten(loft))  # -> Breps, Closed
area_2 = Area(Geometry=flatten(srf_14))  # -> Area, Centroid
line_4 = LineSDL(Start=divide_12.Points, Direction=Z_9, Length=1)
join_5 = BrepJoin(Breps=flatten(loft_6))  # -> Breps, Closed
blx = BrepLine(Brep=join_4.Breps, Line=line_3, LimitToFirst=False)  # -> Curves, Points
blx_2 = BrepLine(Brep=join_5.Breps, Line=line_4, LimitToFirst=False)  # -> Curves, Points
sheet_area_mq = Panel("0.7")
ma_2 = MassAddition(Input=area_2.Area)  # -> Result, PartialResults
ln_5 = Line(StartPoint=graft(divide_11.Points), EndPoint=blx.Points)
dist = Distance(PointA=graft(divide_11.Points), PointB=blx.Points)  # -> flatten(Distance)
# counts
dist_2 = Distance(PointA=graft(divide_12.Points), PointB=blx_2.Points)  # -> flatten(Distance)
ln_6 = Line(StartPoint=graft(divide_12.Points), EndPoint=blx_2.Points)
extremums = MinMax(Number=[dist_2, dist])  # -> Minimum, Maximum
min_max_depth_cm = Panel([extremums.Minimum, extremums.Maximum])

multiplication_9 = Multiplication(A=ma_2.Result, B=0.0001)

multiplication_10 = Multiplication(A=multiplication_9, B=2)
division_3 = Division(A=multiplication_10, B=sheet_area_mq)
# deviation
int_7 = Integer(division_3)
total_area_sqm = Panel(multiplication_9)
n_of_sheets = Panel(int_7)

area_3 = Area(Geometry=flatten(merge_7))  # -> Area, Centroid
area_4 = Area(Geometry=flatten(pshift_7))  # -> Area, Centroid
area_5 = Area(Geometry=flatten(merge_8))  # -> Area, Centroid
area_6 = Area(Geometry=flatten(pshift_8))  # -> Area, Centroid
subtraction_5 = Subtraction(A=area_3.Area, B=area_4.Area)
lng_10 = ListLength(List=area_3.Centroid)
lng_11 = ListLength(List=area_5.Centroid)
subtraction_6 = Subtraction(A=area_5.Area, B=area_6.Area)
series_5 = Series(Start=0, Step=1, Count=lng_10)
abs = Absolute(Value=subtraction_5)
abs_2 = Absolute(Value=subtraction_6)
series_6 = Series(Start=0, Step=1, Count=lng_11)
division_4 = Division(A=abs, B=area_3.Area)
division_5 = Division(A=abs_2, B=area_5.Area)
multiplication_11 = Multiplication(A=division_4, B=100)
multiplication_12 = Multiplication(A=division_5, B=100)
panel_10 = Panel(multiplication_12)
panel_11 = Panel(multiplication_11)
tag_3 = TextTag3D(Location=area_3.Centroid, Text=series_5, Size=Slider(2.399, range=0..100), Justification=7)
tag_4 = TextTag3D(Location=area_5.Centroid, Text=series_6, Size=Slider(2.399, range=0..100), Justification=7)
bar_graph_4 = BarGraph(multiplication_12, BarColor=RGB(255, 0, 90))
bar_graph_5 = BarGraph(multiplication_11, BarColor=RGB(255, 0, 90))

bnd_3 = Bounds(Numbers=[subtraction_5, subtraction_6])

remap_3 = RemapNumbers(Value=subtraction_5, Source=bnd_3, Target=Domain(0, 1))  # -> Mapped, Clipped
remap_4 = RemapNumbers(Value=subtraction_6, Source=bnd_3, Target=Domain(0, 1))  # -> Mapped, Clipped
gradient = Gradient(LowerLimit=0, UpperLimit=1, Parameter=remap_3.Mapped, stops=[0: RGB(255, 0, 0), 1: RGB(255, 255, 255)])
gradient_2 = Gradient(LowerLimit=0, UpperLimit=1, Parameter=remap_4.Mapped, stops=[0: RGB(255, 0, 0), 1: RGB(255, 255, 255)])
previewmat_3 = CustomPreviewMaterials(Geometry=flatten(merge_8), DiffuseColor=gradient_2)
previewmat_4 = CustomPreviewMaterials(Geometry=flatten(merge_7), DiffuseColor=gradient)

srf_15 = Surface(reparameterize(graft(adjust_orient)))
# tagging
crv_12 = Curve(pshift_15)
lng_12 = ListLength(List=crv_12)
viewer_11 = ParamViewer(crv_12)
disc = Discontinuity(Curve=crv_12, Level=1)  # -> Points, Parameters
series_7 = Series(Start=0, Step=1, Count=lng_12)
int_8 = Integer(simplify(series_7))
number_slider_16 = Slider(2.849, range=0..100)

dpath = DeconstructPath(Branch=viewer_11)
item_9 = ListItem(List=dpath, Index=0, Wrap=True)  # -> Item, Item1, Item2
expression = Expression(x=item_9.Item, y=item_9.Item1, z=item_9.Item2, Expression="Format(\"{0}.{1}.{2}_\", x, y,z)")  # -> flatten(R)
avr_6 = Average(Input=disc.Points)
pshift_23 = ShiftPaths(Data=avr_6, Offset=-1)
viewer_12 = ParamViewer(pshift_23)

concat_3 = Concatenate(FragmentA=graft(expression), FragmentB=int_8)
tag_5 = TextTag3D(
    Location=pshift_23,
    Text=concat_3,
    Size=number_slider_16,
    Colour=ColourSwatch(SwatchColor=RGB(255, 255, 255)),
    Justification=5)

# ----
# on model
srf_16 = Surface(reparameterize(graft(entwine)))
srf_cp = SurfaceClosestPoint(Point=pshift_23, Surface=srf_15)  # -> Point, UVPoint, Distance
evalsrf_3 = EvaluateSurface(Surface=srf_16, Point=srf_cp.UVPoint)  # -> Point, Normal, Frame
tag_6 = TextTag3D(
    Location=evalsrf_3.Frame,
    Text=concat_3,
    Size=number_slider_16,
    Colour=ColourSwatch(SwatchColor=RGB(0, 0, 0)),
    Justification=5)

fpars = FontParser(S=concat_3, font=font, size=Slider(1.5, range=0..100), prec=Slider(220, range=1..500), P=pshift_23, J="4")  # -> out, C; inputs S: String, font: String, close: Boolean, size: Double, prec: Double, P: Plane, J: Int32
# ---------- fpars: C# ----------
        /*
    Font Parser
    Adaptation of code written by David Rutten, Giulio Piacentino et al.
    Adaptation for C# by Alessio Erioli - Co-de-iT
    */

    Component.Name = "Font Parser";
    Component.NickName = "FPars";
    Component.Description = "converts text into polylines - useful for fabrication";
    Component.Params.Input[0].Description = "text to convert";
    Component.Params.Input[1].Description = "text font";
    Component.Params.Input[2].Description = "close polylines (optional)";
    Component.Params.Input[3].Description = "text size";
    Component.Params.Input[4].Description = "sampling precision (usually 100-250 is ok)";
    Component.Params.Input[5].Description = "destination plane";
    Component.Params.Input[6].Description = "text justification (0-8)";


    float fS = size == 0 ? 1 : (float) size;
    System.Drawing.Font local_font = new System.Drawing.Font(font, (float) fS);

    System.Drawing.Drawing2D.GraphicsPath path = new System.Drawing.Drawing2D.GraphicsPath();
    path.AddString(S, local_font.FontFamily, (int) local_font.Style, local_font.Size, new PointF(0, 0), new StringFormat());

    System.Drawing.Drawing2D.Matrix matrix = new  System.Drawing.Drawing2D.Matrix(); // transformation matrix
    matrix.Reset(); // build identity matrix

    // ______________ text justification ______________

    RectangleF rec = path.GetBounds(); // bounding rectangle for text
    float dX = Convert.ToSingle(rec.Width * -0.5), dY = Convert.ToSingle(rec.Height * 0.5);
    switch(J){
      case 0:// top left
        dX = 0;
        dY = fS;
        break;
      case 1: // middle left
        dX = 0;
        dY = Convert.ToSingle((-rec.Height) * 0.5 + fS);
        break;
      case 2:  // bottom left
        dX = 0;
        dY = Convert.ToSingle(-rec.Height + fS * 0.5);
        break;
      case 3: // top center
        dX = Convert.ToSingle(rec.Width * -0.5);
        dY = fS;
        break;
      case 4: // middle center
        dX = Convert.ToSingle(rec.Width * -0.5);
        dY = Convert.ToSingle((-rec.Height) * 0.5 + fS);
        break;
      case 5: // bottom center
        dX = Convert.ToSingle(rec.Width * -0.5);
        dY = Convert.ToSingle(-rec.Height + fS * 0.5);
        break;
      case 6: // top right
        dX = Convert.ToSingle(rec.Width * -1);
        dY = fS;
        break;
      case 7: // middle right
        dX = Convert.ToSingle(rec.Width * -1);
        dY = Convert.ToSingle((-rec.Height) * 0.5 + fS);
        break;
      case 8: // bottom right
        dX = Convert.ToSingle(rec.Width * -1);
        dY = Convert.ToSingle(-rec.Height + fS * 0.5);
        break;

    }
    //float dX = Convert.ToSingle(rec.Width * -0.5);
    //float dY = Convert.ToSingle(rec.Height * 0.5);
    System.Drawing.Drawing2D.Matrix mTrans = new  System.Drawing.Drawing2D.Matrix(1, 0, 0, 1, dX, dY); // build transformation matrix
    path.Transform(mTrans); // transform text path

    // ______________ convert to polylines ______________

    path.Flatten(matrix, (float) (size / prec)); // turns the path into a polyline that approximates the path

    PointF[] pts = path.PathPoints; // get path points
    Byte[] tps = path.PathTypes;   // get path point types
    List<Polyline> strokes = new  List<Polyline>(); // List for strokes
    Polyline stroke = new Polyline();

    Byte typ_start = Convert.ToByte(System.Drawing.Drawing2D.PathPointType.Start);// find start points condition

    // the conversion loop
    for (int i = 0; i < pts.Length; i++){
      // if a start point is found, and the existing polyline is not null nor a single point,
      // add polyline to the strokes and create a new polyline
      if(tps[i] == typ_start){
        if (stroke != null && stroke.Count > 1) {
          if (close) stroke.Add(stroke[0]); // close polyline if necessary
          strokes.Add(stroke);}
        stroke = new Polyline();
      }
      // in any other case add the next point to a polyline
      stroke.Add(pts[i].X, -pts[i].Y + size, 0);
      // add last stroke to the list
      if (i == pts.Length - 1) {
        if (close) stroke.Add(stroke[0]); // and close it if necessary
        strokes.Add(stroke);
      }
    }


    // ______________ align strokes to given plane ______________

    Transform align = Transform.PlaneToPlane(Plane.WorldXY, P); // align transformation
    for(int j = 0; j < strokes.Count; j++){
      strokes[j].Transform(align);
    }

    C = strokes;
# ---------- end fpars ----------

# ==== cluster DoubleShift: Shifts a list +1 and -1, wrap option available
list = ClusterInput()
wrap = ClusterInput()
shift = ShiftList(List=list, Shift=1, Wrap=wrap)
shift_2 = ShiftList(List=list, Shift="-1", Wrap=wrap)
no_last = ClusterOutput(shift_2)
no_first = ClusterOutput(shift)

# ==== cluster AdjustOrient
srf = ClusterInput()
srf_2 = Surface(reparameterize(srf))
pt = Point(Point(0.5, 0.5, 0))
evalsrf = EvaluateSurface(Surface=srf_2, Point=pt)  # -> Point, Normal, Frame
Z = UnitZ(Factor=1)
angle = Angle(VectorA=evalsrf.Normal, VectorB=Z)  # -> Angle, Reflex
larger = LargerThan(FirstNumber=angle.Angle, SecondNumber=0.0001)  # -> LargerThan, OrEqualTo
dispatch = Dispatch(List=evalsrf.Point, DispatchPattern=larger.LargerThan)  # -> ListA, ListB
dispatch_2 = Dispatch(List=srf_2, DispatchPattern=larger.LargerThan)  # -> ListA, ListB
X = UnitX(Factor=1)
rot3d = Rotate3D(Geometry=dispatch_2.ListA, Angle="Pi", Center=dispatch.ListA, Axis=X)  # -> Geometry, Transform
weave = Weave(Pattern=larger.LargerThan, Stream0=dispatch_2.ListB, Stream1=rot3d.Geometry, NullGaps=False)
W = ClusterOutput(weave)
