# Grasshopper definition Relief final geometry 20160514_03_conn.gh (Grasshopper 0.9.76)
# Copyright: Co-de-iT
# plug-ins: Heteroptera, Unroller, Human

shorten = Slider(0, range=0..0.4)
subtraction = Subtraction(A=1, B=shorten)
dom = ConstructDomain(DomainStart=shorten, DomainEnd=subtraction)
# curves_right
crv = Curve(reparameterize([<curve referenced from the Rhino model> x2]))
# curves_left
crv_2 = Curve(reparameterize([<curve referenced from the Rhino model> x2]))
sampling = Slider(20, range=2..200)
fill_curves = Slider(4, range=2..50)

# ---- group: medial axis
crv_3 = Curve(<curve referenced from the Rhino model>)

# ---- group: surface for Z regulation
srf = Surface(<surface referenced from the Rhino model>)

# ----
subcrv = SubCurve(BaseCurve=crv, Domain=dom)
subcrv_2 = SubCurve(BaseCurve=crv_2, Domain=dom)
divide = DivideCurve(Curve=subcrv_2, Count=sampling, Kinks=False)  # -> Points, Tangents, Parameters
flip = FlipMatrix(Data=divide.Points)
pline = PolyLine(Vertices=flip, Closed=False)
divide_2 = DivideCurve(Curve=subcrv, Count=sampling, Kinks=False)  # -> Points, Tangents, Parameters
explode = Explode(Curve=pline, Recursive=True)  # -> Segments, Vertices
flip_2 = FlipMatrix(Data=divide_2.Points)

number_slider = Slider(0.21, range=0..1)  # disabled
crv_4 = Curve(reparameterize(<curve referenced from the Rhino model>))  # disabled
eval = EvaluateCurve(Curve=crv_4, Parameter=number_slider)  # -> Point, Tangent, Angle; disabled
number_slider_2 = Slider(10, range=0..30)  # disabled
divide_3 = DivideCurve(Curve=crv_4, Count=number_slider_2, Kinks=False)  # -> Points, Tangents, Parameters; disabled
vec2pt = Vector2Pt(PointA=flip, PointB=eval.Point, Unitize=False)  # -> Vector, Length; disabled
vdis = VectorDisplay(Anchor=divide_3.Points, Vector=vec2pt.Vector)  # disabled

divide_4 = DivideCurve(Curve=explode.Segments, Count=fill_curves, Kinks=False)  # -> Points, Tangents, Parameters
pline_2 = PolyLine(Vertices=flip_2, Closed=False)
pshift = ShiftPaths(Data=divide_4.Points, Offset=-1)
number_slider_3 = Slider(-16.1, range=-30..0)
number_slider_4 = Slider(-0.161, range=-2..0.001)
number_slider_5 = Slider(-1, range=-100..0)
explode_2 = Explode(Curve=pline_2, Recursive=True)  # -> Segments, Vertices
flip_3 = FlipMatrix(Data=pshift)
lng = ListLength(List=flip_3)  # -> expr("x-1", Length)
range = Range(Domain=Domain(0, 1), Steps=lng)
graph = GraphMapper(range, x0=0, x1=1, y0=0, y1=1, container_name="Sine", Equation_px=[0, 0.5223546624], Equation_py=[0.1705827117, 1])
divide_5 = DivideCurve(Curve=explode_2.Segments, Count=fill_curves, Kinks=False)  # -> Points, Tangents, Parameters
number_slider_6 = Slider(-0.161, range=-2..0.001)
pshift_2 = ShiftPaths(Data=divide_5.Points, Offset=-1)
multiplication = Multiplication(A=graph, B=number_slider_3)
number_slider_7 = Slider(-1, range=-100..0)
flip_4 = FlipMatrix(Data=pshift_2)
lng_2 = ListLength(List=flip_4)  # -> expr("x-1", Length)
range_2 = Range(Domain=Domain(0, 1), Steps=lng_2)
graph_2 = GraphMapper(range_2, x0=0, x1=1, y0=0, y1=1, container_name="Sine", Equation_px=[0, 0.5223546624], Equation_py=[0.1705827117, 1])
Z = UnitZ(Factor=multiplication)
move = Move(Geometry=flip_3, Motion=Z)  # -> Geometry, Transform
multiplication_2 = Multiplication(A=graph_2, B=number_slider_3)
Z_2 = UnitZ(Factor=multiplication_2)
intcrv = Interpolate(Vertices=flip_3, Degree=3, Periodic=False, KnotStyle=1)  # -> flatten(Curve), Length, Domain
intcrv_2 = Interpolate(Vertices=move.Geometry, Degree=3, Periodic=False, KnotStyle=1)  # -> flatten(Curve), Length, Domain
move_2 = Move(Geometry=flip_4, Motion=Z_2)  # -> Geometry, Transform
intcrv_3 = Interpolate(Vertices=flip_4, Degree=3, Periodic=False, KnotStyle=1)  # -> flatten(Curve), Length, Domain
intcrv_4 = Interpolate(Vertices=move_2.Geometry, Degree=3, Periodic=False, KnotStyle=1)  # -> Curve, Length, Domain
srf_2 = Surface(<surface referenced from the Rhino model>)
divide_6 = DivideCurve(Curve=intcrv_3.Curve, Count=10, Kinks=False)  # -> Points, Tangents, Parameters
Z_3 = UnitZ(Factor=1)
Z_4 = UnitZ(Factor=-1)
project = Project(Curve=intcrv_4.Curve, Brep=srf, Direction=Z_3)
Z_5 = UnitZ(Factor=1)
line = LineSDL(Start=divide_6.Points, Direction=Z_4, Length="100")
divide_7 = DivideCurve(Curve=intcrv.Curve, Count=10, Kinks=False)  # -> Points, Tangents, Parameters
Z_6 = UnitZ(Factor=-1)
scx = SurfaceCurve(Surface=srf, Curve=line)  # -> Curves, Points, UVPoints, Normals, Parameters, Tangents
project_2 = Project(Curve=intcrv_2.Curve, Brep=srf_2, Direction=Z_5)
line_2 = LineSDL(Start=divide_7.Points, Direction=Z_6, Length="100")
pshift_3 = ShiftPaths(Data=scx.Points, Offset=-1)
scx_2 = SurfaceCurve(Surface=srf, Curve=line_2)  # -> Curves, Points, UVPoints, Normals, Parameters, Tangents
pshift_4 = ShiftPaths(Data=scx_2.Points, Offset=-1)
nurbs = NurbsCurve(Vertices=pshift_4, Degree=3, Periodic=False)  # -> Curve, Length, Domain
divide_8 = DivideCurve(Curve=nurbs.Curve, Count=10, Kinks=False)  # -> Points, Tangents, Parameters
int = Integer(fill_curves)
nurbs_2 = NurbsCurve(Vertices=pshift_3, Degree=3, Periodic=False)  # -> Curve, Length, Domain
flip_5 = FlipMatrix(Data=divide_8.Points)
int_2 = Integer(fill_curves)
merge = Merge(Data1="0", Data2=int)
merge_2 = Merge(Data1="0", Data2=int_2)
toggle = BooleanToggle(False)
toggle_2 = BooleanToggle(False)
divide_9 = DivideCurve(Curve=nurbs_2.Curve, Count=10, Kinks=False)  # -> Points, Tangents, Parameters
replace = ReplaceItems(List=intcrv.Curve, Item=subcrv_2, Indices=merge, Wrap=False)  # -> flatten(List)
replace_2 = ReplaceItems(List=intcrv_3.Curve, Item=subcrv, Indices=merge_2, Wrap=False)  # -> flatten(List)
flip_6 = FlipMatrix(Data=divide_9.Points)
shift = ShiftList(List=flip_6, Shift="1", Wrap=toggle)  # -> graft(List)
shift_2 = ShiftList(List=flip_5, Shift="1", Wrap=toggle_2)  # -> graft(List)
shift_3 = ShiftList(List=flip_6, Shift="-1", Wrap=toggle)  # -> graft(List)
shift_4 = ShiftList(List=flip_5, Shift="-1", Wrap=toggle_2)  # -> graft(List)
number_slider_8 = Slider(69, range=0..100)

# ---- group: top curves - right
crv_5 = Curve(reparameterize(intcrv_3.Curve))

# ---- group: top curves - left
crv_6 = Curve(reparameterize(intcrv.Curve))

# ----
avr = Average(Input=[shift, shift_3])
avr_2 = Average(Input=[shift_2, shift_4])
vec2pt_2 = Vector2Pt(PointA=shift_3, PointB=shift, Unitize=False)  # -> Vector, Length
crv_cp = CurveClosestPoint(Point=avr, Curve=crv_3)  # -> Point, Parameter, Distance
crv_cp_2 = CurveClosestPoint(Point=avr_2, Curve=crv_3)  # -> Point, Parameter, Distance
vec2pt_3 = Vector2Pt(PointA=shift_4, PointB=shift_2, Unitize=False)  # -> Vector, Length
bar_graph = BarGraph(crv_cp.Distance, BarColor=RGB(255, 0, 90))
bar_graph_2 = BarGraph(crv_cp_2.Distance, BarColor=RGB(255, 0, 90))
min = Minimum(A=crv_cp.Distance, B=number_slider_8)
min_2 = Minimum(A=crv_cp_2.Distance, B=number_slider_8)
bnd = Bounds(Numbers=flatten(min))
bnd_2 = Bounds(Numbers=flatten(min_2))
dom_2 = ConstructDomain(DomainStart=0, DomainEnd=Slider(0.6, range=0..1))
dom_3 = ConstructDomain(DomainStart=0, DomainEnd=Slider(0.6, range=0..1))
toggle_3 = BooleanToggle(False)
toggle_4 = BooleanToggle(False)
remap = RemapNumbers(Value=min_2, Source=bnd_2, Target=dom_3)  # -> Mapped, Clipped
multiplication_3 = Multiplication(A=vec2pt_3.Vector, B=remap.Clipped)
remap_2 = RemapNumbers(Value=min, Source=bnd, Target=dom_2)  # -> Mapped, Clipped
multiplication_4 = Multiplication(A=vec2pt_2.Vector, B=remap_2.Clipped)
multiplication_5 = Multiplication(A=multiplication_3, B=-1)
move_3 = Move(Geometry=avr, Motion=multiplication_4)  # -> Geometry, Transform
vdisex = VectorDisplayEx(Point=avr, Vector=multiplication_4, Colour=RGB(0, 0, 0), Width=2)
move_4 = Move(Geometry=avr_2, Motion=multiplication_5)  # -> Geometry, Transform
shift_5 = ShiftList(List=crv_6, Shift="1", Wrap=toggle_4)  # -> simplify(graft(List))
shift_6 = ShiftList(List=crv_5, Shift="1", Wrap=toggle_3)  # -> simplify(graft(List))
shift_7 = ShiftList(List=crv_5, Shift="-1", Wrap=toggle_3)  # -> simplify(graft(List))
shift_8 = ShiftList(List=crv_6, Shift="-1", Wrap=toggle_4)  # -> simplify(graft(List))
vdisex_2 = VectorDisplayEx(Point=avr_2, Vector=multiplication_5, Colour=RGB(0, 0, 0), Width=2)
pshift_5 = ShiftPaths(Data=move_3.Geometry, Offset=-1)  # -> simplify(Data)
pshift_6 = ShiftPaths(Data=move_4.Geometry, Offset=-1)  # -> simplify(Data)
flip_7 = FlipMatrix(Data=pshift_5)
flip_8 = FlipMatrix(Data=pshift_6)

# ---- group: bottom curves
intcrv_5 = Interpolate(Vertices=flip_8, Degree=3, Periodic=False, KnotStyle=1)  # -> simplify(graft(Curve)), Length, Domain

intcrv_6 = Interpolate(Vertices=flip_7, Degree=3, Periodic=False, KnotStyle=1)  # -> simplify(graft(Curve)), Length, Domain

# ----
merge_3 = Merge(Data1=shift_8, Data2=shift_5)
merge_4 = Merge(Data1=shift_7, Data2=shift_6)
merge_5 = Merge(Data1=intcrv_5.Curve, Data2=shift_8)
merge_6 = Merge(Data1=intcrv_6.Curve, Data2=shift_7)
# left
# top surf
loft = Loft(Curves=merge_3, Options={Adjust=False, Closed=False, LoftEnds=0, LoftSimp=0, LoftType=0, Rebuild=10, Refit=0.01})
# right surf
loft_2 = Loft(Curves=merge_5, Options={Adjust=False, Closed=False, LoftEnds=0, LoftSimp=0, LoftType=0, Rebuild=10, Refit=0.01})
# left surf
loft_3 = Loft(
    Curves=[shift_5, intcrv_5.Curve],
    Options={Adjust=False, Closed=False, LoftEnds=0, LoftSimp=0, LoftType=0, Rebuild=10, Refit=0.01})
# left surf
loft_4 = Loft(
    Curves=[shift_6, intcrv_6.Curve],
    Options={Adjust=False, Closed=False, LoftEnds=0, LoftSimp=0, LoftType=0, Rebuild=10, Refit=0.01})
# right surf
loft_5 = Loft(Curves=merge_6, Options={Adjust=False, Closed=False, LoftEnds=0, LoftSimp=0, LoftType=0, Rebuild=10, Refit=0.01})
# right
# top surf
loft_6 = Loft(Curves=merge_4, Options={Adjust=False, Closed=False, LoftEnds=0, LoftSimp=0, LoftType=0, Rebuild=10, Refit=0.01})
merge_7 = Merge(Data1=loft, Data2=loft_3, Data3=loft_2)

merge_8 = Merge(Data1=loft_6, Data2=loft_4, Data3=loft_5)
entwine = Entwine(Branch0X=merge_8, Branch1X=merge_7, FlattenInputs=False)
srf_3 = Surface(entwine)

previewmat = CustomPreviewMaterials(Geometry=merge_8, DiffuseColor=RGB(255, 255, 255))
previewmat_2 = CustomPreviewMaterials(Geometry=merge_7, DiffuseColor=RGB(255, 255, 255))

viewer = ParamViewer(srf_3)

# ---- group: left
crv_7 = Curve(Tree({0;0}: [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], {0;1}: [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], {0;2}: [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], {0;3}: [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], {0;4}: [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], {0;5}: [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]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))

# ---- group: right
crv_8 = Curve(Tree({0;0}: [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], {0;1}: [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], {0;2}: [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], {0;3}: [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], {0;4}: [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], {0;5}: [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]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))

# ----
# tag surfaces
srf_4 = Surface(entwine)
lng_3 = ListLength(List=srf_4)
viewer_2 = ParamViewer(srf_4)
series = Series(Start=0, Step=1, Count=lng_3)
pt = Point(Point(0.5, 0.5, 0))
int_3 = Integer(series)
evalsrf = EvaluateSurface(Surface=reparameterize(srf_4), Point=pt)  # -> Point, Normal, Frame
concat = Concatenate(FragmentA=graft(viewer_2), FragmentB=int_3)
tag = TextTag3D(
    Location=evalsrf.Point,
    Text=concat,
    Size=Slider(5.435, range=0..100),
    Colour=ColourSwatch(SwatchColor=RGB(255, 82, 82)),
    Justification=5)

number_slider_9 = Slider(5, range=0..10)
crv_9 = Curve(crv_6)
crv_10 = Curve(crv_5)
panel = Panel("""0
-1""")
cull_i = CullIndex(List=crv_10, Indices=panel, Wrap=True)
cull_i_2 = CullIndex(List=crv_9, Indices=panel, Wrap=True)
merge_9 = Merge(Data1=cull_i, Data2=cull_i_2)  # -> graft(Result)

# ----
# reorganize paths
panel_2 = Panel("{0;0;<3}")
split = SplitTree(Data=merge_9, Masks=flatten(panel_2))  # -> Positive, Negative
viewer_3 = ParamViewer(split.Negative)
branch = TreeBranch(Tree=split.Negative, Path=viewer_3, MaintainPaths=False)
entwine_2 = Entwine(Branch0X=simplify(split.Positive), Branch1X=simplify(branch), FlattenInputs=False)

# ----
# right
# top surf
# left surf
srf_5 = Surface(loft_6)
# right surf
srf_6 = Surface(loft_4)
# top surf
# left surf
srf_7 = Surface(loft)
srf_8 = Surface(loft_2)
# left
srf_9 = Surface(loft_5)
# right surf
srf_10 = Surface(loft_3)
shift_9 = ShiftList(List=flatten(srf_10), Shift="-1", Wrap=False)
shift_10 = ShiftList(List=flatten(srf_8), Shift="1", Wrap=False)
shift_11 = ShiftList(List=flatten(srf_6), Shift="-1", Wrap=False)
shift_12 = ShiftList(List=flatten(srf_9), Shift="1", Wrap=False)
merge_10 = Merge(Data1=graft(shift_9), Data2=graft(shift_10))
merge_11 = Merge(Data1=graft(shift_11), Data2=graft(shift_12))
entwine_3 = Entwine(Branch0X=simplify(merge_11), Branch1X=simplify(merge_10), FlattenInputs=False)

# ---- group: mid axis
crv_11 = Curve(reparameterize(<curve referenced from the Rhino model>))

# ----
# all others
item = ListItem(List=entwine_3, Index=0, Wrap=True)  # -> Item, Item1
number_slider_10 = Slider(2, range=0..10)
crv_12 = Curve(entwine_2)

# ---- group: just the bottom surfaces
srf_11 = Surface(srf_3)
cull_i_3 = CullIndex(List=srf_11, Indices="0", Wrap=True)  # -> flatten(List)

# ----
srf_12 = Surface(graft(srf_3))
Z_7 = UnitZ(Factor=1)
Y = UnitY(Factor=Slider(35.958, range=0..100))
rev = Reverse(Vector=Z_7)
number_slider_11 = Slider(29.25, range=0..100)
multiplication_6 = Multiplication(A=number_slider_11, B=0.9)
font = ValueList({"Machine Tool Gothic", "Machine Tool SanSerif"}, selected="Machine Tool Gothic")

Y_2 = UnitY(Factor=Slider(579.459, range=0..1500))

srf_13 = Surface(reparameterize(graft(entwine)))

pt_2 = Point(Point(0.5, 0.5, 0))

resolution = Slider(190, range=2..200)
divide_10 = DivideCurve(Curve=intcrv_5.Curve, Count=resolution, Kinks=False)  # -> Points, Tangents, Parameters
Z_8 = UnitZ(Factor=1)
divide_11 = DivideCurve(Curve=intcrv_6.Curve, Count=resolution, Kinks=False)  # -> Points, Tangents, Parameters
line_3 = LineSDL(Start=divide_10.Points, Direction=Z_8, Length=1)
srf_14 = Surface([merge_8, merge_7])
join = BrepJoin(Breps=flatten(loft))  # -> Breps, Closed
area = Area(Geometry=flatten(srf_14))  # -> Area, Centroid
line_4 = LineSDL(Start=divide_11.Points, Direction=Z_8, Length=1)
join_2 = BrepJoin(Breps=flatten(loft_6))  # -> Breps, Closed
blx = BrepLine(Brep=join.Breps, Line=line_3, LimitToFirst=False)  # -> Curves, Points
blx_2 = BrepLine(Brep=join_2.Breps, Line=line_4, LimitToFirst=False)  # -> Curves, Points
sheet_area_mq = Panel("0.7")
ma = MassAddition(Input=area.Area)  # -> Result, PartialResults
ln = Line(StartPoint=graft(divide_10.Points), EndPoint=blx.Points)
dist = Distance(PointA=graft(divide_10.Points), PointB=blx.Points)  # -> flatten(Distance)
# counts
dist_2 = Distance(PointA=graft(divide_11.Points), PointB=blx_2.Points)  # -> flatten(Distance)
ln_2 = Line(StartPoint=graft(divide_11.Points), EndPoint=blx_2.Points)
extremums = MinMax(Number=[dist_2, dist])  # -> Minimum, Maximum
min_max_depth_cm = Panel([extremums.Minimum, extremums.Maximum])

multiplication_7 = Multiplication(A=ma.Result, B=0.0001)

multiplication_8 = Multiplication(A=multiplication_7, B=2)
division = Division(A=multiplication_8, B=sheet_area_mq)
# deviation
int_4 = Integer(division)
total_area_sqm = Panel(multiplication_7)
n_of_sheets = Panel(int_4)

area_2 = Area(Geometry=flatten(merge_7))  # -> Area, Centroid
area_3 = Area(Geometry=flatten(merge_8))  # -> Area, Centroid
lng_4 = ListLength(List=area_2.Centroid)
lng_5 = ListLength(List=area_3.Centroid)
series_2 = Series(Start=0, Step=1, Count=lng_4)
series_3 = Series(Start=0, Step=1, Count=lng_5)
tag_2 = TextTag3D(Location=area_2.Centroid, Text=series_2, Size=Slider(2.399, range=0..100), Justification=7)
tag_3 = TextTag3D(Location=area_3.Centroid, Text=series_3, Size=Slider(2.399, range=0..100), Justification=7)

# ----
# connection frames
number_slider_12 = Slider(0.475, range=0..1)
panel_3 = Panel("""0
-1""")
# beam2beam connectors
panel_4 = Panel("""0
-1""")
item_2 = ListItem(List=crv_5, Index=-1, Wrap=True)
cull_i_4 = CullIndex(List=crv_6, Indices=panel_3, Wrap=True)
cull_i_5 = CullIndex(List=crv_5, Indices=panel_4, Wrap=True)
eval_2 = EvaluateCurve(Curve=crv_5, Parameter=number_slider_12)  # -> Point, Tangent, Angle
item_3 = ListItem(List=crv_6, Index=0, Wrap=True)
item_4 = ListItem(List=eval_2.Point, Index=-1, Wrap=True)
crv_cp_3 = CurveClosestPoint(Point=item_4, Curve=item_3)  # -> Point, Parameter, Distance
shatter = Shatter(Curve=cull_i_5, Parameters=number_slider_12)
shatter_2 = Shatter(Curve=cull_i_4, Parameters=crv_cp_3.Parameter)
dispatch = Dispatch(List=shatter, DispatchPattern=[True, False])  # -> ListA, ListB
flip_9 = FlipCurve(Curve=dispatch.ListA)  # -> Curve, Flag
dispatch_2 = Dispatch(List=shatter_2, DispatchPattern=[True, False])  # -> ListA, ListB
number_slider_13 = Slider(0.5, range=0..1)
flip_10 = FlipCurve(Curve=dispatch_2.ListA)  # -> Curve, Flag
weave = Weave(Pattern=[0, 1], Stream0=dispatch.ListB, Stream1=flip_9.Curve, NullGaps=False)
len = Length(Curve=weave)
weave_2 = Weave(Pattern=[0, 1], Stream0=dispatch_2.ListB, Stream1=flip_10.Curve, NullGaps=False)
division_2 = Division(A=len, B=number_slider_13)
range_3 = Range(Domain=Domain(0, 1), Steps=Slider(5, range=2..8))
int_5 = Integer(division_2)
cull_i_6 = CullIndex(List=range_3, Indices=-1, Wrap=True)
divlength = DivideLength(Curve=weave_2, Length=number_slider_13)  # -> Points, Tangents, Parameters
divlength_2 = DivideLength(Curve=weave, Length=number_slider_13)  # -> Points, Tangents, Parameters
graph_3 = GraphMapper(
    cull_i_6,
    x0=0,
    x1=1,
    y0=0,
    y1=1,
    container_name="Bezier",
    cpx=[0, 0.2869572341, 0.6637688279, 1],
    cpy=[0, 0.4768119454, 0.9695655704, 1])
number_slider_14 = Slider(0.03, range=0..1)
pframe = PerpFrame(Curve=reparameterize(graft(weave)), Parameter=graph_3)
pframe_2 = PerpFrame(Curve=reparameterize(graft(weave_2)), Parameter=graph_3)
eval_3 = EvaluateCurve(Curve=reparameterize(graft(weave)), Parameter=graph_3)  # -> Point, Tangent, Angle
eval_4 = EvaluateCurve(Curve=reparameterize(graft(weave_2)), Parameter=graph_3)  # -> Point, Tangent, Angle
Z_9 = UnitZ(Factor=1)
subtraction_2 = Subtraction(A="1", B=number_slider_14)
item_5 = ListItem(List=crv_6, Index=0, Wrap=True)
align = AlignPlane(Plane=pframe, Direction=Z_9)  # -> Plane, Angle
align_2 = AlignPlane(Plane=pframe_2, Direction=Z_9)  # -> Plane, Angle
merge_12 = Merge(Data1=number_slider_14, Data2=subtraction_2)
pframe_3 = PerpFrame(Curve=reparameterize(graft(item_5)), Parameter=merge_12)
pframe_4 = PerpFrame(Curve=item_2, Parameter=number_slider_12)
pshift_7 = ShiftPaths(Data=align_2.Plane, Offset=-1)
pshift_8 = ShiftPaths(Data=align.Plane, Offset=-1)
dam = DataDam(DataA=merge_8, BufferDelay=10000000, BufferMode=0)
align_3 = AlignPlane(Plane=pframe_4, Direction=Z_9)  # -> Plane, Angle
align_4 = AlignPlane(Plane=pframe_3, Direction=Z_9)  # -> Plane, Angle

cull_i_7 = CullIndex(List=pshift_7, Indices=0, Wrap=True)
cull_i_8 = CullIndex(List=pshift_8, Indices=0, Wrap=True)

lng_6 = ListLength(List=flatten([cull_i_8, cull_i_7, align_3.Plane, align_4.Plane]))
sec = BrepPlane(Brep=graft(dam), Plane=flatten(cull_i_8))  # -> Curves, Points; disabled

pln = Plane([cull_i_8, cull_i_7, align_3.Plane, align_4.Plane])
sph = Sphere(Base=pln, Radius=number_slider_9)  # -> flatten(Sphere)
bcx = BrepCurve(Brep=sph, Curve=entwine_2)  # -> Curves, Points
pshift_9 = ShiftPaths(Data=bcx.Points, Offset=-1)
crv_cp_4 = CurveClosestPoint(Point=pshift_9, Curve=entwine_2)  # -> Point, Parameter, Distance
# parameter t
sort = SortList(Keys=crv_cp_4.Parameter)  # -> Keys, ValuesA
# frames
pframe_5 = PerpFrame(Curve=entwine_2, Parameter=sort.Keys)

# ----
# depth control
pi = Pi(Factor=1)
multiplication_9 = Multiplication(A=sort.Keys, B=pi)
number_slider_15 = Slider(8, range=0..10)
sin = Sine(Value=multiplication_9)
multiplication_10 = Multiplication(A=sin, B=Slider(4, range=0..10))
addition = Addition(A=number_slider_15, B=multiplication_10)
bar_graph_3 = BarGraph(addition, BarColor=RGB(255, 0, 90))

merge_13 = Merge(Data1=align_3.Plane, Data2=align_4.Plane)
sph_2 = Sphere(Base=merge_13, Radius=number_slider_9)  # -> flatten(Sphere)
bcx_2 = BrepCurve(Brep=sph_2, Curve=crv_11)  # -> Curves, Points
cir = Circle(Plane=pframe_5, Radius=addition)

crv_cp_5 = CurveClosestPoint(Point=flatten(bcx_2.Points), Curve=crv_11)  # -> Point, Parameter, Distance
sort_2 = SortList(Keys=crv_cp_5.Parameter)  # -> Keys, ValuesA
dispatch_3 = Dispatch(List=sort_2.Keys, DispatchPattern=[True, False])  # -> ListA, ListB
merge_14 = Merge(Data1=graft(dispatch_3.ListA), Data2=graft(dispatch_3.ListB))
avr_3 = Average(Input=merge_14)  # -> flatten(ArithmeticMean)
pframe_6 = PerpFrame(Curve=crv_11, Parameter=avr_3)

item_6 = ListItem(List=flatten(srf_6), Index="-1", Wrap=True)
item_7 = ListItem(List=flatten(srf_8), Index=0, Wrap=True)
# center line
pframe_7 = PerpFrame(Curve=crv_11, Parameter=merge_14)
merge_15 = Merge(Data1=item_6, Data2=item_7)
cir_2 = Circle(Plane=pframe_7, Radius=number_slider_15)
bcx_3 = BrepCurve(Brep=merge_15, Curve=graft(cir_2))  # -> Curves, Points
pshift_10 = ShiftPaths(Data=bcx_3.Points, Offset=-1)
pt_3 = Point(graft(pframe_7))
merge_16 = Merge(Data1=pt_3, Data2=pshift_10)
pline_3 = PolyLine(Vertices=merge_16, Closed=True)
pshift_11 = ShiftPaths(Data=pline_3, Offset=-1)

bcx_4 = BrepCurve(Brep=item.Item, Curve=cir)  # -> Curves, Points
bcx_5 = BrepCurve(Brep=item.Item1, Curve=cir)  # -> Curves, Points
merge_17 = Merge(Data1=bcx_4.Points, Data2=bcx_5.Points)
pt_4 = Point(graft(pframe_5))
merge_18 = Merge(Data1=merge_17, Data2=pt_4)
dispatch_4 = Dispatch(List=sort.Keys, DispatchPattern=[True, False])  # -> ListA, ListB
merge_19 = Merge(Data1=graft(dispatch_4.ListA), Data2=graft(dispatch_4.ListB))
pline_4 = PolyLine(Vertices=merge_18, Closed=True)
avr_4 = Average(Input=merge_19)
pshift_12 = ShiftPaths(Data=pline_4, Offset=-1)
pshift_13 = ShiftPaths(Data=avr_4, Offset=-1)
dispatch_5 = Dispatch(List=pshift_12, DispatchPattern=[True, False])  # -> ListA, ListB
pframe_8 = PerpFrame(Curve=crv_12, Parameter=pshift_13)
merge_20 = Merge(Data1=graft(dispatch_5.ListA), Data2=graft(dispatch_5.ListB))

# ---- group: all other circles
cir_3 = Circle(Plane=pframe_8, Radius=number_slider_10)

# ---- group: center circles
cir_4 = Circle(Plane=pframe_6, Radius=number_slider_10)

# ---- group: all circles
merge_21 = Merge(Data1=cir_4, Data2=cir_3)  # -> flatten(Result)

# ----
loft_7 = Loft(Curves=pshift_11, Options={Adjust=False, Closed=False, LoftEnds=0, LoftSimp=0, LoftType=0, Rebuild=10, Refit=0.01})
loft_8 = Loft(Curves=merge_20, Options={Adjust=False, Closed=False, LoftEnds=0, LoftSimp=0, LoftType=0, Rebuild=10, Refit=0.01})

# ---- group: points for unroll on connectors
bcx_6 = BrepCurve(Brep=flatten(loft_7), Curve=graft(cir_4))  # -> Curves, Points
pshift_14 = ShiftPaths(Data=bcx_6.Points, Offset=-1)

# ----
brep = Brep([loft_7, loft_8])
bcx_7 = BrepCurve(Brep=srf_12, Curve=merge_21)  # -> Curves, Points
bcx_8 = BrepCurve(Brep=flatten(loft_8), Curve=graft(cir_3))  # -> Curves, Points

# ---- group: points fo unroll on surfaces
pshift_15 = ShiftPaths(Data=bcx_7.Points, Offset=-1)

# ----
pt_5 = Point(pshift_15)

split_2 = SplitTree(Data=pt_5, Masks=flatten("{0;*}"))  # -> Positive, Negative
path_mapper = PathMapper(split_2.Negative, source="{A;B;C}", target="{0;B;C}")

# ----
# right
unroller = Unroller(Brep=graft(merge_8), Points=split_2.Positive)  # -> simplify(Brep), Curves, simplify(Points)
lng_7 = ListLength(List=flatten(unroller.Brep))  # -> expr("x-1", Length)
range_4 = Range(Domain=Slider(1139.98, range=0..1500), Steps=lng_7)  # -> graft(Range)
X = UnitX(Factor=range_4)
move_5 = Move(Geometry=unroller.Points, Motion=X)  # -> Geometry, Transform
move_6 = Move(Geometry=unroller.Brep, Motion=X)  # -> Geometry, Transform
srf_15 = Surface(reparameterize(move_6.Geometry))
adjust_orient = AdjustOrient(srf=srf_15, pt=move_5.Geometry)  # -> S, pt_4
pt_6 = Point(adjust_orient.pt_4)
pshift_16 = ShiftPaths(Data=adjust_orient.S, Offset=-1)

lng_8 = ListLength(List=flatten(loft_7))
pshift_17 = ShiftPaths(Data=bcx_8.Points, Offset=-1)
lng_9 = ListLength(List=flatten(loft_8))
series_4 = Series(Start=0, Step=Slider(54.505, range=0..100), Count=lng_8)
unroller_2 = Unroller(Brep=loft_7, Points=pshift_14)  # -> Brep, Curves, Points
series_5 = Series(Start=0, Step=Slider(15.662, range=0..100), Count=lng_9)
pshift_18 = ShiftPaths(Data=pshift_15, Offset=-1)
unroller_3 = Unroller(Brep=loft_8, Points=pshift_17)  # -> Brep, Curves, Points
X_2 = UnitX(Factor=graft(series_4))
viewer_4 = ParamViewer(pshift_15)
X_3 = UnitX(Factor=graft(series_5))
addition_2 = Addition(A=X_2, B=Y)

move_7 = Move(Geometry=unroller_2.Brep, Motion=addition_2)  # -> Geometry, Transform
move_8 = Move(Geometry=unroller_3.Brep, Motion=X_3)  # -> Geometry, Transform

# ---- group: points
move_9 = Move(Geometry=unroller_2.Points, Motion=addition_2)  # -> Geometry, Transform

move_10 = Move(Geometry=unroller_3.Points, Motion=X_3)  # -> Geometry, Transform

# ----
area_4 = Area(Geometry=[move_7.Geometry, move_8.Geometry])  # -> Area, Centroid
ma_2 = MassAddition(Input=flatten(area_4.Area))  # -> Result, PartialResults
multiplication_11 = Multiplication(A="70", B="100")
subtraction_3 = Subtraction(A=multiplication_11, B=ma_2.Result)
# automated layer separation and grouping for automated nesting
panel_5 = Panel(subtraction_3)

# ----
# left
unroller_4 = Unroller(Brep=graft(merge_7), Points=path_mapper)  # -> simplify(Brep), Curves, simplify(Points)
lng_10 = ListLength(List=flatten(unroller_4.Brep))  # -> expr("x-1", Length)
range_5 = Range(Domain=Slider(1139.98, range=0..1500), Steps=lng_10)  # -> graft(Range)
X_4 = UnitX(Factor=range_5)

addition_3 = Addition(A=X_4, B=Y_2)

move_11 = Move(Geometry=unroller_4.Points, Motion=addition_3)  # -> Geometry, Transform
move_12 = Move(Geometry=unroller_4.Brep, Motion=addition_3)  # -> Geometry, Transform
srf_16 = Surface(reparameterize(move_12.Geometry))
adjust_orient_2 = AdjustOrient(srf=srf_16, pt=move_11.Geometry)  # -> S, pt_4
pshift_19 = ShiftPaths(Data=adjust_orient_2.S, Offset=-1)
pt_7 = Point(adjust_orient_2.pt_4)

# ----
# points
entwine_4 = Entwine(Branch0X=pt_6, Branch1X=pt_7, FlattenInputs=False)
# surfs
entwine_5 = Entwine(Branch0X=pshift_16, Branch1X=pshift_19, FlattenInputs=False)

srf_17 = Surface(entwine_5)
lng_11 = ListLength(List=srf_17)
viewer_5 = ParamViewer(srf_17)
series_6 = Series(Start=0, Step=1, Count=lng_11)
int_6 = Integer(series_6)
evalsrf_2 = EvaluateSurface(Surface=reparameterize(srf_17), Point=pt_2)  # -> Point, Normal, Frame
concat_2 = Concatenate(FragmentA=graft(viewer_5), FragmentB=int_6)
tag_4 = TextTag3D(
    Location=evalsrf_2.Point,
    Text=concat_2,
    Size=Slider(5.435, range=0..100),
    Colour=ColourSwatch(SwatchColor=RGB(255, 82, 82)),
    Justification=5)

srf_18 = Surface(entwine_5)
pt_8 = Point(entwine_4)
tag_5 = TextTag3D(Location=pt_8, Size=Slider(10, range=0..10), Justification=7)
move_13 = Move(Geometry=pt_8, Motion=Z_7)  # -> Geometry, Transform
line_5 = LineSDL(Start=move_13.Geometry, Direction=rev, Length="2")

srf_19 = Surface(reparameterize(graft(entwine_5)))

# ----
# reparametrize + graft
# sub-list takes only the elements
# up to index 1
# another way of reversing lists
# or we can use a split list
# since we'll need also the
# other curves
edges = BrepEdges(Brep=srf_18)  # -> Naked, Interior, NonManifold
# create jigsaw contours
len_2 = Length(Curve=edges.Naked)
sort_3 = SortList(Keys=len_2, ValuesA=edges.Naked)  # -> Keys, reverse(ValuesA)
split_3 = SplitList(List=sort_3.ValuesA, Index="2")  # -> ListA, ListB
subset = SubList(List=sort_3.ValuesA, Domain="1", Wrap=True)  # -> List, Index
crv_13 = Curve(reparameterize(graft(split_3.ListA)))
jig_length = Slider(4, range=0..10)
len_3 = Length(Curve=crv_13)
division_3 = Division(A=len_3, B=jig_length)
int_7 = Integer(division_3)
divide_12 = DivideCurve(Curve=crv_13, Count=int_7, Kinks=False)  # -> Points, Tangents, Parameters
Z_10 = UnitZ(Factor=1)
shatter_3 = Shatter(Curve=crv_13, Parameters=divide_12.Parameters)
xprod = CrossProduct(VectorA=divide_12.Tangents, VectorB=Z_10, Unitize=False)  # -> Vector, Length
bishift = DoubleShift(list=simplify(xprod.Vector), wrap=Toggle(False))  # -> graft(no_last), graft(no_first)
avr_5 = Average(Input=[bishift.no_last, bishift.no_first])
pshift_20 = ShiftPaths(Data=avr_5, Offset=-1)
dispatch_6 = Dispatch(List=pshift_20, DispatchPattern=[True, False])  # -> ListA, ListB
dispatch_7 = Dispatch(List=shatter_3, DispatchPattern=[True, False])  # -> ListA, ListB
move_14 = Move(Geometry=dispatch_7.ListA, Motion=dispatch_6.ListA)  # -> Geometry, Transform
curvepoint = PointOnCurve(move_14.Geometry, parameter=0.5)
scale = Scale(Geometry=move_14.Geometry, Center=curvepoint, Factor=Slider(1.1, range=1..1.2))  # -> Geometry, Transform
end = EndPoints(Curve=dispatch_7.ListA)  # -> Start, End
end_2 = EndPoints(Curve=scale.Geometry)  # -> Start, End
ln_3 = Line(StartPoint=end.Start, EndPoint=end_2.Start)
ln_4 = Line(StartPoint=end.End, EndPoint=end_2.End)
merge_22 = Merge(Data1=dispatch_7.ListB, Data2=ln_3, Data3=scale.Geometry, Data4=ln_4)
crv_14 = Curve(simplify(split_3.ListB))
pshift_21 = ShiftPaths(Data=merge_22, Offset=-1)

pshift_22 = ShiftPaths(Data=simplify(pshift_21), Offset=-1)
merge_23 = Merge(Data1=pshift_22, Data2=crv_14)
join_3 = JoinCurves(Curves=merge_23, Preserve=False)  # -> simplify(Curves)

viewer_6 = ParamViewer(join_3)
previewlw = CustomPreviewLineweights(Geometry=join_3, Shader=ColourSwatch(SwatchColor=RGB(255, 255, 255)), Thickness=Slider(2, range=1..3), Absolute=False)

# ----
# inter-beam connections
curvepoint_2 = PointOnCurve(dispatch_7.ListB, parameter=0.5)
pt_9 = Point(simplify(curvepoint_2))
number_slider_16 = Slider(7, range=2..10)
viewer_7 = ParamViewer(pt_9)
not = GateNot(A="True")
dispatch_8 = Dispatch(List=viewer_7, DispatchPattern=[True, False])  # -> ListA, ListB
repeat = RepeatData(Data=not, Length=number_slider_16)  # -> flatten(Data)
branch_2 = TreeBranch(Tree=pt_9, Path=dispatch_8.ListA, MaintainPaths=True)
branch_3 = TreeBranch(Tree=pt_9, Path=dispatch_8.ListB, MaintainPaths=True)
subtraction_4 = Subtraction(A=number_slider_16, B="1")
merge_24 = Merge(Data1="True", Data2=repeat)
path_mapper_2 = PathMapper(branch_3, source="{A;B;C;D}", target="{A;B;C;0}")
shift_13 = ShiftList(List=merge_24, Shift=Slider(5, range=2..10), Wrap=True)
shift_14 = ShiftList(List=shift_13, Shift=Slider(6, range=2..10), Wrap=True)
panel_6 = Panel(shift_14)
panel_7 = Panel(shift_13)
panel_8 = Panel(merge_24)
pt_10 = Point(reverse(path_mapper_2))
merge_25 = Merge(Data1=graft(branch_2), Data2=graft(pt_10))
entwine_6 = Entwine(Branch00=merge_24, Branch01=shift_13, Branch02=shift_14, FlattenInputs=True)
viewer_8 = ParamViewer(entwine_6)
pline_5 = PolyLine(Vertices=merge_25, Closed=False)
pshift_23 = ShiftPaths(Data=pline_5, Offset=-1)  # -> simplify(Data)
entwine_7 = Entwine(Branch0X=entwine_6, Branch1X=entwine_6, Branch2X=entwine_6, Branch3X=entwine_6, FlattenInputs=False)  # -> simplify(Result)
entwine_8 = Entwine(Branch0X=entwine_7, Branch1X=entwine_7, FlattenInputs=False)
viewer_9 = ParamViewer(pshift_23)
join_4 = JoinCurves(Curves=pshift_22, Preserve=False)
cull = CullPattern(List=pshift_23, CullPattern=entwine_8)
viewer_10 = ParamViewer(entwine_8)
item_8 = ListItem(List=join_4, Index=0, Wrap=True)  # -> Item, Item1
ccx = CurveCurve(CurveA=item_8.Item1, CurveB=cull)  # -> Points, ParamsA, ParamsB
ccx_2 = CurveCurve(CurveA=item_8.Item, CurveB=cull)  # -> Points, ParamsA, ParamsB
pshift_24 = ShiftPaths(Data=ccx.ParamsA, Offset=-1)
pshift_25 = ShiftPaths(Data=ccx_2.ParamsA, Offset=-1)
shatter_4 = Shatter(Curve=item_8.Item1, Parameters=pshift_24)  # -> reverse(simplify(Segments))
shatter_5 = Shatter(Curve=item_8.Item, Parameters=pshift_25)  # -> simplify(Segments)
end_3 = EndPoints(Curve=shatter_4)  # -> Start, End
end_4 = EndPoints(Curve=shatter_5)  # -> Start, End
ln_5 = Line(StartPoint=end_4.End, EndPoint=end_3.Start)  # -> simplify(Line)
ln_6 = Line(StartPoint=end_4.Start, EndPoint=end_3.End)  # -> simplify(Line)
merge_26 = Merge(Data1=graft(shatter_5), Data2=graft(ln_6), Data3=graft(ln_5), Data4=graft(shatter_4))
join_5 = JoinCurves(Curves=merge_26, Preserve=False)
previewlw_2 = CustomPreviewLineweights(Geometry=join_5, Shader=ColourSwatch(SwatchColor=RGB(255, 255, 255)), Thickness=Slider(2, range=1..3), Absolute=False)

crv_15 = Curve(cull)
end_5 = EndPoints(Curve=crv_15)  # -> Start, End
srf_cp = SurfaceClosestPoint(Point=end_5.Start, Surface=srf_19)  # -> Point, UVPoint, Distance
srf_cp_2 = SurfaceClosestPoint(Point=end_5.End, Surface=srf_19)  # -> Point, UVPoint, Distance
lng_12 = ListLength(List=srf_cp.UVPoint)
repeat_2 = RepeatData(Data=srf_13, Length=lng_12)  # -> simplify(graft(Data))
merge_27 = Merge(Data1=graft(srf_cp.UVPoint), Data2=graft(srf_cp_2.UVPoint))

# ----
# division curves (on model)
crvsrf = CurveOnSurface(Surface=repeat_2, UVCoordinates=merge_27, Closed=False)  # -> Curve, Length, Domain
pshift_26 = ShiftPaths(Data=join_5, Offset=-2)  # -> simplify(Data)
crv_16 = Curve(graft(pshift_26))
srf_20 = Surface(crv_16)
blx_3 = BrepLine(Brep=srf_20, Line=flatten(line_5), LimitToFirst=False)  # -> Curves, Points
pshift_27 = ShiftPaths(Data=blx_3.Points, Offset=-1)
cir_5 = Circle(Plane=pshift_27, Radius=".5")

area_5 = Area(Geometry=flatten(unroller_4.Brep))  # -> Area, Centroid
area_6 = Area(Geometry=flatten(unroller.Brep))  # -> Area, Centroid
subtraction_5 = Subtraction(A=area_2.Area, B=area_5.Area)
subtraction_6 = Subtraction(A=area_3.Area, B=area_6.Area)
abs = Absolute(Value=subtraction_5)
abs_2 = Absolute(Value=subtraction_6)
division_4 = Division(A=abs, B=area_2.Area)
division_5 = Division(A=abs_2, B=area_3.Area)
multiplication_12 = Multiplication(A=division_4, B=100)
multiplication_13 = Multiplication(A=division_5, B=100)
panel_9 = Panel(multiplication_13)
panel_10 = Panel(multiplication_12)
bar_graph_4 = BarGraph(multiplication_13, BarColor=RGB(255, 0, 90))
bar_graph_5 = BarGraph(multiplication_12, BarColor=RGB(255, 0, 90))

bnd_3 = Bounds(Numbers=[subtraction_5, subtraction_6])

remap_3 = RemapNumbers(Value=subtraction_5, Source=bnd_3, Target=Domain(0, 1))  # -> Mapped, Clipped
remap_4 = RemapNumbers(Value=subtraction_6, Source=bnd_3, Target=Domain(0, 1))  # -> Mapped, Clipped
gradient = Gradient(LowerLimit=0, UpperLimit=1, Parameter=remap_3.Mapped, stops=[0: RGB(255, 0, 0), 1: RGB(255, 255, 255)])
gradient_2 = Gradient(LowerLimit=0, UpperLimit=1, Parameter=remap_4.Mapped, stops=[0: RGB(255, 0, 0), 1: RGB(255, 255, 255)])
previewmat_3 = CustomPreviewMaterials(Geometry=flatten(merge_8), DiffuseColor=gradient_2)
previewmat_4 = CustomPreviewMaterials(Geometry=flatten(merge_7), DiffuseColor=gradient)

srf_21 = Surface(reparameterize(graft(entwine_5)))
# tagging
crv_17 = Curve(pshift_26)
viewer_11 = ParamViewer(crv_17)
lng_13 = ListLength(List=crv_17)
disc = Discontinuity(Curve=crv_17, Level=1)  # -> Points, Parameters
series_7 = Series(Start=0, Step=1, Count=lng_13)
int_8 = Integer(simplify(series_7))
number_slider_17 = Slider(2.849, range=0..100)

dpath = DeconstructPath(Branch=viewer_11)
item_9 = ListItem(List=dpath, Index=0, Wrap=True)  # -> Item, Item1, Item2
expression = Expression(x=item_9.Item, y=item_9.Item1, z=item_9.Item2, Expression="Format(\"{0}.{1}.{2}_\", x, y,z)")  # -> flatten(R)
avr_6 = Average(Input=disc.Points)
pshift_28 = ShiftPaths(Data=avr_6, Offset=-1)
viewer_12 = ParamViewer(pshift_28)

concat_3 = Concatenate(FragmentA=graft(expression), FragmentB=int_8)
tag_6 = TextTag3D(
    Location=pshift_28,
    Text=concat_3,
    Size=number_slider_17,
    Colour=ColourSwatch(SwatchColor=RGB(255, 255, 255)),
    Justification=5)

fpars = FontParser(S=concat_3, font=font, size=Slider(1.5, range=0..100), prec=Slider(220, range=1..500), P=pshift_28, J="4")  # -> out, C; inputs S: String, font: String, close: Boolean, size: Double, prec: Double, P: Plane, J: Int32
# ---------- fpars: C# ----------
        /*
    Font Parser
    Adaptation of code written by David Rutten, Giulio Piacentino et al.
    Adaptation for C# by Alessio Erioli - Co-de-iT
    */

    Component.Name = "Font Parser";
    Component.NickName = "FPars";
    Component.Description = "converts text into polylines - useful for fabrication";
    Component.Params.Input[0].Description = "text to convert";
    Component.Params.Input[1].Description = "text font";
    Component.Params.Input[2].Description = "close polylines (optional)";
    Component.Params.Input[3].Description = "text size";
    Component.Params.Input[4].Description = "sampling precision (usually 100-250 is ok)";
    Component.Params.Input[5].Description = "destination plane";
    Component.Params.Input[6].Description = "text justification (0-8)";


    float fS = size == 0 ? 1 : (float) size;
    System.Drawing.Font local_font = new System.Drawing.Font(font, (float) fS);

    System.Drawing.Drawing2D.GraphicsPath path = new System.Drawing.Drawing2D.GraphicsPath();
    path.AddString(S, local_font.FontFamily, (int) local_font.Style, local_font.Size, new PointF(0, 0), new StringFormat());

    System.Drawing.Drawing2D.Matrix matrix = new  System.Drawing.Drawing2D.Matrix(); // transformation matrix
    matrix.Reset(); // build identity matrix

    // ______________ text justification ______________

    RectangleF rec = path.GetBounds(); // bounding rectangle for text
    float dX = Convert.ToSingle(rec.Width * -0.5), dY = Convert.ToSingle(rec.Height * 0.5);
    switch(J){
      case 0:// top left
        dX = 0;
        dY = fS;
        break;
      case 1: // middle left
        dX = 0;
        dY = Convert.ToSingle((-rec.Height) * 0.5 + fS);
        break;
      case 2:  // bottom left
        dX = 0;
        dY = Convert.ToSingle(-rec.Height + fS * 0.5);
        break;
      case 3: // top center
        dX = Convert.ToSingle(rec.Width * -0.5);
        dY = fS;
        break;
      case 4: // middle center
        dX = Convert.ToSingle(rec.Width * -0.5);
        dY = Convert.ToSingle((-rec.Height) * 0.5 + fS);
        break;
      case 5: // bottom center
        dX = Convert.ToSingle(rec.Width * -0.5);
        dY = Convert.ToSingle(-rec.Height + fS * 0.5);
        break;
      case 6: // top right
        dX = Convert.ToSingle(rec.Width * -1);
        dY = fS;
        break;
      case 7: // middle right
        dX = Convert.ToSingle(rec.Width * -1);
        dY = Convert.ToSingle((-rec.Height) * 0.5 + fS);
        break;
      case 8: // bottom right
        dX = Convert.ToSingle(rec.Width * -1);
        dY = Convert.ToSingle(-rec.Height + fS * 0.5);
        break;

    }
    //float dX = Convert.ToSingle(rec.Width * -0.5);
    //float dY = Convert.ToSingle(rec.Height * 0.5);
    System.Drawing.Drawing2D.Matrix mTrans = new  System.Drawing.Drawing2D.Matrix(1, 0, 0, 1, dX, dY); // build transformation matrix
    path.Transform(mTrans); // transform text path

    // ______________ convert to polylines ______________

    path.Flatten(matrix, (float) (size / prec)); // turns the path into a polyline that approximates the path

    PointF[] pts = path.PathPoints; // get path points
    Byte[] tps = path.PathTypes;   // get path point types
    List<Polyline> strokes = new  List<Polyline>(); // List for strokes
    Polyline stroke = new Polyline();

    Byte typ_start = Convert.ToByte(System.Drawing.Drawing2D.PathPointType.Start);// find start points condition

    // the conversion loop
    for (int i = 0; i < pts.Length; i++){
      // if a start point is found, and the existing polyline is not null nor a single point,
      // add polyline to the strokes and create a new polyline
      if(tps[i] == typ_start){
        if (stroke != null && stroke.Count > 1) {
          if (close) stroke.Add(stroke[0]); // close polyline if necessary
          strokes.Add(stroke);}
        stroke = new Polyline();
      }
      // in any other case add the next point to a polyline
      stroke.Add(pts[i].X, -pts[i].Y + size, 0);
      // add last stroke to the list
      if (i == pts.Length - 1) {
        if (close) stroke.Add(stroke[0]); // and close it if necessary
        strokes.Add(stroke);
      }
    }


    // ______________ align strokes to given plane ______________

    Transform align = Transform.PlaneToPlane(Plane.WorldXY, P); // align transformation
    for(int j = 0; j < strokes.Count; j++){
      strokes[j].Transform(align);
    }

    C = strokes;
# ---------- end fpars ----------

# ----
# outer cuts
# inner cuts
# engrave
# engrave text
crv_18 = Curve(crv_16)
crv_19 = Curve(cir_5)
crv_20 = Curve()  # disabled
crv_21 = Curve(fpars.C)

# ----
# curves
# the Bakery: obj - objects to bake
# name - objects names (optional)
# layer - objects layer (optional)
# color - objects color (optional)
# pWidth - polylines width (optional)
# wires
# material - objects material (optional)
# group_n - group number (mandatory if you want to bake in groups - see also note below)
# group - boolean toggle to bake in groups (one group for each tree branch)
# bake_iT - button: hit once to bake ALL
# NOTE: please erase all groups from the Rhino file before baking.
# If unsure copy the polylines in a new file before referencing them in this part of the definition to avoid previous groups.
# Insert here the polylines if not generated in this definition.
# 
# There should be one tree branch for each piece to be cut.
# 
# Example: 3 pieces (each with outer cuts, inner cuts, engraving and text)
# 
# For each of those works I'll have a datat tree with 3 branches, {0}, {1} e {2}.
# 
# In the "outer cuts" component I'll put all the polylines for outer cuts, in branch {0} the ones relative to the first component, branch {1} those relative to the second one and so on. Same structure for all other works.
# 
# Maintaining this order is necessary for a correct group bake and thus use Rhinonest
# outer cuts
# inner cuts
# engrave
# engrave text
lng_14 = ListLength(List=crv_18)
lng_15 = ListLength(List=crv_19)
lng_16 = ListLength(List=crv_20)
lng_17 = ListLength(List=crv_21)
swatch = ColourSwatch(SwatchColor=RGB(0, 0, 255))
swatch_2 = ColourSwatch(SwatchColor=RGB(255, 255, 255))
layers_names = Panel("""l_outer_cut
l_inner_cut
l_engrave_text""")
merge_28 = Merge(Data1=simplify(lng_14), Data2=simplify(lng_15), Data3=simplify(lng_17))
merge_29 = Merge(Data1=simplify(crv_18), Data2=simplify(crv_19), Data3=simplify(crv_20), Data4=simplify(crv_21))
preview = CustomPreview(Geometry=crv_18, Shader=ColourSwatch(SwatchColor=RGB(255, 0, 0)))
preview_2 = CustomPreview(Geometry=crv_19, Shader=ColourSwatch(SwatchColor=RGB(0, 255, 0)))
preview_3 = CustomPreview(Geometry=crv_20, Shader=swatch)
preview_4 = CustomPreview(Geometry=crv_21, Shader=swatch)
tstat = TreeStatistics(Tree=merge_29)  # -> Paths, Length, Count
stack = StackData(Data=layers_names, Stack=merge_28)
series_8 = Series(Start=0, Step=1, Count=tstat.Count)
group = BooleanToggle(True)
bake = Button()
int_9 = Integer(simplify(graft(series_8)))
bakeatt = BakeAttributesEnhanced(obj=merge_29, layer=stack, group_n=int_9, group=group, bake_iT=bake)  # -> info, obj_out; inputs obj: GeometryBase, name: String, layer: String, color: Color, pWidth: Double, wires: Int32, group_n: Int32, group: Boolean, bake_iT: Boolean
# ---------- bakeatt: C# ----------
    //Inserts geometry into the Rhino document, with custom attributes
    //Written by Giulio Piacentino
    //Version written 2010 11 21 - for Grasshopper 0.8.002
    //Enhanced by Co-de-iT (Alessio) - now bakes on chosen layer(s) and in groups

    String eol = Environment.NewLine;
    Component.Name = "Bake Attributes Enhanced";
    Component.NickName = "BakeAtt++";
    Component.Message = "v1.1 _ by Giulio Piacentino" + eol + "enhanced by Co-de-iT";
    Component.Description = "Bakes objects with attributes such as color, material, layer, object name, wire density. Option to bake in groups";

    if (bake_iT)
    {
      if(obj == null)
      {
        Print("No object to bake");
        return;
      }

      //Make new attribute to set name
      Rhino.DocObjects.ObjectAttributes att = new Rhino.DocObjects.ObjectAttributes();

      //Set object name
      if(!string.IsNullOrEmpty(name))
      {
        att.Name = name;
      }

      //Set color
      if(!color.IsEmpty)
      {
        att.ColorSource = Rhino.DocObjects.ObjectColorSource.ColorFromObject; //Make the color type "by object"
        att.ObjectColor = color;

        att.PlotColorSource = Rhino.DocObjects.ObjectPlotColorSource.PlotColorFromObject; //Make the plot color type "by object"
        att.PlotColor = color;
      }

      // Set group

      if(group)
      {
        doc.Groups.Add(Convert.ToString(group_n));
        att.AddToGroup(group_n);

      }

      //Set layer
      if(!string.IsNullOrEmpty(layer) && Rhino.DocObjects.Layer.IsValidName(layer))
      {
        //Get the current layer index
        Rhino.DocObjects.Tables.LayerTable layerTable = doc.Layers;
        int layerIndex = layerTable.Find(layer, true);

        if(layerIndex < 0) //This layer does not exist, we add it
        {
          Rhino.DocObjects.Layer onlayer = new Rhino.DocObjects.Layer(); //Make a new layer
          onlayer.Name = layer;
          

          layerIndex = layerTable.Add(onlayer); //Add the layer to the layer table
          if (layerIndex > -1) //We manged to add layer!
          {
            att.LayerIndex = layerIndex;
            Print("Added new layer to the document at position " + layerIndex + " named " + layer + ". ");
          } else
            Print("Layer did not add. Try cleaning up your layers."); //This never happened to me.
        }
        else
          att.LayerIndex = layerIndex; //We simply add to the existing layer
      }


      //Set plotweight
      if(pWidth > 0)
      {
        att.PlotWeightSource = Rhino.DocObjects.ObjectPlotWeightSource.PlotWeightFromObject;
        att.PlotWeight = pWidth;
      }


      //Set material
      bool materialByName = !string.IsNullOrEmpty(material as string);
      Rhino.Display.DisplayMaterial inMaterial = material as Rhino.Display.DisplayMaterial;
      if(material is Color)
      {
        inMaterial = new Rhino.Display.DisplayMaterial((Color) material);
      }
      if(material != null && inMaterial == null && !materialByName)
      {
        if(!(material is string))
        {
          try //We also resort to try with IConvertible
          {
            inMaterial = (Rhino.Display.DisplayMaterial) Convert.ChangeType(material, typeof(Rhino.Display.DisplayMaterial));
          }
          catch(InvalidCastException)
          {
          }
        }
      }
      if(inMaterial != null || materialByName)
      {
        string matName;

        if(!materialByName)
        {
          matName = string.Format("A:{0}-D:{1}-E:{2}-S:{3},{4}-T:{5}",
            Format(inMaterial.Ambient),
            Format(inMaterial.Diffuse),
            Format(inMaterial.Emission),
            Format(inMaterial.Specular),
            inMaterial.Shine.ToString(),
            inMaterial.Transparency.ToString()
            );
        }
        else
        {
          matName = (string) material;
        }

        int materialIndex = doc.Materials.Find(matName, true);
        if(materialIndex < 0 && !materialByName) //Material does not exist and we have its specs
        {
          materialIndex = doc.Materials.Add(); //Let's add it
          if(materialIndex > -1)
          {
            Print("Added new material at position " + materialIndex + " named \"" + matName + "\". ");
            Rhino.DocObjects.Material m = doc.Materials[materialIndex];
            m.Name = matName;
            m.AmbientColor = inMaterial.Ambient;
            m.DiffuseColor = inMaterial.Diffuse;
            m.EmissionColor = inMaterial.Emission;
            //m.ReflectionColor = no equivalent
            m.SpecularColor = inMaterial.Specular;
            m.Shine = inMaterial.Shine;
            m.Transparency = inMaterial.Transparency;
            //m.TransparentColor = no equivalent
            m.CommitChanges();

            att.MaterialSource = Rhino.DocObjects.ObjectMaterialSource.MaterialFromObject;
            att.MaterialIndex = materialIndex;
          }
          else
            Print("Material did not add. Try cleaning up your materials."); //This never happened to me.
        }
        else if(materialIndex < 0 && materialByName) //Material does not exist and we do not have its specs. We do nothing
        {
          Print("Warning: material name not found. I cannot set the source to this material name. Add a material with name: " + matName);
        }
        else
        {
          //If this material exists, we do not replace it!
          att.MaterialSource = Rhino.DocObjects.ObjectMaterialSource.MaterialFromObject;
          att.MaterialIndex = materialIndex;
        }
      }


      //Set wire density
      if(wires == -1 || wires > 0)
      {
        att.WireDensity = wires;
      }


      //Bake to the right type of object
      switch(obj.ObjectType)
      {
        case Rhino.DocObjects.ObjectType.Brep:
          doc.Objects.AddBrep(obj as Brep, att);
          break;
        case Rhino.DocObjects.ObjectType.Curve:
          doc.Objects.AddCurve(obj as Curve, att);
          break;
        case Rhino.DocObjects.ObjectType.Point:
          doc.Objects.AddPoint((obj as Rhino.Geometry.Point).Location, att);
          break;
        case Rhino.DocObjects.ObjectType.Surface:
          doc.Objects.AddSurface(obj as Surface, att);
          break;
        case Rhino.DocObjects.ObjectType.Mesh:
          doc.Objects.AddMesh(obj as Mesh, att);
          break;
        case Rhino.DocObjects.ObjectType.Extrusion:
          typeof(Rhino.DocObjects.Tables.ObjectTable).InvokeMember("AddExtrusion", BindingFlags.Instance | BindingFlags.InvokeMethod, null, doc.Objects, new object[]{obj, att});
          break;
        case Rhino.DocObjects.ObjectType.PointSet:
          doc.Objects.AddPointCloud(obj as Rhino.Geometry.PointCloud, att); //This is a speculative entry
          break;
        default:
          Print("The script does not know how to handle this type of geometry: " + obj.GetType().FullName);
          break;
      }
      Print("Added " + obj.GetType().Name);

    }
    else
    {
      Print("Inactive");
    }
    obj_out = obj;
# ---------- bakeatt: C# additional code ----------
  static string Format(Color c)
  {
    return (new System.Text.StringBuilder("A")).Append(c.A.ToString()).Append("R").Append(c.R.ToString()).Append("G")
      .Append(c.G.ToString()).Append("B").Append(c.B.ToString()).ToString();
  }
# ---------- end bakeatt ----------

# ----
# on model
srf_22 = Surface(reparameterize(graft(entwine)))
srf_cp_3 = SurfaceClosestPoint(Point=pshift_28, Surface=srf_21)  # -> Point, UVPoint, Distance
evalsrf_3 = EvaluateSurface(Surface=srf_22, Point=srf_cp_3.UVPoint)  # -> Point, Normal, Frame

amp = Amplitude(Vector=evalsrf_3.Normal, Amplitude=number_slider_11)
move_15 = Move(Geometry=evalsrf_3.Frame, Motion=amp)  # -> Geometry, Transform

tag_7 = TextTag3D(
    Location=move_15.Geometry,
    Text=concat_3,
    Size=number_slider_17,
    Colour=ColourSwatch(SwatchColor=RGB(0, 0, 0)),
    Justification=5)

line_6 = LineSDL(Start=evalsrf_3.Frame, Direction=evalsrf_3.Normal, Length=multiplication_6)

# ==== cluster DoubleShift: Shifts a list +1 and -1, wrap option available
list = ClusterInput()
wrap = ClusterInput()
shift = ShiftList(List=list, Shift=1, Wrap=wrap)
shift_2 = ShiftList(List=list, Shift="-1", Wrap=wrap)
no_last = ClusterOutput(shift_2)
no_first = ClusterOutput(shift)

# ==== cluster AdjustOrient
srf = ClusterInput()
pt = ClusterInput()
srf_2 = Surface(reparameterize(srf))
pt_2 = Point(Point(0.5, 0.5, 0))
pt_3 = Point(pt)
evalsrf = EvaluateSurface(Surface=srf_2, Point=pt_2)  # -> Point, Normal, Frame
Z = UnitZ(Factor=1)
angle = Angle(VectorA=evalsrf.Normal, VectorB=Z)  # -> Angle, Reflex
larger = LargerThan(FirstNumber=angle.Angle, SecondNumber=0.0001)  # -> LargerThan, OrEqualTo
dispatch = Dispatch(List=evalsrf.Point, DispatchPattern=larger.LargerThan)  # -> ListA, ListB
dispatch_2 = Dispatch(List=srf_2, DispatchPattern=larger.LargerThan)  # -> ListA, ListB
dispatch_3 = Dispatch(List=pt_3, DispatchPattern=larger.LargerThan)  # -> ListA, ListB
X = UnitX(Factor=1)
rot3d = Rotate3D(Geometry=dispatch_3.ListA, Angle="Pi", Center=dispatch.ListA, Axis=X)  # -> Geometry, Transform
rot3d_2 = Rotate3D(Geometry=dispatch_2.ListA, Angle="Pi", Center=dispatch.ListA, Axis=X)  # -> Geometry, Transform
weave = Weave(Pattern=larger.LargerThan, Stream0=dispatch_3.ListB, Stream1=rot3d.Geometry, NullGaps=False)
weave_2 = Weave(Pattern=larger.LargerThan, Stream0=dispatch_2.ListB, Stream1=rot3d_2.Geometry, NullGaps=False)
pt_4 = ClusterOutput(weave)
S = ClusterOutput(weave_2)
