# Grasshopper definition powercopy_mereology.gh (Grasshopper 0.9.76)
# Copyright: Co-de-iT
# plug-ins: Human, Weaverbird

# RELIEF
# shape as structural device
# tutor: Alessio Erioli
# Thessaloniki . 10-16.05.2016
crv = Curve([<curve referenced from the Rhino model> x7])
crv_2 = Curve([<curve referenced from the Rhino model> x5])
closed_loft = BooleanToggle(True)
adjust_seams = BooleanToggle(False)
loft_opt = LoftOptions(Closed=Toggle(False), Adjust=Toggle(False), Rebuild=0, Refit=0, Type=Slider(2, range=0..5))
loft_opt_2 = LoftOptions(Closed=closed_loft, Adjust=adjust_seams, Rebuild=0, Refit=0, Type=Slider(2, range=0..5))
# <title>
# 
# <description>
# 
# code by <author>
# 
# v <version>
# 
# © Co-de-iT 2016 _ Creative Commons Attribution-NonCommercial-ShareAlike 4.0 International License
loft = Loft(Curves=crv, Options=loft_opt)
loft_2 = Loft(Curves=crv_2, Options=loft_opt_2)
srf = Surface(loft)
brep = Brep(loft)
debrep = DeconstructBrep(Brep=brep)  # -> Faces, Edges, Vertices
srf_2 = Surface(loft_2)
brep_2 = Brep(loft_2)
srf_3 = Surface(reparameterize(debrep.Faces))
debrep_2 = DeconstructBrep(Brep=brep_2)  # -> Faces, Edges, Vertices
srf_4 = Surface(reparameterize(debrep_2.Faces))
divide = DivideDomain²(Domain=srf_3, UCount=Slider(42, range=2..50), VCount=Slider(25, range=1..50))
subsrf = Isotrim(Surface=graft(srf_3), Domain=divide)  # -> reparameterize(Surface)
sdivide = DivideSurface(Surface=srf_4, UCount=Slider(50, range=2..50), VCount=Slider(30, range=2..50))  # -> Points, Normals, Parameters
pt = Point(Point(0.5, 0.5, 0))
pt_2 = Point(<point referenced from the Rhino model>)
mesh_uv = MeshSurface(Surface=srf_3, UCount=Slider(27, range=2..50), VCount=Slider(28, range=2..50), Overhang=True, Equalize=Toggle(False))
evalsrf = EvaluateSurface(Surface=subsrf, Point=pt)  # -> Point, Normal, Frame
flip = FlipMatrix(Data=sdivide.Points)
mesh_uv_2 = MeshSurface(Surface=srf_4, UCount=Slider(20, range=2..50), VCount=Slider(15, range=2..50), Overhang=True, Equalize=Toggle(False))
X = UnitX(Factor=Slider(151.84, range=0..300))
# attractor point
pt_3 = Point(<point referenced from the Rhino model>)
neg = Negative(Value=closed_loft)
vec2pt = Vector2Pt(PointA=evalsrf.Point, PointB=pt_2, Unitize=False)  # -> Vector, Length
intcrv = Interpolate(Vertices=sdivide.Points, Degree=3, Periodic=False, KnotStyle=1)  # -> Curve, Length, Domain
intcrv_2 = Interpolate(Vertices=flip, Degree=3, Periodic=False, KnotStyle=1)  # -> Curve, Length, Domain
viewer = ParamViewer(intcrv.Curve)
crv_3 = Curve(<curve referenced from the Rhino model>)
move = Move(Geometry=mesh_uv_2, Motion=X)  # -> Geometry, Transform
smaller = SmallerThan(FirstNumber=vec2pt.Length, SecondNumber=Slider(63.65, range=0..100))  # -> SmallerThan, OrEqualTo
vec2pt_2 = Vector2Pt(PointA=sdivide.Points, PointB=pt_3, Unitize=False)  # -> Vector, Length
demesh = DeconstructMesh(Mesh=move.Geometry)  # -> Vertices, Faces, Colours, Normals
cull_i = CullIndex(List=viewer, Indices=neg, Wrap=True)
dispatch = Dispatch(List=subsrf, DispatchPattern=smaller.SmallerThan)  # -> ListA, ListB
smaller_2 = SmallerThan(FirstNumber=vec2pt_2.Length, SecondNumber=Slider(61.25, range=0..100))  # -> SmallerThan, OrEqualTo
# vecs
dispatch_2 = Dispatch(List=vec2pt.Vector, DispatchPattern=smaller.SmallerThan)  # -> ListA, ListB
# lenghts
dispatch_3 = Dispatch(List=vec2pt.Length, DispatchPattern=smaller.SmallerThan)  # -> ListA, ListB
crv_cp = CurveClosestPoint(Point=demesh.Vertices, Curve=crv_3)  # -> Point, Parameter, Distance
branch = TreeBranch(Tree=intcrv.Curve, Path=cull_i, MaintainPaths=True)
filter = StreamFilter(Gate=closed_loft, Stream0=intcrv.Curve, Stream1=branch)
bnd = Bounds(Numbers=crv_cp.Distance)
remap = RemapNumbers(Value=crv_cp.Distance, Source=bnd, Target=Domain(0, 1))  # -> Mapped, Clipped
divide_2 = DivideCurve(Curve=filter, Count=Slider(50, range=2..50), Kinks=False)  # -> Points, Tangents, Parameters
graph = GraphMapper(
    remap.Mapped,
    x0=0,
    x1=1,
    y0=0,
    y1=1,
    container_name="Bezier",
    cpx=[0, 0.6869577765, 0.4736239612, 1],
    cpy=[1, 0.7687473297, 0.1137485504, 0.07642745972])
crv_4 = Curve(<curve referenced from the Rhino model>)
srf_5 = Surface(dispatch.ListA)
min_rad = Slider(12.949, range=0..100)
max_rad = Slider(84.25, range=0..100)
flip_2 = FlipMatrix(Data=divide_2.Points)
bnd_2 = Bounds(Numbers=dispatch_3.ListA)
pt_4 = Point(Point(0.5, 0.5, 0))
crv_cp_2 = CurveClosestPoint(Point=flip_2, Curve=crv_4)  # -> Point, Parameter, Distance
sdivide_2 = DivideSurface(Surface=srf_5, UCount="1", VCount="1")  # -> Points, Normals, Parameters
shift = ShiftList(List=flip_2, Shift=1, Wrap=True)

srf_6 = Surface(dispatch.ListA)
sdivide_3 = DivideSurface(Surface=srf_6, UCount="1", VCount="1")  # -> Points, Normals, Parameters
pshift = ShiftPaths(Data=sdivide_3.Points, Offset=-1)
item = ListItem(List=pshift, Index="0", Wrap=True)
item_2 = ListItem(List=pshift, Index="1", Wrap=True)
item_3 = ListItem(List=pshift, Index="2", Wrap=True)
item_4 = ListItem(List=pshift, Index="3", Wrap=True)
pl_3pt = Plane3Pt(PointA=item, PointB=item_2, PointC=item_3)
cp = PlaneClosestPoint(Point=item_4, Plane=pl_3pt)  # -> Point, UVPoint, Distance
srf4pt = _4PointSurface(CornerA=item, CornerB=item_2, CornerC=cp.Point, CornerD=item_3)
srf4pt_2 = _4PointSurface(CornerA=item_4, CornerB=cp.Point, CornerC=item_2)
srf4pt_3 = _4PointSurface(CornerA=item_4, CornerB=cp.Point, CornerC=item_3)
srf_7 = Surface(dispatch.ListB)
preview = CustomPreview(Geometry=[srf4pt, srf_7], Shader=ColourSwatch(SwatchColor=RGB(28, 28, 28)))
preview_2 = CustomPreview(Geometry=[srf4pt_2, srf4pt_3], Shader=ColourSwatch(SwatchColor=RGB(255, 0, 0)))

remap_2 = RemapNumbers(Value=dispatch_3.ListA, Source=bnd_2, Target=Domain(0, 1))  # -> graft(Mapped), Clipped
evalsrf_2 = EvaluateSurface(Surface=srf_5, Point=pt_4)  # -> graft(Point), Normal, Frame
multiplication = Multiplication(A=graph, B=Slider(21.483, range=0..50))
intcrv_3 = Interpolate(Vertices=divide_2.Points, Degree=3, Periodic=False, KnotStyle=1)  # -> Curve, Length, Domain
pipe = Pipe(Curve=crv_4, Radius=min_rad, Caps=0)
pipe_2 = Pipe(Curve=crv_4, Radius=max_rad, Caps=0)
min = Minimum(A=crv_cp_2.Distance, B=max_rad)
pshift_2 = ShiftPaths(Data=sdivide_2.Points, Offset=-1)
amp = Amplitude(Vector=demesh.Normals, Amplitude=multiplication)
vec2pt_3 = Vector2Pt(PointA=flip_2, PointB=shift, Unitize=False)  # -> Vector, Length
number_slider = Slider(0, range=0..3.142)
number_slider_2 = Slider(2.104, range=0..3.142)
move_2 = Move(Geometry=demesh.Vertices, Motion=amp)  # -> Geometry, Transform
deface = DeconstructFace(Face=demesh.Faces)  # -> CornerA, CornerB, CornerC, CornerD
max = Maximum(A=min, B=min_rad)
item_5 = ListItem(List=pshift_2, Index="0", Wrap=True)
item_6 = ListItem(List=pshift_2, Index="1", Wrap=True)
item_7 = ListItem(List=pshift_2, Index="2", Wrap=True)
item_8 = ListItem(List=pshift_2, Index="3", Wrap=True)
conmesh = ConstructMesh(Vertices=move_2.Geometry, Faces=demesh.Faces)
bnd_3 = Bounds(Numbers=flatten(max))
graph_2 = GraphMapper(
    remap_2.Mapped,
    x0=0,
    x1=1,
    y0=0,
    y1=1,
    container_name="Bezier",
    cpx=[0, 0, 0.7126197219, 1],
    cpy=[0.853589952, 0.2423080206, 0.535230577, 0.01666653156])
graph_3 = GraphMapper(
    remap_2.Mapped,
    x0=0,
    x1=1,
    y0=0,
    y1=1,
    container_name="Bezier",
    cpx=[0, 0.4887708426, 0.7112299204, 1],
    cpy=[1, 0.9782049656, 0.3474355936, 0.03974330425])
deface_2 = DeconstructFace(Face=demesh.Faces)  # -> graft(CornerA), graft(CornerB), graft(CornerC), graft(CornerD)
dom = ConstructDomain(DomainStart=number_slider, DomainEnd=number_slider_2)
item_9 = ListItem(List=demesh.Vertices, Index=deface.CornerA, Wrap=True)
item_10 = ListItem(List=demesh.Vertices, Index=deface.CornerB, Wrap=True)
item_11 = ListItem(List=demesh.Vertices, Index=deface.CornerC, Wrap=True)
item_12 = ListItem(List=demesh.Vertices, Index=deface.CornerD, Wrap=True)
item_13 = ListItem(List=move_2.Geometry, Index=deface.CornerA, Wrap=True)
item_14 = ListItem(List=move_2.Geometry, Index=deface.CornerB, Wrap=True)
item_15 = ListItem(List=move_2.Geometry, Index=deface.CornerC, Wrap=True)
item_16 = ListItem(List=move_2.Geometry, Index=deface.CornerD, Wrap=True)
merge = Merge(Data1=item_5, Data2=item_6, Data3=item_8, Data4=item_7)
remap_3 = RemapNumbers(Value=max, Source=bnd_3, Target=dom)  # -> Mapped, Clipped
item_17 = ListItem(List=demesh.Vertices, Index=deface_2.CornerA, Wrap=True)
item_18 = ListItem(List=demesh.Vertices, Index=deface_2.CornerB, Wrap=True)
item_19 = ListItem(List=demesh.Vertices, Index=deface_2.CornerC, Wrap=True)
item_20 = ListItem(List=demesh.Vertices, Index=deface_2.CornerD, Wrap=True)
ln = Line(StartPoint=item_5, EndPoint=item_8)

# ----
# components
mesh = Mesh(<mesh referenced from the Rhino model>)
mesh_2 = Mesh(<mesh referenced from the Rhino model>)

mesh_3 = Mesh(<mesh referenced from the Rhino model>)
# components
mesh_4 = Mesh(<mesh referenced from the Rhino model>)

Z = UnitZ(Factor=1)
neg_2 = Negative(Value=remap_3.Mapped)
tbox = TwistedBox(
    CornerA=item_9,
    CornerB=item_10,
    CornerC=item_11,
    CornerD=item_12,
    CornerE=item_13,
    CornerF=item_14,
    CornerG=item_15,
    CornerH=item_16)
pline = PolyLine(Vertices=merge, Closed=Toggle(True))
gradient = Gradient(
    LowerLimit=number_slider,
    UpperLimit=number_slider_2,
    Parameter=remap_3.Mapped,
    stops=[0: RGB(0, 0, 0), 1: RGB(255, 255, 255)])
demesh_2 = DeconstructMesh(Mesh=mesh_4)  # -> Vertices, Faces, Colours, Normals
demesh_3 = DeconstructMesh(Mesh=mesh_3)  # -> Vertices, Faces, Colours, Normals
avr = Average(Input=[item_17, item_18, item_19, item_20])
vrot = Rotate(Vector=vec2pt_3.Vector, Axis=Z, Angle=neg_2)
multiplication_2 = Multiplication(A=graph_3, B=Slider(10.25, range=0..100))
amp_2 = Amplitude(Vector=graft(dispatch_2.ListA), Amplitude=multiplication_2)
Z_2 = UnitZ(Factor=1)
ln_2 = Line(StartPoint=demesh_2.Vertices, EndPoint=demesh_3.Vertices)

# ---- group: transition mesh
eval = EvaluateCurve(Curve=reparameterize(ln_2), Parameter=Slider(0.65, range=0..1))  # -> Point, Tangent, Angle
conmesh_2 = ConstructMesh(Vertices=eval.Point, Faces=demesh_2.Faces)

# ----
move_3 = Move(Geometry=flip_2, Motion=vrot)  # -> Geometry, Transform

# ----
# section
crv_5 = Curve(<curve referenced from the Rhino model>)
pt_5 = Point(<point referenced from the Rhino model>)
xy = XYPlane(Origin=pt_5)

crv_cp_3 = CurveClosestPoint(Point=avr, Curve=crv_3)  # -> Point, Parameter, Distance
vrot_2 = Rotate(Vector=vrot, Axis=Z_2, Angle="PI*.5")
scale = Scale(Geometry=pline, Center=evalsrf_2.Point, Factor=graph_2)  # -> Geometry, Transform
srf_8 = Surface(dispatch.ListB)
flip_3 = FlipMatrix(Data=move_3.Geometry)
bnd_4 = Bounds(Numbers=flatten(crv_cp_3.Distance))
preview_3 = CustomPreview(Geometry=srf_8, Shader=ColourSwatch(SwatchColor=RGB(28, 28, 28)))
pl = ConstructPlane(Origin=flip_2, XAxis=vrot_2, YAxis=vrot)
vdisex = VectorDisplayEx(Point=flip_2, Vector=vec2pt_3.Vector, Colour=RGB(0, 0, 0), Width=2)
vdisex_2 = VectorDisplayEx(Point=flip_2, Vector=vrot, Colour=gradient, Width=2)
vdisex_3 = VectorDisplayEx(Point=flip_2, Vector=vrot_2, Colour=gradient, Width=2)
move_4 = Move(Geometry=scale.Geometry, Motion=amp_2)  # -> Geometry, Transform
intcrv_4 = Interpolate(Vertices=flip_3, Degree=3, Periodic=False, KnotStyle=1)  # -> Curve, Length, Domain
remap_4 = RemapNumbers(Value=crv_cp_3.Distance, Source=bnd_4, Target=Domain(0, 1))  # -> Mapped, Clipped
merge_2 = Merge(Data1=pline, Data3=move_4.Geometry)
merge_3 = Merge(Data1=simplify(intcrv_3.Curve), Data2=simplify(intcrv_4.Curve))
orient = Orient(Geometry=crv_5, Source=xy, Target=pl)  # -> simplify(Geometry), Transform
graph_4 = GraphMapper(
    remap_4.Mapped,
    x0=0,
    x1=1,
    y0=0,
    y1=1,
    container_name="Bezier",
    cpx=[0, 0.6869577765, 0.4736239612, 1],
    cpy=[1, 0.7687473297, 0.1137485504, 0.07642745972])
eval_2 = EvaluateCurve(Curve=ln_2, Parameter=graph_4)  # -> Point, Tangent, Angle
flip_4 = FlipMatrix(Data=orient.Geometry)
loft_3 = Loft(Curves=merge_3, Options={Adjust=False, Closed=False, LoftEnds=0, LoftSimp=0, LoftType=0, Rebuild=10, Refit=0.01})
conmesh_3 = ConstructMesh(Vertices=eval_2.Point, Faces=demesh_2.Faces)  # -> flatten(Mesh)
loft_4 = Loft(Curves=merge_2, Options={Adjust=False, Closed=False, LoftEnds=0, LoftSimp=0, LoftType=3, Rebuild=10, Refit=0.01})
loft_5 = Loft(Curves=flip_4, Options={Adjust=False, Closed=False, LoftEnds=0, LoftSimp=0, LoftType=0, Rebuild=10, Refit=0.01})
bbox = BoundingBox(Content=mesh_2, Plane=PlaneXY(0, 0, 0))  # -> Box, Box_2
preview_4 = CustomPreview(Geometry=loft_4, Shader=ColourSwatch(SwatchColor=RGB(92, 108, 130)))
bbox_2 = BoundingBox(Content=conmesh_3, Plane=PlaneXY(0, 0, 0))  # -> Box, Box_2
cap = CapHoles(Brep=loft_5)
morph = BoxMorph(Geometry=mesh_2, Reference=bbox.Box, Target=tbox)
component = ValueList({"single": 0, "transition": 1}, selected="single")
morph_2 = BoxMorph(Geometry=conmesh_3, Reference=bbox_2.Box, Target=tbox)
previewmat = CustomPreviewMaterials(Geometry=cap, DiffuseColor=RGB(255, 255, 255))
previewlw = CustomPreviewLineweights(Geometry=cap, Shader=ColourSwatch(SwatchColor=RGBA(0, 0, 0, 0)), Absolute=False)
wbjoin = WeaverbirdsJoinMeshesAndWeld(Mesh=morph, Weld=Toggle(True))
wbjoin_2 = WeaverbirdsJoinMeshesAndWeld(Mesh=morph_2, Weld=Toggle(True))
wbcatmullclark = WeaverbirdsCatmullClarkSubdivision(MeshCurves=wbjoin, Level=Slider(2, range=1..3), SmoothNakedEdges=1)  # disabled
filter_2 = StreamFilter(Gate=component, Stream0=wbjoin, Stream1=wbjoin_2)
wbcatmullclark_2 = WeaverbirdsCatmullClarkSubdivision(MeshCurves=wbjoin_2, Level=Slider(2, range=1..3), SmoothNakedEdges=1)  # disabled
mesh_5 = Mesh(filter_2)
previewmat_2 = CustomPreviewMaterials(Geometry=mesh_5, DiffuseColor=RGB(255, 255, 255))
previewlw_2 = CustomPreviewLineweights(Geometry=mesh_5, Shader=ColourSwatch(SwatchColor=RGBA(0, 0, 0, 0)), Absolute=False)
