# Grasshopper definition simulation_relaxation.gh (Grasshopper 0.9.76)
# Copyright: Co-de-iT
# plug-ins: MeshEdit Components, Human, Weaverbird, Kangaroo2 Components

# RELIEF
# shape as structural device
# tutor: Alessio Erioli
# Thessaloniki . 10-16.05.2016
crv = Curve([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])
# <title>
# 
# <description>
# 
# code by <author>
# 
# v <version>
# 
# © Co-de-iT 2016 _ Creative Commons Attribution-NonCommercial-ShareAlike 4.0 International License
loft = Loft(Curves=crv, Options={Adjust=False, Closed=True, LoftEnds=0, LoftSimp=0, LoftType=0, Rebuild=10, Refit=0.01})
mesh_uv = MeshSurface(Surface=loft, UCount=Slider(50, range=2..50), VCount=Slider(71, range=2..100), Overhang=True, Equalize=False)
wbjoin = WeaverbirdsJoinMeshesAndWeld(Mesh=mesh_uv, Weld=Toggle(True))
mesh = Mesh(wbjoin)
nakededge = MeshNakedEdge(Mesh=mesh)  # -> V, A, B
crv_cp = CurveClosestPoint(Point=graft(nakededge.V), Curve=crv)  # -> Point, Parameter, Distance
medges = MeshEdges(Mesh=mesh)  # -> NakedEdges, InteriorEdges, NonManifoldEdges
sort = SortList(Keys=crv_cp.Distance)  # -> Keys, ValuesA
Z = UnitZ(Factor=Slider(-1, range=-1..0))
len = Length(Curve=[medges.NakedEdges, medges.InteriorEdges])
item = ListItem(List=sort.Keys, Index=0, Wrap=True)
multiplication = Multiplication(A=len, B=Slider(0.232, range=0..1))
load = Load(Point=nakededge.V, ForceVector=Z)
item_2 = ListItem(List=nakededge.V, Index=nakededge.A, Wrap=True)
smaller = SmallerThan(FirstNumber=flatten(item), SecondNumber=Slider(0.8, range=0..20))  # -> SmallerThan, OrEqualTo
dispatch = Dispatch(List=nakededge.V, DispatchPattern=smaller.SmallerThan)  # -> ListA, ListB
pt = Point(dispatch.ListA)
anchor = Anchor(Point=[dispatch.ListA, item_2], Strength=1000)
length_line = LengthLine(Line=[medges.NakedEdges, medges.InteriorEdges], Length=multiplication, Strength=10)
show = Show(G=mesh)
preview = CustomPreview(Geometry=pt, Shader=ColourSwatch(SwatchColor=RGB(0, 0, 0)))
solver = Solver(GoalObjects=[show, length_line, load, anchor], Reset=Button(), Threshold=1e-15, Tolerance=0.01, On=Toggle(False))  # -> I, V, O
mesh_2 = Mesh(solver.O)
clean = CleanTree(RemoveNulls=True, RemoveInvalid=True, RemoveEmpty=False, Tree=mesh_2)
previewmat = CustomPreviewMaterials(Geometry=clean, DiffuseColor=RGB(255, 255, 255))
